# Grasshopper definition LAB_01_Rhino_PythonBasic_Data_Processing.gh (Grasshopper 1.0.8)
# plug-ins: RhinoCodePluginGH

# ---- group: for loop
panel = Panel("""1
2
3
7
9
5
3
2
4
6
7""")
py3 = Python3Script(d=panel)  # -> out, a; inputs d: list
# ---------- py3: Python ----------
for i in range(len(d)):
    value = int(d[i])
    if(value > 5):
        print(i)
# ---------- end py3 ----------
panel_2 = Panel(py3.out)

# ---- group: Condition
panel_3 = Panel("""NY
NJ
MA
CA""")
py3_2 = Python3Script(d=panel_3)  # -> out, a; inputs d: list
# ---------- py3_2: Python ----------
length = len(d)


for i in range(length):
    value = d[i]
    if(value == "MA"):
        print("Boston is in " + value + ".")
    elif(value == "NJ"):
        print(value + " is next to NY.")
    elif(value == "CA"):
        print("LA is in " + value + ".")
    else:
        print("There is no data for " + value + "!!")
    
    print("How easy!! right!!??")
# ---------- end py3_2 ----------
panel_4 = Panel(py3_2.out)

# ---- group: while
py3_3 = Python3Script()  # -> out, a; inputs d: list
# ---------- py3_3: Python ----------
myLoop = 5

while myLoop:
    print(myLoop)
    myLoop =  myLoop - 1
    

theNum = 0
keyworld = "fun "
while True:
    print("loop is " + keyworld * theNum + "!" * (1 + theNum))
    theNum += 1
    if(theNum > 5):
        break
# ---------- end py3_3 ----------
panel_5 = Panel(py3_3.out)

# ---- group: string
py3_4 = Python3Script()  # -> out
# ---------- py3_4: Python ----------
a = "Hello World!!"
a+= ' "Hello, Universe!"  '

print(a)
print(type(a))

a = a.split(" ")
print(a)
print(type(a))

for t in a:
    print(t)
# ---------- end py3_4 ----------
panel_6 = Panel(py3_4)

py3_5 = Python3Script()  # -> out
# ---------- py3_5: Python ----------
a = range(10)

print(a)
print("the length : " + str(len(a))) # we need to cast int to string

for i in a:
    print(i)

alphabet = ["a" , "b" , "c", "d"]
for i in range(len(alphabet)):
    print("index i = " + str(i) + ", the content : '" + alphabet[i] + "'")
# ---------- end py3_5 ----------
panel_7 = Panel(py3_5)

# ---- group: data type
py3_6 = Python3Script()  # -> out, a
# ---------- py3_6: Python ----------
a = 1 

print(a)
print(type(a))

b = 1.5

print(b)
print(type(b))

c = "1.5"

print(c)
print(type(c))
# ---------- end py3_6 ----------
# Data in Design
# 
# Instructor : NJ Namju Lee / nj.namju@gmail.com
# 
# * class - https://namjulee.github.io/data-in-design/
# 
# * Lab - https://namjulee.github.io/njs-lab-public/
# 
# * Video(English) - https://www.youtube.com/c/njnamjulee
# * Writing(English) - https://medium.com/@nj-namju
# 
# * Video(Korean) - https://www.youtube.com/c/CodeforDesign
# * Writing(Korean) - https://brunch.co.kr/@njnamju
# 
# Installation - https://namjulee.github.io/njs-lab-public/installation
panel_8 = Panel(py3_6.out)

# ---- group: data structure
py3_7 = Python3Script()  # -> out, a
# ---------- py3_7: Python ----------
a = [ 1, 2, 3, 4, 5] 
a.append(9)

print(a)
print(a[3]) # zero base
print(type(a))


b = (1,2,3)
print(b)
print(type(b))


c = {"3" : 33 , "4": 44}
c["Hello"] = "World"
print (c)
print (c["3"])
print (type(c))
# ---------- end py3_7 ----------
panel_9 = Panel(py3_7.out)

# ---- group: Domain
# Additional Reading and Resources
# 
# instructor: NJ Namju Lee
# email: nj.namju@gmail.com
# https://namjulee.github.io/njs-lab-public/
# 
# ------------------------------------------------------------
# Colab:
# https://colab.research.google.com/drive/1hF5YaGvZxKX3ME1MJCTbZkeqPkALz0xS?usp=sharing
# 
# ------------------------------------------------------------
# python documentation(3.x)
# https://docs.python.org/3/
# 
# ------------------------------------------------------------
# codecademy
# https://www.codecademy.com/learn/learn-python-3
# 
# ------------------------------------------------------------
# Think Python
# https://www.greenteapress.com/thinkpython/thinkpython.pdf
number_slider = Slider(1, range=0..1)
dom = ConstructDomain(DomainStart=number_slider, DomainEnd=Slider(10, range=0..10))
py3_8 = Python3Script(A=Slider(1, range=0..1), B=Slider(10, range=0..10), N=Slider(4, range=0..10))  # -> out, a; inputs N: Int32
# ---------- py3_8: Python ----------
interval = (B - A) / N

outList = [];
for i in range(N + 1):
    result = A + ( i * interval ) 
    outList.append(result);

a = outList
# ---------- end py3_8 ----------
range = Range(Domain=dom, Steps=Slider(4, range=0..10))
panel_10 = Panel(range)
panel_11 = Panel(py3_8.a)

# ---- group: Series
series = Series(Start=Slider(1, range=0..1), Step=Slider(10, range=0..10), Count=Slider(4, range=0..10))
py3_9 = Python3Script(S=Slider(1, range=0..1), N=Slider(10, range=0..10), C=Slider(4, range=0..10))  # -> out, a; inputs N: Int32, C: Int32
# ---------- py3_9: Python ----------
outList = [];
for i in range(C):
    result = S + ( i * N  )
    outList.append(result);

a = outList
# ---------- end py3_9 ----------
py3_10 = Python3Script(L=py3_9.a, i=Slider(0, range=0..10), W=Toggle(True))  # -> out, a; inputs L: list, i: Int32, W: Boolean
# ---------- py3_10: Python ----------
if W == True:
    a = L[int(i % len(L))];
else :
    try:
        a = L[i];
    except:
        print('out of range');
# ---------- end py3_10 ----------
panel_12 = Panel(series)
item = ListItem(List=series, Index=Slider(5, range=0..10), Wrap=Toggle(True))
panel_13 = Panel(py3_9.a)
panel_14 = Panel(item)
panel_15 = Panel(py3_10.a)

# ---- group: remap
dom_2 = ConstructDomain(DomainStart=Slider(0, range=0..1), DomainEnd=Slider(10, range=0..10))
dom_3 = ConstructDomain(DomainStart=Slider(0, range=0..1), DomainEnd=Slider(51.4, range=0..100))
py3_11 = Python3Script(
    V=Slider(8, range=0..10),
    sMin=Slider(0, range=0..1),
    sMax=Slider(10, range=0..10),
    tMin=Slider(0, range=0..1),
    tMax=Slider(51.4, range=0..100))  # -> out, a; inputs sMax: Int32
# ---------- py3_11: Python ----------
a = (((V - sMin) * (tMax - tMin)) / (sMax - sMin)) + tMin;
# ---------- end py3_11 ----------
remap = RemapNumbers(Value=Slider(8, range=0..10), Source=dom_2, Target=dom_3)  # -> Mapped, Clipped
panel_16 = Panel(remap.Mapped)
panel_17 = Panel(py3_11.a)

# ---- group: item
panel_18 = Panel("""a
b
c
d
1
2
3
4""")
number_slider_2 = Slider(5, range=0..10)
toggle = BooleanToggle(True)
item_2 = ListItem(List=panel_18, Index=number_slider_2, Wrap=toggle)
py3_12 = Python3Script(L=panel_18, i=number_slider_2, W=toggle)  # -> out, a; inputs L: list, i: Int32, W: Boolean
# ---------- py3_12: Python ----------
if W == True:
    a = (L[int(i % len(L))]);
else :
    try:
        a = (L[i])
    except:
        print('out of range');
# ---------- end py3_12 ----------
panel_19 = Panel(item_2)
panel_20 = Panel(py3_12.a)

# ---- group: split
panel_21 = Panel("""nj, 180, 80
mj, 190, 90
tj, 170, 65
dj, 177, 80""")
split = TextSplit(Text=panel_21, Separators=",")
py3_13 = Python3Script(T=panel_21, C=",")  # -> out, a; inputs C: String
# ---------- py3_13: Python ----------
outList = [];
for i in T.split(","):
    outList.append(i);

a = outList;
# ---------- end py3_13 ----------
panel_22 = Panel(split)
panel_23 = Panel(py3_13.a)

# ---- group: reverse string
py3_14 = Python3Script(T="helloWorld", C=",")  # -> out, a; inputs C: String
# ---------- py3_14: Python ----------
a = T[::-1]
# ---------- end py3_14 ----------
py3_15 = Python3Script(T="helloWorld", C=",")  # -> out, a; inputs C: String; same code as py3_13
panel_24 = Panel(py3_15.a)
panel_25 = Panel(py3_14.a)
