# Grasshopper definition LAB_03_PythonGH-DataStructure.gh (Grasshopper 1.0.8)

pt = Point([Point(13.00925598, 4.716614018, 0), Point(14.84177294, 11.59593051, 0), Point(16.30243432, 8.252244423, 0)])
# Data in Design
# 
# Instructor : NJ Namju Lee / nj.namju@gmail.com
# 
# * class - https://namjulee.github.io/data-in-design/
# 
# * Lab - https://namjulee.github.io/njs-lab-public/
# 
# * Video(English) - https://www.youtube.com/c/njnamjulee
# * Writing(English) - https://medium.com/@nj-namju
# 
# * Video(Korean) - https://www.youtube.com/c/CodeforDesign
# * Writing(Korean) - https://brunch.co.kr/@njnamju
# 
# Installation - https://namjulee.github.io/njs-lab-public/installation
# Challenge, 02 Point 가져오기
pt_2 = Point(<point referenced from the Rhino model>)
panel = Panel(pt_2)
panel_2 = Panel(pt)

# ----
# Challenge, 03 Point 만들기
number_slider = Slider(0, range=0..55)
number_slider_2 = Slider(1.5973, range=0..10)
number_slider_3 = Slider(3, range=0..10)
python = GhPythonScript(x=number_slider, y=number_slider_2, z=number_slider_3)  # -> out, a
# ---------- python: Python ----------
__author__ = "namju"
__version__ = "2021.05.05"

import rhinoscriptsyntax as rs


data = (x, y, z)
a = rs.AddPoint(data)
# ---------- end python ----------
pt_3 = ConstructPoint(XCoordinate=number_slider, YCoordinate=number_slider_2, ZCoordinate=number_slider_3)
py3 = Python3Script(x=number_slider, y=number_slider_2, z=number_slider_3)  # -> out, a
# ---------- py3: Python ----------
"""Grasshopper Script"""
a = "Hello Python 3 in Grasshopper!"


import rhinoscriptsyntax as rs

data = (x, y, z)
a = rs.AddPoint(data)
# ---------- end py3 ----------
panel_3 = Panel([pt_3, python.a])
pt_4 = Point(py3.a)

pt_5 = Point([Point(2.165797806, 8.639240419, 0), Point(13.00925598, 4.716614018, 0), Point(8.434446008, 9.13319088, 0), Point(14.57316189, 15.53336701, 0), Point(16.30243432, 8.252244423, 0)])
# Challenge, 04 Point 분해하기
panel_4 = Panel(pt_5)
python_2 = GhPythonScript(p=pt_5)  # -> out, X, Y, Z; inputs p: list
# ---------- python_2: Python ----------
__author__ = "namju"
__version__ = "2021.05.05"

import rhinoscriptsyntax as rs

xList = []
yList = []
zList = []

for i in p:
    pt = rs.PointCoordinates(i)
    xList.append(pt[0])
    yList.append(pt[1])
    zList.append(pt[2])

X = xList
Y = yList
Z = zList
# ---------- end python_2 ----------
pdecon = Deconstruct(Point=pt_5)  # -> XComponent, YComponent, ZComponent
panel_5 = Panel(pdecon.YComponent)
panel_6 = Panel(python_2.X)
panel_7 = Panel(python_2.Y)
panel_8 = Panel(pdecon.ZComponent)
panel_9 = Panel(python_2.Z)
panel_10 = Panel(pdecon.XComponent)
pt_6 = ConstructPoint(XCoordinate=panel_10, YCoordinate=panel_5, ZCoordinate=panel_8)

number_slider_4 = Slider(3.52, range=0..10)
# Challenge, 05 실행 순서의 중요성
number_slider_5 = Slider(2.88, range=0..10)
addition = Addition(A=number_slider_4, B="2")
python_3 = GhPythonScript(x=number_slider_5, y=number_slider_4)  # -> out, a, b
# ---------- python_3: Python ----------
__author__ = "namju"
__version__ = "2021.05.05"

import rhinoscriptsyntax as rs


a =  3 + 3 

a = (x * (y + 2) + 3.14) / 2.5 

b0 = (y + 2)
b1 = b0 * x
b2 = b1 + 3.14
b3 = b2 / 2.5
b = b3
# ---------- end python_3 ----------
multiplication = Multiplication(A=number_slider_5, B=addition)
addition_2 = Addition(A=multiplication, B="3.14")
division = Division(A=addition_2, B=Slider(2.5, range=0..10))
panel_11 = Panel([python_3.a, python_3.b, division])

number_slider_6 = Slider(4.48, range=0..10)
number_slider_7 = Slider(1.31, range=0..10)
number_slider_8 = Slider(5.42, range=0..10)
series = Series(Start=number_slider_6, Step=number_slider_7, Count=number_slider_8)
python_4 = GhPythonScript(S=number_slider_6, N=number_slider_7, C=number_slider_8)  # -> out, a; inputs C: Int32
# ---------- python_4: Python ----------
__author__ = "namju"
__version__ = "2021.05.05"

import rhinoscriptsyntax as rs


myList = []

for i in range(C):
    result = S + N * i
    myList.append(result)

print(myList)

a = myList
# ---------- end python_4 ----------
panel_12 = Panel(series)
panel_13 = Panel(python_4.a)

# ----
# Challenge, 06 데이터 구조 Series , GH 컴포넌트
number_slider_9 = Slider(3, range=0..10)
series_2 = Series(Start=0, Step=1, Count=10)
pt_7 = ConstructPoint(XCoordinate=series_2, YCoordinate=number_slider_9, ZCoordinate=Slider(0, range=0..10))

# ----
# Challenge, 07 데이터 구조 List, Python
number_slider_10 = Slider(4.48, range=0..10)
number_slider_11 = Slider(1.31, range=0..10)
number_slider_12 = Slider(5.42, range=0..10)
python_5 = GhPythonScript(S=number_slider_10, N=number_slider_11, C=number_slider_12)  # -> out, a; inputs C: Int32; same code as python_4
series_3 = Series(Start=number_slider_10, Step=number_slider_11, Count=number_slider_12)
panel_14 = Panel(series_3)
panel_15 = Panel(python_5.a)
number_slider_13 = Slider(0, range=0..10)
number_slider_14 = Slider(1.1136, range=0..10)
number_slider_15 = Slider(1.8792, range=0..10)
number_slider_16 = Slider(4.785, range=0..55)
number_slider_17 = Slider(0, range=0..10)
python_6 = GhPythonScript(X=python_5.a, Y=number_slider_14, Z=number_slider_17)  # -> out, a; inputs X: list
# ---------- python_6: Python ----------
__author__ = "namju"
__version__ = "2021.05.05"

import rhinoscriptsyntax as rs

myPoints = []
for i in X:
    p = rs.AddPoint(i, Y, Z)
    myPoints.append(p)

a = myPoints
# ---------- end python_6 ----------
pt_8 = ConstructPoint(XCoordinate=series_3, YCoordinate=number_slider_14, ZCoordinate=number_slider_17)
panel_16 = Panel(pt_8)
panel_17 = Panel(python_6.a)
