# Grasshopper definition LAB_01_VectorRhinoAPI.gh (Grasshopper 1.0.8)
# plug-ins: RhinoCodePluginGH

# representation
vec = VectorXYZ(XComponent=Slider(6.1, range=0..10), YComponent=Slider(2.3, range=0..10), ZComponent=Slider(0, range=0..10))  # -> Vector, Length
# addition
vec_2 = VectorXYZ(XComponent=Slider(6.1, range=0..10), YComponent=Slider(2.3, range=0..10), ZComponent=Slider(0, range=0..10))  # -> Vector, Length
vec_3 = VectorXYZ(XComponent=Slider(1.9, range=0..10), YComponent=Slider(4.9, range=0..10), ZComponent=Slider(4, range=0..10))  # -> Vector, Length
vec_4 = VectorXYZ(XComponent=Slider(1.9, range=0..10), YComponent=Slider(4.9, range=0..10), ZComponent=Slider(4, range=0..10))  # -> Vector, Length
# division
vec_5 = VectorXYZ(XComponent=Slider(6.1, range=0..10), YComponent=Slider(2.3, range=0..10), ZComponent=Slider(0, range=0..10))  # -> Vector, Length
# multiply
vec_6 = VectorXYZ(XComponent=Slider(6.1, range=0..10), YComponent=Slider(2.3, range=0..10), ZComponent=Slider(0, range=0..10))  # -> Vector, Length
# length
vec_7 = VectorXYZ(XComponent=Slider(6.1, range=0..10), YComponent=Slider(2.3, range=0..10), ZComponent=Slider(0, range=0..10))  # -> Vector, Length
# subtraction
vec_8 = VectorXYZ(XComponent=Slider(6.1, range=0..10), YComponent=Slider(2.3, range=0..10), ZComponent=Slider(0, range=0..10))  # -> Vector, Length
# division
vec_9 = VectorXYZ(XComponent=Slider(6.1, range=0..10), YComponent=Slider(2.3, range=0..10), ZComponent=Slider(0, range=0..10))  # -> Vector, Length
panel = Panel("0,0,0")
# visualization
vec_10 = VectorXYZ(XComponent=Slider(6.1, range=0..10), YComponent=Slider(2.3, range=0..10), ZComponent=Slider(0, range=0..10))  # -> Vector, Length
vdis = VectorDisplay(Anchor="0,0,0", Vector=vec_2.Vector)
vdis_2 = VectorDisplay(Anchor="0,0,0", Vector=vec_8.Vector)
vlen = VectorLength(Vector=vec_7.Vector)
devec = DeconstructVector(Vector=vec.Vector)  # -> XComponent, YComponent, ZComponent
panel_5 = Panel(vec.Vector)
vdis_3 = VectorDisplay(Anchor=vec_2.Vector, Vector=vec_3.Vector)
vdis_4 = VectorDisplay(Anchor="0,0,0", Vector=vec_4.Vector)
panel_6 = Panel(vec_7.Vector)
panel_7 = Panel(vec_10.Vector)
vdis_5 = VectorDisplay(Anchor="0,0,0", Vector=vec_6.Vector)
vdis_6 = VectorDisplay(Anchor="0,0,0", Vector=vec_5.Vector)
vdis_7 = VectorDisplay(Anchor="0,0,0", Vector=vec_9.Vector)
division = Division(A=vec_5.Vector, B=Slider(3, range=-3..3))
division_2 = Division(A=vec_9.Vector, B=Slider(3, range=-3..3))
addition = Addition(A=vec_2.Vector, B=vec_3.Vector)
multiplication = Multiplication(A=vec_6.Vector, B=Slider(2.068, range=-3..3))
subtraction = Subtraction(A=vec_8.Vector, B=vec_4.Vector)
panel_8 = Panel(devec.YComponent)
panel_9 = Panel(devec.ZComponent)
panel_10 = Panel(devec.XComponent)
vdis_8 = VectorDisplay(Anchor="0,0,0", Vector=vec_10.Vector)
panel_11 = Panel(vec_7.Length)
panel_12 = Panel(vlen)
vdis_9 = VectorDisplay(Anchor="0,0,0", Vector=division)
vdis_10 = VectorDisplay(Anchor="0,0,0", Vector=multiplication)
vdis_11 = VectorDisplay(Anchor="0,0,0", Vector=division_2)
vec_11 = Vector(subtraction)
vec_12 = Vector(addition)
vdis_12 = VectorDisplay(Anchor="0,0,0", Vector=vec_12)
dist = Distance(PointA="0,0,0", PointB=vec_7.Vector)
vdis_13 = VectorDisplay(Anchor="0,0,0", Vector=vec_11)
panel_13 = Panel(dist)
number_slider = Slider(6.1, range=0..10)
number_slider_2 = Slider(2.3, range=0..10)
number_slider_3 = Slider(0, range=0..10)
number_slider_4 = Slider(7, range=0..100)
number_slider_5 = Slider(7, range=0..100)
pt = Point(<point referenced from the Rhino model>)
number_slider_6 = Slider(6.3, range=0..10)
number_slider_7 = Slider(0, range=0..10)
subtraction_2 = Subtraction(A=number_slider, B=Slider(1.9, range=0..10))
subtraction_3 = Subtraction(A=number_slider_2, B=Slider(4.9, range=0..10))
subtraction_4 = Subtraction(A=number_slider_3, B=Slider(4, range=0..10))
vec_13 = VectorXYZ(XComponent=number_slider, YComponent=number_slider_2, ZComponent=number_slider_3)  # -> Vector, Length
pt_2 = Point(Point(3.000186271, 3.071208414, 0))
pt_3 = Point(Point(4.237334187, 7.454795811, 0))
pt_4 = Point(<point referenced from the Rhino model>)
pt_5 = Point(<point referenced from the Rhino model>)
multiplication_2 = Multiplication(A=number_slider_4, B=Slider(0.5, range=0..1))
multiplication_3 = Multiplication(A=number_slider_5, B=Slider(0.5, range=0..1))
vec_14 = VectorXYZ(XComponent=subtraction_2, YComponent=subtraction_3, ZComponent=subtraction_4)  # -> Vector, Length
rectangle = Rectangle(Plane=pt, XSize=number_slider_5, YSize=number_slider_4, Radius=0)  # -> Rectangle, Length
c_script = CSharpScript(p0=pt_5, p1=pt_4)  # -> out, A; inputs p0: Vector3d, p1: Vector3d
# ---------- c_script: C# ----------
    Vector3d v0 = new Vector3d(p1.X - p0.X, p1.Y - p0.Y, p1.Z - p0.Z);

    v0.Unitize();
    //  p1.Unitize();

    double dot = DotProduct(new Vector3d(1, 0, 0), v0);

    double angle = Math.Atan2(p1.X - p0.X, p1.Y - p0.Y);


    Print(dot.ToString());
    Print(angle.ToString());

    A = -angle;
# ---------- c_script: C# additional code ----------
  public static double DotProduct(Vector3d v1, Vector3d v2)
  {
    return v1.X * v2.X + v1.Y * v2.Y + v1.Z * v2.Z;
  }
# ---------- end c_script ----------
vec2pt = Vector2Pt(PointA=pt_3, PointB=pt_2, Unitize=False)  # -> Vector, Length
subtraction_5 = Subtraction(A=pt_2, B=pt_3)
# rotate
vec_15 = VectorXYZ(XComponent=number_slider_6, YComponent=number_slider_7, ZComponent=Slider(0, range=0..10))  # -> Vector, Length
neg = Negative(Value=multiplication_2)
neg_2 = Negative(Value=multiplication_3)
number_slider_8 = Slider(3.14, range=0..10)
vdis_14 = VectorDisplay(Anchor="0,0,0", Vector=vec_13.Vector)
xy = XYPlane(Origin=Point(0, 0, 0))
X = UnitX(Factor=neg_2)
vdis_15 = VectorDisplay(Anchor="0,0,0", Vector=vec_14.Vector)
Y = UnitY(Factor=neg)
python = GhPythonScript(x=number_slider_6, y=number_slider_7, a=number_slider_8)  # -> out, X, Y
# ---------- python: Python ----------
__author__ = "namju"
__version__ = "2022.09.20"

import rhinoscriptsyntax as rs
import math

cos = math.cos(a);
#cos = math.cos(a * (3.14159265358979 / 180.0));
sin = math.sin(a);
#sin = math.sin(a * (3.14159265358979 / 180.0));
X = x * cos - y * sin;
Y = x * sin + y * cos;
# ---------- end python ----------
vdis_16 = VectorDisplay(Anchor="0,0,0", Vector=vec2pt.Vector)
vdis_17 = VectorDisplay(Anchor="0,0,0", Vector=subtraction_5)
vdis_18 = VectorDisplay(Anchor="0,0,0", Vector=vec_15.Vector)
move = Move(Geometry=rectangle.Rectangle, Motion=X)  # -> Geometry, Transform
vrot = Rotate(Vector=vec_15.Vector, Axis=xy, Angle=number_slider_8)
vec_16 = VectorXYZ(XComponent=python.X, YComponent=python.Y, ZComponent=0)  # -> Vector, Length
move_2 = Move(Geometry=move.Geometry, Motion=Y)  # -> Geometry, Transform
vdis_19 = VectorDisplay(Anchor="0,0,0", Vector=vrot)
rotate = Rotate(Geometry=move_2.Geometry, Angle=c_script.A, Plane=pt)  # -> Geometry, Transform
vdis_20 = VectorDisplay(Anchor="0,0,0", Vector=vec_16.Vector)

# ----
# Multip Amp
number_slider_9 = Slider(2, range=0..10)
# Scaling a vector
pt_6 = ConstructPoint(XCoordinate=0, YCoordinate=0, ZCoordinate=0)
vec_17 = VectorXYZ(XComponent=number_slider_9, YComponent=Slider(3, range=0..10), ZComponent=0)  # -> Vector, Length
pt_7 = ConstructPoint(XCoordinate=0, YCoordinate=0, ZCoordinate=0)
vec_18 = VectorXYZ(XComponent=Slider(2, range=0..10), YComponent=Slider(3, range=0..10), ZComponent=0)  # -> Vector, Length
number_slider_10 = Slider(10, range=-10..10)
vdis_21 = VectorDisplay(Anchor=pt_6, Vector=vec_17.Vector)
vdis_22 = VectorDisplay(Anchor=pt_7, Vector=vec_18.Vector)
unit = UnitVector(Vector=vec_18.Vector)
multiplication_4 = Multiplication(A=vec_17.Vector, B=Slider(2.971, range=-10..10))
multiplication_5 = Multiplication(A=unit, B=number_slider_10)
amp = Amplitude(Vector=vec_18.Vector, Amplitude=number_slider_10)
vdis_23 = VectorDisplay(Anchor=pt_6, Vector=multiplication_4)
vdis_24 = VectorDisplay(Anchor=pt_7, Vector=multiplication_5)
vdis_25 = VectorDisplay(Anchor=pt_7, Vector=amp)

# ----
# Rev
number_slider_11 = Slider(2, range=0..10)
vec_19 = VectorXYZ(XComponent=number_slider_11, YComponent=Slider(3, range=0..10), ZComponent=0)  # -> Vector, Length
pt_8 = ConstructPoint(XCoordinate=0, YCoordinate=0, ZCoordinate=0)
vdis_26 = VectorDisplay(Anchor=pt_8, Vector=vec_19.Vector)
rev = Reverse(Vector=vec_19.Vector)
vdis_27 = VectorDisplay(Anchor=pt_8, Vector=rev)

number_slider_12 = Slider(10, range=0..10)

# ----
# Vector as differences of points
number_slider_13 = Slider(2, range=0..10)
vec_20 = VectorXYZ(XComponent=number_slider_13, YComponent=Slider(3, range=0..10), ZComponent=0)  # -> Vector, Length
pt_9 = ConstructPoint(XCoordinate=0, YCoordinate=0, ZCoordinate=0)
vec_21 = VectorXYZ(XComponent=Slider(5, range=0..10), YComponent=Slider(2, range=0..10), ZComponent=0)  # -> Vector, Length
pt_10 = ConstructPoint(XCoordinate=0, YCoordinate=0, ZCoordinate=0)
vdis_28 = VectorDisplay(Anchor=pt_9, Vector=vec_20.Vector)
vdis_29 = VectorDisplay(Anchor=pt_10, Vector=vec_21.Vector)
dist_2 = Distance(PointA=vec_20.Vector, PointB=vec_21.Vector)
panel_14 = Panel(dist_2)

# ----
# Length
number_slider_14 = Slider(2, range=0..10)
vec_22 = VectorXYZ(XComponent=number_slider_14, YComponent=Slider(3, range=0..10), ZComponent=0)  # -> Vector, Length
pt_11 = ConstructPoint(XCoordinate=0, YCoordinate=0, ZCoordinate=0)
vdis_30 = VectorDisplay(Anchor=pt_11, Vector=vec_22.Vector)
vlen_2 = VectorLength(Vector=vec_22.Vector)
panel_15 = Panel(vlen_2)

pt_12 = Point(Point(8.135291842, 7.489643704, 1.524588026))
panel_16 = Panel(c_script.out)
# unit vector
vec_23 = VectorXYZ(XComponent=Slider(6.1, range=0..10), YComponent=Slider(2.3, range=0..10), ZComponent=Slider(4, range=0..10))  # -> Vector, Length
# amplitude
vec_24 = VectorXYZ(XComponent=Slider(6.1, range=0..10), YComponent=Slider(2.3, range=0..10), ZComponent=Slider(4, range=0..10))  # -> Vector, Length
vec_25 = VectorXYZ(XComponent=Slider(0.4, range=-9..10), YComponent=Slider(10, range=-10..10), ZComponent=Slider(0, range=0..10))  # -> Vector, Length
# reverse
vec_26 = VectorXYZ(XComponent=Slider(6.3, range=0..10), YComponent=Slider(4.1, range=0..10), ZComponent=Slider(0, range=0..10))  # -> Vector, Length
# cross product
vec_27 = VectorXYZ(XComponent=Slider(6.3, range=0..10), YComponent=Slider(0, range=0..10), ZComponent=Slider(0, range=0..10))  # -> Vector, Length

# ----
# XYZ Vec
Z = UnitZ(Factor=1)
Y_2 = UnitY(Factor=1)
X_2 = UnitX(Factor=1)
pt_13 = ConstructPoint(XCoordinate=0, YCoordinate=0, ZCoordinate=0)
vdis_31 = VectorDisplay(Anchor=pt_13, Vector=[X_2, Y_2, Z])

vec_28 = VectorXYZ(XComponent=Slider(10, range=0..10), YComponent=Slider(2.9, range=0..10), ZComponent=Slider(0, range=0..10))  # -> Vector, Length
# dot product
vec_29 = VectorXYZ(XComponent=Slider(0, range=0..10), YComponent=Slider(2.3, range=0..10), ZComponent=Slider(0, range=0..10))  # -> Vector, Length
geo = Geometry(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)
c_script_2 = CSharpScript(p=pt_12, radius=Slider(2.77, range=0..10))  # -> out, A; inputs p: Point3d, radius: Double
# ---------- c_script_2: C# ----------
    A = CircularProjctionFromPoint(p, radius);
# ---------- c_script_2: C# additional code ----------
  static Vector3d CircularProjctionFromPoint(Point3d p, double radius = 1) {
    double radian = Math.Atan2(p.X, p.Y);

    radian -= Math.PI * 0.5;
    radian *= -1;

    Vector3d v = Vector3d.Unset;
    v.X = Math.Cos(radian);
    v.Y = Math.Sin(radian);
    v.Z = Math.Tan(0);
    v.Unitize();
    v *= radius;

    return v;
  }
# ---------- end c_script_2 ----------
panel_17 = Panel(vec_23.Length)
panel_18 = Panel(vec_24.Length)
vdis_32 = VectorDisplay(Anchor="0,0,0", Vector=vec_25.Vector)
unit_2 = UnitVector(Vector=vec_23.Vector)
rev_2 = Reverse(Vector=vec_26.Vector)
multiplication_6 = Multiplication(A=vec_26.Vector, B="-1")
c_script_3 = CSharpScript(ln=geo)  # -> out, OP, A, NV, B, C, D; inputs ln: Curve
# ---------- c_script_3: C# ----------
    Vector3d ray = new Vector3d(5, 0, 10);
    //ray.Unitize();

    A = ray;

    Vector3d v0 = (Vector3d) ln.PointAtStart;
    Vector3d v1 = (Vector3d) ln.PointAtEnd;



    Vector3d xv = v1 - v0;

    Vector3d up = Vector3d.ZAxis;



    Vector3d binormalVec = Vector3d.CrossProduct(xv, up);
    binormalVec.Unitize();

    Vector3d principalNormalVec = Vector3d.CrossProduct(xv, binormalVec);
    principalNormalVec.Unitize();

    OP = ln.PointAtStart;
    NV = principalNormalVec;


    double dot = ray * principalNormalVec;

    Vector3d vvv = new Vector3d(
      ray.X + 2 * (principalNormalVec.X * dot),
      0,
      ray.Z + 2 * (principalNormalVec.Z * dot)

      );

    D = Reflect(ray, principalNormalVec);
# ---------- c_script_3: C# additional code ----------
  public static Vector3d Reflect(Vector3d vector, Vector3d normal)
  {
    return vector - 2 * (vector * normal) * normal;
  }
# ---------- end c_script_3 ----------
amp_2 = Amplitude(Vector=vec_24.Vector, Amplitude=number_slider_12)
vdis_33 = VectorDisplay(Anchor="0,0,0", Vector=vec_23.Vector)
vdis_34 = VectorDisplay(Anchor="0,0,0", Vector=vec_24.Vector)
vdis_35 = VectorDisplay(Anchor="0,0,0", Vector=vec_27.Vector)
panel_19 = Panel(c_script_2.A)
pt_14 = Point(c_script_2.A)
xprod = CrossProduct(VectorA=vec_27.Vector, VectorB=vec_25.Vector, Unitize=False)  # -> Vector, Length
vdis_36 = VectorDisplay(Anchor="0,0,0", Vector=rev_2)
dprod = DotProduct(VectorA=vec_29.Vector, VectorB=vec_28.Vector, Unitize=False)
vlen_3 = VectorLength(Vector=unit_2)
vdis_37 = VectorDisplay(Anchor="0,0,0", Vector=amp_2)
vdis_38 = VectorDisplay(Anchor="0,0,0", Vector=multiplication_6)
unit_3 = UnitVector(Vector=vec_24.Vector)
python_2 = GhPythonScript(v=vec_19.Vector)  # -> out, a, b; inputs v: Vector3d
# ---------- python_2: Python ----------
__author__ = "namju"
__version__ = "2023.08.04"

import rhinoscriptsyntax as rs
import math;

 
a = rs.VectorReverse(v)



v[0] *= -1
v[1] *= -1
v[2] *= -1

b = v
# ---------- end python_2 ----------
vdis_39 = VectorDisplay(Anchor="0,0,0", Vector=c_script_3.A)
vdis_40 = VectorDisplay(Anchor=c_script_3.OP, Vector=c_script_3.C)
vdis_41 = VectorDisplay(Anchor=c_script_3.OP, Vector=c_script_3.D)
vdis_42 = VectorDisplay(Anchor=c_script_3.OP, Vector=c_script_3.C)
vdis_43 = VectorDisplay(Anchor="0,0,0", Vector=unit_2)
# https://datascience.stackexchange.com/questions/744/cosine-similarity-versus-dot-product-as-distance-metrics
panel_20 = Panel(dprod)
panel_21 = Panel(vlen_3)
vdis_44 = VectorDisplay(Anchor=c_script_3.OP, Vector=c_script_3.NV)
vdis_45 = VectorDisplay(Anchor="0,0,0", Vector=xprod.Vector)
panel_22 = Panel(c_script_3.out)
multiplication_7 = Multiplication(A=unit_3, B=number_slider_12)
vdis_46 = VectorDisplay(Anchor="0,0,0", Vector=unit_3)
vlen_4 = VectorLength(Vector=unit_3)
c_script_4 = CSharpScript()  # -> out, A
# ---------- c_script_4: C# ----------
    var canv = document.getElementById("canvas");
    canv.width = 256;
    canv.height = 256;
    // document.body.appendChild(canv);
    var ctx = canv.getContext("2d");
    
    var rayTracer = new RayTracer();
    
    return rayTracer.render(defaultScene(), ctx, 256, 256);
# ---------- c_script_4: C# additional code ----------
  // https://codepen.io/Zbeyer/pen/MewYoW?editors=1010

  class Vector {

    static times(double k, Vector v) {
      return new Vector(k * v.x, k * v.y, k * v.z);
    }
    static minus(Vector v1, Vector v2) { return new Vector(v1.x - v2.x, v1.y - v2.y, v1.z - v2.z); }
    static plus(Vector v1, Vector v2) { return new Vector(v1.x + v2.x, v1.y + v2.y, v1.z + v2.z); }
    static dot(Vector v1, Vector v2) { return v1.x * v2.x + v1.y * v2.y + v1.z * v2.z; }
    static mag(Vector v) { return Math.sqrt(v.x * v.x + v.y * v.y + v.z * v.z); }
    static norm(Vector v) {
      var mag = Vector.mag(v);
      var div = (mag == 0) ? Infinity : 1.0 / mag;
      return Vector.times(div, v);
    }
    static cross(Vector v1, Vector v2) {
      return new Vector(v1.y * v2.z - v1.z * v2.y,
        v1.z * v2.x - v1.x * v2.z,
        v1.x * v2.y - v1.y * v2.x);
    }

    public double x;
    public double y;
    public double z;

    public Vector(double x, double y, double z) {
      this.x = x;
      this.y = y;
      this.z = z;
    }

  }

  class Color {
    public double r;
    public double g;
    public double b;
    public Color(double r, double g, double b) {
      this.r = r;
      this.g = g;
      this.b = b;
    }

    public static scale(Color k, Color v) { return new Color(k * v.r, k * v.g, k * v.b); }
    public static plus(Color v1, Color v2) { return new Color(v1.r + v2.r, v1.g + v2.g, v1.b + v2.b); }
    public static times(Color v1, Color v2) { return new Color(v1.r * v2.r, v1.g * v2.g, v1.b * v2.b); }
    public static Color white = new Color(1.0, 1.0, 1.0);
    public static Color grey = new Color(0.5, 0.5, 0.5);
    public static Color black = new Color(0.0, 0.0, 0.0);
    public static Color background = Color.black;
    public static Color defaultColor = Color.black;
    public static List<double> toDrawingColor(Color c) {
      var legalize = d => d > 1 ? 1 : d;
      return List < double > {
          Math.Floor(legalize(c.r) * 255),
          Math.Floor(legalize(c.g) * 255),
          Math.Floor(legalize(c.b) * 255)
          };
    }
  }

  class Camera {
    public Vector forward;
    public Vector right;
    public Vector up;
    public Camera(Camera pos, Camera lookAt){
      Vector down = new Vector(0.0, -1.0, 0.0);
      this.forward = Vector.norm(Vector.minus(lookAt, this.pos));
      this.right = Vector.times(1.5, Vector.norm(Vector.cross(this.forward, down)));
      this.up = Vector.times(1.5, Vector.norm(Vector.cross(this.forward, this.right)));
    }
  }

  class Ray {
    Vector start;
    Vector dir;
  }

  class Intersection {
    Thing thing;
    Ray ray;
    double dist;
  }

  class Surface {
    diffuse: (pos: Vector) => Color;
    specular: (pos: Vector) => Color;
    reflect: (pos: Vector) => number;
    roughness: number;
  }

  interface Thing {
    intersect: (ray: Ray) => Intersection;
    normal: (pos: Vector) => Vector;
    surface: Surface;
  }

  class Scene {
    Light light;
    Vector pos;
    Color color;
  }
 

  class Scene {
    Thing[] things;
    Light[] lights:
    Camera camera;
  }

  class Sphere: Thing {
    public double radius2;
    Vector center;
    Surface surface;

    public Sphere(Vector center, double radius, Surface surface) {
      this.radius2 = radius * radius;
      this.center = center;
      this.surface = surface;
    }
  }
    
  Vector normal(Vector pos) { 
    return Vector.norm(Vector.minus(pos, this.center)); 
  }
  intersect(Ray ray) {
    var eo = Vector.minus(this.center, ray.start);
    var v = Vector.dot(eo, ray.dir);
    var dist = 0;
    if (v >= 0) {
      var disc = this.radius2 - (Vector.dot(eo, eo) - v * v);
      if (disc >= 0) {
        dist = v - Math.sqrt(disc);
      }
    }
    if (dist == 0) {
      return null;
    } else {
      return { thing: this, ray: ray, dist: dist };
  }
}
}

class Plane implements Thing {
  public normal: (pos: Vector) =>Vector;
  public intersect: (ray: Ray) =>Intersection;
  constructor(norm: Vector, offset: number, public surface: Surface) {
  this.normal = function(pos: Vector) { return norm; }
  this.intersect = function(ray: Ray): Intersection {
    var denom = Vector.dot(norm, ray.dir);
    if (denom > 0) {
      return null;
    } else {
      var dist = (Vector.dot(norm, ray.start) + offset) / (-denom);
      return { thing: this, ray: ray, dist: dist };
  }
}
    }
}

module Surfaces {
    export var shiny: Surface = {
diffuse: function(pos) { return Color.white; },
specular: function(pos) { return Color.grey; },
reflect: function(pos) { return 0.7; },
        roughness: 250
    }
    export var checkerboard: Surface = {
diffuse: function(pos) {
  if ((Math.floor(pos.z) + Math.floor(pos.x)) % 2 != 0) {
    return Color.white;
  } else {
    return Color.black;
  }
},
specular: function(pos) { return Color.white; },
reflect: function(pos) {
  if ((Math.floor(pos.z) + Math.floor(pos.x)) % 2 != 0) {
    return 0.1;
  } else {
    return 0.7;
  }
},
        roughness: 150
    }
}


class RayTracer {
  private int maxDepth = 5;

  private intersections(Ray ray, Scene scene) {
    var closest = +Infinity;
    Intersection closestInter = undefined;
    for (int i in scene.things){
      var inter = scene.things[i].intersect(ray);
      
      if (inter != null && inter.dist < closest) {
        closestInter = inter;
        closest = inter.dist;
      }
    }
    return closestInter;
  }

  private testRay(Ray ray, Scene scene) {
    var isect = this.intersections(ray, scene);
    if (isect != null) {
      return isect.dist;
    } else {
      return undefined;
    }
  }

  private Color traceRay(Ray ray, Scene scene, double depth) {
    var isect = this.intersections(ray, scene);
    if (isect == undefined) {
      return Color.background;
    } else {
      return this.shade(isect, scene, depth);
    }
  }

  private shade(Intersection isect, Scene scene, double depth) {
    var d = isect.ray.dir;
    var pos = Vector.plus(Vector.times(isect.dist, d), isect.ray.start);
    var normal = isect.thing.normal(pos);
    var reflectDir = Vector.minus(d, Vector.times(2, Vector.times(Vector.dot(normal, d), normal)));
    var naturalColor = Color.plus(Color.background,
      this.getNaturalColor(isect.thing, pos, normal, reflectDir, scene));
    var reflectedColor = (depth >= this.maxDepth) ? Color.grey : this.getReflectionColor(isect.thing, pos, normal, reflectDir, scene, depth);
    return Color.plus(naturalColor, reflectedColor);
  }

  private getReflectionColor(Thing thing, Vector pos, Vector normal, Vector rd, Scene scene, double depth) {
    return Color.scale(thing.surface.reflect(pos), this.traceRay({ start: pos, dir: rd }, scene, depth + 1));
  }

  private getNaturalColor(thing: Thing, pos: Vector, norm: Vector, rd: Vector, scene: Scene) {
    var addLight = (col, light) => {
      var ldis = Vector.minus(light.pos, pos);
      var livec = Vector.norm(ldis);
      var neatIsect = this.testRay({ start: pos, dir: livec }, scene);
      var isInShadow = (neatIsect === undefined) ? false : (neatIsect <= Vector.mag(ldis));
      if (isInShadow) {
        return col;
      } else {
        var illum = Vector.dot(livec, norm);
        var lcolor = (illum > 0) ? Color.scale(illum, light.color)
          : Color.defaultColor;
        var specular = Vector.dot(livec, Vector.norm(rd));
        var scolor = (specular > 0) ? Color.scale(Math.pow(specular, thing.surface.roughness), light.color)
          : Color.defaultColor;
        return Color.plus(col, Color.plus(Color.times(thing.surface.diffuse(pos), lcolor),
          Color.times(thing.surface.specular(pos), scolor)));
      }
      }
    return scene.lights.reduce(addLight, Color.defaultColor);
  }

  render(scene, ctx, screenWidth, screenHeight) {
    var getPoint = (x, y, camera) => {
      var recenterX = x => (x - (screenWidth / 2.0)) / 2.0 / screenWidth;
      var recenterY = y => -(y - (screenHeight / 2.0)) / 2.0 / screenHeight;
      return Vector.norm(Vector.plus(camera.forward, Vector.plus(Vector.times(recenterX(x), camera.right), Vector.times(recenterY(y), camera.up))));
      }
    for (var y = 0; y < screenHeight; y++) {
      for (var x = 0; x < screenWidth; x++) {
        var color = this.traceRay({ start: scene.camera.pos, dir: getPoint(x, y, scene.camera) }, scene, 0);
        var c = Color.toDrawingColor(color);
        ctx.fillStyle = "rgb(" + String(c.r) + ", " + String(c.g) + ", " + String(c.b) + ")";
        ctx.fillRect(x, y, x + 1, y + 1);
      }
    }
  }
}


function defaultScene(): Scene {
  return {
      things: [new Plane(new Vector(0.0, 1.0, 0.0), 0.0, Surfaces.checkerboard),
  new Sphere(new Vector(0.0, 1.0, -0.25), 1.0, Surfaces.shiny),
  new Sphere(new Vector(-6, 3.0, -5.0), 1.0, Surfaces.shiny),
  // new Sphere(new Vector(-6, 8.0, 15.0), 5.0, Surfaces.shiny),
  new Sphere(new Vector(-1.0, 0.5, 1.5), 0.5, Surfaces.shiny)],

  lights: [{ pos: new Vector(-2.0, 2.5, 0.0), color: new Color(0.49, 0.07, 0.07) },
  { pos: new Vector(1.5, 2.5, 1.5), color: new Color(0.07, 0.07, 0.49) },
  { pos: new Vector(1.5, 2.5, -1.5), color: new Color(0.07, 0.49, 0.071) },
  { pos: new Vector(0.0, 3.5, 0.0), color: new Color(0.21, 0.21, 0.35) }],
  camera: new Camera(new Vector(3.0, 2.0, 4.0), new Vector(-1.0, 0.5, 0.0))
};
}
# ---------- end c_script_4 ----------
c_script_5 = CSharpScript()  # -> out, A
# ---------- c_script_5: C# ----------
    //  var canv = document.getElementById("canvas");
    // canv.width = 256;
    // canv.height = 256;
    // document.body.appendChild(canv);
    // var ctx = canv.getContext("2d");

    // var rayTracer = new RayTracer();

    //   return rayTracer.render(defaultScene(), ctx, 256, 256);
# ---------- c_script_5: C# additional code ----------
  // https://codepen.io/Zbeyer/pen/MewYoW?editors=1010

  double screenWidth = 400;
  double screenHeight = 400;


  double getX(int x) {
    return (x - (screenWidth / 2.0)) / 2.0 / screenWidth;
  }
  double getY(int y) {
    return -(y - (screenHeight / 2.0)) / 2.0 / screenHeight;
  }

  private Vector getPoint(int x, int y, Camera camera){
    // double recenterX = getX(x);
    // double recenterY = getX(y);

    return Vector.norm(
      Vector.plus(camera.forward,
      Vector.plus(
      Vector.times(getX(x), camera.right),
      Vector.times(getX(y), camera.up)
      )
      )
      );
  }


  public void render(Scene scene, int screenWidth, int screenHeight) {

    for (var y = 0; y < screenHeight; y++) {
      for (var x = 0; x < screenWidth; x++) {
        //   Color color = traceRay(
        //   { start: scene.camera.pos, dir: getPoint(x, y, scene.camera) },
        //  scene,
        //  0);


        // var c = Color.toDrawingColor(color);
        // ctx.fillStyle = "rgb(" + String(c.r) + ", " + String(c.g) + ", " + String(c.b) + ")";
        // ctx.fillRect(x, y, x + 1, y + 1);
      }
    }
  }
  private Intersection intersections(Ray ray, Scene scene) {
    double closest = double.MaxValue;
    Intersection closestInter = null;
    for(int i = 0; i < scene.things.Count; ++i) {
      var inter = scene.things[i].intersect(ray);
      if (inter != null && inter.dist < closest) {
        closestInter = inter;
        closest = inter.dist;
      }
    }
    return closestInter;
  }
  public Intersection intersect(Ray ray) {
    var denom = Vector.dot(norm, ray.dir);
    if (denom > 0) {
      return null;
    } else {
      var dist = (Vector.dot(norm, ray.start) + offset) / (-denom);
      return new Intersection(this, ray, dist);
    }
  }


  public Color traceRay(Ray ray, Scene scene, double depth) {
    var isect = intersections(ray, scene);
    if (isect == null) {
      return Color.background;
    } else {
      return shade(isect, scene, depth);
    }
  }

  public Color shade(Intersection isect, Scene scene, double depth) {
    int maxDepth = 5;
    Vector d = isect.ray.dir;
    var pos = Vector.plus(Vector.times(isect.dist, d), isect.ray.start);
    var normal = isect.thing.normal(pos);
    var reflectDir = Vector.minus(d, Vector.times(2, Vector.times(Vector.dot(normal, d), normal)));
    Color naturalColor = Color.plus(Color.background, this.getNaturalColor(isect.thing, pos, normal, reflectDir, scene));
    Color reflectedColor = (depth >= maxDepth) ? Color.grey : this.getReflectionColor(isect.thing, pos, normal, reflectDir, scene, depth);
    return Color.plus(naturalColor, reflectedColor);
  }

  public Color getNaturalColor(Thing thing, Vector pos, Vector norm, Vector rd, Scene scene) {
    var addLight = (col, light) => {
      var ldis = Vector.minus(light.pos, pos);
      var livec = Vector.norm(ldis);
      var neatIsect = this.testRay({ start: pos, dir: livec }, scene);
      var isInShadow = (neatIsect === undefined) ? false : (neatIsect <= Vector.mag(ldis));
      if (isInShadow) {
        return col;
      } else {
        var illum = Vector.dot(livec, norm);
        var lcolor = (illum > 0) ? Color.scale(illum, light.color)
          : Color.defaultColor;
        var specular = Vector.dot(livec, Vector.norm(rd));
        var scolor = (specular > 0) ? Color.scale(Math.pow(specular, thing.surface.roughness), light.color)
          : Color.defaultColor;
        return Color.plus(col, Color.plus(Color.times(thing.surface.diffuse(pos), lcolor),
          Color.times(thing.surface.specular(pos), scolor)));
      }
      }
    return scene.lights.reduce(addLight, Color.defaultColor);
  }
  public double testRay(Ray ray, Scene scene) {
    var isect = this.intersections(ray, scene);
    if (isect != null) {
      return isect.dist;
    } else {
      return null;
    }
  }

  public Color getReflectionColor(Thing thing, Vector pos, Vector normal, Vector rd, Scene scene, double depth) {
    return Color.scale(thing.surface.reflect(pos), traceRay({ start: pos, dir: rd }, scene, depth + 1));
  }





  public class Vector {
    public static Vector times(double k, Vector v) { return new Vector(k * v.x, k * v.y, k * v.z); }
    public static Vector minus(Vector v1, Vector v2) { return new Vector(v1.x - v2.x, v1.y - v2.y, v1.z - v2.z); }
    public static Vector plus(Vector v1, Vector v2) { return new Vector(v1.x + v2.x, v1.y + v2.y, v1.z + v2.z); }
    public static double dot(Vector v1, Vector v2) { return v1.x * v2.x + v1.y * v2.y + v1.z * v2.z; }
    public static double mag(Vector v) { return Math.Sqrt(v.x * v.x + v.y * v.y + v.z * v.z); }
    public static Vector norm(Vector v) {
      double mag = Vector.mag(v);
      var div = (mag == 0) ? double.MaxValue : 1.0 / mag;
      return Vector.times(div, v);
    }
    public static Vector cross(Vector v1, Vector v2) {
      return new Vector(v1.y * v2.z - v1.z * v2.y,
        v1.z * v2.x - v1.x * v2.z,
        v1.x * v2.y - v1.y * v2.x);
    }

    public double x;
    public double y;
    public double z;

    public Vector(double x, double y, double z) {
      this.x = x;
      this.y = y;
      this.z = z;
    }

  }

  public class Color {
    public double r;
    public double g;
    public double b;
    public Color(double r, double g, double b) {
      this.r = r;
      this.g = g;
      this.b = b;
    }

    public static Color scale(double k, Color v) { return new Color(k * v.r, k * v.g, k * v.b); }
    public static Color plus(Color v1, Color v2) { return new Color(v1.r + v2.r, v1.g + v2.g, v1.b + v2.b); }
    public static Color times(Color v1, Color v2) { return new Color(v1.r * v2.r, v1.g * v2.g, v1.b * v2.b); }
    public static Color white = new Color(1.0, 1.0, 1.0);
    public static Color grey = new Color(0.5, 0.5, 0.5);
    public static Color black = new Color(0.0, 0.0, 0.0);
    public static Color background = Color.black;
    public static Color defaultColor = Color.black;
    public static List<double> toDrawingColor(Color c) {
      // var legalize = d => d > 1 ? 1 : d;
      return new List<double> {
          Math.Floor(Color.legalize(c.r) * 255),
          Math.Floor(Color.legalize(c.g) * 255),
          Math.Floor(Color.legalize(c.b) * 255)
          };
    }
    private static double legalize(double d){
      return d > 1 ? 1 : d;
    }
  }

  public class Camera {
    public Vector forward;
    public Vector right;
    public Vector down;
    public Vector up;
    public Vector pos;
    public Camera(Vector pos, Vector lookAt){
      this.pos = pos;
      this.down = new Vector(0.0, -1.0, 0.0);
      this.forward = Vector.norm(Vector.minus(lookAt, this.pos));
      this.right = Vector.times(1.5, Vector.norm(Vector.cross(this.forward, down)));
      this.up = Vector.times(1.5, Vector.norm(Vector.cross(this.forward, this.right)));
    }
  }


  public class Sphere: Thing {
    public double radius2;
    public Vector center;
    public double radius;
    public Surface surface;

    public Sphere(Vector center, double radius, Surface surface) {
      this.radius2 = radius * radius;
    }
    public Vector normal(Vector pos) {
      return Vector.norm(Vector.minus(pos, this.center));
    }

    public Intersection intersect(Ray ray) {
      var eo = Vector.minus(this.center, ray.start);
      var v = Vector.dot(eo, ray.dir);
      var dist = 0;
      if (v >= 0) {
        var disc = this.radius2 - (Vector.dot(eo, eo) - v * v);
        if (disc >= 0) {
          dist = v - Math.sqrt(disc);
        }
      }
      if (dist == 0) {
        return null;
      } else {
        return new Intersection(this, ray, dist);
      }
    }
  }

  /*
  class Scene {
    Light light;
    Vector pos;
    Color color;
  }
*/

  public class Surface {
    diffuse: (pos: Vector) => Color;
    specular: (pos: Vector) => Color;
    reflect: (pos: Vector) => number;
    roughness: number;
  }

  public abstract class Thing {
    public abstract Intersection intersect(Ray ray);
    public abstract Vector normal(Vector pos);
    public Surface surface;
  }

  public class Scene {
    public List<Thing> things;
    public List<Light> lights;
    public Camera camera;
    public Scene(){
      this.things = new List<Thing>();
      this.lights = new List<Light>();
    }
  }

  public class Ray {
    public Vector start;
    public Vector dir;
  }

  public class Intersection {
    public Thing thing;
    public Ray ray;
    public double dist;
    public Intersection(Thing thing, Ray ray, double dist){
      this.thing = thing;
      this.ray = ray;
      this.dist = dist;
    }
  }

  /*




  class Surface {
    diffuse: (pos: Vector) => Color;
    specular: (pos: Vector) => Color;
    reflect: (pos: Vector) => number;
    roughness: number;
  }




  class Sphere: Thing {
    public double radius2;
    Vector center;
    Surface surface;

    public Sphere(Vector center, double radius, Surface surface) {
      this.radius2 = radius * radius;
      this.center = center;
      this.surface = surface;
    }
  }

  Vector normal(Vector pos) {
    return Vector.norm(Vector.minus(pos, this.center));
  }
  intersect(Ray ray) {
    var eo = Vector.minus(this.center, ray.start);
    var v = Vector.dot(eo, ray.dir);
    var dist = 0;
    if (v >= 0) {
      var disc = this.radius2 - (Vector.dot(eo, eo) - v * v);
      if (disc >= 0) {
        dist = v - Math.sqrt(disc);
      }
    }
    if (dist == 0) {
      return null;
    } else {
      return { thing: this, ray: ray, dist: dist };
  }
}
}

class Plane implements Thing {
  public normal: (pos: Vector) =>Vector;
  public intersect: (ray: Ray) =>Intersection;
  constructor(norm: Vector, offset: number, public surface: Surface) {
  this.normal = function(pos: Vector) { return norm; }
  this.intersect = function(ray: Ray): Intersection {
    var denom = Vector.dot(norm, ray.dir);
    if (denom > 0) {
      return null;
    } else {
      var dist = (Vector.dot(norm, ray.start) + offset) / (-denom);
      return { thing: this, ray: ray, dist: dist };
  }
}
    }
}

module Surfaces {
    export var shiny: Surface = {
diffuse: function(pos) { return Color.white; },
specular: function(pos) { return Color.grey; },
reflect: function(pos) { return 0.7; },
        roughness: 250
    }
    export var checkerboard: Surface = {
diffuse: function(pos) {
  if ((Math.floor(pos.z) + Math.floor(pos.x)) % 2 != 0) {
    return Color.white;
  } else {
    return Color.black;
  }
},
specular: function(pos) { return Color.white; },
reflect: function(pos) {
  if ((Math.floor(pos.z) + Math.floor(pos.x)) % 2 != 0) {
    return 0.1;
  } else {
    return 0.7;
  }
},
        roughness: 150
    }
}



class RayTracer {
  private int maxDepth = 5;

  private intersections(Ray ray, Scene scene) {
    var closest = +Infinity;
    Intersection closestInter = undefined;
    for (int i in scene.things){
      var inter = scene.things[i].intersect(ray);

      if (inter != null && inter.dist < closest) {
        closestInter = inter;
        closest = inter.dist;
      }
    }
    return closestInter;
  }

  private testRay(Ray ray, Scene scene) {
    var isect = this.intersections(ray, scene);
    if (isect != null) {
      return isect.dist;
    } else {
      return undefined;
    }
  }



  private shade(Intersection isect, Scene scene, double depth) {
    var d = isect.ray.dir;
    var pos = Vector.plus(Vector.times(isect.dist, d), isect.ray.start);
    var normal = isect.thing.normal(pos);
    var reflectDir = Vector.minus(d, Vector.times(2, Vector.times(Vector.dot(normal, d), normal)));
    var naturalColor = Color.plus(Color.background,
      this.getNaturalColor(isect.thing, pos, normal, reflectDir, scene));
    var reflectedColor = (depth >= this.maxDepth) ? Color.grey : this.getReflectionColor(isect.thing, pos, normal, reflectDir, scene, depth);
    return Color.plus(naturalColor, reflectedColor);
  }

  private getReflectionColor(Thing thing, Vector pos, Vector normal, Vector rd, Scene scene, double depth) {
    return Color.scale(thing.surface.reflect(pos), this.traceRay({ start: pos, dir: rd }, scene, depth + 1));
  }

  private getNaturalColor(thing: Thing, pos: Vector, norm: Vector, rd: Vector, scene: Scene) {
    var addLight = (col, light) => {
      var ldis = Vector.minus(light.pos, pos);
      var livec = Vector.norm(ldis);
      var neatIsect = this.testRay({ start: pos, dir: livec }, scene);
      var isInShadow = (neatIsect === undefined) ? false : (neatIsect <= Vector.mag(ldis));
      if (isInShadow) {
        return col;
      } else {
        var illum = Vector.dot(livec, norm);
        var lcolor = (illum > 0) ? Color.scale(illum, light.color)
          : Color.defaultColor;
        var specular = Vector.dot(livec, Vector.norm(rd));
        var scolor = (specular > 0) ? Color.scale(Math.pow(specular, thing.surface.roughness), light.color)
          : Color.defaultColor;
        return Color.plus(col, Color.plus(Color.times(thing.surface.diffuse(pos), lcolor),
          Color.times(thing.surface.specular(pos), scolor)));
      }
      }
    return scene.lights.reduce(addLight, Color.defaultColor);
  }



  public render(Scene scene, ctx, int screenWidth, int screenHeight) {

    for (var y = 0; y < screenHeight; y++) {
      for (var x = 0; x < screenWidth; x++) {
        var color = this.traceRay({ start: scene.camera.pos, dir: getPoint(x, y, scene.camera) }, scene, 0);
        var c = Color.toDrawingColor(color);
        ctx.fillStyle = "rgb(" + String(c.r) + ", " + String(c.g) + ", " + String(c.b) + ")";
        ctx.fillRect(x, y, x + 1, y + 1);
      }
    }
  }
}

 */
# ---------- end c_script_5 ----------
pt_15 = Point(Point(8.135291842, 7.489643704, 1.524588026))
c_script_6 = CSharpScript()  # -> out, A
# ---------- c_script_6: C# additional code ----------
  public class Ray {
    public Vector start;
    public Vector dir;
  }
  public class Intersection {
    public Thing thing;
    public Ray ray;
    public double dist;
    public Intersection(Thing thing, Ray ray, double dist){
      this.thing = thing;
      this.ray = ray;
      this.dist = dist;
    }
  }


  public abstract class Thing {
    public abstract Intersection intersect(Ray ray);
    public abstract Vector normal(Vector pos);
    public Surface surface;
  }



  public class Camera {
    public Vector forward;
    public Vector right;
    public Vector down;
    public Vector up;
    public Vector pos;
    public Camera(Vector pos, Vector lookAt){
      this.pos = pos;
      this.down = new Vector(0.0, -1.0, 0.0);
      this.forward = Vector.norm(Vector.minus(lookAt, this.pos));
      this.right = Vector.times(1.5, Vector.norm(Vector.cross(this.forward, down)));
      this.up = Vector.times(1.5, Vector.norm(Vector.cross(this.forward, this.right)));
    }
  }



  public class Vector {
    public static Vector times(double k, Vector v) { return new Vector(k * v.x, k * v.y, k * v.z); }
    public static Vector minus(Vector v1, Vector v2) { return new Vector(v1.x - v2.x, v1.y - v2.y, v1.z - v2.z); }
    public static Vector plus(Vector v1, Vector v2) { return new Vector(v1.x + v2.x, v1.y + v2.y, v1.z + v2.z); }
    public static double dot(Vector v1, Vector v2) { return v1.x * v2.x + v1.y * v2.y + v1.z * v2.z; }
    public static double mag(Vector v) { return Math.Sqrt(v.x * v.x + v.y * v.y + v.z * v.z); }
    public static Vector norm(Vector v) {
      double mag = Vector.mag(v);
      var div = (mag == 0) ? double.MaxValue : 1.0 / mag;
      return Vector.times(div, v);
    }
    public static Vector cross(Vector v1, Vector v2) {
      return new Vector(v1.y * v2.z - v1.z * v2.y,
        v1.z * v2.x - v1.x * v2.z,
        v1.x * v2.y - v1.y * v2.x);
    }

    public double x;
    public double y;
    public double z;

    public Vector(double x, double y, double z) {
      this.x = x;
      this.y = y;
      this.z = z;
    }

  }
  public class Color {
    public double r;
    public double g;
    public double b;
    public Color(double r, double g, double b) {
      this.r = r;
      this.g = g;
      this.b = b;
    }

    public static Color scale(double k, Color v) { return new Color(k * v.r, k * v.g, k * v.b); }
    public static Color plus(Color v1, Color v2) { return new Color(v1.r + v2.r, v1.g + v2.g, v1.b + v2.b); }
    public static Color times(Color v1, Color v2) { return new Color(v1.r * v2.r, v1.g * v2.g, v1.b * v2.b); }
    public static Color white = new Color(1.0, 1.0, 1.0);
    public static Color grey = new Color(0.5, 0.5, 0.5);
    public static Color black = new Color(0.0, 0.0, 0.0);
    public static Color background = Color.black;
    public static Color defaultColor = Color.black;
    public static List<double> toDrawingColor(Color c) {
      // var legalize = d => d > 1 ? 1 : d;
      return new List<double> {
          Math.Floor(Color.legalize(c.r) * 255),
          Math.Floor(Color.legalize(c.g) * 255),
          Math.Floor(Color.legalize(c.b) * 255)
          };
    }
    private static double legalize(double d){
      return d > 1 ? 1 : d;
    }
  }
# ---------- end c_script_6 ----------
vdis_47 = VectorDisplay(Anchor="0,0,0", Vector=multiplication_7)
panel_23 = Panel([rev, python_2.a, python_2.b])
panel_24 = Panel(vlen_4)
c_script_7 = CSharpScript(p=pt_15, radius=Slider(1.6, range=0..10))  # -> out, A; inputs p: Point3d, radius: Double; same code as c_script_2
panel_25 = Panel([multiplication_5, amp])
pt_16 = Point(Point(4.430372459, 3.507695044, 1.389582233))
pt_17 = Point(Point(1, 1, 0.5186752969))
panel_26 = Panel(c_script_6.out)
python_3 = GhPythonScript(v=vec_17.Vector, s=Slider(2.971, range=-10..10))  # -> out, a, b; inputs v: Vector3d
# ---------- python_3: Python ----------
__author__ = "namju"
__version__ = "2023.08.04"

import rhinoscriptsyntax as rs
import math;


a = rs.VectorScale(v, s)




v[0] *= s
v[1] *= s
v[2] *= s

b = v
# ---------- end python_3 ----------
panel_27 = Panel(c_script_5.out)
panel_28 = Panel(multiplication_4)
panel_29 = Panel(c_script_7.A)
pt_18 = Point(c_script_7.A)
# ray tracer
c_script_8 = CSharpScript(Ca=pt_16, Tar=pt_17)  # -> out, P, T, Forward, Up, Right; inputs Ca: Point3d, Tar: Point3d
# ---------- c_script_8: C# ----------
    Camera c = new Camera(new Vector(Ca.X, Ca.Y, Ca.Z), new Vector(Tar.X, Tar.Y, Tar.Z));


    P = new Point3d(c.pos.x, c.pos.y, c.pos.z);
    T = new Point3d(c.lookAt.x, c.lookAt.y, c.lookAt.z);
    Forward = new Vector3d(c.forward.x, c.forward.y, c.forward.z);
    Up = new Vector3d(c.up.x, c.up.y, c.up.z);
    Right = new Vector3d(c.right.x, c.right.y, c.right.z);
# ---------- c_script_8: C# additional code ----------
  public class Camera {
    public Vector forward;
    public Vector right;
    public Vector down;
    public Vector up;
    public Vector pos;
    public Vector lookAt;
    public Camera(Vector pos, Vector lookAt){
      this.pos = pos;
      this.lookAt = lookAt;
      this.down = new Vector(0.0, 0.0, -1.0);
      this.forward = Vector.norm(Vector.minus(lookAt, this.pos));
      this.right = Vector.times(1.5, Vector.norm(Vector.cross(down, this.forward)));
      this.up = Vector.times(1.5, Vector.norm(Vector.cross(this.right, this.forward)));
    }
  }



  public class Vector {
    public static Vector times(double k, Vector v) { return new Vector(k * v.x, k * v.y, k * v.z); }
    public static Vector minus(Vector v1, Vector v2) { return new Vector(v1.x - v2.x, v1.y - v2.y, v1.z - v2.z); }
    public static Vector plus(Vector v1, Vector v2) { return new Vector(v1.x + v2.x, v1.y + v2.y, v1.z + v2.z); }
    public static double dot(Vector v1, Vector v2) { return v1.x * v2.x + v1.y * v2.y + v1.z * v2.z; }
    public static double mag(Vector v) { return Math.Sqrt(v.x * v.x + v.y * v.y + v.z * v.z); }
    public static Vector norm(Vector v) {
      double mag = Vector.mag(v);
      var div = (mag == 0) ? double.MaxValue : 1.0 / mag;
      return Vector.times(div, v);
    }
    public static Vector cross(Vector v1, Vector v2) {
      return new Vector(v1.y * v2.z - v1.z * v2.y,
        v1.z * v2.x - v1.x * v2.z,
        v1.x * v2.y - v1.y * v2.x);
    }

    public double x;
    public double y;
    public double z;

    public Vector(double x, double y, double z) {
      this.x = x;
      this.y = y;
      this.z = z;
    }

  }
  public class Color {
    public double r;
    public double g;
    public double b;
    public Color(double r, double g, double b) {
      this.r = r;
      this.g = g;
      this.b = b;
    }

    public static Color scale(double k, Color v) { return new Color(k * v.r, k * v.g, k * v.b); }
    public static Color plus(Color v1, Color v2) { return new Color(v1.r + v2.r, v1.g + v2.g, v1.b + v2.b); }
    public static Color times(Color v1, Color v2) { return new Color(v1.r * v2.r, v1.g * v2.g, v1.b * v2.b); }
    public static Color white = new Color(1.0, 1.0, 1.0);
    public static Color grey = new Color(0.5, 0.5, 0.5);
    public static Color black = new Color(0.0, 0.0, 0.0);
    public static Color background = Color.black;
    public static Color defaultColor = Color.black;
    public static List<double> toDrawingColor(Color c) {
      // var legalize = d => d > 1 ? 1 : d;
      return new List<double> {
          Math.Floor(Color.legalize(c.r) * 255),
          Math.Floor(Color.legalize(c.g) * 255),
          Math.Floor(Color.legalize(c.b) * 255)
          };
    }
    private static double legalize(double d){
      return d > 1 ? 1 : d;
    }
  }
# ---------- end c_script_8 ----------
panel_30 = Panel([python_3.a, python_3.b])
number_slider_15 = Slider(7, range=0..100)
number_slider_16 = Slider(7, range=0..100)
# Vector Angle
number_slider_17 = Slider(0.5, range=0..1)
pt_19 = Point(<point referenced from the Rhino model>)
vec_30 = VectorXYZ(XComponent=Slider(8, range=0..10), YComponent=Slider(5, range=0..10), ZComponent=Slider(5, range=0..10))  # -> Vector, Length
python_4 = GhPythonScript(v=vec_30.Vector)  # -> out, a, b; inputs v: Vector3d
# ---------- python_4: Python ----------
__author__ = "namju"
__version__ = "2023.08.04"

import rhinoscriptsyntax as rs
import math;


a = rs.VectorLength(v)



value = v[0] * v[0] + v[1] * v[1] + v[2] * v[2] 
b =  math.sqrt(value);
# ---------- end python_4 ----------
vec_31 = VectorXYZ(XComponent=Slider(10, range=0..10), YComponent=Slider(0, range=0..10), ZComponent=Slider(0, range=0..10))  # -> Vector, Length
vec_32 = VectorXYZ(XComponent=Slider(0, range=0..10), YComponent=Slider(2.3, range=0..10), ZComponent=Slider(0, range=0..10))  # -> Vector, Length
vec_33 = VectorXYZ(XComponent=Slider(8, range=0..10), YComponent=Slider(5, range=0..10), ZComponent=Slider(5, range=0..10))  # -> Vector, Length
vdis_48 = VectorDisplay(Anchor=c_script_8.P, Vector=c_script_8.Up)
vdis_49 = VectorDisplay(Anchor=c_script_8.P, Vector=c_script_8.Right)
vdis_50 = VectorDisplay(Anchor=c_script_8.P, Vector=c_script_8.Forward)
pt_20 = Point(<point referenced from the Rhino model>)
pt_21 = Point(<point referenced from the Rhino model>)
unit_4 = UnitVector(Vector=vec_32.Vector)
vec_34 = VectorXYZ(XComponent=Slider(10, range=0..10), YComponent=Slider(0, range=0..10), ZComponent=Slider(0, range=0..10))  # -> Vector, Length
multiplication_8 = Multiplication(A=number_slider_15, B=Slider(0.5, range=0..1))
unit_5 = UnitVector(Vector=vec_31.Vector)
multiplication_9 = Multiplication(A=number_slider_16, B=number_slider_17)
vec_35 = VectorXYZ(XComponent=Slider(0, range=0..10), YComponent=Slider(2.3, range=0..10), ZComponent=Slider(0, range=0..10))  # -> Vector, Length
panel_31 = Panel(python_4.a)
vlen_5 = VectorLength(Vector=vec_33.Vector)
panel_32 = Panel(python_4.b)
vdis_51 = VectorDisplay(Anchor="0,0,0", Vector=unit_4)
vlen_6 = VectorLength(Vector=vec_30.Vector)
vdis_52 = VectorDisplay(Anchor=Point(0, 0, 0), Vector=vec_30.Vector)
rectangle_2 = Rectangle(Plane=pt_19, XSize=number_slider_16, YSize=number_slider_15, Radius=0)  # -> Rectangle, Length
panel_33 = Panel(vec_30.Length)
c_script_9 = CSharpScript(p0=pt_21, p1=pt_20)  # -> out, A; inputs p0: Vector3d, p1: Vector3d; same code as c_script
c_script_10 = CSharpScript()  # -> out, A; same code as c_script_4
vdis_53 = VectorDisplay(Anchor="0,0,0", Vector=unit_5)
unit_6 = UnitVector(Vector=vec_35.Vector)
dprod_2 = DotProduct(VectorA=unit_4, VectorB=unit_5, Unitize=False)
unit_7 = UnitVector(Vector=vec_34.Vector)
neg_3 = Negative(Value=multiplication_8)
neg_4 = Negative(Value=multiplication_9)
c_script_11 = CSharpScript()  # -> out, A; same code as c_script_5
c_script_12 = CSharpScript()  # -> out, A
# ---------- c_script_12: C# additional code ----------
  public class Ray {
    public Vector start;
    public Vector dir;
  }
  public class Intersection {
    public Thing thing;
    public Ray ray;
    public double dist;
    public Intersection(Thing thing, Ray ray, double dist){
      this.thing = thing;
      this.ray = ray;
      this.dist = dist;
    }
  }
  
  
  public abstract class Thing {
    public abstract Intersection intersect(Ray ray);
    public abstract Vector normal(Vector pos);
    public Surface surface;
  }
  
  

  public class Camera {
    public Vector forward;
    public Vector right;
    public Vector down;
    public Vector up;
    public Vector pos;
    public Camera(Vector pos, Vector lookAt){
      this.pos = pos;
      this.down = new Vector(0.0, -1.0, 0.0);
      this.forward = Vector.norm(Vector.minus(lookAt, this.pos));
      this.right = Vector.times(1.5, Vector.norm(Vector.cross(this.forward, down)));
      this.up = Vector.times(1.5, Vector.norm(Vector.cross(this.forward, this.right)));
    }
  }



  public class Vector {
    public static Vector times(double k, Vector v) { return new Vector(k * v.x, k * v.y, k * v.z); }
    public static Vector minus(Vector v1, Vector v2) { return new Vector(v1.x - v2.x, v1.y - v2.y, v1.z - v2.z); }
    public static Vector plus(Vector v1, Vector v2) { return new Vector(v1.x + v2.x, v1.y + v2.y, v1.z + v2.z); }
    public static double dot(Vector v1, Vector v2) { return v1.x * v2.x + v1.y * v2.y + v1.z * v2.z; }
    public static double mag(Vector v) { return Math.Sqrt(v.x * v.x + v.y * v.y + v.z * v.z); }
    public static Vector norm(Vector v) {
      double mag = Vector.mag(v);
      var div = (mag == 0) ? double.MaxValue : 1.0 / mag;
      return Vector.times(div, v);
    }
    public static Vector cross(Vector v1, Vector v2) {
      return new Vector(v1.y * v2.z - v1.z * v2.y,
        v1.z * v2.x - v1.x * v2.z,
        v1.x * v2.y - v1.y * v2.x);
    }

    public double x;
    public double y;
    public double z;

    public Vector(double x, double y, double z) {
      this.x = x;
      this.y = y;
      this.z = z;
    }

  }
  public class Color {
    public double r;
    public double g;
    public double b;
    public Color(double r, double g, double b) {
      this.r = r;
      this.g = g;
      this.b = b;
    }

    public static Color scale(double k, Color v) { return new Color(k * v.r, k * v.g, k * v.b); }
    public static Color plus(Color v1, Color v2) { return new Color(v1.r + v2.r, v1.g + v2.g, v1.b + v2.b); }
    public static Color times(Color v1, Color v2) { return new Color(v1.r * v2.r, v1.g * v2.g, v1.b * v2.b); }
    public static Color white = new Color(1.0, 1.0, 1.0);
    public static Color grey = new Color(0.5, 0.5, 0.5);
    public static Color black = new Color(0.0, 0.0, 0.0);
    public static Color background = Color.black;
    public static Color defaultColor = Color.black;
    public static List<double> toDrawingColor(Color c) {
      // var legalize = d => d > 1 ? 1 : d;
      return new List<double> {
          Math.Floor(Color.legalize(c.r) * 255),
          Math.Floor(Color.legalize(c.g) * 255),
          Math.Floor(Color.legalize(c.b) * 255)
          };
    }
    private static double legalize(double d){
      return d > 1 ? 1 : d;
    }
  }
# ---------- end c_script_12 ----------
panel_34 = Panel(vlen_6)
vdis_54 = VectorDisplay(Anchor="0,0,0", Vector=unit_6)
vdis_55 = VectorDisplay(Anchor=Point(0, 0, 0), Vector=vec_33.Vector)
panel_35 = Panel(vec_33.Length)
vdis_56 = VectorDisplay(Anchor="0,0,0", Vector=unit_7)
X_3 = UnitX(Factor=neg_4)
panel_36 = Panel(dprod_2)
dprod_3 = DotProduct(VectorA=unit_6, VectorB=unit_7, Unitize=False)
Y_3 = UnitY(Factor=neg_3)
panel_37 = Panel(c_script_12.out)
panel_38 = Panel(c_script_11.out)
panel_39 = Panel(dprod_3)
move_3 = Move(Geometry=rectangle_2.Rectangle, Motion=X_3)  # -> Geometry, Transform
move_4 = Move(Geometry=move_3.Geometry, Motion=Y_3)  # -> Geometry, Transform
rotate_2 = Rotate(Geometry=move_4.Geometry, Angle=c_script_9.A, Plane=pt_19)  # -> Geometry, Transform

vec_36 = VectorXYZ(XComponent=Slider(2, range=0..10), YComponent=Slider(3, range=0..10), ZComponent=0)  # -> Vector, Length
pt_22 = ConstructPoint(XCoordinate=0, YCoordinate=0, ZCoordinate=0)
vec_37 = VectorXYZ(XComponent=Slider(5, range=0..10), YComponent=Slider(2, range=0..10), ZComponent=0)  # -> Vector, Length
pt_23 = ConstructPoint(XCoordinate=0, YCoordinate=0, ZCoordinate=0)
vdis_57 = VectorDisplay(Anchor=pt_22, Vector=vec_36.Vector)
vdis_58 = VectorDisplay(Anchor=pt_23, Vector=vec_37.Vector)
vec_38 = Vector(vec_36.Vector)
vec_39 = Vector(vec_37.Vector)
python_5 = GhPythonScript(v0=vec_38, v1=vec_39)  # -> out, a; inputs v0: Point3d, v1: Point3d
# ---------- python_5: Python ----------
__author__ = "namju"
__version__ = "2023.06.03"

import rhinoscriptsyntax as rs

x = v0.X - v1.X 
y = v0.Y - v1.Y 
z = v0.Z - v1.Z 

a = rs.AddPoint(x, y, z)
# ---------- end python_5 ----------
subtraction_6 = Subtraction(A=vec_38, B=vec_39)
addition_2 = Addition(A=vec_38, B=vec_39)
vdis_59 = VectorDisplay(Anchor=pt_22, Vector=python_5.a)
vdis_60 = VectorDisplay(Anchor=pt_22, Vector=addition_2)
vdis_61 = VectorDisplay(Anchor=pt_22, Vector=subtraction_6)

panel_40 = Panel(c_script_9.out)

# ----
# XProd
number_slider_18 = Slider(2, range=0..10)
vec_40 = VectorXYZ(XComponent=number_slider_18, YComponent=Slider(3, range=0..10), ZComponent=0)  # -> Vector, Length
pt_24 = ConstructPoint(XCoordinate=0, YCoordinate=0, ZCoordinate=0)
vec_41 = VectorXYZ(XComponent=Slider(5, range=0..10), YComponent=Slider(2, range=0..10), ZComponent=0)  # -> Vector, Length
pt_25 = ConstructPoint(XCoordinate=0, YCoordinate=0, ZCoordinate=0)
vdis_62 = VectorDisplay(Anchor=pt_25, Vector=vec_41.Vector)
vdis_63 = VectorDisplay(Anchor=pt_24, Vector=vec_40.Vector)
toggle = BooleanToggle(True)
xprod_2 = CrossProduct(VectorA=vec_40.Vector, VectorB=vec_41.Vector, Unitize=toggle)  # -> Vector, Length
vdis_64 = VectorDisplay(Anchor=pt_24, Vector=xprod_2.Vector)

python_6 = GhPythonScript(v0=vec_40.Vector, v1=vec_41.Vector, u=toggle)  # -> out, a, b; inputs v0: Point3d, v1: Point3d, u: Boolean
# ---------- python_6: Python ----------
__author__ = "namju"
__version__ = "2023.06.03"

import rhinoscriptsyntax as rs
import math


a = rs.VectorCrossProduct(v0, v1)
if (u):
    a = rs.VectorUnitize(a)



x = v0[1] * v1[2] - v0[2] * v1[1]
y = v0[2] * v1[1] - v0[0] * v1[2]
z = v0[0] * v1[1] - v0[1] * v1[0]


len = 1
if (u):
    len = math.sqrt(x * x + y * y + z * z)


b = rs.AddPoint(x / len, y / len, z / len)
# ---------- end python_6 ----------
panel_41 = Panel([xprod_2.Vector, python_6.a, python_6.b])

# ----
# Angle
number_slider_19 = Slider(4, range=0..10)
vec_42 = VectorXYZ(XComponent=number_slider_19, YComponent=Slider(1, range=0..10), ZComponent=0)  # -> Vector, Length
pt_26 = ConstructPoint(XCoordinate=0, YCoordinate=0, ZCoordinate=0)
vec_43 = VectorXYZ(XComponent=Slider(3, range=0..10), YComponent=Slider(5, range=-10..10), ZComponent=0)  # -> Vector, Length
pt_27 = ConstructPoint(XCoordinate=0, YCoordinate=0, ZCoordinate=0)
vdis_65 = VectorDisplay(Anchor=pt_27, Vector=vec_43.Vector)
vdis_66 = VectorDisplay(Anchor=pt_26, Vector=vec_42.Vector)
angle = Angle(VectorA=vec_43.Vector, VectorB=vec_42.Vector)  # -> Angle, Reflex
panel_42 = Panel(angle.Angle)
panel_43 = Panel(angle.Reflex)

# ----
# VRot
number_slider_20 = Slider(2, range=0..10)
vec_44 = VectorXYZ(XComponent=number_slider_20, YComponent=Slider(3, range=0..10), ZComponent=0)  # -> Vector, Length
pt_28 = ConstructPoint(XCoordinate=0, YCoordinate=0, ZCoordinate=0)
number_slider_21 = Slider(2.0094, range=0..7)
vdis_67 = VectorDisplay(Anchor=pt_28, Vector=vec_44.Vector)
Z_2 = UnitZ(Factor=1)
vrot_2 = Rotate(Vector=vec_44.Vector, Axis=Z_2, Angle=number_slider_21)
vdis_68 = VectorDisplay(Anchor=pt_28, Vector=vrot_2)

c_script_13 = CSharpScript(v0=pt_27, v1=vec_42.Vector)  # -> out, A; inputs v0: Vector3d, v1: Vector3d
# ---------- c_script_13: C# ----------
double angle = Math.Acos(
    (v0 * v1) / ( v0.Length * v1.Length )
);


A = angle;
# ---------- end c_script_13 ----------
python_7 = GhPythonScript(v0=vec_43.Vector, v1=vec_42.Vector)  # -> out, a, b; inputs v0: Point3d, v1: Point3d
# ---------- python_7: Python ----------
__author__ = "namju"
__version__ = "2023.06.03"

import rhinoscriptsyntax as rs
import math




a = rs.VectorAngle(v0, v1) * math.pi / 180



firstAngle = math.atan2(v0[0], v0[1]);
secondAngle = math.atan2(v1[0], v1[1]);

b = secondAngle - firstAngle;
# ---------- end python_7 ----------
python_8 = GhPythonScript(v=vec_44.Vector, A=number_slider_21)  # -> out, a
# ---------- python_8: Python ----------
__author__ = "njnamjulee"

import rhinoscriptsyntax as rs
import math






cosTheta = math.cos(A);
sinTheta = math.sin(A);

x = v[0] * cosTheta - v[1] * sinTheta;
y = v[0] * sinTheta + v[1] * cosTheta;


a = rs.AddPoint(x, y ,0)
# ---------- end python_8 ----------
panel_44 = Panel([python_7.a, python_7.b])
panel_45 = Panel(c_script_13.A)
panel_46 = Panel([vrot_2, python_8.a])

# ---- group: Plane
crv = Curve(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)
eval = EvaluateCurve(Curve=crv, Parameter=Slider(14, range=0..20))  # -> Point, Tangent, Angle
Z_3 = UnitZ(Factor=1)
xprod_3 = CrossProduct(VectorA=eval.Tangent, VectorB=Z_3, Unitize=False)  # -> Vector, Length
vdis_69 = VectorDisplay(Anchor=eval.Point, Vector=xprod_3.Vector)
xprod_4 = CrossProduct(VectorA=eval.Tangent, VectorB=xprod_3.Vector, Unitize=False)  # -> Vector, Length
vdis_70 = VectorDisplay(Anchor=eval.Point, Vector=eval.Tangent)
vdis_71 = VectorDisplay(Anchor=eval.Point, Vector=xprod_4.Vector)

# ---- group: Curve Tangent
number_slider_22 = Slider(12, range=0..20)
crv_2 = Curve(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)
addition_3 = Addition(A=number_slider_22, B=Slider(0.1, range=0..1))
eval_2 = EvaluateCurve(Curve=crv_2, Parameter=number_slider_22)  # -> Point, Tangent, Angle
eval_3 = EvaluateCurve(Curve=crv_2, Parameter=addition_3)  # -> Point, Tangent, Angle
vdis_72 = VectorDisplay(Anchor=eval_2.Point, Vector=eval_2.Tangent)
subtraction_7 = Subtraction(A=eval_3.Point, B=eval_2.Point)
unit_8 = UnitVector(Vector=subtraction_7)
vdis_73 = VectorDisplay(Anchor=eval_2.Point, Vector=unit_8)

# ----
# unit vector
number_slider_23 = Slider(6.1, range=0..10)
vec_45 = VectorXYZ(XComponent=number_slider_23, YComponent=Slider(2.3, range=0..10), ZComponent=Slider(4, range=0..10))  # -> Vector, Length
panel_47 = Panel(vec_45.Length)
unit_9 = UnitVector(Vector=vec_45.Vector)
vdis_74 = VectorDisplay(Anchor="0,0,0", Vector=vec_45.Vector)
python_9 = GhPythonScript(v=vec_45.Vector)  # -> out, V, L
# ---------- python_9: Python ----------
import rhinoscriptsyntax as rs


newV = rs.VectorUnitize(v)
newLen = rs.VectorLength(newV)

V = newV
L = newLen
# ---------- end python_9 ----------
python_10 = GhPythonScript(v=vec_45.Vector)  # -> out, V, L
# ---------- python_10: Python ----------
import Rhino as r
import math

def Length(v):
    return math.sqrt(v.X * v.X + v.Y * v.Y + v.Z * v.Z)
def Unitize(v):
    len = Length(v) 
    return r.Geometry.Vector3d(
        v.X / len,
        v.Y / len,
        v.Z / len,
    )


newV = Unitize(v)

V = newV
L = Length(newV)
# ---------- end python_10 ----------
python_11 = GhPythonScript(v=vec_45.Vector)  # -> out, V, L
# ---------- python_11: Python ----------
import Rhino as r


v.Unitize();

V = v
L = v.Length
# ---------- end python_11 ----------
c_script_14 = CSharpScript(v=vec_45.Vector)  # -> out, V, L; inputs v: Vector3d
# ---------- c_script_14: C# ----------
    v.Unitize();
    
    V = v;
    L = v.Length;
# ---------- end c_script_14 ----------
c_script_15 = CSharpScript(v=vec_45.Vector)  # -> out, V, L; inputs v: Vector3d
# ---------- c_script_15: C# ----------
    
    Vector3d nv = Unitize(v);
    
    V = nv;
    L = Length(nv);
# ---------- c_script_15: C# additional code ----------
  static double Length(Vector3d v){
    return Math.Sqrt(v.X * v.X + v.Y * v.Y + v.Z * v.Z);
  }
  static Vector3d Unitize(Vector3d v){
    double len = Length(v);
    return new Vector3d(
      v.X / len,
      v.Y / len,
      v.Z / len
      );
  }
# ---------- end c_script_15 ----------
vlen_7 = VectorLength(Vector=unit_9)
vdis_75 = VectorDisplay(Anchor="0,0,0", Vector=unit_9)
panel_48 = Panel(vlen_7)
vdis_76 = VectorDisplay(Anchor="0,0,0", Vector=c_script_15.V)
vdis_77 = VectorDisplay(Anchor="0,0,0", Vector=c_script_14.V)
panel_49 = Panel(c_script_15.L)
panel_50 = Panel(c_script_14.L)
vdis_78 = VectorDisplay(Anchor="0,0,0", Vector=python_11.V)
panel_51 = Panel(python_11.L)
vdis_79 = VectorDisplay(Anchor="0,0,0", Vector=python_10.V)
vdis_80 = VectorDisplay(Anchor="0,0,0", Vector=python_9.V)
panel_52 = Panel(python_9.L)
panel_53 = Panel(python_10.L)

# ----
# division
number_slider_24 = Slider(6.1, range=0..10)
number_slider_25 = Slider(1.05, range=0..9)
vec_46 = VectorXYZ(XComponent=number_slider_24, YComponent=Slider(2.3, range=0..10), ZComponent=Slider(0, range=0..10))  # -> Vector, Length
vdis_81 = VectorDisplay(Anchor="0,0,0", Vector=vec_46.Vector)
division_3 = Division(A=vec_46.Vector, B=number_slider_25)
c_script_16 = CSharpScript(A=vec_46.Vector, B=number_slider_25)  # -> out, R; inputs A: Vector3d, B: Double
# ---------- c_script_16: C# ----------
    R = A / B;
# ---------- end c_script_16 ----------
c_script_17 = CSharpScript(A=vec_46.Vector, B=number_slider_25)  # -> out, R1, R2; inputs A: Vector3d, B: Double
# ---------- c_script_17: C# ----------
    R1 = new Vector3d(A.X / B, A.Y / B, A.Z / B);



    A.X = A.X / B;
    A.Y /= B;
    A.Z /= B;

    R2 = A;
# ---------- end c_script_17 ----------
python_12 = GhPythonScript(A=vec_46.Vector, B=number_slider_25)  # -> out, a; inputs A: Vector3d
# ---------- python_12: Python ----------
a = A / B
# ---------- end python_12 ----------
python_13 = GhPythonScript(A=vec_46.Vector, B=number_slider_25)  # -> out, a; inputs A: Vector3d
# ---------- python_13: Python ----------
A.X = A.X / B
A.Y /= B
A.Z /= B


a = A
# ---------- end python_13 ----------
vdis_82 = VectorDisplay(Anchor="0,0,0", Vector=division_3)
panel_54 = Panel([division_3, c_script_16.R, c_script_17.R1, c_script_17.R2])
panel_55 = Panel([python_12.a, python_13.a])

# ----
# Author: NJ Namju Lee / nj.namju@gmail.com
# * Linkedin - https://www.linkedin.com/in/nj-namju-lee-926b3252/
# * Git - https://github.com/NamjuLee
# 
# * Web - http://www.njstudio.co.kr
# * Lab - http://www.njslab.com/NJSLabCore/
# 
# * Video(English) - https://www.youtube.com/c/njnamjulee
# * Writing(English) - https://medium.com/@nj-namju
# 
# * Video(Korean) - https://www.youtube.com/c/CodeforDesign
# * Writing(Korean) - https://brunch.co.kr/@njnamju
# https://computationaldesign.tistory.com/39
# Basic operation of Vectors
# Vector & Point
# Grasshopper CSharp #Workshop Episode A
# 
# https://computationaldesign.tistory.com/14
# 디자인 스크립팅을 위한 C# 기초 문법 [맴버십 강의]
# 
# https://computationaldesign.tistory.com/38
# [한국어]Python For Designers / 디자이너를 위한 파이썬
# 
#  https://computationaldesign.tistory.com/20
# 
# https://github.com/NamjuLee/Introduction-to-computational-design-python-notebook/blob/master/Workshop_02_PythonClass.ipynb
number_slider_26 = Slider(3, range=0..10)
number_slider_27 = Slider(3, range=0..10)
number_slider_28 = Slider(3, range=0..10)
vec_47 = VectorXYZ(XComponent=number_slider_26, YComponent=number_slider_28, ZComponent=number_slider_27)  # -> Vector, Length
c_script_18 = CSharpScript(x=number_slider_26, y=number_slider_28, z=number_slider_27)  # -> out, V, Pt; inputs x: Double, y: Double, z: Double
# ---------- c_script_18: C# ----------
    V = new Rhino.Geometry.Vector3d(x, y, z);
    Pt = new Point3d(x, y, z);
# ---------- end c_script_18 ----------
python_14 = GhPythonScript(x=number_slider_26, y=number_slider_28, z=number_slider_27)  # -> out, V, Pt
# ---------- python_14: Python ----------
import Rhino.Geometry as r

V = r.Vector3d(x, y, z);
Pt = r.Point3d(x, y, z);
# ---------- end python_14 ----------
python_15 = GhPythonScript(x=number_slider_26, y=number_slider_28, z=number_slider_27)  # -> out, V, Pt
# ---------- python_15: Python ----------
import rhinoscriptsyntax as rs

V = rs.CreateVector(x, y, z)
Pt = rs.AddPoint(x, y, z)
# ---------- end python_15 ----------
pt_29 = ConstructPoint(XCoordinate=number_slider_26, YCoordinate=number_slider_28, ZCoordinate=number_slider_27)
panel_56 = Panel([c_script_18.V, c_script_18.Pt])
panel_57 = Panel([python_15.V, python_15.Pt])
panel_58 = Panel([python_14.V, python_14.Pt])
panel_59 = Panel([vec_47.Vector, pt_29])
number_slider_29 = Slider(3, range=0..10)
number_slider_30 = Slider(3, range=0..10)
number_slider_31 = Slider(3, range=0..10)
c_script_19 = CSharpScript(x=number_slider_29, y=number_slider_31, z=number_slider_30)  # -> out, NPt, RPt; inputs x: Double, y: Double, z: Double
# ---------- c_script_19: C# ----------
    NPoint3d npt = new NPoint3d(x, y, z);
    
    NPt = npt.Print();
    RPt = npt.ToRhinoPt();
# ---------- c_script_19: C# additional code ----------
  public class NPoint3d
  {
    public double size = 0.5;
    public double x = 0;
    public double y = 0;
    public double z = 0;

    public NPoint3d() {

    }
    public NPoint3d(double x, double y) {
      this.x = x; this.y = y;
    }
    public NPoint3d(double x, double y, double z){
      this.x = x; this.y = y; this.z = z;
    }
    public string Print(){
      return "{" + this.x.ToString() + ", " + this.y.ToString() + ", " + this.z.ToString() + "}";
    }
    public bool IsMouseInside(double x, double y) {
      // TODO:
      return false;
    }

    public void Move(double x, double y, double z){
      // TODO:
    }
    public void Remove(){
      // TODO:
    }
    public double Distance(NPoint3d p){
      // TODO:
      return 0;
    }
    public void Translate(double x, double y){
      // TODO:
    }
    public bool IsOverlap(NPoint3d p, double tor = 0.1){
      if (this.Distance(p) < tor) { return true; } else { return false; }
    }
    public Point3d ToRhinoPt(){
      return new Point3d(this.x, this.y, this.z);
    }
  }
# ---------- end c_script_19 ----------
c_script_20 = CSharpScript(x=number_slider_29, y=number_slider_31, z=number_slider_30)  # -> out, NVec, RVec; inputs x: Double, y: Double, z: Double
# ---------- c_script_20: C# ----------
    NVector3d nvec = new NVector3d(x, y, z);

    NVec = nvec.Print();
    RVec = nvec.ToRhinoVec();
# ---------- c_script_20: C# additional code ----------
  public class NVector3d{

    public double x = 0;
    public double y = 0;
    public double z = 0;

    public NVector3d(double x, double y, double z){
      this.x = x; this.y = y; this.z = z;
    }
    public string Print(){
      return "{" + this.x.ToString() + ", " + this.y.ToString() + ", " + this.z.ToString() + "}";
    }
    public Vector3d ToRhinoVec(){
      return new Vector3d(this.x, this.y, this.z);
    }
  }
# ---------- end c_script_20 ----------
python_16 = GhPythonScript(x=Slider(3, range=0..10), y=Slider(3, range=0..10), z=Slider(3, range=0..10))  # -> out, V, Pt
# ---------- python_16: Python ----------
import Rhino as r

class NVector3d:
    def __init__(self, x, y, z):
        self.x = x
        self.y = y
        self.z = z

    def Print(self):
        return "{" + str(self.x) + ", " + str(self.y) + ", " + str(self.z) + "}"

    def ToRhino(self):
        return r.Geometry.Vector3d(self.x, self.y, self.z)


nvec = NVector3d(x, y, z)

V = nvec.Print()

class NPoint3d:
    def __init__(self, x, y, z):
        self.x = x
        self.y = y
        self.z = z

    def Print(self):
        return "{" + str(self.x) + ", " + str(self.y) + ", " + str(self.z) + "}"

    def ToRhino(self):
        return r.Geometry.Point3d(self.x, self.y, self.z)


npt = NPoint3d(x, y, z)

Pt = npt.Print()
# ---------- end python_16 ----------
panel_60 = Panel([c_script_19.NPt, c_script_19.RPt])
panel_61 = Panel([c_script_20.NVec, c_script_20.RVec])
panel_62 = Panel([python_16.V, python_16.Pt])

# ----
# length
number_slider_32 = Slider(6.1, range=0..10)
number_slider_33 = Slider(2.3, range=0..10)
number_slider_34 = Slider(0, range=0..10)
vec_48 = VectorXYZ(XComponent=number_slider_32, YComponent=number_slider_33, ZComponent=number_slider_34)  # -> Vector, Length
c_script_21 = CSharpScript(x=number_slider_32, y=number_slider_33, z=number_slider_34)  # -> out, V, L; inputs x: Double, y: Double, z: Double
# ---------- c_script_21: C# ----------
    Vector3d v = new Vector3d(x, y, z);

    V = v;
    L = v.Length;
# ---------- end c_script_21 ----------
c_script_22 = CSharpScript(x=number_slider_32, y=number_slider_33, z=number_slider_34)  # -> out, V, L; inputs x: Double, y: Double, z: Double
# ---------- c_script_22: C# ----------
    Vector3d v = new Vector3d(x, y, z);

    V = v;
    L = GetLength(v);
# ---------- c_script_22: C# additional code ----------
  static double GetLength(Vector3d v){
    return Math.Sqrt(v.X * v.X + v.Y * v.Y + v.Z * v.Z);
  }
# ---------- end c_script_22 ----------
python_17 = GhPythonScript(x=number_slider_32, y=number_slider_33, z=number_slider_34)  # -> out, V, L
# ---------- python_17: Python ----------
import Rhino as r

v = r.Geometry.Vector3d(x, y, z)

V = v
L = v.Length
# ---------- end python_17 ----------
python_18 = GhPythonScript(x=number_slider_32, y=number_slider_33, z=number_slider_34)  # -> out, V, L
# ---------- python_18: Python ----------
import rhinoscriptsyntax as rs
import math
def GetLength(v):
    return math.sqrt(v.X * v.X + v.Y * v.Y + v.Z * v.Z);

v = rs.CreateVector(x, y, z);

V = v
L = GetLength(v)
# ---------- end python_18 ----------
python_19 = GhPythonScript(x=number_slider_32, y=number_slider_33, z=number_slider_34)  # -> out, V, L
# ---------- python_19: Python ----------
import rhinoscriptsyntax as rs

v = rs.CreateVector(x, y, z);

V = v
L = rs.VectorLength(v)
# ---------- end python_19 ----------
panel_63 = Panel(vec_48.Vector)
vlen_8 = VectorLength(Vector=vec_48.Vector)
panel_64 = Panel(c_script_22.L)
panel_65 = Panel(vlen_8)
panel_66 = Panel(c_script_21.L)
panel_67 = Panel(python_17.L)
panel_68 = Panel(vec_48.Length)
panel_69 = Panel(python_19.L)
panel_70 = Panel(python_18.L)
c_script_23 = CSharpScript(V0="0,0,0", V1=c_script_21.V)  # -> out, D; inputs V0: Vector3d, V1: Vector3d
# ---------- c_script_23: C# ----------
    Point3d p0 = (Point3d) V0;
    Point3d p1 = new Point3d(V1.X, V1.Y, V1.Z);

    D = p0.DistanceTo(p1);
# ---------- end c_script_23 ----------
c_script_24 = CSharpScript(V0="0,0,0", V1=c_script_21.V)  # -> out, D; inputs V0: Vector3d, V1: Vector3d
# ---------- c_script_24: C# ----------
    Point3d p0 = (Point3d) V0;
    Point3d p1 = new Point3d(V1.X, V1.Y, V1.Z);

    D = Distance(p0, p1);
# ---------- c_script_24: C# additional code ----------
  public static double Distance(Point3d v0, Point3d v1){
    return Math.Sqrt((v0.X - v1.X) * (v0.X - v1.X) + (v0.Y - v1.Y) * (v0.Y - v1.Y) + (v0.Z - v1.Z) * (v0.Z - v1.Z));
  }
# ---------- end c_script_24 ----------
python_20 = GhPythonScript(V0="0,0,0", V1=python_17.V)  # -> out, D; inputs V0: Vector3d, V1: Vector3d
# ---------- python_20: Python ----------
import Rhino as r

p0 = r.Geometry.Point3d(V0)
p1 = r.Geometry.Point3d(V1.X, V1.Y, V1.Z)

D = p0.DistanceTo(p1)
# ---------- end python_20 ----------
python_21 = GhPythonScript(V0="0,0,0", V1=python_18.V)  # -> out, D; inputs V0: Vector3d, V1: Vector3d
# ---------- python_21: Python ----------
import Rhino as r
import math
def DistanceTo(p0, p1):
    return math.sqrt((p0.X - p1.X) * (p0.X - p1.X) + (p0.Y - p1.Y) * (p0.Y - p1.Y) + (p0.Z - p1.Z) * (p0.Z - p1.Z));


p0 = r.Geometry.Point3d(V0)
p1 = r.Geometry.Point3d(V1.X, V1.Y, V1.Z)

D = DistanceTo(p0, p1)
# ---------- end python_21 ----------
dist_3 = Distance(PointA="0,0,0", PointB=vec_48.Vector)
python_22 = GhPythonScript(V0="0,0,0", V1=python_19.V)  # -> out, D; inputs V0: Vector3d, V1: Vector3d
# ---------- python_22: Python ----------
import rhinoscriptsyntax as rs

p0 = rs.AddPoint(V0)
p1 = rs.AddPoint(V1.X, V1.Y, V1.Z)

D = rs.Distance(p0, p1)
# ---------- end python_22 ----------
panel_71 = Panel(dist_3)
panel_72 = Panel(c_script_23.D)
panel_73 = Panel(c_script_24.D)
panel_74 = Panel(python_20.D)
panel_75 = Panel(python_22.D)
panel_76 = Panel(python_21.D)

# ----
# representation
number_slider_35 = Slider(6.1, range=0..10)
vec_49 = VectorXYZ(XComponent=number_slider_35, YComponent=Slider(2.3, range=0..10), ZComponent=Slider(0, range=0..10))  # -> Vector, Length
devec_2 = DeconstructVector(Vector=vec_49.Vector)  # -> XComponent, YComponent, ZComponent
panel_77 = Panel(vec_49.Vector)
panel_78 = Panel(devec_2.YComponent)
panel_79 = Panel(devec_2.XComponent)
panel_80 = Panel(devec_2.ZComponent)

# ----
# Data in Design
# 
# Instructor : NJ Namju Lee / nj.namju@gmail.com
# 
# * class - https://namjulee.github.io/data-in-design/
# 
# * Lab - https://namjulee.github.io/njs-lab-public/
# 
# * Video(English) - https://www.youtube.com/c/njnamjulee
# * Writing(English) - https://medium.com/@nj-namju
# 
# * Video(Korean) - https://www.youtube.com/c/CodeforDesign
# * Writing(Korean) - https://brunch.co.kr/@njnamju
# 
# Installation - https://namjulee.github.io/njs-lab-public/installation
# https://computationaldesign.tistory.com/39
# Vector construction
number_slider_36 = Slider(5, range=0..10)
number_slider_37 = Slider(10, range=0..10)
number_slider_38 = Slider(0, range=0..10)

# ----
# Scalar Multiplication of a Vector &
# Division by a Scalar (Scalar Division of a Vector)
number_slider_39 = Slider(63, range=0..100)
pt_30 = Point(Point(31.70203215, -11.15786631, 0))
pt_31 = Point(Point(23.21938373, 13.57029378, 0))

# ----
# Vector addition
pt_32 = Point(Point(39.26666409, 39.24109607, 0))
pt_33 = Point(Point(59.05914631, 18.74173948, 0))

# ----
# Vector subtraction
pt_34 = Point(Point(71.55914466, 16.21133967, 0))
pt_35 = Point(Point(34.10622422, 30.24523842, 0))

vdis_83 = VectorDisplay(Anchor="0,0,0", Vector=pt_32)
vdis_84 = VectorDisplay(Anchor="0,0,0", Vector=pt_33)
addition_4 = Addition(A=pt_32, B=pt_33)
vdis_85 = VectorDisplay(Anchor=pt_32, Vector=pt_33)
vdis_86 = VectorDisplay(Anchor="0,0,0", Vector=addition_4)

py3 = Python3Script(v0=pt_32, v1=pt_33)  # -> out, a; inputs v0: Vector3d, v1: Vector3d
# ---------- py3: Python ----------
import rhinoscriptsyntax as rs

a = rs.VectorAdd(v0, v1)
# ---------- end py3 ----------
py3_2 = Python3Script(v0=pt_32, v1=pt_33)  # -> out, a; inputs v0: Vector3d, v1: Vector3d
# ---------- py3_2: Python ----------
import rhinoscriptsyntax as rs

x = v0.X + v1.X
y = v0.Y + v1.Y
z = v0.Z + v1.Z

a = rs.AddPoint(x, y, z)
# ---------- end py3_2 ----------
py3_3 = Python3Script(v0=pt_32, v1=pt_33)  # -> out, a; inputs v0: Vector3d, v1: Vector3d
# ---------- py3_3: Python ----------
import rhinoscriptsyntax as rs


v = v0 + v1
a = v
# ---------- end py3_3 ----------
c_script_25 = CSharpScript(v0=pt_32, v1=pt_33)  # -> out, a; inputs v0: Vector3d, v1: Vector3d
# ---------- c_script_25: C# ----------
// Grasshopper Script Instance
#region Usings
using System;
using System.Linq;
using System.Collections;
using System.Collections.Generic;
using System.Drawing;

using Rhino;
using Rhino.Geometry;

using Grasshopper;
using Grasshopper.Kernel;
using Grasshopper.Kernel.Data;
using Grasshopper.Kernel.Types;
#endregion

public class Script_Instance : GH_ScriptInstance
{
    private void RunScript(Vector3d v0, Vector3d v1, ref object a)
    {
        // Write your logic here
       
        Vector3d v = v0 + v1;
        a = v;
    }
}
# ---------- end c_script_25 ----------
vdis_87 = VectorDisplay(Anchor="0,0,0", Vector=py3.a)
vdis_88 = VectorDisplay(Anchor="0,0,0", Vector=py3_2.a)
vdis_89 = VectorDisplay(Anchor="0,0,0", Vector=py3_3.a)
vdis_90 = VectorDisplay(Anchor="0,0,0", Vector=c_script_25.a)

vdis_91 = VectorDisplay(Anchor="0,0,0", Vector=pt_35)
vdis_92 = VectorDisplay(Anchor="0,0,0", Vector=pt_34)
subtraction_8 = Subtraction(A=pt_35, B=pt_34)
subtraction_9 = Subtraction(A=pt_34, B=pt_35)
multiplication_10 = Multiplication(A=pt_35, B="-1")
vdis_93 = VectorDisplay(Anchor=pt_34, Vector=multiplication_10)
vdis_94 = VectorDisplay(Anchor="0,0,0", Vector=subtraction_9)
vdis_95 = VectorDisplay(Anchor=pt_34, Vector=pt_35)
vdis_96 = VectorDisplay(Anchor="0,0,0", Vector=subtraction_8)

vec_50 = VectorXYZ(XComponent=number_slider_36, YComponent=number_slider_37, ZComponent=number_slider_38)  # -> Vector, Length
vdis_97 = VectorDisplay(Anchor="0,0,0", Vector=vec_50.Vector)
pt_36 = Point(vec_50.Vector)

py3_4 = Python3Script(x=number_slider_36, y=number_slider_37, z=number_slider_38)  # -> out, a
# ---------- py3_4: Python ----------
import rhinoscriptsyntax as rs

a = rs.AddPoint(x, y, z)
# ---------- end py3_4 ----------
py3_5 = Python3Script(x=number_slider_36, y=number_slider_37, z=number_slider_38)  # -> out, a
# ---------- py3_5: Python ----------
import Rhino as r

a = (x, y, z)
# ---------- end py3_5 ----------
c_script_26 = CSharpScript(x=number_slider_36, y=number_slider_37, z=number_slider_38)  # -> out, a; inputs x: Double, y: Double, z: Double
# ---------- c_script_26: C# ----------
// Grasshopper Script Instance
#region Usings
using System;
using System.Linq;
using System.Collections;
using System.Collections.Generic;
using System.Drawing;

using Rhino;
using Rhino.Geometry;

using Grasshopper;
using Grasshopper.Kernel;
using Grasshopper.Kernel.Data;
using Grasshopper.Kernel.Types;
#endregion

public class Script_Instance : GH_ScriptInstance
{
    private void RunScript(double x, double y, double z, ref object a)
    {
        Vector3d v = new Vector3d(x, y, z);
        a = v;
    }
}
# ---------- end c_script_26 ----------
py3_6 = Python3Script(x=number_slider_36, y=number_slider_37, z=number_slider_38)  # -> out, a
# ---------- py3_6: Python ----------
import Rhino as r

a = r.Geometry.Vector3d(x, y, z)
# ---------- end py3_6 ----------
panel_81 = Panel(py3_5.a)
vdis_98 = VectorDisplay(Anchor="0,0,0", Vector=py3_4.a)
vdis_99 = VectorDisplay(Anchor="0,0,0", Vector=py3_6.a)
vdis_100 = VectorDisplay(Anchor="0,0,0", Vector=c_script_26.a)

py3_7 = Python3Script(v0=pt_34, v1=pt_35)  # -> out, a; inputs v0: Vector3d, v1: Vector3d
# ---------- py3_7: Python ----------
import rhinoscriptsyntax as rs

a = rs.VectorSubtract(v0, v1)
# ---------- end py3_7 ----------
py3_8 = Python3Script(v0=pt_34, v1=pt_35)  # -> out, a; inputs v0: Vector3d, v1: Vector3d
# ---------- py3_8: Python ----------
import rhinoscriptsyntax as rs

x = v0.X - v1.X
y = v0.Y - v1.Y
z = v0.Z - v1.Z

a = rs.AddPoint(x, y, z)
# ---------- end py3_8 ----------
py3_9 = Python3Script(v0=pt_34, v1=pt_35)  # -> out, a; inputs v0: Vector3d, v1: Vector3d
# ---------- py3_9: Python ----------
import rhinoscriptsyntax as rs


v = v0 - v1
a = v
# ---------- end py3_9 ----------
c_script_27 = CSharpScript(v0=pt_34, v1=pt_35)  # -> out, a; inputs v0: Vector3d, v1: Vector3d
# ---------- c_script_27: C# ----------
// Grasshopper Script Instance
#region Usings
using System;
using System.Linq;
using System.Collections;
using System.Collections.Generic;
using System.Drawing;

using Rhino;
using Rhino.Geometry;

using Grasshopper;
using Grasshopper.Kernel;
using Grasshopper.Kernel.Data;
using Grasshopper.Kernel.Types;
#endregion

public class Script_Instance : GH_ScriptInstance
{
    private void RunScript(Vector3d v0, Vector3d v1, ref object a)
    {
        // Write your logic here
       
        Vector3d v = new Vector3d(v0.X, v0.Y, v0.Z);

        v.X = v.X - v1.X;
        v.Y = v0.Y - v1.Y;
        v.Z -= v1.Z;

        a = v;
    }
}
# ---------- end c_script_27 ----------
vdis_101 = VectorDisplay(Anchor="0,0,0", Vector=py3_7.a)
vdis_102 = VectorDisplay(Anchor="0,0,0", Vector=py3_8.a)
vdis_103 = VectorDisplay(Anchor="0,0,0", Vector=py3_9.a)
vdis_104 = VectorDisplay(Anchor="0,0,0", Vector=c_script_27.a)

unit_10 = UnitVector(Vector=pt_31)
amp_3 = Amplitude(Vector=unit_10, Amplitude=number_slider_39)
vdis_105 = VectorDisplay(Anchor="0,0,0", Vector=pt_31)
move_5 = Move(Geometry=pt_30, Motion=pt_31)  # -> Geometry, Transform
move_6 = Move(Geometry=pt_30, Motion=amp_3)  # -> Geometry, Transform

py3_10 = Python3Script(vec=pt_31, tVec=pt_30)  # -> out, a; inputs vec: Vector3d, tVec: Vector3d
# ---------- py3_10: Python ----------
import rhinoscriptsyntax as rs

a = rs.AddPoint(
    tVec.X + vec.X,
    tVec.Y + vec.Y,
    tVec.Z + vec.Z
    )
# ---------- end py3_10 ----------
py3_11 = Python3Script(vec=pt_31, tVec=pt_30, amp=number_slider_39)  # -> out, a; inputs vec: Vector3d, tVec: Vector3d
# ---------- py3_11: Python ----------
import rhinoscriptsyntax as rs


vecNor = rs.VectorUnitize(vec)


a = rs.AddPoint(
    tVec.X + (vecNor[0] * amp),
    tVec.Y + (vecNor[1] * amp),
    tVec.Z + (vecNor[2] * amp),
    )
# ---------- end py3_11 ----------
c_script_28 = CSharpScript(vec=pt_31, tVec=pt_30, amp=number_slider_39)  # -> out, a; inputs vec: Vector3d, tVec: Vector3d, amp: Double
# ---------- c_script_28: C# ----------
// Grasshopper Script Instance
#region Usings
using System;
using System.Linq;
using System.Collections;
using System.Collections.Generic;
using System.Drawing;

using Rhino;
using Rhino.Geometry;

using Grasshopper;
using Grasshopper.Kernel;
using Grasshopper.Kernel.Data;
using Grasshopper.Kernel.Types;
#endregion

public class Script_Instance : GH_ScriptInstance
{
    private void RunScript(Vector3d vec, Vector3d tVec, double amp, ref object a)
    {
        // Write your logic here
        vec.Unitize();

        tVec.X += vec.X * amp;
        tVec.Y += vec.Y * amp;
        tVec.Z += vec.Z * amp;

        a = tVec;
    }
}
# ---------- end c_script_28 ----------
py3_12 = Python3Script(vec=pt_31, tVecObj=pt_30)  # -> out, a; inputs vec: Vector3d
# ---------- py3_12: Python ----------
import rhinoscriptsyntax as rs

a = rs.MoveObject(tVecObj, vec)
# ---------- end py3_12 ----------
vdis_106 = VectorDisplay(Anchor="0,0,0", Vector=py3_11.a)
vdis_107 = VectorDisplay(Anchor="0,0,0", Vector=c_script_28.a)

# ----
# visualization
number_slider_40 = Slider(6.1, range=0..10)
vec_51 = VectorXYZ(XComponent=number_slider_40, YComponent=Slider(2.3, range=0..10), ZComponent=Slider(0, range=0..10))  # -> Vector, Length
panel_82 = Panel(vec_51.Vector)
vdis_108 = VectorDisplay(Anchor="0,0,0", Vector=vec_51.Vector)

# ----
# multiply
number_slider_41 = Slider(6.1, range=0..10)
number_slider_42 = Slider(2.068, range=-3..3)
vec_52 = VectorXYZ(XComponent=number_slider_41, YComponent=Slider(2.3, range=0..10), ZComponent=Slider(0, range=0..10))  # -> Vector, Length
vdis_109 = VectorDisplay(Anchor="0,0,0", Vector=vec_52.Vector)
c_script_29 = CSharpScript(A=vec_52.Vector, B=number_slider_42)  # -> out, R; inputs A: Vector3d, B: Double
# ---------- c_script_29: C# ----------
    R = A * B;
# ---------- end c_script_29 ----------
c_script_30 = CSharpScript(A=vec_52.Vector, B=number_slider_42)  # -> out, R1, R2; inputs A: Vector3d, B: Double
# ---------- c_script_30: C# ----------
    R1 = new Vector3d(A.X * B, A.Y * B, A.Z * B);



    A.X = A.X * B;
    A.Y *= B;
    A.Z *= B;

    R2 = A;
# ---------- end c_script_30 ----------
python_23 = GhPythonScript(A=vec_52.Vector, B=number_slider_42)  # -> out, a; inputs A: Vector3d
# ---------- python_23: Python ----------
a = A * B
# ---------- end python_23 ----------
multiplication_11 = Multiplication(A=vec_52.Vector, B=number_slider_42)
python_24 = GhPythonScript(A=vec_52.Vector, B=number_slider_42)  # -> out, a; inputs A: Vector3d
# ---------- python_24: Python ----------
A.X = A.X * B
A.Y *= B
A.Z *= B


a = A
# ---------- end python_24 ----------
vdis_110 = VectorDisplay(Anchor="0,0,0", Vector=multiplication_11)
panel_83 = Panel([multiplication_11, c_script_30.R1, c_script_29.R, c_script_30.R2])
panel_84 = Panel([python_23.a, python_24.a])

# ----
# Length of Vector
pt_37 = Point(Point(26.31242815, 8.868225097, 0))
py3_13 = Python3Script(p0=pt_37)  # -> out, a; inputs p0: Point3d
# ---------- py3_13: Python ----------
import rhinoscriptsyntax as rs

a = rs.VectorLength(p0)
# ---------- end py3_13 ----------
py3_14 = Python3Script(p0=pt_37)  # -> out, a; inputs p0: Point3d
# ---------- py3_14: Python ----------
import rhinoscriptsyntax as rs
import math

def deistance(p0):
    return math.sqrt(p0.X * p0.X +  p0.Y * p0.Y + p0.Z * p0.Z)

a = deistance(p0)
# ---------- end py3_14 ----------
c_script_31 = CSharpScript(p0=pt_37)  # -> out, a; inputs p0: Point3d
# ---------- c_script_31: C# ----------
// Grasshopper Script Instance
#region Usings
using System;
using System.Linq;
using System.Collections;
using System.Collections.Generic;
using System.Drawing;

using Rhino;
using Rhino.Geometry;

using Grasshopper;
using Grasshopper.Kernel;
using Grasshopper.Kernel.Data;
using Grasshopper.Kernel.Types;
#endregion

public class Script_Instance : GH_ScriptInstance
{
    #region Notes
    /* 
      Members:
        RhinoDoc RhinoDocument
        GH_Document GrasshopperDocument
        IGH_Component Component
        int Iteration

      Methods (Virtual & overridable):
        Print(string text)
        Print(string format, params object[] args)
        Reflect(object obj)
        Reflect(object obj, string method_name)
    */
    #endregion

    private void RunScript(Point3d p0, ref object a)
    {

        // Write your logic here
        a = ((Vector3d)p0).Length;
    }
}
# ---------- end c_script_31 ----------
vlen_9 = VectorLength(Vector=pt_37)
panel_85 = Panel([vlen_9, py3_13.a, py3_14.a, c_script_31.a])

# ----
# Distance
pt_38 = Point(Point(39.90326481, 51.54171705, 0))
pt_39 = Point(Point(26.31242815, 8.868225097, 0))
dist_4 = Distance(PointA=pt_39, PointB=pt_38)
py3_15 = Python3Script(p0=pt_39, p1=pt_38)  # -> out, a; inputs p0: Point3d, p1: Point3d
# ---------- py3_15: Python ----------
import rhinoscriptsyntax as rs

a = rs.Distance(p0, p1)
# ---------- end py3_15 ----------
py3_16 = Python3Script(p0=pt_39, p1=pt_38)  # -> out, a; inputs p0: Point3d, p1: Point3d
# ---------- py3_16: Python ----------
import rhinoscriptsyntax as rs
import math

def deistance(p0, p1):
    return math.sqrt((p1.X - p0.X) * (p1.X - p0.X) + (p1.Y - p0.Y) * (p1.Y - p0.Y) + (p1.Z - p0.Z) * (p1.Z - p0.Z))


a = deistance(p0, p1)
# ---------- end py3_16 ----------
c_script_32 = CSharpScript(p0=pt_39, p1=pt_38)  # -> out, a; inputs p0: Point3d, p1: Point3d
# ---------- c_script_32: C# ----------
// Grasshopper Script Instance
#region Usings
using System;
using System.Linq;
using System.Collections;
using System.Collections.Generic;
using System.Drawing;

using Rhino;
using Rhino.Geometry;

using Grasshopper;
using Grasshopper.Kernel;
using Grasshopper.Kernel.Data;
using Grasshopper.Kernel.Types;
#endregion

public class Script_Instance : GH_ScriptInstance
{
    #region Notes
    /* 
      Members:
        RhinoDoc RhinoDocument
        GH_Document GrasshopperDocument
        IGH_Component Component
        int Iteration

      Methods (Virtual & overridable):
        Print(string text)
        Print(string format, params object[] args)
        Reflect(object obj)
        Reflect(object obj, string method_name)
    */
    #endregion

    private void RunScript(Point3d p0, Point3d p1, ref object a)
    {

        // Write your logic here
        a = p0.DistanceTo(p1);
    }
}
# ---------- end c_script_32 ----------
panel_86 = Panel([dist_4, py3_15.a, py3_16.a, c_script_32.a])

# ----
# Vector Angle
pt_40 = Point(Point(26.31242815, 8.868225097, 0))
pt_41 = Point(Point(39.90326481, 51.54171705, 0))
py3_17 = Python3Script(p0=pt_40, p1=pt_41)  # -> out, a; inputs p0: Point3d, p1: Point3d
# ---------- py3_17: Python ----------
import rhinoscriptsyntax as rs
import math


import math

def getVectorAngle(p0, p1):
    def magnitude(v):
        return math.sqrt(v.X**2 + v.Y**2 + v.Z**2)
    def dot_product(v1, v2):
        return v1.X * v2.X + v1.Y * v2.Y + v1.Z * v2.Z
    
    mag_p0 = magnitude(p0)
    mag_p1 = magnitude(p1)
    
    dot = dot_product(p0, p1)
    angle_rad = math.acos(dot / (mag_p0 * mag_p1))
    angle_deg = math.degrees(angle_rad)
    
    return [angle_rad, angle_deg]


a = getVectorAngle(p0, p1)[0]
# ---------- end py3_17 ----------
py3_18 = Python3Script(p0=pt_40, p1=pt_41)  # -> out, a; inputs p0: Point3d, p1: Point3d
# ---------- py3_18: Python ----------
import rhinoscriptsyntax as rs

a = rs.VectorAngle(p0, p1) * 3.14159 / 180
# ---------- end py3_18 ----------
c_script_33 = CSharpScript(p0=pt_40, p1=pt_41)  # -> out, a; inputs p0: Vector3d, p1: Vector3d
# ---------- c_script_33: C# ----------
// Grasshopper Script Instance
#region Usings
using System;
using System.Linq;
using System.Collections;
using System.Collections.Generic;
using System.Drawing;

using Rhino;
using Rhino.Geometry;

using Grasshopper;
using Grasshopper.Kernel;
using Grasshopper.Kernel.Data;
using Grasshopper.Kernel.Types;
#endregion

public class Script_Instance : GH_ScriptInstance
{
    private void RunScript(Vector3d p0, Vector3d p1, ref object a)
    {

        // Write your logic here
        a = Vector3d.VectorAngle(p0, p1);
    }
}
# ---------- end c_script_33 ----------
angle_2 = Angle(VectorA=pt_40, VectorB=pt_41)  # -> Angle, Reflex
panel_87 = Panel([c_script_33.a, angle_2.Angle, py3_18.a, py3_17.a])

# ----
# Unit Vector
pt_42 = Point(Point(39.90326481, 51.54171705, 0))
py3_19 = Python3Script(p=pt_42)  # -> out, a; inputs p: Point3d
# ---------- py3_19: Python ----------
import rhinoscriptsyntax as rs

a = rs.VectorUnitize(p)
# ---------- end py3_19 ----------
unit_11 = UnitVector(Vector=pt_42)
py3_20 = Python3Script(p=pt_42)  # -> out, a; inputs p: Point3d
# ---------- py3_20: Python ----------
import rhinoscriptsyntax as rs
import math

def getNormalized(v):
    print(v)
    len = math.sqrt(v.X * v.X + v.Y * v.Y + v.Z * v.Z);
    if len < 0.0001:
        return [v.X, v.Y, v.Z];
    return [v.X / len, v.Y / len, v.Z / len];


np = getNormalized(p)

a = rs.AddPoint(np)
# ---------- end py3_20 ----------
c_script_34 = CSharpScript(p=pt_42)  # -> out, a; inputs p: Vector3d
# ---------- c_script_34: C# ----------
// Grasshopper Script Instance
#region Usings
using System;
using System.Linq;
using System.Collections;
using System.Collections.Generic;
using System.Drawing;

using Rhino;
using Rhino.Geometry;

using Grasshopper;
using Grasshopper.Kernel;
using Grasshopper.Kernel.Data;
using Grasshopper.Kernel.Types;
#endregion

public class Script_Instance : GH_ScriptInstance
{
    private void RunScript(Vector3d p, ref object a)
    {
        // Write your logic here
        p.Unitize();
        a = p;
    }
}
# ---------- end c_script_34 ----------
pt_43 = Point(py3_19.a)
pt_44 = Point(unit_11)
pt_45 = Point(py3_20.a)
pt_46 = Point(c_script_34.a)
panel_88 = Panel([pt_44, pt_43, pt_45, pt_46])

# ----
# GH Component
# amplitude
number_slider_43 = Slider(4.1, range=0..10)
number_slider_44 = Slider(1, range=0..10)
vec_53 = VectorXYZ(XComponent=number_slider_43, YComponent=Slider(3, range=0..10), ZComponent=Slider(2.8, range=0..10))  # -> Vector, Length
amp_4 = Amplitude(Vector=vec_53.Vector, Amplitude=number_slider_44)
panel_89 = Panel(vec_53.Length)
python_25 = GhPythonScript(V=vec_53.Vector, A=number_slider_44)  # -> out, v; inputs V: Vector3d
# ---------- python_25: Python ----------
V.Unitize()
V = V * A;


v = V
# ---------- end python_25 ----------
c_script_35 = CSharpScript(V=vec_53.Vector, A=number_slider_44)  # -> out, v; inputs V: Vector3d, A: Double
# ---------- c_script_35: C# ----------
    V.Unitize();
    V *= A;



    v = V;
# ---------- end c_script_35 ----------
vdis_111 = VectorDisplay(Anchor="0,0,0", Vector=vec_53.Vector)
unit_12 = UnitVector(Vector=vec_53.Vector)
vdis_112 = VectorDisplay(Anchor="0,0,0", Vector=amp_4)
vdis_113 = VectorDisplay(Anchor="0,0,0", Vector=c_script_35.v)
vdis_114 = VectorDisplay(Anchor="0,0,0", Vector=python_25.v)
multiplication_12 = Multiplication(A=unit_12, B=number_slider_44)
vdis_115 = VectorDisplay(Anchor="0,0,0", Vector=unit_12)
vdis_116 = VectorDisplay(Anchor="0,0,0", Vector=multiplication_12)

# ----
# Dot Product
toggle_2 = BooleanToggle(True)
pt_47 = Point(Point(47.19998883, 54.55045878, 0))
pt_48 = Point(Point(-15.286727, 47.9932229, 0))
py3_21 = Python3Script(p0=pt_47, p1=pt_48, U=toggle_2)  # -> out, a; inputs p0: Point3d, p1: Point3d
# ---------- py3_21: Python ----------
import rhinoscriptsyntax as rs


if U:
    p0Unit = rs.VectorUnitize(p0)
    p1Unit = rs.VectorUnitize(p1)
    a = rs.VectorDotProduct(p0Unit, p1Unit)
else:
    a = rs.VectorDotProduct(p0, p1)
# ---------- end py3_21 ----------
dprod_4 = DotProduct(VectorA=pt_47, VectorB=pt_48, Unitize=toggle_2)
py3_22 = Python3Script(p0=pt_47, p1=pt_48, U=toggle_2)  # -> out, a; inputs p0: Point3d, p1: Point3d, U: Boolean
# ---------- py3_22: Python ----------
import rhinoscriptsyntax as rs
import math

def getDotProduct (v1, v2):
    return v1.X * v2.X + v1.Y * v2.Y + v1.Z * v2.Z;

def getDotProductDict (v1, v2):
    return v1["X"] * v2["X"] + v1["Y"] * v2["Y"] + v1["Z"] * v2["Z"];

def getUnitVector(v):
    print(v)
    len = math.sqrt(v.X * v.X + v.Y * v.Y + v.Z * v.Z);
    if len < 0.0001:
        return [v.X, v.Y, v.Z];
    return { 
        "X": v.X / len, 
        "Y": v.Y / len, 
        "Z": v.Z / len
        };

if U:
    unitP0 = getUnitVector(p0)
    unitP1 = getUnitVector(p1)
    a = getDotProductDict(unitP0, unitP1)
else :
    a = getDotProduct(p0, p1)
# ---------- end py3_22 ----------
c_script_36 = CSharpScript(p0=pt_47, p1=pt_48, U=toggle_2)  # -> out, a; inputs p0: Point3d, p1: Point3d, U: Boolean
# ---------- c_script_36: C# ----------
// Grasshopper Script Instance
#region Usings
using System;
using System.Linq;
using System.Collections;
using System.Collections.Generic;
using System.Drawing;

using Rhino;
using Rhino.Geometry;

using Grasshopper;
using Grasshopper.Kernel;
using Grasshopper.Kernel.Data;
using Grasshopper.Kernel.Types;
#endregion

public class Script_Instance : GH_ScriptInstance
{

    public double GetDotProduct (Vector3d v1, Vector3d v2) {
        return v1.X * v2.X + v1.Y * v2.Y + v1.Z * v2.Z;
    }

    private void RunScript(Point3d p0, Point3d p1, bool U, ref object a)
    {
        // Write your logic here
        Vector3d v0 =(Vector3d)p0;
        Vector3d v1 =(Vector3d)p1;
        if (U) {
            v0.Unitize();
            v1.Unitize();
        } 
         double dotValue = this.GetDotProduct(v0 , v1);
        a = dotValue;
    }
}
# ---------- end c_script_36 ----------
panel_90 = Panel(dprod_4)
panel_91 = Panel([py3_21.a, py3_22.a, c_script_36.a])

# ----
# reverse
number_slider_45 = Slider(6.3, range=0..10)
vec_54 = VectorXYZ(XComponent=number_slider_45, YComponent=Slider(4.1, range=0..10), ZComponent=Slider(0, range=0..10))  # -> Vector, Length
c_script_37 = CSharpScript(A=vec_54.Vector, B="-1")  # -> out, R1, R2; inputs A: Vector3d, B: Double; same code as c_script_30
python_26 = GhPythonScript(A=vec_54.Vector, B="-1")  # -> out, a; inputs A: Vector3d; same code as python_24
rev_3 = Reverse(Vector=vec_54.Vector)
multiplication_13 = Multiplication(A=vec_54.Vector, B="-1")
vdis_117 = VectorDisplay(Anchor="0,0,0", Vector=c_script_37.R1)
vdis_118 = VectorDisplay(Anchor="0,0,0", Vector=c_script_37.R2)
vdis_119 = VectorDisplay(Anchor="0,0,0", Vector=python_26.a)
vdis_120 = VectorDisplay(Anchor="0,0,0", Vector=rev_3)
vdis_121 = VectorDisplay(Anchor="0,0,0", Vector=multiplication_13)

# ----
# Cross Product
toggle_3 = BooleanToggle(True)
pt_49 = Point(Point(37.4647209, 7.429503802, 0))
pt_50 = Point(Point(-15.286727, 47.9932229, 0))
xprod_5 = CrossProduct(VectorA=pt_49, VectorB=pt_50, Unitize=toggle_3)  # -> Vector, Length
py3_23 = Python3Script(p0=pt_49, p1=pt_50, U=toggle_3)  # -> out, a; inputs p0: Point3d, p1: Point3d
# ---------- py3_23: Python ----------
import rhinoscriptsyntax as rs

a = rs.VectorCrossProduct(p0, p1)

if U:
    a = rs.VectorUnitize(a)
# ---------- end py3_23 ----------
py3_24 = Python3Script(p0=pt_49, p1=pt_50, U=toggle_3)  # -> out, a; inputs p0: Point3d, p1: Point3d, U: Boolean
# ---------- py3_24: Python ----------
import rhinoscriptsyntax as rs
import math

def getCrossProduct (v1, v2):
    return [
        v1.Y * v2.Z - v1.Z * v2.Y,
        v1.Z * v2.X - v1.X * v2.Z,
        v1.X * v2.Y - v1.Y * v2.X
    ];

def getNormalized(v):
    print(v)
    len = math.sqrt(v[0] * v[0] + v[1] * v[1] + v[2] * v[2]);
    if len < 0.0001:
        return [v[0], v[1], v[2]];
    return [v[0] / len, v[1] / len, v[2] / len];

cv = getCrossProduct(p0, p1)

rhinoPoint = rs.AddPoint(cv)

a = rhinoPoint

if U:
    a = rs.AddPoint(getNormalized(cv))
# ---------- end py3_24 ----------
py3_25 = Python3Script(p0=pt_49, p1=pt_50, U=toggle_3)  # -> out, a; inputs p0: Point3d, p1: Point3d, U: Boolean
# ---------- py3_25: Python ----------
import Rhino as r


a = r.Geometry.Vector3d.CrossProduct(p0, p1)


if U:
    a.Unitize()
# ---------- end py3_25 ----------
c_script_38 = CSharpScript(p0=pt_49, p1=pt_50, U=toggle_3)  # -> out, a; inputs p0: Point3d, p1: Point3d, U: Boolean
# ---------- c_script_38: C# ----------
// Grasshopper Script Instance
#region Usings
using System;
using System.Linq;
using System.Collections;
using System.Collections.Generic;
using System.Drawing;

using Rhino;
using Rhino.Geometry;

using Grasshopper;
using Grasshopper.Kernel;
using Grasshopper.Kernel.Data;
using Grasshopper.Kernel.Types;
#endregion

public class Script_Instance : GH_ScriptInstance
{
    private void RunScript(Point3d p0, Point3d p1, bool U, ref object a)
    {
        // Write your logic here
        Vector3d cv = Vector3d.CrossProduct((Vector3d)p0 , (Vector3d)p1);
        if (U) {
            cv.Unitize();
        } 
        a = cv;
    }
}
# ---------- end c_script_38 ----------
pt_51 = Point(Point(0, 0, 0))
vdis_122 = VectorDisplay(Anchor=pt_51, Vector=xprod_5.Vector)
vdis_123 = VectorDisplay(Anchor=pt_51, Vector=c_script_38.a)
vdis_124 = VectorDisplay(Anchor=pt_51, Vector=py3_24.a)
vdis_125 = VectorDisplay(Anchor=pt_51, Vector=py3_23.a)
vdis_126 = VectorDisplay(Anchor=pt_51, Vector=py3_25.a)
panel_92 = Panel(xprod_5.Vector)
panel_93 = Panel([py3_23.a, py3_24.a, py3_25.a, c_script_38.a])

pt_52 = Point(Point(83.06983115, 50.75180855, 0))
pt_53 = Point(Point(54.68337412, 86.01180132, 0))
pt_54 = Point(Point(34.73878357, 47.79196248, 0))
subtraction_10 = Subtraction(A=pt_53, B=pt_52)
subtraction_11 = Subtraction(A=pt_52, B=pt_54)
pt_55 = Point(Point(0, 0, 0))
pt_56 = Point(Point(0, 0, 0))
vdis_127 = VectorDisplay(Anchor=pt_55, Vector=subtraction_11)
vdis_128 = VectorDisplay(Anchor=pt_56, Vector=subtraction_10)
xprod_6 = CrossProduct(VectorA=subtraction_11, VectorB=subtraction_10, Unitize=False)  # -> Vector, Length
division_4 = Division(A=xprod_6.Length, B="2")
panel_94 = Panel(division_4)

# ----
# addition
number_slider_46 = Slider(6.1, range=0..10)
vec_55 = VectorXYZ(XComponent=number_slider_46, YComponent=Slider(2.3, range=0..10), ZComponent=Slider(0, range=0..10))  # -> Vector, Length
vec_56 = VectorXYZ(XComponent=Slider(1.9, range=0..10), YComponent=Slider(4.9, range=0..10), ZComponent=Slider(4, range=0..10))  # -> Vector, Length
vdis_129 = VectorDisplay(Anchor="0,0,0", Vector=vec_55.Vector)
addition_5 = Addition(A=vec_55.Vector, B=vec_56.Vector)
python_27 = GhPythonScript(A=vec_55.Vector, B=vec_56.Vector)  # -> out, R
# ---------- python_27: Python ----------
R = A + B
# ---------- end python_27 ----------
c_script_39 = CSharpScript(A=vec_55.Vector, B=vec_56.Vector)  # -> out, R; inputs A: Vector3d, B: Vector3d
# ---------- c_script_39: C# ----------
    R = A + B;
# ---------- end c_script_39 ----------
c_script_40 = CSharpScript(A=vec_55.Vector, B=vec_56.Vector)  # -> out, R; inputs A: Vector3d, B: Vector3d
# ---------- c_script_40: C# ----------
    double x = A.X + B.X;
    double y = A.Y + B.Y;
    double z = A.Z + B.Z;


    R = new Vector3d(x, y, z);
# ---------- end c_script_40 ----------
python_28 = GhPythonScript(A=vec_55.Vector, B=vec_56.Vector)  # -> out, R
# ---------- python_28: Python ----------
import Rhino.Geometry as r

x = A.X + B.X
y = A.Y + B.Y
z = A.Z + B.Z

R = r.Vector3d(x,y,z)
# ---------- end python_28 ----------
vdis_130 = VectorDisplay(Anchor=vec_55.Vector, Vector=vec_56.Vector)
vec_57 = Vector(addition_5)
panel_95 = Panel([c_script_39.R, c_script_40.R])
panel_96 = Panel(vec_57)
panel_97 = Panel([python_27.R, python_28.R])
vdis_131 = VectorDisplay(Anchor="0,0,0", Vector=vec_57)

# ----
# subtraction
number_slider_47 = Slider(6.1, range=0..10)
vec_58 = VectorXYZ(XComponent=Slider(1.9, range=0..10), YComponent=Slider(4.9, range=0..10), ZComponent=Slider(4, range=0..10))  # -> Vector, Length
vec_59 = VectorXYZ(XComponent=number_slider_47, YComponent=Slider(2.3, range=0..10), ZComponent=Slider(0, range=0..10))  # -> Vector, Length
vdis_132 = VectorDisplay(Anchor="0,0,0", Vector=vec_59.Vector)
subtraction_12 = Subtraction(A=vec_59.Vector, B=vec_58.Vector)
c_script_41 = CSharpScript(A=vec_59.Vector, B=vec_58.Vector)  # -> out, R; inputs A: Vector3d, B: Vector3d
# ---------- c_script_41: C# ----------
    R = A - B;
# ---------- end c_script_41 ----------
c_script_42 = CSharpScript(A=vec_59.Vector, B=vec_58.Vector)  # -> out, R; inputs A: Vector3d, B: Vector3d
# ---------- c_script_42: C# ----------
    double x = A.X - B.X;
    double y = A.Y - B.Y;
    double z = A.Z - B.Z;


    R = new Vector3d(x, y, z);
# ---------- end c_script_42 ----------
python_29 = GhPythonScript(A=vec_59.Vector, B=vec_58.Vector)  # -> out, R
# ---------- python_29: Python ----------
R = A - B
# ---------- end python_29 ----------
python_30 = GhPythonScript(A=vec_59.Vector, B=vec_58.Vector)  # -> out, R
# ---------- python_30: Python ----------
import Rhino.Geometry as r

x = A.X - B.X
y = A.Y - B.Y
z = A.Z - B.Z

R = r.Vector3d(x,y,z)
# ---------- end python_30 ----------
vdis_133 = VectorDisplay(Anchor="0,0,0", Vector=vec_58.Vector)
vec_60 = Vector(subtraction_12)
panel_98 = Panel(vec_60)
panel_99 = Panel([c_script_41.R, c_script_42.R])
panel_100 = Panel([python_29.R, python_30.R])
vdis_134 = VectorDisplay(Anchor="0,0,0", Vector=vec_60)

# ----
# dot product
# https://datascience.stackexchange.com/questions/744/cosine-similarity-versus-dot-product-as-distance-metrics
number_slider_48 = Slider(10, range=0..10)
vec_61 = VectorXYZ(XComponent=Slider(0, range=0..10), YComponent=Slider(2.3, range=0..10), ZComponent=Slider(0, range=0..10))  # -> Vector, Length
vec_62 = VectorXYZ(XComponent=number_slider_48, YComponent=Slider(2.9, range=0..10), ZComponent=Slider(0, range=0..10))  # -> Vector, Length
c_script_43 = CSharpScript(v0=vec_61.Vector, v1=vec_62.Vector)  # -> out, A; inputs v0: Vector3d, v1: Vector3d
# ---------- c_script_43: C# ----------
    double dot = v0 * v1;
    A = dot;
# ---------- end c_script_43 ----------
c_script_44 = CSharpScript(v0=vec_61.Vector, v1=vec_62.Vector)  # -> out, A; inputs v0: Vector3d, v1: Vector3d
# ---------- c_script_44: C# ----------
    double dot = DotProduct(v0, v1);
    A = dot;
# ---------- c_script_44: C# additional code ----------
  public static double DotProduct(Vector3d v1, Vector3d v2) {
    return v1.X * v2.X + v1.Y * v2.Y + v1.Z * v2.Z;
  }
# ---------- end c_script_44 ----------
python_31 = GhPythonScript(v0=vec_61.Vector, v1=vec_62.Vector)  # -> out, a; inputs v0: Vector3d, v1: Vector3d
# ---------- python_31: Python ----------
a = v0 * v1
# ---------- end python_31 ----------
python_32 = GhPythonScript(v0=vec_61.Vector, v1=vec_62.Vector)  # -> out, a; inputs v0: Vector3d, v1: Vector3d
# ---------- python_32: Python ----------
import rhinoscriptsyntax as rs

a = rs.VectorDotProduct(v0, v1);
# ---------- end python_32 ----------
dprod_5 = DotProduct(VectorA=vec_61.Vector, VectorB=vec_62.Vector, Unitize=False)
python_33 = GhPythonScript(v0=vec_61.Vector, v1=vec_62.Vector)  # -> out, a; inputs v0: Vector3d, v1: Vector3d
# ---------- python_33: Python ----------
def DotProduct(v1, v2):
    return v1.X * v2.X + v1.Y * v2.Y + v1.Z * v2.Z;

a = DotProduct(v0, v1);
# ---------- end python_33 ----------
panel_101 = Panel(dprod_5)
panel_102 = Panel(c_script_43.A)
panel_103 = Panel(c_script_44.A)
panel_104 = Panel(python_31.a)
panel_105 = Panel(python_32.a)
panel_106 = Panel(python_33.a)

# ----
# cross product
number_slider_49 = Slider(0.4, range=-9..10)
vec_63 = VectorXYZ(XComponent=number_slider_49, YComponent=Slider(10, range=-10..10), ZComponent=Slider(0, range=0..10))  # -> Vector, Length
vec_64 = VectorXYZ(XComponent=Slider(6.3, range=0..10), YComponent=Slider(0, range=0..10), ZComponent=Slider(0, range=0..10))  # -> Vector, Length
python_34 = GhPythonScript(v0=vec_64.Vector, v1=vec_63.Vector)  # -> out, a; inputs v0: Vector3d, v1: Vector3d
# ---------- python_34: Python ----------
import rhinoscriptsyntax as rs



a = rs.VectorCrossProduct(v0, v1)
# ---------- end python_34 ----------
python_35 = GhPythonScript(v0=vec_64.Vector, v1=vec_63.Vector)  # -> out, a; inputs v0: Vector3d, v1: Vector3d
# ---------- python_35: Python ----------
import Rhino as r

def CrossProduct(v1, v2):
    return r.Geometry.Vector3d(
    v1.Y * v2.Z - v1.Z * v2.Y,
    v1.Z * v2.X - v1.X * v2.Z,
    v1.X * v2.Y - v1.Y * v2.X
    );


a = CrossProduct(v0, v1)
# ---------- end python_35 ----------
python_36 = GhPythonScript(v0=vec_64.Vector, v1=vec_63.Vector)  # -> out, a; inputs v0: Vector3d, v1: Vector3d
# ---------- python_36: Python ----------
import Rhino as r


a = r.Geometry.Vector3d.CrossProduct(v0, v1)
# ---------- end python_36 ----------
c_script_45 = CSharpScript(v0=vec_64.Vector, v1=vec_63.Vector)  # -> out, A; inputs v0: Vector3d, v1: Vector3d
# ---------- c_script_45: C# ----------
    Vector3d nv = Vector3d.CrossProduct(v0, v1);
    A = nv;
# ---------- end c_script_45 ----------
c_script_46 = CSharpScript(v0=vec_64.Vector, v1=vec_63.Vector)  # -> out, A; inputs v0: Vector3d, v1: Vector3d
# ---------- c_script_46: C# ----------
    A = CrossProduct(v0, v1);
# ---------- c_script_46: C# additional code ----------
  static Vector3d CrossProduct(Vector3d v1, Vector3d v2) {
    return new Vector3d(
      v1.Y * v2.Z - v1.Z * v2.Y,
      v1.Z * v2.X - v1.X * v2.Z,
      v1.X * v2.Y - v1.Y * v2.X
      );
  }
# ---------- end c_script_46 ----------
vdis_135 = VectorDisplay(Anchor="0,0,0", Vector=vec_64.Vector)
vdis_136 = VectorDisplay(Anchor="0,0,0", Vector=vec_63.Vector)
xprod_7 = CrossProduct(VectorA=vec_64.Vector, VectorB=vec_63.Vector, Unitize=False)  # -> Vector, Length
vdis_137 = VectorDisplay(Anchor="0,0,0", Vector=c_script_45.A)
vdis_138 = VectorDisplay(Anchor="0,0,0", Vector=python_36.a)
vdis_139 = VectorDisplay(Anchor="0,0,0", Vector=python_34.a)
vdis_140 = VectorDisplay(Anchor="0,0,0", Vector=c_script_46.A)
vdis_141 = VectorDisplay(Anchor="0,0,0", Vector=python_35.a)
vdis_142 = VectorDisplay(Anchor="0,0,0", Vector=xprod_7.Vector)

py3_26 = Python3Script(p0=pt_54, p1=pt_52, p2=pt_53)  # -> out, a; inputs p0: Point3d, p1: Point3d, p2: Point3d
# ---------- py3_26: Python ----------
import rhinoscriptsyntax as rs
import math

v0 = [
    p1.X - p0.X,
    p1.Y - p0.Y,
    p1.Z - p0.Z
]

v1 = [
    p2.X - p0.X,
    p2.Y - p0.Y,
    p2.Z - p0.Z
]

def getCrossProduct (v1, v2):
    return [
        v1[1] * v2[2] - v1[2] * v2[1],
        v1[2] * v2[0] - v1[0] * v2[2],
        v1[0] * v2[1] - v1[1] * v2[0]
    ];

def getLength(vec):
    return math.sqrt(vec[0] * vec[0] + vec[1] * vec[1] + vec[2] * vec[2])

cp = getCrossProduct(v0, v1)
area = getLength(cp) * 0.5

a = area
# ---------- end py3_26 ----------
c_script_47 = CSharpScript(p0=pt_54, p1=pt_52, p2=pt_53)  # -> out, a; inputs p0: Vector3d, p1: Vector3d, p2: Vector3d
# ---------- c_script_47: C# ----------
// Grasshopper Script Instance
#region Usings
using System;
using System.Linq;
using System.Collections;
using System.Collections.Generic;
using System.Drawing;

using Rhino;
using Rhino.Geometry;

using Grasshopper;
using Grasshopper.Kernel;
using Grasshopper.Kernel.Data;
using Grasshopper.Kernel.Types;
#endregion

public class Script_Instance : GH_ScriptInstance
{

    private void RunScript(Vector3d p0, Vector3d p1, Vector3d p2, ref object a)
    {
        
        Vector3d v0 = p1 - p0;
        Vector3d v1 = p2 - p0;

        a = Vector3d.CrossProduct(v0, v1).Length * 0.5;;
    }
}
# ---------- end c_script_47 ----------
panel_107 = Panel(c_script_47.a)
panel_108 = Panel(py3_26.a)

pt_57 = Point(Point(16.48236113, 51.54171705, 0))
pt_58 = Point(Point(26.31242815, 8.868225097, 0))
pt_59 = Point(Point(70.97654297, 28.81648377, 0))
c_script_48 = CSharpScript(pts=[pt_58, pt_57, pt_59])  # -> out, a; inputs pts: list of Point3d
# ---------- c_script_48: C# ----------
// Grasshopper Script Instance
#region Usings
using System;
using System.Linq;
using System.Collections;
using System.Collections.Generic;
using System.Drawing;

using Rhino;
using Rhino.Geometry;

using Grasshopper;
using Grasshopper.Kernel;
using Grasshopper.Kernel.Data;
using Grasshopper.Kernel.Types;
#endregion

public class Script_Instance : GH_ScriptInstance
{
    private void RunScript(List<Point3d> pts, ref object a)
    {
        Point3d v = new Point3d(0, 0, 0);

        foreach (Point3d p in pts)
        {
            v.X += p.X;
            v.Y += p.Y;
            v.Z += p.Z;
        }

        v.X /= pts.Count;
        v.Y /= pts.Count;
        v.Z /= pts.Count;

        a = v;
       
    }
}
# ---------- end c_script_48 ----------
py3_27 = Python3Script(p0=pt_58, p1=pt_57, p2=pt_59)  # -> out, a; inputs p0: Point3d, p1: Point3d, p2: Point3d
# ---------- py3_27: Python ----------
import rhinoscriptsyntax as rs

cp = [0, 0, 0]

pts = [p0, p1, p2]

for p in pts:
    print(p)

    cp[0] += p.X
    cp[1] += p.Y
    cp[2] += p.Z


length = len(pts)

a = rs.AddPoint(cp[0] / length, cp[1] / length, cp[2] / length)
# ---------- end py3_27 ----------
panel_109 = Panel([c_script_48.a, py3_27.a])

# ----
# Center Point
pt_60 = Point([pt_58, pt_57, pt_59])
devec_3 = DeconstructVector(Vector=pt_60)  # -> XComponent, YComponent, ZComponent
lng = ListLength(List=pt_60)
ma = MassAddition(Input=devec_3.YComponent)  # -> Result, PartialResults
ma_2 = MassAddition(Input=devec_3.XComponent)  # -> Result, PartialResults
ma_3 = MassAddition(Input=devec_3.ZComponent)  # -> Result, PartialResults
division_5 = Division(A=ma.Result, B=lng)
division_6 = Division(A=ma_2.Result, B=lng)
division_7 = Division(A=ma_3.Result, B=lng)
pt_61 = ConstructPoint(XCoordinate=division_6, YCoordinate=division_5, ZCoordinate=division_7)
panel_110 = Panel(pt_61)

vec_65 = VectorXYZ(XComponent=Slider(5.9, range=0..10), YComponent=Slider(2.3, range=0..10), ZComponent=Slider(0, range=0..10))  # -> Vector, Length
vec_66 = VectorXYZ(XComponent=Slider(10, range=0..10), YComponent=Slider(0, range=0..10), ZComponent=Slider(0, range=0..10))  # -> Vector, Length
unit_13 = UnitVector(Vector=vec_65.Vector)
unit_14 = UnitVector(Vector=vec_66.Vector)
c_script_49 = CSharpScript(v0=vec_65.Vector, v1=vec_66.Vector, U=Toggle(True))  # -> out, A; inputs v0: Vector3d, v1: Vector3d, U: Boolean
# ---------- c_script_49: C# ----------
    if (U){
      v0.Unitize();
      v1.Unitize();
    }

    double dot = v0 * v1;
    A = dot;
# ---------- end c_script_49 ----------
c_script_50 = CSharpScript(v0=vec_65.Vector, v1=vec_66.Vector, U=Toggle(True))  # -> out, A; inputs v0: Vector3d, v1: Vector3d, U: Boolean
# ---------- c_script_50: C# ----------
    if (U) {
      v0 = Unitize(v0);
      v1 = Unitize(v1);
    }

    double dot = DotProduct(v0, v1);
    A = dot;
# ---------- c_script_50: C# additional code ----------
  public static double DotProduct(Vector3d v1, Vector3d v2) {
    return v1.X * v2.X + v1.Y * v2.Y + v1.Z * v2.Z;
  }
  static Vector3d Unitize(Vector3d v){
    double len = Math.Sqrt(v.X * v.X + v.Y * v.Y + v.Z * v.Z);
    return new Vector3d(
      v.X / len,
      v.Y / len,
      v.Z / len
      );
  }
# ---------- end c_script_50 ----------
python_37 = GhPythonScript(v0=vec_65.Vector, v1=vec_66.Vector, U=Toggle(True))  # -> out, a; inputs v0: Vector3d, v1: Vector3d, U: Boolean
# ---------- python_37: Python ----------
import rhinoscriptsyntax as rs

if U:
    v0 = rs.VectorUnitize(v0)
    v1 = rs.VectorUnitize(v1)

a = rs.VectorDotProduct(v0, v1);
# ---------- end python_37 ----------
python_38 = GhPythonScript(v0=vec_65.Vector, v1=vec_66.Vector, U=Toggle(True))  # -> out, a; inputs v0: Vector3d, v1: Vector3d, U: Boolean
# ---------- python_38: Python ----------
import Rhino as r

if U:
    r.Geometry.Vector3d.Unitize(v0);
    r.Geometry.Vector3d.Unitize(v1);


a = v0 * v1
# ---------- end python_38 ----------
python_39 = GhPythonScript(v0=vec_65.Vector, v1=vec_66.Vector, U=Toggle(False))  # -> out, a; inputs v0: Vector3d, v1: Vector3d, U: Boolean
# ---------- python_39: Python ----------
import Rhino as r
import math
def Unitize(v):
    len = math.sqrt(v.X * v.X + v.Y * v.Y + v.Z * v.Z);
    return r.Geometry.Vector3d(
        v.X / len,
        v.Y / len,
        v.Z / len,
    )
def DotProduct(v1, v2):
    return v1.X * v2.X + v1.Y * v2.Y + v1.Z * v2.Z;

def main(v0, v1):
    return DotProduct(Unitize(v0), Unitize(v1));

a = main(v0, v1);
# ---------- end python_39 ----------
vdis_143 = VectorDisplay(Anchor="0,0,0", Vector=unit_13)
vdis_144 = VectorDisplay(Anchor="0,0,0", Vector=unit_14)
panel_111 = Panel(c_script_49.A)
panel_112 = Panel(c_script_50.A)
panel_113 = Panel(python_38.a)
panel_114 = Panel(python_37.a)
panel_115 = Panel(python_39.a)
dprod_6 = DotProduct(VectorA=unit_13, VectorB=unit_14, Unitize=Toggle(False))
panel_116 = Panel(dprod_6)

vec_67 = VectorXYZ(XComponent=Slider(0, range=0..10), YComponent=Slider(6.4, range=0..10), ZComponent=Slider(0, range=0..10))  # -> Vector, Length
vec_68 = VectorXYZ(XComponent=Slider(6, range=0..10), YComponent=Slider(0, range=0..10), ZComponent=Slider(0, range=0..10))  # -> Vector, Length
unit_15 = UnitVector(Vector=vec_68.Vector)
unit_16 = UnitVector(Vector=vec_67.Vector)
vdis_145 = VectorDisplay(Anchor="0,0,0", Vector=unit_15)
c_script_51 = CSharpScript(v0=vec_68.Vector, v1=vec_67.Vector, U=Toggle(True))  # -> out, A; inputs v0: Vector3d, v1: Vector3d, U: Boolean
# ---------- c_script_51: C# ----------
    if (U) {
      v0.Unitize();
      v1.Unitize();
    }

    Vector3d nv = Vector3d.CrossProduct(v0, v1);
    A = nv;
# ---------- end c_script_51 ----------
python_40 = GhPythonScript(v0=vec_68.Vector, v1=vec_67.Vector, U=Toggle(True))  # -> out, a; inputs v0: Vector3d, v1: Vector3d, U: Boolean
# ---------- python_40: Python ----------
import rhinoscriptsyntax as rs

if U:
    v0 = rs.VectorUnitize(v0)
    v1 = rs.VectorUnitize(v1)

a = rs.VectorCrossProduct(v0, v1)
# ---------- end python_40 ----------
python_41 = GhPythonScript(v0=vec_68.Vector, v1=vec_67.Vector, U=Toggle(True))  # -> out, a; inputs v0: Vector3d, v1: Vector3d
# ---------- python_41: Python ----------
import Rhino as r

def CrossProduct(v1, v2):
    return r.Geometry.Vector3d(
    v1.Y * v2.Z - v1.Z * v2.Y,
    v1.Z * v2.X - v1.X * v2.Z,
    v1.X * v2.Y - v1.Y * v2.X
    );

import math
def Unitize(v):
    len = math.sqrt(v.X * v.X + v.Y * v.Y + v.Z * v.Z);
    return r.Geometry.Vector3d(
        v.X / len,
        v.Y / len,
        v.Z / len,
    )

if U:
    v0 = Unitize(v0)
    v1 = Unitize(v1)

a = CrossProduct(v0, v1)
# ---------- end python_41 ----------
python_42 = GhPythonScript(v0=vec_68.Vector, v1=vec_67.Vector, U=Toggle(True))  # -> out, a; inputs v0: Vector3d, v1: Vector3d
# ---------- python_42: Python ----------
import Rhino as r

if U:
    r.Geometry.Vector3d.Unitize(v0)
    r.Geometry.Vector3d.Unitize(v1)

a = r.Geometry.Vector3d.CrossProduct(v0, v1)
# ---------- end python_42 ----------
c_script_52 = CSharpScript(v0=vec_68.Vector, v1=vec_67.Vector, U=Toggle(True))  # -> out, A; inputs v0: Vector3d, v1: Vector3d, U: Boolean
# ---------- c_script_52: C# ----------
    if (U) {
      v0 = Unitize(v0);
      v1 = Unitize(v1);
    }

    Vector3d nv = CrossProduct(v0, v1);
    A = nv;
# ---------- c_script_52: C# additional code ----------
  static Vector3d CrossProduct(Vector3d v1, Vector3d v2) {
    return new Vector3d(
      v1.Y * v2.Z - v1.Z * v2.Y,
      v1.Z * v2.X - v1.X * v2.Z,
      v1.X * v2.Y - v1.Y * v2.X
      );
  }
  static Vector3d Unitize(Vector3d v){
    double len = Math.Sqrt(v.X * v.X + v.Y * v.Y + v.Z * v.Z);
    return new Vector3d(
      v.X / len,
      v.Y / len,
      v.Z / len
      );
  }
# ---------- end c_script_52 ----------
vdis_146 = VectorDisplay(Anchor="0,0,0", Vector=unit_16)
xprod_8 = CrossProduct(VectorA=unit_15, VectorB=unit_16, Unitize=Toggle(False))  # -> Vector, Length
vdis_147 = VectorDisplay(Anchor="0,0,0", Vector=c_script_51.A)
vdis_148 = VectorDisplay(Anchor="0,0,0", Vector=python_42.a)
vdis_149 = VectorDisplay(Anchor="0,0,0", Vector=python_40.a)
vdis_150 = VectorDisplay(Anchor="0,0,0", Vector=python_41.a)
vdis_151 = VectorDisplay(Anchor="0,0,0", Vector=c_script_52.A)
panel_117 = Panel(xprod_8.Vector)
vdis_152 = VectorDisplay(Anchor="0,0,0", Vector=xprod_8.Vector)

number_slider_50 = Slider(6.1, range=0..10)
number_slider_51 = Slider(2.3, range=0..10)
number_slider_52 = Slider(0, range=0..10)
subtraction_13 = Subtraction(A=number_slider_50, B=Slider(1.9, range=0..10))
subtraction_14 = Subtraction(A=number_slider_51, B=Slider(4.9, range=0..10))
subtraction_15 = Subtraction(A=number_slider_52, B=Slider(2.8, range=0..10))
vec_69 = VectorXYZ(XComponent=number_slider_50, YComponent=number_slider_51, ZComponent=number_slider_52)  # -> Vector, Length
vec_70 = VectorXYZ(XComponent=subtraction_13, YComponent=subtraction_14, ZComponent=subtraction_15)  # -> Vector, Length
vdis_153 = VectorDisplay(Anchor="0,0,0", Vector=vec_69.Vector)
vdis_154 = VectorDisplay(Anchor="0,0,0", Vector=vec_70.Vector)

# ----
# A: Points between two points
number_slider_53 = Slider(0.466, range=0..1)
pt_62 = Point(Point(26.31242815, 8.868225097, 0))
pt_63 = Point(Point(16.48236113, 51.54171705, 0))
py3_28 = Python3Script(p0=pt_62, p1=pt_63, t=number_slider_53)  # -> out, a; inputs p0: Point3d, p1: Point3d, t: Double
# ---------- py3_28: Python ----------
import rhinoscriptsyntax as rs
import math


vec = [p1.X -  p0.X, p1.Y -  p0.Y, p1.Z -  p0.Z ]

x = p0.X + (vec[0] * t)
y = p0.Y + (vec[1] * t)
z = p0.Z + (vec[2] * t)

a = rs.AddPoint(x, y, z)
# ---------- end py3_28 ----------
c_script_53 = CSharpScript(p0=pt_62, p1=pt_63, t=number_slider_53)  # -> out, a; inputs p0: Point3d, p1: Point3d, t: Double
# ---------- c_script_53: C# ----------
// Grasshopper Script Instance
#region Usings
using System;
using System.Linq;
using System.Collections;
using System.Collections.Generic;
using System.Drawing;

using Rhino;
using Rhino.Geometry;

using Grasshopper;
using Grasshopper.Kernel;
using Grasshopper.Kernel.Data;
using Grasshopper.Kernel.Types;
#endregion

public class Script_Instance : GH_ScriptInstance
{
    private void RunScript(Point3d p0, Point3d p1, double t, ref object a)
    {

        // Write your logic here
        Vector3d diff = (Vector3d)p1 - (Vector3d)p0; 


        a = new Vector3d(
            p0.X + diff.X * t, 
            p0.Y + diff.Y * t, 
            p0.Z + diff.Z * t
            );
    }
}
# ---------- end c_script_53 ----------
pt_64 = Point(c_script_53.a)
panel_118 = Panel([py3_28.a, c_script_53.a])

number_slider_54 = Slider(4, range=0..10)
# B: Points between two points
pt_65 = Point(Point(26.31242815, 8.868225097, 0))
pt_66 = Point(Point(16.48236113, 51.54171705, 0))
addition_6 = Addition(A=number_slider_54, B="1")
dist_5 = Distance(PointA=pt_65, PointB=pt_66)
series = Series(Start=0, Step=1, Count=addition_6)
vec2pt_2 = Vector2Pt(PointA=pt_65, PointB=pt_66, Unitize=Toggle(True))  # -> Vector, Length
division_8 = Division(A=dist_5, B=number_slider_54)
vdis_155 = VectorDisplay(Anchor=pt_65, Vector=vec2pt_2.Vector)
multiplication_14 = Multiplication(A=division_8, B=series)
amp_5 = Amplitude(Vector=vec2pt_2.Vector, Amplitude=multiplication_14)
panel_119 = Panel(series)
move_7 = Move(Geometry=pt_65, Motion=amp_5)  # -> Geometry, Transform
pt_67 = Point(move_7.Geometry)

number_slider_55 = Slider(4, range=0..10)
pt_68 = Point(Point(16.48236113, 51.54171705, 0))
pt_69 = Point(Point(26.31242815, 8.868225097, 0))
c_script_54 = CSharpScript(p0=pt_69, p1=pt_68, N=number_slider_55)  # -> out, a; inputs p0: Point3d, p1: Point3d, N: Int32
# ---------- c_script_54: C# ----------
// Grasshopper Script Instance
#region Usings
using System;
using System.Linq;
using System.Collections;
using System.Collections.Generic;
using System.Drawing;

using Rhino;
using Rhino.Geometry;

using Grasshopper;
using Grasshopper.Kernel;
using Grasshopper.Kernel.Data;
using Grasshopper.Kernel.Types;
#endregion

public class Script_Instance : GH_ScriptInstance
{
    private void RunScript(Point3d p0, Point3d p1, int N, ref object a)
    {

        // Write your logic here
        double theDis = p0.DistanceTo(p1);
        Vector3d v = p1 - p0;
        v.Unitize();

        List<Point3d> pts = new List<Point3d>();
        double interval = theDis / N;

        for(int i = 0 ; i < N +1; ++i) {
            Point3d p = new Point3d(
                p0.X + v.X * interval * i, 
                p0.Y + v.Y * interval * i, 
                p0.Z + v.Z * interval * i
                );
            
            pts.Add(p);
        } 
        a = pts;

    }
}
# ---------- end c_script_54 ----------
py3_29 = Python3Script(p0=pt_69, p1=pt_68, N=number_slider_55)  # -> out, a; inputs p0: Point3d, p1: Point3d, N: Int32
# ---------- py3_29: Python ----------
import rhinoscriptsyntax as rs
import math

def deistance(p0, p1):
    return math.sqrt((p1.X - p0.X) * (p1.X - p0.X) + (p1.Y - p0.Y) * (p1.Y - p0.Y) + (p1.Z - p0.Z) * (p1.Z - p0.Z))

def getUnitVector(vec):
    magnitude = math.sqrt(sum(v**2 for v in vec))
    
    if magnitude == 0:
        raise ValueError("A vector with zero magnitude cannot be normalized.")
    
    return [v / magnitude for v in vec]

vecDiff = rs.AddPoint(p1.X -  p0.X, p1.Y -  p0.Y, p1.Z -  p0.Z)
vecNormalized = rs.VectorUnitize(vecDiff)
interval = deistance(p0, p1) / N

pts = []

for i in range(N + 1):

    x = p0.X + (vecNormalized.X * interval * i)
    y = p0.Y + (vecNormalized.Y * interval * i)
    z = p0.Z + (vecNormalized.Z * interval * i)

    p = rs.AddPoint(x, y, z)
    pts.append(p)

a= pts
# ---------- end py3_29 ----------
py3_30 = Python3Script(p0=pt_69, p1=pt_68, N=number_slider_55)  # -> out, a; inputs p0: Point3d, p1: Point3d, N: Int32
# ---------- py3_30: Python ----------
import rhinoscriptsyntax as rs
import math

vecDiff = rs.AddPoint(p1.X -  p0.X, p1.Y -  p0.Y, p1.Z -  p0.Z)
vecNormalized = rs.VectorUnitize(vecDiff)
interval = rs.Distance(p0, p1) / N

pts = []

for i in range(N + 1):

    x = p0.X + (vecNormalized.X * interval * i)
    y = p0.Y + (vecNormalized.Y * interval * i)
    z = p0.Z + (vecNormalized.Z * interval * i)

    p = rs.AddPoint(x, y, z)
    pts.append(p)

a= pts
# ---------- end py3_30 ----------
pt_70 = Point(c_script_54.a)
panel_120 = Panel(py3_30.a)
panel_121 = Panel(py3_29.a)
panel_122 = Panel(c_script_54.a)

number_slider_56 = Slider(7, range=0..10)
pt_71 = Point(Point(16.48236113, 51.54171705, 0))
pt_72 = Point(Point(26.31242815, 8.868225097, 0))
py3_31 = Python3Script(p0=pt_72, p1=pt_71, N=number_slider_56)  # -> out, a; inputs p0: Point3d, p1: Point3d, N: Int32
# ---------- py3_31: Python ----------
import rhinoscriptsyntax as rs
import math


vec = [p1.X -  p0.X, p1.Y -  p0.Y, p1.Z -  p0.Z ]


interval = 1 / N

pts = []

for i in range(N + 1):

    x = p0.X + (vec[0] * interval * i)
    y = p0.Y + (vec[1] * interval * i)
    z = p0.Z + (vec[2] * interval * i)

    p = rs.AddPoint(x, y, z)
    pts.append(p)

a= pts
# ---------- end py3_31 ----------
c_script_55 = CSharpScript(p0=pt_72, p1=pt_71, N=number_slider_56)  # -> out, a; inputs p0: Point3d, p1: Point3d, N: Int32
# ---------- c_script_55: C# ----------
// Grasshopper Script Instance
#region Usings
using System;
using System.Linq;
using System.Collections;
using System.Collections.Generic;
using System.Drawing;

using Rhino;
using Rhino.Geometry;

using Grasshopper;
using Grasshopper.Kernel;
using Grasshopper.Kernel.Data;
using Grasshopper.Kernel.Types;
#endregion

public class Script_Instance : GH_ScriptInstance
{
    private void RunScript(Point3d p0, Point3d p1, int N, ref object a)
    {

        // Write your logic here
        Vector3d diff = (Vector3d)p1 - (Vector3d)p0; 

        List<Point3d> pts = new List<Point3d>();
        double interval = 1.0 / N;

        for(int i = 0 ; i < N +1; ++i) {
            Point3d p = new Point3d(
                p0.X + diff.X * interval * i, 
                p0.Y + diff.Y * interval * i, 
                p0.Z + diff.Z * interval * i
                );
            
            pts.Add(p);
        } 
        a = pts;

    }
}
# ---------- end c_script_55 ----------
pt_73 = Point(c_script_55.a)
panel_123 = Panel(py3_31.a)
panel_124 = Panel(c_script_55.a)

# ----
# Point At & Middle Point
ln = Line(StartPoint=pt_62, EndPoint=pt_63)
eval_4 = EvaluateCurve(Curve=ln, Parameter=number_slider_53)  # -> Point, Tangent, Angle
panel_125 = Panel(eval_4.Point)

ln_2 = Line(StartPoint=pt_72, EndPoint=pt_71)
dom = ConstructDomain(DomainStart=0, DomainEnd=1)
range = Range(Domain=dom, Steps=number_slider_56)
eval_5 = EvaluateCurve(Curve=ln_2, Parameter=range)  # -> Point, Tangent, Angle
panel_126 = Panel(eval_5.Point)

# ---- group: non-linear
py3_32 = Python3Script(p0=pt_72, p1=pt_71, N=number_slider_56)  # -> out, a; inputs p0: Point3d, p1: Point3d, N: Int32
# ---------- py3_32: Python ----------
import rhinoscriptsyntax as rs
import math



vec = [p1.X -  p0.X, p1.Y -  p0.Y, p1.Z -  p0.Z ]


interval = 1 / N

pts = []

for i in range(N + 1):
    cons = math.pow(interval * i, 2)

    x = p0.X + (vec[0] * cons)
    y = p0.Y + (vec[1] * cons)
    z = p0.Z + (vec[2] * cons)

    p = rs.AddPoint(x, y, z)
    pts.append(p)

a= pts
# ---------- end py3_32 ----------

# ----
# Vector 2pt
pt_74 = Point(Point(4.237334187, 7.454795811, 0))
pt_75 = Point(Point(3.000186271, 3.071208414, 0))
vec2pt_3 = Vector2Pt(PointA=pt_74, PointB=pt_75, Unitize=False)  # -> Vector, Length
subtraction_16 = Subtraction(A=pt_75, B=pt_74)
vdis_156 = VectorDisplay(Anchor="0,0,0", Vector=subtraction_16)
vdis_157 = VectorDisplay(Anchor="0,0,0", Vector=vec2pt_3.Vector)

# ----
# Area of Triangle
geo_2 = Geometry(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)
explode = Explode(Curve=geo_2, Recursive=True)  # -> Segments, Vertices
item = ListItem(List=explode.Vertices, Index="0", Wrap=True)
item_2 = ListItem(List=explode.Vertices, Index="2", Wrap=True)
item_3 = ListItem(List=explode.Vertices, Index="1", Wrap=True)
pt_76 = Point(item)
pt_77 = Point(item_3)
pt_78 = Point(item_2)
c_script_56 = CSharpScript(p0=pt_76, p1=pt_77, p2=pt_78)  # -> out, A, B; inputs p0: Point3d, p1: Point3d, p2: Point3d
# ---------- c_script_56: C# ----------
    Vector3d v0 = p1 - p0;
    Vector3d v1 = p2 - p0;


    Vector3d nv = Vector3d.CrossProduct(v0, v1);
    A = nv.Length * 0.5;


    B = CrossProduct(v0, v1).Length * 0.5;
# ---------- c_script_56: C# additional code ----------
  static Vector3d CrossProduct(Vector3d v1, Vector3d v2) {
    return new Vector3d(
      v1.Y * v2.Z - v1.Z * v2.Y,
      v1.Z * v2.X - v1.X * v2.Z,
      v1.X * v2.Y - v1.Y * v2.X
      );
  }
# ---------- end c_script_56 ----------
vec2pt_4 = Vector2Pt(PointA=pt_76, PointB=pt_78, Unitize=False)  # -> Vector, Length
vec2pt_5 = Vector2Pt(PointA=pt_76, PointB=pt_77, Unitize=False)  # -> Vector, Length
xprod_9 = CrossProduct(VectorA=vec2pt_5.Vector, VectorB=vec2pt_4.Vector, Unitize=False)  # -> Vector, Length
area = Area(Geometry=geo_2)  # -> Area, Centroid
multiplication_15 = Multiplication(A=xprod_9.Length, B="0.5")
panel_127 = Panel([c_script_56.A, c_script_56.B])
panel_128 = Panel(multiplication_15)
panel_129 = Panel(area.Area)

# ----
# Angle Between Vectors(Triangle)
vec_71 = Vector(Vector(2.434400087, 4.093042925, 0))
vec_72 = Vector(Vector(9.640437105, 2.183945888, 0))
python_43 = GhPythonScript(A=vec_71, B=vec_72)  # -> out, Ang0, Ang1, Ang2; inputs A: Vector3d, B: Vector3d
# ---------- python_43: Python ----------
import Rhino as r
Ang0 = r.Geometry.Vector3d.VectorAngle(A, B)


import rhinoscriptsyntax as rs
Ang1 = rs.VectorAngle(A, B)  / 180 * 3.14 


import math;
def VectorAngle(v1, v2):
    v1 = rs.VectorUnitize(v1)
    v2 = rs.VectorUnitize(v2)
    dot = v1.X * v2.X + v1.Y * v2.Y + v1.Z * v2.Z;
    return math.acos(dot)

Ang2 = VectorAngle(A, B)
# ---------- end python_43 ----------
c_script_57 = CSharpScript(A=vec_71, B=vec_72)  # -> out, Ang, RAng; inputs A: Vector3d, B: Vector3d
# ---------- c_script_57: C# ----------
    Ang = Vector3d.VectorAngle(A, B);
    RAng = (Math.PI * 2) - Vector3d.VectorAngle(A, B);
# ---------- end c_script_57 ----------
angle_3 = Angle(VectorA=vec_71, VectorB=vec_72)  # -> Angle, Reflex
panel_130 = Panel([angle_3.Angle, angle_3.Reflex])
panel_131 = Panel([python_43.Ang0, python_43.Ang1, python_43.Ang2])
panel_132 = Panel([c_script_57.Ang, c_script_57.RAng])
addition_7 = Addition(A=angle_3.Angle, B=angle_3.Reflex)
addition_8 = Addition(A=c_script_57.Ang, B=c_script_57.RAng)
panel_133 = Panel(addition_7)
panel_134 = Panel(addition_8)

# ----
# Common Geometric problems
# Distance between two vectors
pt_79 = Point(Point(3.235312546, 5.918593275, 0))
pt_80 = Point(Point(8.786216927, 5.473618687, 0))
c_script_58 = CSharpScript(A=pt_79, B=pt_80)  # -> out, D0, D1; inputs A: Point3d, B: Point3d
# ---------- c_script_58: C# ----------
    D0 = A.DistanceTo(B);

    D1 = Distance((Vector3d)A, (Vector3d)B);
# ---------- c_script_58: C# additional code ----------
  public static double Distance(Vector3d v0, Vector3d v1) {
    return Math.Sqrt((v0.X - v1.X) * (v0.X - v1.X) + (v0.Y - v1.Y) * (v0.Y - v1.Y) + (v0.Z - v1.Z) * (v0.Z - v1.Z));
  }
# ---------- end c_script_58 ----------
python_44 = GhPythonScript(A=pt_79, B=pt_80)  # -> out, D0, D1, D2; inputs A: Point3d, B: Point3d
# ---------- python_44: Python ----------
import Rhino as r
D0 = A.DistanceTo(B)


import rhinoscriptsyntax as rs
D1 = rs.Distance(A, B)


import math;
def Distance(v0, v1):
    return math.sqrt((v0.X - v1.X) * (v0.X - v1.X) + (v0.Y - v1.Y) * (v0.Y - v1.Y) + (v0.Z - v1.Z) * (v0.Z - v1.Z));

D2 = Distance(A, B)
# ---------- end python_44 ----------
dist_6 = Distance(PointA=pt_79, PointB=pt_80)
panel_135 = Panel([c_script_58.D0, c_script_58.D1])
panel_136 = Panel(dist_6)
panel_137 = Panel([python_44.D0, python_44.D1, python_44.D2])

# ----
# Triangle Unit normal
pt_81 = Point(Point(2.661882296, 2.633856562, 0))
pt_82 = Point(Point(5.506526056, 7.221991659, 1.318295004))
pt_83 = Point(Point(7.800593605, 3.887946822, 0.9884717143))
subtraction_17 = Subtraction(A=pt_83, B=pt_81)
subtraction_18 = Subtraction(A=pt_82, B=pt_81)
vdis_158 = VectorDisplay(Anchor=pt_81, Vector=subtraction_18)
vdis_159 = VectorDisplay(Anchor=pt_81, Vector=subtraction_17)
xprod_10 = CrossProduct(VectorA=subtraction_17, VectorB=subtraction_18, Unitize=False)  # -> Vector, Length
unit_17 = UnitVector(Vector=xprod_10.Vector)
vdis_160 = VectorDisplay(Anchor=pt_81, Vector=unit_17)

geo_3 = Geometry(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)
geo_4 = Geometry(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)
end = EndPoints(Curve=geo_3)  # -> Start, End
end_2 = EndPoints(Curve=geo_4)  # -> Start, End
pt_84 = Point(end.Start)
pt_85 = Point(end.End)
pt_86 = Point(end_2.End)
python_45 = GhPythonScript(A=pt_85, B=pt_86, S=pt_84)  # -> out, Ang0, Ang1, Ang2; inputs A: Point3d, B: Point3d, S: Point3d
# ---------- python_45: Python ----------
import Rhino as r


v0 = A - S
v1 = B - S

Ang0 = r.Geometry.Vector3d.VectorAngle(v0, v1)


import rhinoscriptsyntax as rs
Ang1 = rs.VectorAngle(v0, v1)  / 180 * 3.14 


import math;
def VectorAngle(v1, v2):
    v1 = rs.VectorUnitize(v1)
    v2 = rs.VectorUnitize(v2)
    dot = v1.X * v2.X + v1.Y * v2.Y + v1.Z * v2.Z;
    return math.acos(dot)

Ang2 = VectorAngle(v0, v1)
# ---------- end python_45 ----------
c_script_59 = CSharpScript(A=pt_85, B=pt_86, S=pt_84)  # -> out, Ang, RAng; inputs A: Point3d, B: Point3d, S: Point3d
# ---------- c_script_59: C# ----------
    Vector3d v0 = (Vector3d) A - (Vector3d) S;
    Vector3d v1 = (Vector3d) B - (Vector3d) S;

    Ang = Vector3d.VectorAngle(v0, v1);
    RAng = (Math.PI * 2) - Vector3d.VectorAngle(v0, v1);
# ---------- end c_script_59 ----------
addition_9 = Addition(A=c_script_59.Ang, B=c_script_59.RAng)
panel_138 = Panel([c_script_59.Ang, c_script_59.RAng])
panel_139 = Panel([python_45.Ang0, python_45.Ang1, python_45.Ang2])
panel_140 = Panel(addition_9)

# ----
# Point at a distance d along line between two vectors
pt_87 = Point(Point(-0.9651064085, -3.730639747, 0.8748614395))
pt_88 = Point(Point(3.871630712, 3.636641709, 5.377548026))
subtraction_19 = Subtraction(A=pt_88, B=pt_87)
unit_18 = UnitVector(Vector=subtraction_19)
multiplication_16 = Multiplication(A=unit_18, B=Slider(3, range=0..10))
addition_10 = Addition(A=pt_87, B=multiplication_16)
pt_89 = Point(addition_10)

# ----
# Projection of Point to plane
srf = Surface(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)
pt_90 = Point(Point(4.31197627, 3.054565331, 1.841776061))
srf_cp = SurfaceClosestPoint(Point=pt_90, Surface=srf)  # -> Point, UVPoint, Distance
evalsrf = EvaluateSurface(Surface=srf, Point=srf_cp.UVPoint)  # -> Point, Normal, UDirection, VDirection, Frame
vec_73 = Vector(evalsrf.Normal)
vdis_161 = VectorDisplay(Anchor=pt_90, Vector=evalsrf.Normal)
pt_91 = Point(pt_90)
pt_92 = Point(Point(3.329760894, 1.307291093, 2.419127196))
subtraction_20 = Subtraction(A=pt_92, B=pt_91)
multiplication_17 = Multiplication(A=subtraction_20, B=vec_73)
multiplication_18 = Multiplication(A=multiplication_17, B=vec_73)
subtraction_21 = Subtraction(A=pt_92, B=multiplication_18)

# ----
# projection of point to line
pt_93 = Point(Point(1.024378676, 0.5959527959, 0))
pt_94 = Point(Point(1.496630335, 1.274728539, 0.7833006623))
pt_95 = Point(Point(2.565891779, 1.447456823, 0.1984190805))
ln_3 = Line(StartPoint=pt_93, EndPoint=pt_95)
subtraction_22 = Subtraction(A=pt_95, B=pt_93)
subtraction_23 = Subtraction(A=pt_94, B=pt_93)
vdis_162 = VectorDisplay(Anchor=pt_93, Vector=subtraction_23)
vdis_163 = VectorDisplay(Anchor=pt_93, Vector=subtraction_22)
unit_19 = UnitVector(Vector=subtraction_22)
dprod_7 = DotProduct(VectorA=subtraction_23, VectorB=unit_19, Unitize=False)
multiplication_19 = Multiplication(A=dprod_7, B=unit_19)
addition_11 = Addition(A=multiplication_19, B=pt_93)
pt_96 = Point(addition_11)

# ----
# mid-point
pt_97 = Point(Point(-0.9651064085, -3.730639747, 0.8748614395))
pt_98 = Point(Point(3.871630712, 3.636641709, 5.377548026))
subtraction_24 = Subtraction(A=pt_98, B=pt_97)
multiplication_20 = Multiplication(A=subtraction_24, B=Slider(0.5, range=0..1))
addition_12 = Addition(A=pt_97, B=multiplication_20)
pt_99 = Point(addition_12)
panel_141 = Panel(pt_99)

# ----
# Linear interpolation between two vectors
number_slider_57 = Slider(0.547, range=0..1)
data = Data(subtraction_24)
data_2 = Data(pt_97)
multiplication_21 = Multiplication(A=data, B=number_slider_57)
addition_13 = Addition(A=data_2, B=multiplication_21)
pt_100 = Point(addition_13)
panel_142 = Panel(pt_100)

# ----
# rotate
number_slider_58 = Slider(6.3, range=0..10)
number_slider_59 = Slider(0, range=0..10)
number_slider_60 = Slider(3.14, range=0..10)
vec_74 = VectorXYZ(XComponent=number_slider_58, YComponent=number_slider_59, ZComponent=Slider(0, range=0..10))  # -> Vector, Length
xy_2 = XYPlane(Origin=Point(0, 0, 0))
python_46 = GhPythonScript(x=number_slider_58, y=number_slider_59, a=number_slider_60)  # -> out, X, Y; same code as python
vdis_164 = VectorDisplay(Anchor="0,0,0", Vector=vec_74.Vector)
vec_75 = VectorXYZ(XComponent=python_46.X, YComponent=python_46.Y, ZComponent=0)  # -> Vector, Length
vrot_3 = Rotate(Vector=vec_74.Vector, Axis=xy_2, Angle=number_slider_60)
vdis_165 = VectorDisplay(Anchor="0,0,0", Vector=vec_75.Vector)
vdis_166 = VectorDisplay(Anchor="0,0,0", Vector=vrot_3)

pt_101 = Point(pt_98)
pt_102 = Point(pt_97)
ln_4 = Line(StartPoint=pt_101, EndPoint=pt_102)
curvepoint = PointOnCurve(ln_4, parameter=0.243)
pt_103 = Point(curvepoint)
panel_143 = Panel(pt_103)

number_slider_61 = Slider(10, range=0..100)
number_slider_62 = Slider(6, range=0..100)
pt_104 = Point(Point(4.28632119, 3.431170983, 0))
multiplication_22 = Multiplication(A=number_slider_62, B="0.5")
multiplication_23 = Multiplication(A=number_slider_61, B="0.5")
pt_105 = Point(Point(4.698104839, 5.612274716, 0))
rectangle_3 = Rectangle(Plane=pt_104, XSize=number_slider_62, YSize=number_slider_61, Radius=0)  # -> Rectangle, Length
neg_5 = Negative(Value=multiplication_23)
neg_6 = Negative(Value=multiplication_22)
c_script_60 = CSharpScript(p0=pt_104, p1=pt_105)  # -> out, A; inputs p0: Vector3d, p1: Vector3d
# ---------- c_script_60: C# ----------
    Vector3d v0 = new Vector3d(p1.X - p0.X, p1.Y - p0.Y, p1.Z - p0.Z);

    v0.Unitize();
    //  p1.Unitize();

    double dot = DotProduct(new Vector3d(1, 0, 0), v0);

    double angle = Math.Atan2(p1.X - p0.X, p1.Y - p0.Y);

    Print(dot.ToString());
    Print(angle.ToString());

    A = -angle;
# ---------- c_script_60: C# additional code ----------
  public static double DotProduct(Vector3d v1, Vector3d v2)
  {
    return v1.X * v2.X + v1.Y * v2.Y + v1.Z * v2.Z;
  }
# ---------- end c_script_60 ----------
X_4 = UnitX(Factor=neg_6)
Y_4 = UnitY(Factor=neg_5)
move_8 = Move(Geometry=rectangle_3.Rectangle, Motion=X_4)  # -> Geometry, Transform
move_9 = Move(Geometry=move_8.Geometry, Motion=Y_4)  # -> Geometry, Transform
panel_144 = Panel(c_script_60.out)
rotate_3 = Rotate(Geometry=move_9.Geometry, Angle=c_script_60.A, Plane=pt_104)  # -> Geometry, Transform

# ----
# Center of point cloud
pt_106 = Point([Point(2.082659891, 1.293614944, 0.9445988636), Point(-2.6939884, -0.6097855939, 0.3714607298), Point(-1.003921722, -2.91636822, 0.564685921), Point(-0.2728452966, -0.4417999617, 2.494999705), Point(1.144669537, 2.180835346, 1.27248702), Point(1.32497743, 1.297846468, -1.65982739)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])
ma_4 = MassAddition(Input=pt_106)  # -> Result, PartialResults
lng_2 = ListLength(List=pt_106)
c_script_61 = CSharpScript(Pts=pt_106)  # -> out, A; inputs Pts: list of Point3d
# ---------- c_script_61: C# ----------
    int i;
    Point3d pmean = new Point3d();
    for(i = 0; i < Pts.Count; ++i) {
      pmean += Pts[i];
    }
    pmean *= (1.0 / (double) (Pts.Count));

    A = pmean;
# ---------- end c_script_61 ----------
pt_107 = Point(ma_4.Result)
division_9 = Division(A=Slider(1, range=0..1), B=lng_2)
multiplication_24 = Multiplication(A=pt_107, B=division_9)
pt_108 = Point(c_script_61.A)
pt_109 = Point(multiplication_24)
panel_145 = Panel([pt_109, pt_108])

# ----
# Center of triangle
pt_110 = Point(Point(0.7823016229, 1.178968611, 0.4459891863))
pt_111 = Point(Point(1.284209739, 2.843261508, 1.44463829))
pt_112 = Point(Point(2.40235186, 1.915573578, 0.6800858764))
addition_14 = Addition(A=pt_111, B=pt_110)
addition_15 = Addition(A=addition_14, B=pt_112)
division_10 = Division(A=Slider(1, range=0..1), B=Slider(3, range=0..10))
multiplication_25 = Multiplication(A=addition_15, B=division_10)

# ----
# reflection
srf_2 = Surface(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)
srf_3 = Surface(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)
pt_113 = Point(Point(19.50145798, 7.983234712, 7.873561334))
srf_cp_2 = SurfaceClosestPoint(Point=pt_113, Surface=srf_3)  # -> Point, UVPoint, Distance
pt_114 = Point(Point(34.87343618, 12.65430509, 8.597101866))
evalsrf_2 = EvaluateSurface(Surface=srf_2, Point=srf_cp_2.UVPoint)  # -> Point, Normal, UDirection, VDirection, Frame
vec2pt_6 = Vector2Pt(PointA=pt_114, PointB=evalsrf_2.Point, Unitize=False)  # -> Vector, Length
c_script_62 = CSharpScript(V=vec2pt_6.Vector, N=evalsrf_2.Normal)  # -> out, A, B; inputs V: Vector3d, N: Vector3d
# ---------- c_script_62: C# ----------
    A = Reflect(V, N, 0.5);
    B = ReflectRhinoCommon(V, N, 0.5);
# ---------- c_script_62: C# additional code ----------
  // http://www.3dkingdoms.com/weekly/weekly.php?a=2
  public static Vector3d ReflectRhinoCommon(Vector3d v, Vector3d n, double strength = 1) {
    v *= -1;
    return (2 * (v * n) * n - v ) * strength;
  }

  public static Vector3d Reflect(Vector3d v, Vector3d n, double strength = 1) {
    v.X *= -1;
    v.Y *= -1;
    v.Z *= -1;

    double dot = DotProduct(v, n);
    return new Vector3d(
      (2 * dot * n.X - v.X) * strength,
      (2 * dot * n.Y - v.Y) * strength,
      (2 * dot * n.Z - v.Z) * strength
      );
  }
  public static double DotProduct(Vector3d v1, Vector3d v2){
    return v1.X * v2.X + v1.Y * v2.Y + v1.Z * v2.Z;
  }
# ---------- end c_script_62 ----------
vdis_167 = VectorDisplay(Anchor=evalsrf_2.Point, Vector=evalsrf_2.Normal)
vdis_168 = VectorDisplay(Anchor=evalsrf_2.Point, Vector=c_script_62.A)
vdis_169 = VectorDisplay(Anchor=pt_114, Vector=vec2pt_6.Vector)
vdis_170 = VectorDisplay(Anchor=evalsrf_2.Point, Vector=c_script_62.B)
panel_146 = Panel(c_script_62.out)

# ----
# Solar panel
number_slider_63 = Slider(-6.1, range=-10..10)
vec_76 = VectorXYZ(XComponent=Slider(5.2, range=0..10), YComponent=Slider(5.2, range=0..10), ZComponent=number_slider_63)  # -> Vector, Length
neg_7 = Negative(Value=vec_76.Vector)
X_5 = UnitX(Factor=1)
Y_5 = UnitY(Factor=1)
Z_4 = UnitZ(Factor=1)
toggle_4 = BooleanToggle(True)
neg_8 = Negative(Value=vec_76.Vector)
Z_5 = UnitZ(Factor=1)
xprod_11 = CrossProduct(VectorA=X_5, VectorB=Y_5, Unitize=toggle_4)  # -> Vector, Length
vdis_171 = VectorDisplay(Anchor=neg_7, Vector=vec_76.Vector)
xprod_12 = CrossProduct(VectorA=neg_8, VectorB=Z_5, Unitize=toggle_4)  # -> Vector, Length
unit_20 = UnitVector(Vector=vec_76.Vector)
vdis_172 = VectorDisplay(Anchor="0,0,0", Vector=xprod_11.Vector)
vdis_173 = VectorDisplay(Anchor="0,0,0", Vector=unit_20)
vdis_174 = VectorDisplay(Anchor="0,0,0", Vector=xprod_12.Vector)
xprod_13 = CrossProduct(VectorA=unit_20, VectorB=xprod_12.Vector, Unitize=Toggle(True))  # -> Vector, Length
vdis_175 = VectorDisplay(Anchor="0,0,0", Vector=xprod_13.Vector)
vec_77 = Vector(xprod_12.Vector)
pl_3pt = Plane3Pt(PointA="0,0,0", PointB=vec_77, PointC=xprod_13.Vector)
box = CenterBox(Base=pl_3pt, X=1, Y=1, Z="0.1")

# ----
# catenary
number_slider_64 = Slider(2.09, range=0..10)
c_script_63 = CSharpScript(x=number_slider_64)  # -> out, A; inputs x: Double
# ---------- c_script_63: C# ----------
    // https://www.youtube.com/watch?v=K7RaikLaMaE

    List<Point3d> pts = new List<Point3d>();

    for(int i = 0; i < 100; ++i) {
      double X = (i * 0.1) - 5;
      double Y = x * Math.Cosh(X / x);
      Print(X.ToString());
      pts.Add(new Point3d(X, Y, 0));
    }

    A = pts;
# ---------- end c_script_63 ----------
intcrv = Interpolate(Vertices=c_script_63.A, Degree=3, Periodic=False, KnotStyle=1)  # -> Curve, Length, Domain
panel_148 = Panel(c_script_63.out)
panel_149 = Panel(c_script_63.A)

# ----
# Unit Vector & normalized vector
number_slider_65 = Slider(5, range=0..10)
vec_78 = VectorXYZ(XComponent=number_slider_65, YComponent=Slider(2, range=0..10), ZComponent=0)  # -> Vector, Length
panel_150 = Panel(vec_78.Vector)
unit_21 = UnitVector(Vector=vec_78.Vector)

python_47 = GhPythonScript(v=vec_78.Vector)  # -> out, a, b; inputs v: Vector3d
# ---------- python_47: Python ----------
__author__ = "namju"
__version__ = "2023.08.04"

import rhinoscriptsyntax as rs
import math;


a = rs.VectorUnitize(v)


len = math.sqrt(v[0] * v[0] + v[1] * v[1] + v[2] * v[2])

v[0] /= len
v[1] /= len
v[2] /= len

b = v
# ---------- end python_47 ----------

panel_151 = Panel([unit_21, python_47.a, python_47.b])

# ----
# DProd
number_slider_66 = Slider(4, range=0..10)
vec_79 = VectorXYZ(XComponent=number_slider_66, YComponent=Slider(2, range=0..10), ZComponent=0)  # -> Vector, Length
pt_115 = ConstructPoint(XCoordinate=0, YCoordinate=0, ZCoordinate=0)
vec_80 = VectorXYZ(XComponent=Slider(4, range=0..10), YComponent=Slider(0, range=0..10), ZComponent=0)  # -> Vector, Length
pt_116 = ConstructPoint(XCoordinate=0, YCoordinate=0, ZCoordinate=0)
vdis_176 = VectorDisplay(Anchor=pt_115, Vector=vec_79.Vector)
vdis_177 = VectorDisplay(Anchor=pt_116, Vector=vec_80.Vector)
unit_22 = UnitVector(Vector=vec_79.Vector)
unit_23 = UnitVector(Vector=vec_80.Vector)
dprod_8 = DotProduct(VectorA=unit_22, VectorB=unit_23, Unitize=False)

python_48 = GhPythonScript(v0=unit_22, v1=unit_23)  # -> out, a, b; inputs v0: Point3d, v1: Point3d
# ---------- python_48: Python ----------
__author__ = "namju"
__version__ = "2023.06.03"

import rhinoscriptsyntax as rs




a = rs.VectorDotProduct(v0, v1)


dotP = v0[0] * v1[0] + v0[1] * v1[1] + v0[2] * v1[2] 
b = dotP
# ---------- end python_48 ----------

panel_152 = Panel([dprod_8, python_48.a, python_48.b])

# ---- group: Line Vector
geo_5 = Geometry(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)
end_3 = EndPoints(Curve=geo_5)  # -> Start, End
pt_117 = Point(end_3.Start)
subtraction_25 = Subtraction(A=end_3.End, B=end_3.Start)

# ----
# Vec2Pt
vec2pt_7 = Vector2Pt(PointA=end_3.Start, PointB=end_3.End, Unitize=Toggle(False))  # -> Vector, Length
vdis_178 = VectorDisplay(Anchor=pt_117, Vector=subtraction_25)

python_49 = GhPythonScript(l=geo_5)  # -> out, a, b; inputs l: Curve
# ---------- python_49: Python ----------
__author__ = "namju"
__version__ = "2023.08.05"

import rhinoscriptsyntax as rs



p0 = l.PointAtStart
p1 = l.PointAtEnd


x = p1[0] - p0[0];
y = p1[1] - p0[1];
z = p1[2] - p0[2];


a = p0;
b = rs.AddPoint(x, y, z);
# ---------- end python_49 ----------

# ---- group: Line Vector (continued)
vdis_179 = VectorDisplay(Anchor=pt_117, Vector=vec2pt_7.Vector)

# ----
panel_153 = Panel([python_49.a, python_49.b])
vdis_180 = VectorDisplay(Anchor=pt_117, Vector=python_49.b)

pt_118 = Point(Point(54.68337412, 86.01180132, 0))
pt_119 = Point(Point(83.06983115, 50.75180855, 0))
# Area of triangle
pt_120 = Point(Point(34.73878357, 47.79196248, 0))

ln_5 = Line(StartPoint=pt_120, EndPoint=pt_119)
ln_6 = Line(StartPoint=pt_119, EndPoint=pt_118)
ln_7 = Line(StartPoint=pt_118, EndPoint=pt_120)
boundary = BoundarySurfaces(Edges=[ln_5, ln_6, ln_7])
area_2 = Area(Geometry=boundary)  # -> Area, Centroid

srf4pt = _4PointSurface(CornerA=pt_120, CornerB=pt_119, CornerC=pt_118)
area_3 = Area(Geometry=srf4pt)  # -> Area, Centroid

panel_154 = Panel([area_3.Area, area_2.Area])
