# Grasshopper definition LAB_02_PointGridRhinoAPI.gh (Grasshopper 1.0.8)

# Data in Design
# 
# Instructor : NJ Namju Lee / nj.namju@gmail.com
# 
# * class - https://namjulee.github.io/data-in-design/
# 
# * Lab - https://namjulee.github.io/njs-lab-public/
# 
# * Video(English) - https://www.youtube.com/c/njnamjulee
# * Writing(English) - https://medium.com/@nj-namju
# 
# * Video(Korean) - https://www.youtube.com/c/CodeforDesign
# * Writing(Korean) - https://brunch.co.kr/@njnamju
# 
# Installation - https://namjulee.github.io/njs-lab-public/installation
number_slider = Slider(10.4985, range=0..100)
crv = Curve([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])
pt = Point([Point(145.1962144, 137.1609561, 12.81185757), Point(78.59188573, 71.4839299, -18.58259157)])
crv_2 = Curve([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])
pt_2 = Point([Point(145.1962144, 137.1609561, 19.86703341), Point(78.59188573, 71.4839299, -14.487487)])
crv_3 = Curve([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])
pt_3 = Point([Point(145.1962144, 137.1609561, 12.81185757), Point(78.59188573, 71.4839299, -18.58259157)])
python = GhPythonScript(cs=crv, p=pt, s=Slider(47.2627, range=0..100), f=Slider(0.0015, range=0..0.29))  # -> out, a, b; inputs cs: list, p: list of Point3d
# ---------- python: Python ----------
__author__ = "namju"
__version__ = "2023.06.27"

import rhinoscriptsyntax as rs
import math

def Falloff(dis, strength, falloff):
    return strength * -(math.exp(-falloff * dis * dis));


numDivi = 10
ptsList = []
for c in cs:
    pts = rs.DivideCurve(c, numDivi)
    ptsList.extend(pts)
#a = ptsList


ptsModified = []

for pt in ptsList:
    newP = [pt[0] , pt[1] , pt[2]]
    
    for attr in p:
        v = rs.VectorSubtract(attr, pt)
        
        dis = rs.VectorLength(v)
        
        v = rs.VectorUnitize(v)
        
        val = Falloff(dis, s, f)
        newP[0] += v[0] * val 
        newP[1] += v[1] * val 
        newP[2] += v[2] * val 
    ptsModified.append(rs.AddPoint(newP))

a = ptsModified


curveList = []
for i in range(0, len(ptsModified), numDivi+1):
    print(i, numDivi)
    curve = rs.AddInterpCurve(ptsModified[i:i+numDivi+1])
    curveList.append(curve)
b = curveList
# ---------- end python ----------
python_2 = GhPythonScript(cs=crv_2, p=pt_2, s=number_slider, f=Slider(0.0015, range=0..0.29))  # -> out, a, b; inputs cs: list, p: list of Point3d
# ---------- python_2: Python ----------
__author__ = "namju"
__version__ = "2023.06.27"

import rhinoscriptsyntax as rs
import math

def Falloff(dis, strength, falloff):
    return strength * (math.exp(-falloff * dis * dis));



numDivi = 10

ptsList = []
for c in cs:
    pts = rs.DivideCurve(c, numDivi)
    ptsList.extend(pts)
#a = ptsList


ptsModified = []

for pt in ptsList:
    
    newP = [pt[0] , pt[1] , pt[2]]
    
    for attr in p:
        v = rs.VectorSubtract(attr, pt)
        
        
        dis = rs.VectorLength(v)
        
        v = rs.VectorUnitize(v)
        
        val = Falloff(dis, s, f)
        print(val)
        newP[0] += v[0] * val 
        newP[1] += v[1] * val 
        newP[2] += v[2] * val 
    ptsModified.append(rs.AddPoint(newP))

a = ptsModified

curveList = []
for i in range(0, len(ptsModified), numDivi+1):
    print(i, numDivi)
    curve = rs.AddInterpCurve(ptsModified[i:i+numDivi+1])
    curveList.append(curve)
b = curveList
# ---------- end python_2 ----------
python_3 = GhPythonScript(cs=crv_3, p=pt_3, s=Slider(11.7977, range=0..100), f=Slider(0.0007, range=0..0.29))  # -> out, a, b; inputs cs: list, p: list of Point3d
# ---------- python_3: Python ----------
__author__ = "namju"
__version__ = "2023.06.27"

import rhinoscriptsyntax as rs
import math

def Falloff(dis, strength, falloff):
    return strength * -(math.exp(-falloff * dis * dis));


numDivi = 10
ptsList = []
for c in cs:
    pts = rs.DivideCurve(c, numDivi)
    ptsList.extend(pts)
#a = ptsList


ptsModified = []

for pt in ptsList:
    newP = [pt[0] , pt[1] , pt[2]]
    
    for attr in p:
        v = rs.VectorSubtract(attr, pt)
        
        dis = rs.VectorLength(v)
        
        v = rs.VectorUnitize(v)
        
        v = rs.VectorRotate(v, 90, [0,0,1])
        
        
        val = Falloff(dis, s, f)
        newP[0] += v[0] * val 
        newP[1] += v[1] * val 
        newP[2] += v[2] * val 
        
    ptsModified.append(rs.AddPoint(newP))

a = ptsModified


curveList = []
for i in range(0, len(ptsModified), numDivi+1):
    print(i, numDivi)
    curve = rs.AddInterpCurve(ptsModified[i:i+numDivi+1])
    curveList.append(curve)
b = curveList
# ---------- end python_3 ----------
pt_4 = Point(python_2.a)
crv_4 = Curve(python_2.b)
panel = Panel(python_2.a)
panel_2 = Panel(python.a)
crv_5 = Curve(python_3.b)
crv_6 = Curve(python.b)
pt_5 = Point(python_3.a)
pt_6 = Point(python.a)
panel_3 = Panel(python_3.a)
