# Grasshopper definition LAB_03_TransformRhinoAPI.gh (Grasshopper 1.0.8)
# plug-ins: RhinoCodePluginGH

number_slider = Slider(10, range=0..10)
# Move
geo = Geometry(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)
# Rotation
geo_2 = Geometry(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)
X = UnitX(Factor=Slider(10, range=0..10))
X_2 = UnitX(Factor=number_slider)
c_script = CSharpScript(G=geo, XVec=Slider(10, range=0..10))  # -> out, A; inputs G: Brep, XVec: Double
# ---------- c_script: C# ----------
    Vector3d xVec = new Vector3d(XVec, 0, 0);

    G.Translate(xVec);

    A = G;
# ---------- end c_script ----------
move = Move(Geometry=geo, Motion=X)  # -> Geometry, Transform
move_2 = Move(Geometry=geo_2, Motion=X_2)  # -> Geometry, Transform
c_script_2 = CSharpScript(G=geo_2, XVec=number_slider, A=Slider(2.94, range=0..6.28))  # -> out, geo; inputs G: Brep, XVec: Double, A: Double
# ---------- c_script_2: C# ----------
    Vector3d xVec = new Vector3d(XVec, 0, 0);

    G.Translate(xVec);

    G.Rotate(A, Vector3d.ZAxis, new Point3d(0, 0, 0));

    geo = G;
# ---------- end c_script_2 ----------
rotate = Rotate(Geometry=move_2.Geometry, Angle=Slider(4.66, range=0..6.28), Plane=PlaneXY(0, 0, 0))  # -> Geometry, Transform
crv = Curve(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)
geo_3 = Geometry(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)
X_3 = UnitX(Factor=Slider(10, range=0..10))
Y = UnitY(Factor=Slider(5, range=0..10))
number_slider_2 = Slider(10, range=0..10)
addition = Addition(A=X_3, B=Y)
c_script_3 = CSharpScript(
    c1=crv,
    pfov=Slider(44.406, range=0..71),
    pratio=Slider(0.98, range=0..3),
    near=Slider(12.58, range=0..23),
    far=Slider(59.389, range=0..71))  # -> out, ViewMatrix, ProjectionMatrix, VP_Matrix, VP_Inverse_Matrix; inputs c1: Curve, pfov: Double, pratio: Double, near: Double, far: Double
# ---------- c_script_3: C# usings ----------
using System.IO;
using System.Linq;
using System.Data;
using System.Drawing;
using System.Reflection;
using System.Windows.Forms;
using System.Xml;
using System.Xml.Linq;
using System.Runtime.InteropServices;

using Rhino.DocObjects;
using Rhino.Collections;
using GH_IO;
using GH_IO.Serialization;
# ---------- c_script_3: C# ----------
    //.....................................Projector transform

    Point3d vp1 = c1.PointAtStart;
    Point3d tp1 = c1.PointAtEnd;

    Transform mv = LookAt(vp1, tp1, Vector3d.ZAxis);
    Transform mp = Perspective(pfov, pratio, near, far);

    Transform mpv = mp * mv;

    Transform mpvInv;
    mpv.TryGetInverse(out mpvInv);

    ViewMatrix = mv;
    ProjectionMatrix = mp;
    VP_Matrix = mpv;
    VP_Inverse_Matrix = mpvInv;
# ---------- c_script_3: C# additional code ----------
  public Transform LookAt(Point3d vp, Point3d tp, Vector3d up) {
    Vector3d za = vp - tp;
    Vector3d ya = up;
    Vector3d xa = Vector3d.CrossProduct(ya, za);
    xa.Unitize();
    ya = Vector3d.CrossProduct(za, xa);
    ya.Unitize();
    za.Unitize();

    Transform vm = Transform.Identity;

    vm.M00 = xa.X;
    vm.M01 = xa.Y;
    vm.M02 = xa.Z;

    vm.M10 = ya.X;
    vm.M11 = ya.Y;
    vm.M12 = ya.Z;

    vm.M20 = za.X;
    vm.M21 = za.Y;
    vm.M22 = za.Z;

    vm = vm * Transform.Translation(-vp.X, -vp.Y, -vp.Z);

    return vm;
  }

  public Transform Perspective(double ifov, double iaspect, double inear, double ifar)
  {
    double f_mul = 1.0 / Math.Tan((0.5 * ifov * Math.PI) / 180.0);

    Transform pm = Transform.Identity;

    pm.M00 = f_mul / iaspect;
    pm.M01 = 0.0;
    pm.M02 = 0.0;
    pm.M03 = 0.0;

    pm.M10 = 0.0;
    pm.M11 = f_mul;
    pm.M12 = 0.0;
    pm.M13 = 0.0;

    pm.M20 = 0.0;
    pm.M21 = 0.0;
    pm.M22 = (ifar + inear) / (inear - ifar);
    pm.M23 = -1.0;

    pm.M30 = 0.0;
    pm.M31 = 0.0;
    pm.M32 = (2.0 * ifar * inear) / (inear - ifar);
    pm.M33 = 0.0;

    return pm.Transpose();
  }

  public Transform PointShadow(Point3d sp)
  {
    Transform pm = Transform.Identity;

    pm.M00 = sp.Z;
    pm.M01 = 0.0;
    pm.M02 = 0.0;
    pm.M03 = 0.0;

    pm.M10 = 0.0;
    pm.M11 = sp.Z;
    pm.M12 = 0.0;
    pm.M13 = 0.0;

    pm.M20 = -sp.X;
    pm.M21 = -sp.Y;
    pm.M22 = 0.0;
    pm.M23 = -1.0;

    pm.M30 = 0.0;
    pm.M31 = 0.0;
    pm.M32 = 0.0;
    pm.M33 = sp.Z;

    return pm.Transpose();
  }
# ---------- end c_script_3 ----------
geo_4 = Geometry([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])
number_slider_3 = Slider(6.28, range=0..6.28)
c_script_4 = CSharpScript()  # -> out, A
# ---------- c_script_4: C# ----------
    double f = 0; //radian for camera

    double width = 300; double height = 300;
    double far = 1876.911; double near = 1252.722;

    double val_00 = Get00(f, width, height);
    double val_11 = f;
    double val_22 = Get22(far, near);
    double val_23 = Get23(far, near);
    double val_32 = -1;


    A = RemapProjection(val_00, val_11, val_22, val_23, val_32);
# ---------- c_script_4: C# additional code ----------
  public Transform RemapProjection(double val_00, double val_11, double val_22, double val_23, double val_32){

    Transform vm = Transform.Identity;

    vm.M00 = val_00;

    vm.M11 = val_11;

    vm.M22 = val_22;
    vm.M23 = val_23;

    vm.M32 = val_32;

    return vm;
  }

  public static double Get00(double fovy, double width, double height){
    double f = GetF(fovy);
    double aspect = GetRatio(width, height);
    return f / aspect;
  }

  public static double Get22(double far, double near){
    return (far + near) / (near - far);
  }

  public static double Get23(double far, double near){
    return (2 * (far + near)) / (near - far);
  }

  public static double GetF(double fovy){
    return Math.Acos(fovy) / 2.0;
  }

  public static double GetRatio(double width, double height){
    return width / height;
  }
# ---------- end c_script_4 ----------
geo_5 = Geometry(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)
geo_unitcube = Geometry([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])
move_3 = Move(Geometry=geo_3, Motion=addition)  # -> Geometry, Transform
c_script_5 = CSharpScript(G=geo_3, X=Slider(10, range=0..10), Y=Slider(10, range=0..10))  # -> out, A; inputs G: Brep, X: Double, Y: Double
# ---------- c_script_5: C# ----------
    Vector3d xVec = new Vector3d(X, Y, 0);

    G.Translate(xVec);

    A = G;
# ---------- end c_script_5 ----------
panel = Panel(c_script_4.A)
X_4 = UnitX(Factor=number_slider_2)
rotate_2 = Rotate(Geometry=geo_4, Angle=Slider(0, range=0..10), Plane=PlaneXY(-44.43518948, 45.36928856, 2.493039686))  # -> Geometry, Transform
image = ImageSampler(
    FilePath="C:\njsCore\workshop\ComputationGH\AnalyticalGeometryBasic\img\matrix_rotation_x.jpg",
    Filter="Colour",
    Interpolate=False,
    Umax=1,
    Umin=0,
    Vmax=1,
    Vmin=0,
    Wrap=1)
move_4 = Move(Geometry=geo_5, Motion=X_4)  # -> Geometry, Transform
c_script_6 = CSharpScript(G=geo_5, XVec=number_slider_2, A=number_slider_3)  # -> out, geo, T; inputs G: Brep, XVec: Double, A: Double
# ---------- c_script_6: C# ----------
    Vector3d xVec = new Vector3d(XVec, 0, 0);
    G.Translate(xVec);

    Transform t = Transform.Identity;
    t.M11 = Math.Cos(A);
    t.M12 = -Math.Sin(A);
    t.M21 = Math.Sin(A);
    t.M22 = Math.Cos(A);
    T = t;


    G.Transform(t);



    geo = G;
# ---------- end c_script_6 ----------
rotate_3 = Rotate(Geometry=move_4.Geometry, Angle=number_slider_3, Plane=PlaneXY(0, 0, 0))  # -> Geometry, Transform
geo_6 = Geometry(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)
transform = Transform(Geometry=rotate_2.Geometry, Transform=c_script_3.VP_Matrix)
transform_2 = Transform(Geometry=geo_unitcube, Transform=c_script_3.VP_Inverse_Matrix)
matrix = TransformMatrix(c_script_6.T, Digits=3)
matrix_2 = TransformMatrix(rotate_3.Transform, Digits=3)
X_5 = UnitX(Factor=Slider(10, range=0..10))
Y_2 = UnitY(Factor=Slider(5, range=0..10))
addition_2 = Addition(A=X_5, B=Y_2)
move_5 = Move(Geometry=geo_6, Motion=addition_2)  # -> Geometry, Transform
c_script_7 = CSharpScript(G=geo_6, X=Slider(10, range=0..10), Y=Slider(10, range=0..10), Z=Slider(2, range=0..10))  # -> out, A, T; inputs G: Brep, X: Double, Y: Double, Z: Double
# ---------- c_script_7: C# ----------
    Transform xf = Transform.Identity;

    xf.M03 = X;
    xf.M13 = Y;
    xf.M23 = Z;

    T = xf;

    G.Transform(xf);

    A = G;
# ---------- end c_script_7 ----------
matrix_3 = TransformMatrix(c_script_7.T, Digits=3)
matrix_4 = TransformMatrix(move_5.Transform, Digits=3)
number_slider_4 = Slider(10, range=0..10)
number_slider_5 = Slider(0.01, range=0..6.28)
crv_2 = Curve(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)
geo_7 = Geometry(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)
X_6 = UnitX(Factor=number_slider_4)
move_6 = Move(Geometry=geo_7, Motion=X_6)  # -> Geometry, Transform
c_script_8 = CSharpScript(G=geo_7, XVec=number_slider_4, A=number_slider_5)  # -> out, geo, T; inputs G: Brep, XVec: Double, A: Double
# ---------- c_script_8: C# ----------
    Vector3d xVec = new Vector3d(XVec, 0, 0);
    G.Translate(xVec);

    Transform t = Transform.Identity;
    t.M00 = Math.Cos(A);
    t.M02 = Math.Sin(A);
    t.M20 = -Math.Sin(A);
    t.M22 = Math.Cos(A);
    T = t;


    G.Transform(t);



    geo = G;
# ---------- end c_script_8 ----------
c_script_9 = CSharpScript(
    c1=crv_2,
    pfov=Slider(44.406, range=0..71),
    pratio=Slider(1.025, range=0..3),
    near=Slider(14.155, range=0..23),
    far=Slider(59.389, range=0..71))  # -> out, ViewMatrix, ProjectionMatrix, VP_Matrix, VP_Inverse_Matrix; inputs c1: Curve, pfov: Double, pratio: Double, near: Double, far: Double
# ---------- c_script_9: C# ----------
    //.....................................Projector transform

    Point3d vp1 = c1.PointAtStart;
    Point3d tp1 = c1.PointAtEnd;

    Transform mv = LookAt(vp1, tp1, Vector3d.ZAxis);
    Transform mp = Perspective(pfov, pratio, near, far);

    Transform mpv = mp * mv;

    Transform mpvInv;
    mpv.TryGetInverse(out mpvInv);


    ViewMatrix = mv;
    ProjectionMatrix = mp;

    VP_Matrix = mpv;
    VP_Inverse_Matrix = mpvInv;
# ---------- c_script_9: C# additional code ----------
  public Transform LookAt(Point3d vp, Point3d tp, Vector3d up) {
    Vector3d za = vp - tp;
    Vector3d ya = up;
    Vector3d xa = Vector3d.CrossProduct(ya, za);
    xa.Unitize();
    ya = Vector3d.CrossProduct(za, xa);
    ya.Unitize();
    za.Unitize();

    Transform vm = Transform.Identity;

    vm.M00 = xa.X;
    vm.M01 = xa.Y;
    vm.M02 = xa.Z;

    vm.M10 = ya.X;
    vm.M11 = ya.Y;
    vm.M12 = ya.Z;

    vm.M20 = za.X;
    vm.M21 = za.Y;
    vm.M22 = za.Z;

    vm = vm * Transform.Translation(-vp.X, -vp.Y, -vp.Z);
    return vm;
  }

  public Transform Perspective(double ifov, double iaspect, double inear, double ifar){
    double f_mul = 1.0 / Math.Tan((0.5 * ifov * Math.PI) / 180.0);

    Transform pm = Transform.Identity;
    pm.M00 = f_mul / iaspect;
    pm.M01 = 0.0;
    pm.M02 = 0.0;
    pm.M03 = 0.0;

    pm.M10 = 0.0;
    pm.M11 = f_mul;
    pm.M12 = 0.0;
    pm.M13 = 0.0;

    pm.M20 = 0.0;
    pm.M21 = 0.0;
    pm.M22 = (ifar + inear) / (inear - ifar);
    pm.M23 = -1.0;

    pm.M30 = 0.0;
    pm.M31 = 0.0;
    pm.M32 = (2.0 * ifar * inear) / (inear - ifar);
    pm.M33 = 0.0;

    return pm.Transpose();
  }

  public Transform PointShadow(Point3d sp){
    Transform pm = Transform.Identity;

    pm.M00 = sp.Z;
    pm.M01 = 0.0;
    pm.M02 = 0.0;
    pm.M03 = 0.0;

    pm.M10 = 0.0;
    pm.M11 = sp.Z;
    pm.M12 = 0.0;
    pm.M13 = 0.0;

    pm.M20 = -sp.X;
    pm.M21 = -sp.Y;
    pm.M22 = 0.0;
    pm.M23 = -1.0;

    pm.M30 = 0.0;
    pm.M31 = 0.0;
    pm.M32 = 0.0;
    pm.M33 = sp.Z;

    return pm.Transpose();
  }
# ---------- end c_script_9 ----------
image_2 = ImageSampler(
    FilePath="C:\njsCore\workshop\ComputationGH\AnalyticalGeometryBasic\img\matrix_rotation_y.jpg",
    Filter="Colour",
    Interpolate=False,
    Umax=1,
    Umin=0,
    Vmax=1,
    Vmin=0,
    Wrap=1)
geo_8 = Geometry([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])
geo_9 = Geometry([<curve referenced from the Rhino model> x6, <mesh referenced from the Rhino model>, <brep referenced from the Rhino model>, <curve referenced from the Rhino model>])
c_script_10 = CSharpScript()  # -> out, A; same code as c_script_4
rotate_4 = Rotate(Geometry=move_6.Geometry, Angle=number_slider_5, Plane=PlaneXY(0, 0, 0))  # -> Geometry, Transform
geo_unitcube_2 = Geometry([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])
panel_2 = Panel(c_script_10.A)
rotate_5 = Rotate(Geometry=geo_9, Angle=Slider(6.888, range=0..10), Plane=PlaneXY(-44.43518948, 45.36928856, 2.493039686))  # -> Geometry, Transform
matrix_5 = TransformMatrix(c_script_8.T, Digits=3)
matrix_6 = TransformMatrix(rotate_4.Transform, Digits=3)

slider = Slider(1, range=-1..1)
slider_2 = Slider(0, range=-1..1)

transform_3 = Transform(Geometry=rotate_5.Geometry, Transform=c_script_9.ViewMatrix)
c_script_11 = CSharpScript()  # -> out, A
# ---------- c_script_11: C# ----------
    Transform vm = Transform.Identity;

    A = vm;
# ---------- end c_script_11 ----------

pt = Point(<point referenced from the Rhino model>)
pt_2 = Point(<point referenced from the Rhino model>)
pt_3 = Point(<point referenced from the Rhino model>)
c_script_12 = CSharpScript(p0=pt_3, p1=pt_2, p2=pt)  # -> out, A, B, C; inputs p0: Point3d, p1: Point3d, p2: Point3d
# ---------- c_script_12: C# ----------
    List<Point3d> pt = new List<Point3d>();
    List<Point3d> vp = new List<Point3d>();
    List<Vector3d> v = new List<Vector3d>();

    pt.Add(p0);

    vp.Add(p0);
    v.Add(p1 - p0);


    vp.Add(p0);
    v.Add(p2 - p0);


    vp.Add(p0);
    v.Add(Vector3d.CrossProduct((p1 - p0), (p2 - p0)));


    A = pt;
    B = vp;
    C = v;
# ---------- end c_script_12 ----------
vdis = VectorDisplay(Anchor=c_script_12.B, Vector=c_script_12.C)

# ---- group: Matric Calcuattion
geo_10 = Geometry([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])
pt_4 = Point(<point referenced from the Rhino model>)
c_script_13 = CSharpScript(m=geo_10, scale=Slider(3.2, range=0..10), cen=pt_4, rot=Slider(7.9, range=0..10))  # -> out, A; inputs m: Mesh, scale: Double, cen: Point3d, rot: Double
# ---------- c_script_13: C# ----------
    Rhino.Geometry.Transform s = Rhino.Geometry.Transform.Scale(Plane.WorldXY, scale, 1.0, 1.0);
    //Rhino.Geometry.Transform s = Rhino.Geometry.Transform.Scale(cen, 2.0);

    Rhino.Geometry.Transform r = Rhino.Geometry.Transform.Rotation(rot, cen);

    //Transform comp = r * s; // s * r
    Transform comp = s * r; // s * r


    m.Transform(comp);

    //m.Transform(s);
    //m.Transform(r);

    A = m;
# ---------- end c_script_13 ----------
panel_3 = Panel(c_script_13.out)

# ----
pt_5 = Point(Point(10.10322058, 2.616096673, 0))
pt_6 = Point(Point(9.736548611, 3.782997424, 0))
pt_7 = Point(Point(11.16651593, 3.217229453, 0))
c_script_14 = CSharpScript(p0=pt_5, p1=pt_7, p2=pt_6)  # -> out, A, B, C; inputs p0: Point3d, p1: Point3d, p2: Point3d; same code as c_script_12
vdis_2 = VectorDisplay(Anchor=c_script_14.B, Vector=c_script_14.C)

# ---- group: Matric Calcuattion
geo_11 = Geometry([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])
pt_8 = Point(<point referenced from the Rhino model>)
c_script_15 = CSharpScript(m=geo_11, scale=Slider(3.2, range=0..10), cen=pt_8, rot=Slider(7.9, range=0..10))  # -> out, A; inputs m: Mesh, scale: Double, cen: Point3d, rot: Double
# ---------- c_script_15: C# ----------
    Rhino.Geometry.Transform s = Rhino.Geometry.Transform.Scale(Plane.WorldXY, scale, 1.0, 1.0);
    //Rhino.Geometry.Transform s = Rhino.Geometry.Transform.Scale(cen, 2.0);

    Rhino.Geometry.Transform r = Rhino.Geometry.Transform.Rotation(rot, cen);

    //Transform comp = r * s; // s * r
    Transform comp = s * r; // s * r


    m.Transform(comp);

    //m.Transform(s);
    //m.Transform(r);

    A = m;
# ---------- end c_script_15 ----------
panel_4 = Panel(c_script_15.out)

# ----
transform_4 = Transform(Geometry=rotate_5.Geometry, Transform=c_script_9.ProjectionMatrix)
transform_5 = Transform(Geometry=rotate_5.Geometry, Transform=c_script_9.VP_Matrix)
transform_6 = Transform(Geometry=rotate_5.Geometry, Transform=c_script_9.VP_Inverse_Matrix)
matrix_7 = TransformMatrix(c_script_11.A, Digits=3)
transform_7 = Transform(Geometry=geo_unitcube_2, Transform=c_script_9.VP_Inverse_Matrix)

slider_3 = Slider(0, range=-1..1)
slider_4 = Slider(1, range=-1..1)

number_slider_6 = Slider(10, range=0..10)
geo_12 = Geometry(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)
number_slider_7 = Slider(2.26, range=0..6.28)

slider_5 = Slider(0, range=0..1)
slider_6 = Slider(0, range=0..1)

geo_13 = Geometry(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)

geo_14 = Geometry([<mesh referenced from the Rhino model> x4])
matrix_8 = TransformMatrix(
    [slider, slider_3, Slider(0, range=0..1), slider_5, slider_2, slider_4, slider_6, Slider(0, range=0..1), Slider(0, range=0..1), Slider(0, range=0..1), Slider(1, range=0..1), Slider(0, range=-1..1), Slider(0, range=0..1), Slider(0, range=0..1), Slider(0, range=0..1), Slider(1, range=0..1)],
    Digits=3)
transform_8 = Transform(Geometry=geo_14, Transform=matrix_8)
preview = CustomPreview(Geometry=transform_8, Shader=ColourSwatch(SwatchColor=RGB(189, 189, 189)))

transform_9 = Transform(Geometry=geo_12, Transform=matrix_7)
X_7 = UnitX(Factor=number_slider_6)
image_3 = ImageSampler(
    FilePath="C:\njsCore\workshop\ComputationGH\AnalyticalGeometryBasic\img\matrix_rotation_z.jpg",
    Filter="Colour",
    Interpolate=False,
    Umax=1,
    Umin=0,
    Vmax=1,
    Vmin=0,
    Wrap=1)

geo_15 = Geometry([<mesh referenced from the Rhino model> x4])
matrix_9 = TransformMatrix(
    [Slider(1, range=0..1), Slider(0, range=0..1), Slider(0, range=0..1), Slider(0, range=0..1), Slider(0, range=-1..1), Slider(1, range=-1..1), Slider(0, range=0..1), Slider(0, range=0..1), Slider(0, range=0..1), Slider(0, range=0..1), Slider(1, range=0..1), Slider(0, range=0..1), Slider(0, range=0..1), Slider(0, range=0..1), Slider(0, range=-1..1), Slider(1, range=0..1)],
    Digits=3)
transform_10 = Transform(Geometry=geo_15, Transform=matrix_9)
preview_2 = CustomPreview(Geometry=transform_10, Shader=ColourSwatch(SwatchColor=RGB(189, 189, 189)))

geo_16 = Geometry([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])
matrix_10 = TransformMatrix(
    [Slider(1, range=0..1), Slider(0, range=0..1), Slider(0, range=0..1), Slider(0, range=0..1), Slider(0, range=-1..1), Slider(1, range=-1..1), Slider(0, range=0..1), Slider(0, range=0..1), Slider(0, range=0..1), Slider(0, range=0..1), Slider(1, range=0..1), Slider(0, range=0..1), Slider(0, range=0..1), Slider(0, range=0..1), Slider(0, range=-1..1), Slider(1, range=0..1)],
    Digits=3)
transform_11 = Transform(Geometry=geo_16, Transform=matrix_10)
preview_3 = CustomPreview(Geometry=transform_11, Shader=ColourSwatch(SwatchColor=RGB(189, 189, 189)))

move_7 = Move(Geometry=geo_13, Motion=X_7)  # -> Geometry, Transform
c_script_16 = CSharpScript(G=geo_13, XVec=number_slider_6, A=number_slider_7)  # -> out, geo, T; inputs G: Brep, XVec: Double, A: Double
# ---------- c_script_16: C# ----------
    Vector3d xVec = new Vector3d(XVec, 0, 0);
    G.Translate(xVec);

    Transform t = Transform.Identity;
    t.M00 = Math.Cos(A);
    t.M01 = -Math.Sin(A);
    t.M10 = Math.Sin(A);
    t.M11 = Math.Cos(A);
    T = t;


    G.Transform(t);



    geo = G;
# ---------- end c_script_16 ----------
c_script_17 = CSharpScript(
    m00=Slider(1, range=0..1),
    m01=Slider(0, range=0..1),
    m02=Slider(0, range=0..1),
    m03=Slider(0, range=0..1),
    m10=Slider(0, range=0..1),
    m11=Slider(1, range=0..1),
    m12=Slider(0, range=0..1),
    m13=Slider(0, range=0..1),
    m20=Slider(0, range=0..1),
    m21=Slider(0, range=0..1),
    m22=Slider(1, range=0..1),
    m23=Slider(1, range=0..1),
    m30=Slider(0, range=0..1),
    m31=Slider(0, range=0..1),
    m32=Slider(0, range=0..1),
    m33=Slider(1, range=0..1))  # -> out, A; inputs m00: Double, m01: Double, m02: Double, m03: Double, m10: Double, m11: Double, m12: Double, m13: Double, m20: Double, m21: Double, m22: Double, m23: Double, m30: Double, m31: Double, m32: Double, m33: Double
# ---------- c_script_17: C# ----------
    Transform vm = Transform.Identity;

    vm.M00 = m00;
    vm.M01 = m01;
    vm.M02 = m02;
    vm.M03 = m03;

    vm.M10 = m10;
    vm.M11 = m11;
    vm.M12 = m12;
    vm.M13 = m13;

    vm.M20 = m20;
    vm.M21 = m21;
    vm.M22 = m22;
    vm.M23 = m23;

    vm.M30 = m30;
    vm.M31 = m31;
    vm.M32 = m32;
    vm.M33 = m33;


    A = vm;
# ---------- end c_script_17 ----------
c_script_18 = CSharpScript(
    m00=Slider(1, range=0..1),
    m01=Slider(0, range=0..1),
    m02=Slider(0, range=0..1),
    m03=Slider(0, range=0..1),
    m10=Slider(0, range=0..1),
    m11=Slider(1, range=0..1),
    m12=Slider(0, range=0..1),
    m13=Slider(0, range=0..1),
    m20=Slider(0, range=0..1),
    m21=Slider(0, range=0..1),
    m22=Slider(1, range=0..1),
    m23=Slider(1, range=0..1),
    m30=Slider(0, range=0..1),
    m31=Slider(0, range=0..1),
    m32=Slider(0, range=0..1),
    m33=Slider(1, range=0..1))  # -> out, A; inputs m00: Double, m01: Double, m02: Double, m03: Double, m10: Double, m11: Double, m12: Double, m13: Double, m20: Double, m21: Double, m22: Double, m23: Double, m30: Double, m31: Double, m32: Double, m33: Double; same code as c_script_17
matrix_11 = TransformMatrix([slider, slider_3, slider_5, slider_2, slider_4, slider_6], Digits=3)
panel_5 = Panel(" IFS demo code")
rotate_6 = Rotate(Geometry=move_7.Geometry, Angle=number_slider_7, Plane=PlaneXY(0, 0, 0))  # -> Geometry, Transform

crv_3 = Curve([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])
slider_7 = Slider(1, range=0..8)
geo_17 = Geometry(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)

crv_4 = Curve([<curve referenced from the Rhino model> x5])

geo_18 = Geometry([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])
matrix_12 = TransformMatrix(
    [Slider(1, range=-1..1), Slider(0, range=-1..1), Slider(0, range=0..1), Slider(0, range=0..1), Slider(0, range=-1..1), Slider(1, range=-1..1), Slider(0, range=0..1), Slider(0, range=0..1), Slider(0, range=0..1), Slider(0, range=0..1), Slider(1, range=0..1), Slider(0, range=-1..1), Slider(0, range=0..1), Slider(0, range=0..1), Slider(0, range=0..1), Slider(1, range=0..1)],
    Digits=3)
transform_12 = Transform(Geometry=geo_18, Transform=matrix_12)  # disabled
preview_4 = CustomPreview(Geometry=transform_12, Shader=ColourSwatch(SwatchColor=RGB(189, 189, 189)))

matrix_13 = TransformMatrix(c_script_17.A, Digits=3)
matrix_14 = TransformMatrix(c_script_18.A, Digits=3)
geo_19 = Geometry(<curve referenced from the Rhino model>)
matrix_15 = TransformMatrix(c_script_16.T, Digits=3)
matrix_16 = TransformMatrix(rotate_6.Transform, Digits=3)
geo_20 = Geometry(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)
geo_21 = Geometry(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)
c_recursive_curve = CSharpScript(c=geo_19, g=geo_17, iter=slider_7)  # -> out, O, X, Y, Z, T; inputs c: Curve, g: GeometryBase, iter: Int32
# ---------- c_recursive_curve: C# ----------
    // Transform tf = TransformFrom2Points(c.PointAtStart, c.PointAtEnd);

    Point3d p0 = c.PointAtStart;
    Point3d p1 = c.PointAtEnd;


    

    Vector3d v1 = p1 - p0;
    v1.Unitize();

    Vector3d v3 = new Vector3d(0.0, 0.0, 1.0);

    Vector3d v2 = Vector3d.CrossProduct(v3, v1);

    v3 = Vector3d.CrossProduct(v1, v2);

    double L = v1.Length;


    v2.Unitize();
    v3.Unitize();

    v2 *= L;
    v3 *= L;


    Transform xform = Transform.Identity;
    xform.M00 = v1.X;
    xform.M10 = v1.Y;
    xform.M20 = v1.Z;

    xform.M01 = v2.X;
    xform.M11 = v2.Y;
    xform.M21 = v2.Z;

    xform.M02 = v3.X;
    xform.M12 = v3.Y;
    xform.M22 = v3.Z;

    xform.M03 = p0.X;
    xform.M13 = p0.Y;
    xform.M23 = p0.Z;


    O = p0;
    X = v1;
    Y = v2;
    Z = v3;


    T = xform;
# ---------- end c_recursive_curve ----------
transform_13 = Transform(Geometry=geo_21, Transform=matrix_14)
transform_14 = Transform(Geometry=geo_20, Transform=matrix_13)

# ----
# draws a recursive curve by substituting each line segment with a transformed version of the whole set again and again
c_recursive_curve_2 = CSharpScript(c=crv_4, g=geo_17, iter=slider_7)  # -> out, A; inputs c: list of Curve, g: GeometryBase, iter: Int32
# ---------- c_recursive_curve_2: C# ----------
    List<Transform> xfs = new List<Transform>();

    foreach(Curve cc in c) {
      Transform tf = TransformFrom2Points(cc.PointAtStart, cc.PointAtEnd);
      xfs.Add(tf);
    }

    //List<GeometryBase> geomoutput = new List<GeometryBase>();
    List<GeometryBase> g0 = new List<GeometryBase>();
    List<GeometryBase> g1 = new List<GeometryBase>();

    g0.Add(g);
    //geomoutput.Add(g);

    int i;

    for(i = 0; i < iter; ++i) {
      foreach(GeometryBase geom in g0) {
        foreach(Transform f in xfs) {
          GeometryBase gcopy = geom.Duplicate();
          gcopy.Transform(f);
          g1.Add(gcopy);
        }
      }
      //geomoutput.AddRange(g1);

      List<GeometryBase> gtemp = g1;
      g1 = g0;
      g0 = gtemp;

      g1.Clear();
    }


    A = g0;
# ---------- c_recursive_curve_2: C# additional code ----------
  Transform TransformFrom2Points(Point3d p0, Point3d p1) {

    Transform xform = Transform.Identity;

    Vector3d v1 = p1 - p0;
    Vector3d v3 = new Vector3d(0.0, 0.0, 1.0);

    Vector3d v2 = Vector3d.CrossProduct(v3, v1);

    v3 = Vector3d.CrossProduct(v1, v2);

    double L = v1.Length;

    v2.Unitize();
    v3.Unitize();

    v2 *= L;
    v3 *= L;


    xform.M00 = v1.X;
    xform.M10 = v1.Y;
    xform.M20 = v1.Z;

    xform.M01 = v2.X;
    xform.M11 = v2.Y;
    xform.M21 = v2.Z;

    xform.M02 = v3.X;
    xform.M12 = v3.Y;
    xform.M22 = v3.Z;

    xform.M03 = p0.X;
    xform.M13 = p0.Y;
    xform.M23 = p0.Z;

    return xform;
  }
# ---------- end c_recursive_curve_2 ----------

geo_22 = Geometry(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)
number_slider_8 = Slider(10, range=0..10)
vdis_3 = VectorDisplay(Anchor=c_recursive_curve.O, Vector=c_recursive_curve.X)
vdis_4 = VectorDisplay(Anchor=c_recursive_curve.O, Vector=c_recursive_curve.Y)
vdis_5 = VectorDisplay(Anchor=c_recursive_curve.O, Vector=c_recursive_curve.Z)
number_slider_9 = Slider(3.36, range=0..6.28)
number_slider_10 = Slider(3.62, range=0..6.28)
transform_15 = Transform(Geometry=geo_22, Transform=c_recursive_curve.T)

preview_5 = CustomPreview(
    Geometry=c_recursive_curve_2.A,
    Shader={diffuse=RGB(0, 0, 0), emission=RGB(76, 32, 54), shine=0.5, specular=RGB(255, 255, 255), transparency=0})

geo_23 = Geometry(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)
X_8 = UnitX(Factor=number_slider_8)
matrix_17 = TransformMatrix(c_recursive_curve.T, Digits=3)
move_8 = Move(Geometry=geo_23, Motion=X_8)  # -> Geometry, Transform
X_9 = UnitX(Factor=1)
c_script_19 = CSharpScript(G=geo_23, XVec=number_slider_8, XA=number_slider_9, YA=number_slider_10, ZA=Slider(0, range=0..6.28))  # -> out, geo, T; inputs G: Brep, XVec: Double, XA: Double, YA: Double, ZA: Double
# ---------- c_script_19: C# ----------
    Vector3d xVec = new Vector3d(XVec, 0, 0);
    G.Translate(xVec);
    
    Transform tX = Transform.Identity;
    tX.M11 = Math.Cos(XA);
    tX.M12 = -Math.Sin(XA);
    tX.M21 = Math.Sin(XA);
    tX.M22 = Math.Cos(XA);

    Transform tY = Transform.Identity;
    tY.M00 = Math.Cos(YA);
    tY.M02 = Math.Sin(YA);
    tY.M20 = -Math.Sin(YA);
    tY.M22 = Math.Cos(YA);
    
    Transform tZ = Transform.Identity;
    tZ.M00 = Math.Cos(ZA);
    tZ.M01 = -Math.Sin(ZA);
    tZ.M10 = Math.Sin(ZA);
    tZ.M11 = Math.Cos(ZA);
    
    Transform tRotation = Transform.Identity;
    tRotation = tX * tY * tZ;
    
    G.Transform(tRotation);



    geo = G;
# ---------- end c_script_19 ----------
ln = Line(StartPoint="0,0,0", EndPoint=X_9)
rotax = RotateAxis(Geometry=move_8.Geometry, Angle=number_slider_9, Axis=ln)  # -> Geometry, Transform
Y_3 = UnitY(Factor=1)
ln_2 = Line(StartPoint="0,0,0", EndPoint=Y_3)
rotax_2 = RotateAxis(Geometry=rotax.Geometry, Angle=number_slider_10, Axis=ln_2)  # -> Geometry, Transform
matrix_18 = TransformMatrix(c_script_19.T, Digits=3)

panel_6 = Panel("variable transform")
pt_9 = Point(Point(2.30996779, 6.426261852, 0))
pt_10 = Point(Point(5.712095009, 3.726722027, 0))
c_script_20 = CSharpScript(
    lengthX=Slider(8.76, range=0..10),
    lengthY=Slider(9.05, range=0..10),
    spansX=Slider(26, range=0..100),
    spansY=Slider(35, range=0..100),
    attractor=pt_9,
    spread=Slider(0.09, range=0..1),
    strength=Slider(0.88, range=-1..1),
    rotor=pt_10,
    scaleFactor=Slider(0.36, range=0..1))  # -> out, A, B; inputs lengthX: Double, lengthY: Double, spansX: Int32, spansY: Int32, attractor: Point3d, spread: Double, strength: Double, rotor: Point3d, scaleFactor: Double
# ---------- c_script_20: C# ----------
    List<Transform> transformsA = new List<Transform>();
    List<Transform> transformsB = new List<Transform>();

    double stepX = lengthX / spansX;
    double stepY = lengthY / spansY;

    Random rnd = new Random();

    for(int j = 0; j <= spansY; ++j) {
      for(int i = 0; i <= spansX; ++i) {

        Point3d p = new Point3d(i * stepX, j * stepY, 0.0);

        //.................attractor
        Vector3d dp = attractor - p;
        double dist = dp.Length;
        dp.Unitize();

        p += dp * strength * Math.Exp(-spread * dist * dist);


        //.................rotor
        Vector3d dpR = rotor - p;
        double distR = dpR.Length;
        dpR.Unitize();

        dpR.Rotate(Math.PI * 0.5, Vector3d.ZAxis);

        p += dpR * strength * Math.Exp(-spread * distR * distR);


        Transform move = Transform.Translation(p - Point3d.Origin);
        Transform scale = Transform.Scale(Plane.WorldXY, scaleFactor, scaleFactor, 0.2 + Math.Exp(-spread * distR * distR));

        double randomness = Math.Exp(-spread * distR * distR);
        Transform rotation = Transform.Rotation(rnd.NextDouble() * 6.28 * randomness, Vector3d.ZAxis, Point3d.Origin);

        Transform composite = move * rotation * scale;

        if ((i * j) % 2 == 0) {
          transformsA.Add(composite);
        }
        else {
          transformsB.Add(composite);
        }
      }
    }

    A = transformsA;
    B = transformsB;
# ---------- end c_script_20 ----------
geo_24 = Geometry(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)
transform_16 = Transform(Geometry=geo_24, Transform=c_script_20.A)

falloff = Slider(0.16, range=0..2)
panel_7 = Panel("grid with attractor")
pt_11 = Point(Point(2.30996779, 6.426261852, 0))
strength = Slider(0.87, range=-1..1)
c_script_21 = CSharpScript(
    lengthX=Slider(8.76, range=0..10),
    lengthY=Slider(9.05, range=0..10),
    spansX=Slider(14, range=0..100),
    spansY=Slider(13, range=0..100),
    attractor=pt_11,
    falloff=falloff,
    strength=strength)  # -> out, A, B; inputs lengthX: Double, lengthY: Double, spansX: Int32, spansY: Int32, attractor: Point3d, falloff: Double, strength: Double
# ---------- c_script_21: C# ----------
    List<Point3d> points = new List<Point3d>();
    List<Vector3d> vectors = new List<Vector3d>(); //this is only used to visualize the vectors

    double stepX = lengthX / spansX;
    double stepY = lengthY / spansY;

    for(int j = 0; j <= spansY; ++j) {
      for(int i = 0; i <= spansX; ++i) {
        Point3d p = new Point3d(i * stepX, j * stepY, 0.0);

        Vector3d dp = attractor - p;

        // vectors.Add(dp);   //this is only used to visualize the vectors
        double dist = dp.Length;
        dp.Unitize();

        // vectors.Add(dp);   //this is only used to visualize the vectors
        
        vectors.Add(dp * strength * Math.Exp(-falloff * dist * dist));  //this is only used to visualize the vectors
        
        p += dp * strength * Math.Exp(-falloff * dist * dist);


        points.Add(p);
      }
    }

    A = points;
    B = vectors;            //this is only used to visualize the vectors
# ---------- end c_script_21 ----------

panel_8 = Panel("grid construction")
c_script_22 = CSharpScript(
    lengthX=Slider(9.18, range=0..10),
    lengthY=Slider(7.8, range=0..10),
    spansX=Slider(26, range=0..100),
    spansY=Slider(21, range=0..100))  # -> out, A; inputs lengthX: Double, lengthY: Double, spansX: Int32, spansY: Int32
# ---------- c_script_22: C# ----------
    List<Point3d> points = new List<Point3d>();

    double stepX = lengthX / spansX;
    double stepY = lengthY / spansY;

    for(int j = 0; j <= spansY; ++j) {
      for(int i = 0; i <= spansX; ++i) {
        Point3d p = new Point3d(i * stepX, j * stepY, 0.0);
        points.Add(p);
      }
    }

    A = points;
# ---------- end c_script_22 ----------

# ----
# grid with attractor and rotor
number_slider_11 = Slider(26, range=0..100)
pt_12 = Point(Point(2.30996779, 6.426261852, 0))
pt_13 = Point(Point(5.712095009, 3.726722027, 0))
c_script_23 = CSharpScript(
    lengthX=Slider(8.76, range=0..10),
    lengthY=Slider(9.05, range=0..10),
    spansX=number_slider_11,
    spansY=Slider(35, range=0..100),
    attractor=pt_12,
    spread=Slider(0.16, range=0..1),
    strength=Slider(0.17, range=-1..1),
    rotor=pt_13)  # -> out, A, B; inputs lengthX: Double, lengthY: Double, spansX: Int32, spansY: Int32, attractor: Point3d, spread: Double, strength: Double, rotor: Point3d
# ---------- c_script_23: C# ----------
    List<Point3d> points = new List<Point3d>();
    List<Vector3d> vectors = new List<Vector3d>();//vector visualization

    double stepX = lengthX / spansX;
    double stepY = lengthY / spansY;

    for(int j = 0; j <= spansY; ++j) {
      for(int i = 0; i <= spansX; ++i) {
        Point3d p = new Point3d(i * stepX, j * stepY, 0.0);

        //.................attractor
        Vector3d dp = attractor - p;
        double dist = dp.Length;
        dp.Unitize();

        p += dp * strength * Math.Exp(-spread * dist * dist);


        //.................rotor
        Vector3d dpR = rotor - p;
        double distR = dpR.Length;
        dpR.Unitize();


        dpR.Rotate(Math.PI * 0.5, Vector3d.ZAxis);

        vectors.Add(dpR * strength * Math.Exp(-spread * distR * distR)); //vector visualization

        p += dpR * strength * Math.Exp(-spread * distR * distR);

        points.Add(p);
      }
    }

    A = points;
    B = vectors;//vector visualization
# ---------- end c_script_23 ----------

panel_9 = Panel("grid of transforms")
pt_14 = Point(Point(2.30996779, 6.426261852, 0))
pt_15 = Point(Point(5.712095009, 3.726722027, 0))
c_script_24 = CSharpScript(
    lengthX=Slider(8.76, range=0..10),
    lengthY=Slider(9.05, range=0..10),
    spansX=Slider(26, range=0..100),
    spansY=Slider(35, range=0..100),
    attractor=pt_14,
    spread=Slider(0.11, range=0..1),
    strength=Slider(-0.57, range=-1..1),
    rotor=pt_15,
    scaleFactor=Slider(0.18, range=0..1))  # -> out, A; inputs lengthX: Double, lengthY: Double, spansX: Int32, spansY: Int32, attractor: Point3d, spread: Double, strength: Double, rotor: Point3d, scaleFactor: Double
# ---------- c_script_24: C# ----------
    List<Transform> transforms = new List<Transform>();

    double stepX = lengthX / spansX;
    double stepY = lengthY / spansY;

    for(int j = 0; j <= spansY; ++j) {
      for(int i = 0; i <= spansX; ++i) {
        Point3d p = new Point3d(i * stepX, j * stepY, 0.0);

        //.................attractor
        Vector3d dp = attractor - p;
        double dist = dp.Length;
        dp.Unitize();

        p += dp * strength * Math.Exp(-spread * dist * dist);


        //.................rotor
        Vector3d dpR = rotor - p;
        double distR = dpR.Length;
        dpR.Unitize();

        dpR.Rotate(Math.PI * 0.5, Vector3d.ZAxis);

        p += dpR * strength * Math.Exp(-spread * distR * distR);


        Transform move = Transform.Translation(p - Point3d.Origin);
        Transform scale = Transform.Scale(Point3d.Origin, scaleFactor);

        Transform composite = move * scale;

        transforms.Add(composite);
      }
    }

    A = transforms;
# ---------- end c_script_24 ----------
geo_25 = Geometry(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)
transform_17 = Transform(Geometry=geo_25, Transform=c_script_24.A)

move_9 = Move(Geometry=geo_23, Motion=Vector(0, 0, 10))  # -> Geometry, Transform
matrix_19 = TransformMatrix(rotax.Transform, Digits=3)
matrix_20 = TransformMatrix(Digits=3)
geo_26 = Geometry(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)
preview_6 = CustomPreview(Geometry=transform_17, Shader=ColourSwatch(SwatchColor=RGB(151, 191, 176)))

panel_10 = Panel("""strength = 
falloff = """)
vdisex = VectorDisplayEx(Point=c_script_21.A, Vector=c_script_21.B, Colour=RGB(0, 0, 0), Width=1)
num = Number([strength, falloff])
concat = Concatenate(FragmentA=panel_10, FragmentB=num)
pt_16 = Point([Point(0.4612186222, -0.7102168915, 0), Point(0.4996616864, -1.382970515, 0)])
tag = TextTag3D(Location=pt_16, Text=concat, Size=Slider(0.36, range=0..1), Justification=7)

vdisex_2 = VectorDisplayEx(Point=c_script_23.A, Vector=c_script_23.B, Colour=[RGB(0, 0, 0), RGB(255, 0, 0)], Width=1)
transform_18 = Transform(Geometry=geo_26, Transform=c_script_20.B)
preview_7 = CustomPreview(Geometry=transform_16, Shader=ColourSwatch(SwatchColor=RGB(151, 191, 191)))

number_slider_12 = Slider(29, range=0..100)
number_slider_13 = Slider(29, range=0..100)

pt_17 = Point(Point(292.1382921, 398.7052112, 0))
pt_18 = Point(Point(282.0418644, 154.1630257, 0))
pt_19 = Point(Point(188.7854675, 222.631663, 0))

python = PythonScript()  # -> out, H
# ---------- python: Python ----------
import Rhino as r
import random
import rhinoscriptsyntax as rs
import copy
#r.Collections.Point3dList(Point3d(1,-1,0),Point3d(1,-1,0),Point3d(-1,1,0),Point3d(1,-1,0))


class House():
    
    def __init__(self,):
        
        self.basedPts = [[1,-1,0],[1,1,0],[-1,1,0],[-1,-1,0]]
        self.height = [1,2,3]
        self.baseLine = None
        self.walls = None
    
    def __repr__(self):
        return 'House Generator'
    
    def built(self):
        random.shuffle(self.basedPts)
        random.shuffle(self.height)
        self.baseLine = rs.AddPolyline(self.basedPts[:4])
        self.walls = rs.ExtrudeCurve(self.baseLine, rs.AddLine([0,0,0], [0,0,self.height[0]*0.5]))
        #rs.CopyObject(baseLine, [0,0,10])
        #upper = copy.deepcopy(self.baseLine[0])
        #upper = rs.MoveObject(upper,[0,0,self.height[0]])
        #self.baseLine.append(upper)
        #self.walls = rs.AddLoftSrf(self.baseLine)
        #r.Geometry.Transform.Translation(0,0,self.height[0])
        #return self.questions[str(q_index)]



H = House

#k = House
#k.built()
#a = k.walls
# ---------- end python ----------
c_script_25 = CSharpScript(
    xNum=number_slider_12,
    yNum=number_slider_13,
    xSpan=Slider(27.5, range=0..40),
    ySpan=Slider(27.9, range=0..40),
    height=Slider(-0.2, range=-10..10),
    attractors=pt_17,
    explosions=pt_19,
    rotors=pt_18,
    strength=Slider(0.8, range=-10..10),
    falloff=Slider(0.58, range=0..1),
    rotorStrength=Slider(3.1, range=-10..10),
    rotorsFalloff=Slider(1.46, range=0..3))  # -> out, P, V, T; inputs xNum: Int32, yNum: Int32, xSpan: Double, ySpan: Double, height: Double, attractors: list of Point3d, explosions: list of Point3d, rotors: list, strength: Double, falloff: Double, rotorStrength: Double, rotorsFalloff: Double
# ---------- c_script_25: C# ----------
    Rhino.Collections.RhinoList<Transform> trans = new Rhino.Collections.RhinoList<Transform>();
    Rhino.Collections.RhinoList<Vector3d> vecs = new Rhino.Collections.RhinoList<Vector3d>();
    Vector3d vec = new Vector3d(0, 0, 0);
    Point3dList pts = new Rhino.Collections.Point3dList();

    double xd = (double) xSpan / ((double) xNum - 1);
    double yd = (double) ySpan / ((double) yNum - 1);


    for(int j = 0 ; j < yNum ; j++){
      for(int i = 0 ; i < xNum ; i++){
        double z;
        Transform move = Transform.Translation(0, 0, 0);
        Transform scale;

        if( i % 2 == 0){
          z = height * Math.Sin(i);
        }else{
          z = height * Math.Cos(j);
        }
        Point3d pt = new Rhino.Geometry.Point3d(xd * i, yd * j, z);

        foreach(Point3d attPt in attractors){
          Vector3d v = Attractor(pt, attPt, strength * 0.8, falloff * 1.5);

          vec = v;
          pt += v;

        }

        foreach(Point3d explosion in explosions){
          Vector3d v = Attractor(pt, explosion, -strength, falloff);
         
          vec += v;
          pt += v;
         
        }

        foreach(Point3d rotor in rotors){
          Vector3d v = Rotor(pt, rotor, -rotorStrength, rotorsFalloff);
          vec += v;
          pt += v;
        }
        scale = Transform.Scale(Point3d.Origin, 1);

         move *= Transform.Translation((Vector3d) pt - (Vector3d) Point3d.Origin);
        Transform composite = move * scale;
        trans.Add(composite);
        //trans.Add(vec);
        //vec.Unitize();
        vecs.Add(vec);
        pts.Add(pt);
      }
    }




    P = pts;
    V = vecs;
    T = trans;
# ---------- c_script_25: C# additional code ----------
  private Vector3d Attractor(Point3d pt, Point3d attractor, double strength, double falloff){
    Vector3d v = attractor - pt;
    v.Unitize();
    double dist = v.Length;
    return(v * (strength * Math.Exp(-falloff * dist * dist)));
  }

  private Vector3d Rotor(Point3d pt, Point3d rotor, double strength, double falloff){
    Vector3d v = rotor - pt;
    v.Unitize();
    v.Rotate(3.141592 / 2, Vector3d.ZAxis);
    double dist = v.Length;
    return(v * (strength * (Math.Exp(-falloff * dist * dist))));
  }
# ---------- end c_script_25 ----------
python_2 = PythonScript(xNum=number_slider_12, yNum=number_slider_13, H=python.H)  # -> out, walls, a; inputs xNum: Int32, yNum: Int32
# ---------- python_2: Python ----------
import Rhino as r
import rhinoscriptsyntax as rs
outMesh = []


for i in range(xNum * yNum ):
    wall = H()
    wall.built()
    outMesh.append(r.Geometry.Mesh.CreateFromBrep(rs.coercebrep(wall.walls))[0])
    
walls = outMesh
a = walls[0]
# ---------- end python_2 ----------
panel_11 = Panel(c_script_25.out)
vdis_6 = VectorDisplay(Anchor=c_script_25.P, Vector=c_script_25.V)
transform_19 = Transform(Geometry=python_2.walls, Transform=c_script_25.T)
panel_12 = Panel(c_script_25.P)
panel_13 = Panel(python_2.walls)

preview_8 = CustomPreview(Geometry=transform_18, Shader=ColourSwatch(SwatchColor=RGB(151, 191, 191)))

crv_5 = Curve([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])
geo_27 = Geometry(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)

pt_20 = Point(Point(10.10322058, 2.616096673, 0))
pt_21 = Point(Point(9.736548611, 3.782997424, 0))
pt_22 = Point(Point(11.16651593, 3.217229453, 0))
# Harvard University
# Graduate School of Design
# Introduction to Computational Design (SCI 0633800)
# Fall 2015
# Prof. Panagiotis Michalatos
c_script_26 = CSharpScript(p0=pt_20, p1=pt_22, p2=pt_21)  # -> out, A, B, C; inputs p0: Point3d, p1: Point3d, p2: Point3d; same code as c_script_12
vdis_7 = VectorDisplay(Anchor=c_script_26.B, Vector=c_script_26.C)

# ---- group: Matric Calcuattion
geo_28 = Geometry([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])
pt_23 = Point(Point(11.16651593, 3.217229453, 0))
c_script_27 = CSharpScript(m=geo_28, scale=Slider(1.5, range=0..10), cen=pt_23, rot=Slider(10, range=0..10))  # -> out, A; inputs m: Mesh, scale: Double, cen: Point3d, rot: Double; same code as c_script_15
panel_14 = Panel(c_script_27.out)

# ----
# draws a recursive curve by substituting each line segment with a transformed version of the whole set again and again
c_recursive_curve_3 = CSharpScript(c=crv_5, g=geo_27, iter=Slider(3, range=0..8))  # -> out, A; inputs c: list of Curve, g: GeometryBase, iter: Int32
# ---------- c_recursive_curve_3: C# ----------
    List<Transform> xfs = new List<Transform>();

    foreach(Curve cc in c) {
      Transform tf = TransformFrom2Points(cc.PointAtStart, cc.PointAtEnd);
      xfs.Add(tf);
    }

    //List<GeometryBase> geomoutput = new List<GeometryBase>();
    List<GeometryBase> g0 = new List<GeometryBase>();
    List<GeometryBase> g1 = new List<GeometryBase>();

    g0.Add(g);
    //geomoutput.Add(g);

    int i;

    for(i = 0; i < iter; ++i) {
      foreach(GeometryBase geom in g0) {
        foreach(Transform f in xfs) {
          GeometryBase gcopy = geom.Duplicate();
          gcopy.Transform(f);
          g1.Add(gcopy);
        }
      }
      //geomoutput.AddRange(g1);

      List<GeometryBase> gtemp = g1;
      g1 = g0;
      g0 = gtemp;

      g1.Clear();
    }


    A = g0;
# ---------- c_recursive_curve_3: C# additional code ----------
  Transform TransformFrom2Points(Point3d p0, Point3d p1) {

    Transform xform = Transform.Identity;

    Vector3d v1 = p1 - p0;
    Vector3d v3 = new Vector3d(0.0, 0.0, 1.0);

    Vector3d v2 = Vector3d.CrossProduct(v3, v1);

    v3 = Vector3d.CrossProduct(v1, v2);

    double L = v1.Length;

    v2.Unitize();
    v3.Unitize();

    v2 *= L;
    v3 *= L;


    xform.M00 = v1.X;
    xform.M10 = v1.Y;
    xform.M20 = v1.Z;

    xform.M01 = v2.X;
    xform.M11 = v2.Y;
    xform.M21 = v2.Z;

    xform.M02 = v3.X;
    xform.M12 = v3.Y;
    xform.M22 = v3.Z;

    xform.M03 = p0.X;
    xform.M13 = p0.Y;
    xform.M23 = p0.Z;

    return xform;
  }
# ---------- end c_recursive_curve_3 ----------

preview_9 = CustomPreview(
    Geometry=c_recursive_curve_3.A,
    Shader={diffuse=RGB(0, 0, 0), emission=RGB(76, 32, 54), shine=0.5, specular=RGB(255, 255, 255), transparency=0})

crv_6 = Curve(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)
py3 = Python3Script()  # -> out, a; unedited script template
c_script_28 = CSharpScript(
    c1=crv_6,
    pfov=Slider(32.267, range=0..71),
    pratio=Slider(0.933, range=0..3),
    near=Slider(5.379, range=0..23),
    far=Slider(55.367, range=0..71))  # -> out, ViewMatrix, ProjectionMatrix, VP_Matrix, VP_Inverse_Matrix; inputs c1: Curve, pfov: Double, pratio: Double, near: Double, far: Double
# ---------- c_script_28: C# ----------
    //.....................................Projector transform

    Point3d vp1 = c1.PointAtStart;
    Point3d tp1 = c1.PointAtEnd;

    Transform mv = LookAt(vp1, tp1, Vector3d.ZAxis);
    Transform mp = Perspective(pfov, pratio, near, far);

    Transform mpv = mp * mv;

    Transform mpvInv;
    mpv.TryGetInverse(out mpvInv);

    ViewMatrix = mv;
    ProjectionMatrix = mp;
    VP_Matrix = mpv;
    VP_Inverse_Matrix = mpvInv;
# ---------- c_script_28: C# additional code ----------
  public Transform LookAt(Point3d vp, Point3d tp, Vector3d up) {
    Vector3d za = vp - tp;
    Vector3d ya = up;
    Vector3d xa = Vector3d.CrossProduct(ya, za);
    xa.Unitize();
    ya = Vector3d.CrossProduct(za, xa);
    ya.Unitize();
    za.Unitize();

    Transform vm = Transform.Identity;

    vm.M00 = xa.X;
    vm.M01 = xa.Y;
    vm.M02 = xa.Z;

    vm.M10 = ya.X;
    vm.M11 = ya.Y;
    vm.M12 = ya.Z;

    vm.M20 = za.X;
    vm.M21 = za.Y;
    vm.M22 = za.Z;

    vm = vm * Transform.Translation(-vp.X, -vp.Y, -vp.Z);

    return vm;
  }

  public Transform Perspective(double ifov, double iaspect, double inear, double ifar)
  {
    double f_mul = 1.0 / Math.Tan((0.5 * ifov * Math.PI) / 180.0);

    Transform pm = Transform.Identity;

    pm.M00 = f_mul / iaspect;
    pm.M01 = 0.0;
    pm.M02 = 0.0;
    pm.M03 = 0.0;

    pm.M10 = 0.0;
    pm.M11 = f_mul;
    pm.M12 = 0.0;
    pm.M13 = 0.0;

    pm.M20 = 0.0;
    pm.M21 = 0.0;
    pm.M22 = (ifar + inear) / (inear - ifar);
    pm.M23 = -1.0;

    pm.M30 = 0.0;
    pm.M31 = 0.0;
    pm.M32 = (2.0 * ifar * inear) / (inear - ifar);
    pm.M33 = 0.0;

    return pm.Transpose();
  }

  public Transform PointShadow(Point3d sp)
  {
    Transform pm = Transform.Identity;

    pm.M00 = sp.Z;
    pm.M01 = 0.0;
    pm.M02 = 0.0;
    pm.M03 = 0.0;

    pm.M10 = 0.0;
    pm.M11 = sp.Z;
    pm.M12 = 0.0;
    pm.M13 = 0.0;

    pm.M20 = -sp.X;
    pm.M21 = -sp.Y;
    pm.M22 = 0.0;
    pm.M23 = -1.0;

    pm.M30 = 0.0;
    pm.M31 = 0.0;
    pm.M32 = 0.0;
    pm.M33 = sp.Z;

    return pm.Transpose();
  }
# ---------- end c_script_28 ----------
geo_29 = Geometry([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])
geo_unitcube_3 = Geometry([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])
c_script_29 = CSharpScript()  # -> out, A; same code as c_script_4
panel_15 = Panel(c_script_29.A)
rotate_7 = Rotate(Geometry=geo_29, Angle=Slider(0, range=0..10), Plane=PlaneXY(-44.43518948, 45.36928856, 2.493039686))  # -> Geometry, Transform
transform_20 = Transform(Geometry=rotate_7.Geometry, Transform=c_script_28.VP_Matrix)
transform_21 = Transform(Geometry=geo_unitcube_3, Transform=c_script_28.VP_Inverse_Matrix)

# ---- group: TRANSLATION
number_slider_14 = Slider(10, range=-10..10)
number_slider_15 = Slider(9.59, range=-10..10)
number_slider_16 = Slider(10, range=-10..10)
vec = VectorXYZ(XComponent=number_slider_14, YComponent=number_slider_16, ZComponent=number_slider_15)  # -> Vector, Length
move_10 = Move(Motion=vec.Vector)  # -> Geometry, Transform
matrix_21 = TransformMatrix(move_10.Transform, Digits=3)

# ---- group: SCALING
number_slider_17 = Slider(1.5, range=-10..10)
number_slider_18 = Slider(6.57, range=-10..10)
number_slider_19 = Slider(0.89, range=-10..10)
scale_nu = ScaleNU(Plane=PlaneXY(0, 0, 0), ScaleX=number_slider_18, ScaleY=number_slider_17, ScaleZ=number_slider_19)  # -> Geometry, Transform
matrix_22 = TransformMatrix(scale_nu.Transform, Digits=3)

# ---- group: ROTATION AROUND Y AXIS
Y_4 = UnitY(Factor=1)
rot3d = Rotate3D(Angle=Slider(0, range=0..6.28), Center=Point(0, 0, 0), Axis=Y_4)  # -> Geometry, Transform
matrix_23 = TransformMatrix(rot3d.Transform, Digits=3)

# ---- group: ROTATION AROUND X AXIS
X_10 = UnitX(Factor=1)
pi = Pi(Factor=Slider(0, range=0..1))
rot3d_2 = Rotate3D(Angle=pi, Center=Point(0, 0, 0), Axis=X_10)  # -> Geometry, Transform
matrix_24 = TransformMatrix(rot3d_2.Transform, Digits=3)

# ---- group: ROTATION AROUND Z AXIS
Z = UnitZ(Factor=1)
rot3d_3 = Rotate3D(Angle=Slider(0, range=0..6.28), Center=Point(0, 0, 0), Axis=Z)  # -> Geometry, Transform
matrix_25 = TransformMatrix(rot3d_3.Transform, Digits=3)

# ---- group: Obj
geo_30 = Geometry(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)

# ----
geo_31 = Geometry(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)
geo_32 = Geometry(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)
transform_22 = Transform(Geometry=geo_31, Transform=matrix_24)
py3_2 = Python3Script(O=geo_30, mat=matrix_21)  # -> out, a
# ---------- py3_2: Python ----------
"""Grasshopper Script"""
a = "Hello Python 3 in Grasshopper!"
print(a)


import rhinoscriptsyntax as rs

a = rs.TransformObject(O, mat)
# ---------- end py3_2 ----------
transform_23 = Transform(Geometry=geo_30, Transform=matrix_21)
c_script_30 = CSharpScript(O=geo_30, mat=matrix_21)  # -> out, a; inputs O: GeometryBase, mat: Transform
# ---------- c_script_30: C# ----------
// Grasshopper Script Instance
#region Usings
using System;
using System.Linq;
using System.Collections;
using System.Collections.Generic;
using System.Drawing;

using Rhino;
using Rhino.Geometry;

using Grasshopper;
using Grasshopper.Kernel;
using Grasshopper.Kernel.Data;
using Grasshopper.Kernel.Types;
#endregion

public class Script_Instance : GH_ScriptInstance
{
    private void RunScript(GeometryBase O, Transform mat, ref object a)
    {

        O.Transform(mat);
        a = O;
    }
}
# ---------- end c_script_30 ----------
py3_3 = Python3Script(O=geo_31, xRot=matrix_24, yRot=matrix_23, zRot=matrix_25)  # -> out, a
# ---------- py3_3: Python ----------
"""Grasshopper Script"""
a = "Hello Python 3 in Grasshopper!"
print(a)


import rhinoscriptsyntax as rs

mat = xRot * yRot * zRot

a = rs.TransformObject(O, mat)
# ---------- end py3_3 ----------
c_script_31 = CSharpScript(O=geo_30, x=number_slider_14, y=number_slider_16, z=number_slider_15)  # -> out, a; inputs O: GeometryBase, x: Double, y: Double, z: Double
# ---------- c_script_31: C# ----------
// Grasshopper Script Instance
#region Usings
using System;
using System.Linq;
using System.Collections;
using System.Collections.Generic;
using System.Drawing;

using Rhino;
using Rhino.Geometry;

using Grasshopper;
using Grasshopper.Kernel;
using Grasshopper.Kernel.Data;
using Grasshopper.Kernel.Types;
#endregion

public class Script_Instance : GH_ScriptInstance
{
    #region Notes
    /* 
      Members:
        RhinoDoc RhinoDocument
        GH_Document GrasshopperDocument
        IGH_Component Component
        int Iteration

      Methods (Virtual & overridable):
        Print(string text)
        Print(string format, params object[] args)
        Reflect(object obj)
        Reflect(object obj, string method_name)
    */
    #endregion

    private void RunScript(
	GeometryBase O,
	double x,
	double y,
	double z,
	ref object a)
    {

;

        Transform xform = Transform.Identity;

        xform.M03 = x + x;
        xform.M13 = y + y;
        xform.M23 = z + z;

        Print(xform.ToString());
        O.Transform(xform);
        
        a = O;
    }
}
# ---------- end c_script_31 ----------
transform_24 = Transform(Geometry=geo_31, Transform=matrix_23)
transform_25 = Transform(Geometry=geo_32, Transform=matrix_22)
py3_4 = Python3Script(O=geo_32, xS=number_slider_18, yS=number_slider_17, zS=number_slider_19)  # -> out, a; inputs xS: Double, yS: Double, zS: Double
# ---------- py3_4: Python ----------
"""Grasshopper Script"""
a = "Hello Python 3 in Grasshopper!"
print(a)


import rhinoscriptsyntax as rs

scale_matrix = rs.XformScale([xS, yS, zS])

mat = rs.XformIdentity()

mat = rs.XformMultiply(mat, scale_matrix)

a = rs.TransformObject(O, mat)
# ---------- end py3_4 ----------
c_script_32 = CSharpScript(O=geo_32, x=number_slider_18, y=number_slider_17, z=number_slider_19)  # -> out, a; inputs O: GeometryBase, x: Double, y: Double, z: Double
# ---------- c_script_32: C# ----------
// Grasshopper Script Instance
#region Usings
using System;
using System.Linq;
using System.Collections;
using System.Collections.Generic;
using System.Drawing;

using Rhino;
using Rhino.Geometry;

using Grasshopper;
using Grasshopper.Kernel;
using Grasshopper.Kernel.Data;
using Grasshopper.Kernel.Types;
#endregion

public class Script_Instance : GH_ScriptInstance
{
    #region Notes
    /* 
      Members:
        RhinoDoc RhinoDocument
        GH_Document GrasshopperDocument
        IGH_Component Component
        int Iteration

      Methods (Virtual & overridable):
        Print(string text)
        Print(string format, params object[] args)
        Reflect(object obj)
        Reflect(object obj, string method_name)
    */
    #endregion

    private void RunScript(
	GeometryBase O,
	double x,
	double y,
	double z,
	ref object a)
    {

;

        Transform xform = Transform.Identity;

        xform.M00 = x;
        xform.M11 = y;
        xform.M22 = z;

        Print(xform.ToString());
        O.Transform(xform);
        
        a = O;
    }
}
# ---------- end c_script_32 ----------
transform_26 = Transform(Geometry=geo_31, Transform=matrix_25)
geo_33 = Geometry(transform_22)
geo_34 = Geometry(transform_23)
geo_35 = Geometry(transform_24)
panel_16 = Panel(c_script_31.out)
geo_36 = Geometry(transform_25)
geo_37 = Geometry(py3_4.a)
panel_17 = Panel(c_script_32.out)
geo_38 = Geometry(transform_26)
geo_39 = Geometry(py3_3.a)

# ---- group: ROTATION AROUND X AXIS
pi_2 = Pi(Factor=Slider(0.059, range=0..1))
X_11 = UnitX(Factor=1)
rot3d_4 = Rotate3D(Angle=pi_2, Center=Point(0, 0, 0), Axis=X_11)  # -> Geometry, Transform
matrix_26 = TransformMatrix(rot3d_4.Transform, Digits=3)

# ----
pi_3 = Pi(Factor=Slider(0.234, range=0..1))
Z_2 = UnitZ(Factor=1)
rot3d_5 = Rotate3D(Angle=pi_3, Center=Point(0, 0, 0), Axis=Z_2)  # -> Geometry, Transform
matrix_27 = TransformMatrix(rot3d_5.Transform, Digits=3)

scale_nu_2 = ScaleNU(
    Plane=PlaneXY(0, 0, 0),
    ScaleX=Slider(1, range=-10..10),
    ScaleY=Slider(5.3, range=-10..10),
    ScaleZ=Slider(4.05, range=-10..10))  # -> Geometry, Transform
matrix_28 = TransformMatrix(scale_nu_2.Transform, Digits=3)

pi_4 = Pi(Factor=Slider(0.504, range=0..1))
Y_5 = UnitY(Factor=1)
rot3d_6 = Rotate3D(Angle=pi_4, Center=Point(0, 0, 0), Axis=Y_5)  # -> Geometry, Transform
matrix_29 = TransformMatrix(rot3d_6.Transform, Digits=3)

# ---- group: TRANSLATION
vec_2 = VectorXYZ(XComponent=Slider(1.29, range=-10..10), YComponent=Slider(-0.3, range=-10..10), ZComponent=Slider(-0.33, range=-10..10))  # -> Vector, Length
move_11 = Move(Motion=vec_2.Vector)  # -> Geometry, Transform
matrix_30 = TransformMatrix(move_11.Transform, Digits=3)

# ----
geo_40 = Geometry(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)
comp = Compound(Transforms=[matrix_26, matrix_29, matrix_27, matrix_30])
comp_2 = Compound(Transforms=[matrix_30, matrix_26, matrix_29, matrix_27, matrix_28])
comp_3 = Compound(Transforms=[matrix_28, matrix_30, matrix_26, matrix_29, matrix_27])
transform_27 = Transform(Geometry=geo_40, Transform=comp_2)
transform_28 = Transform(Geometry=geo_40, Transform=comp)
transform_29 = Transform(Geometry=geo_40, Transform=comp_3)

# ---- group: SCALING
scale_nu_3 = ScaleNU(
    Plane=PlaneXY(0, 0, 0),
    ScaleX=Slider(1, range=-10..10),
    ScaleY=Slider(2, range=-10..10),
    ScaleZ=Slider(3, range=-10..10))  # -> Geometry, Transform
matrix_31 = TransformMatrix(scale_nu_3.Transform, Digits=3)

# ---- group: TRANSLATION
vec_3 = VectorXYZ(XComponent=Slider(1.29, range=-10..10), YComponent=Slider(-0.3, range=-10..10), ZComponent=Slider(-0.33, range=-10..10))  # -> Vector, Length
move_12 = Move(Motion=vec_3.Vector)  # -> Geometry, Transform
matrix_32 = TransformMatrix(move_12.Transform, Digits=3)

# ---- group: ROTATION AROUND X AXIS
pi_5 = Pi(Factor=Slider(0.333, range=0..1))
X_12 = UnitX(Factor=1)
rot3d_7 = Rotate3D(Angle=pi_5, Center=Point(0, 0, 0), Axis=X_12)  # -> Geometry, Transform
matrix_33 = TransformMatrix(rot3d_7.Transform, Digits=3)

# ---- group: ROTATION AROUND Y AXIS
pi_6 = Pi(Factor=Slider(0.333, range=0..1))
Y_6 = UnitY(Factor=1)
rot3d_8 = Rotate3D(Angle=pi_6, Center=Point(0, 0, 0), Axis=Y_6)  # -> Geometry, Transform
matrix_34 = TransformMatrix(rot3d_8.Transform, Digits=3)

# ---- group: ROTATION AROUND Z AXIS
pi_7 = Pi(Factor=Slider(0.333, range=0..1))
Z_3 = UnitZ(Factor=1)
rot3d_9 = Rotate3D(Angle=pi_7, Center=Point(0, 0, 0), Axis=Z_3)  # -> Geometry, Transform
matrix_35 = TransformMatrix(rot3d_9.Transform, Digits=3)

# ----
geo_41 = Geometry(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)

# ---- group: TRANSLATE + ROTATE Z
comp_4 = Compound(Transforms=[move_12.Transform, rot3d_9.Transform])
transform_30 = Transform(Geometry=geo_41, Transform=comp_4)

# ---- group: ROTATE Z + TRANSLATE
comp_5 = Compound(Transforms=[rot3d_9.Transform, move_12.Transform])
transform_31 = Transform(Geometry=geo_41, Transform=comp_5)

# ---- group: ROTATE X,Y,Z + TRANSLATE
comp_6 = Compound(Transforms=[rot3d_7.Transform, rot3d_8.Transform, rot3d_9.Transform, move_12.Transform])
transform_32 = Transform(Geometry=geo_41, Transform=comp_6)

comp_7 = Compound(Transforms=[move_12.Transform, rot3d_7.Transform, rot3d_8.Transform, rot3d_9.Transform])
transform_33 = Transform(Geometry=geo_41, Transform=comp_7)

# ---- group: TRANSLATE + SCALE
comp_8 = Compound(Transforms=[move_12.Transform, scale_nu_3.Transform])
transform_34 = Transform(Geometry=geo_41, Transform=comp_8)

# ---- group: TRANSLATE
comp_9 = Compound(Transforms=move_12.Transform)
transform_35 = Transform(Geometry=geo_41, Transform=comp_9)

# ---- group: SCALE + TRANSLATE
comp_10 = Compound(Transforms=[scale_nu_3.Transform, move_12.Transform])
transform_36 = Transform(Geometry=geo_41, Transform=comp_10)

# ----
matrix_36 = TransformMatrix(comp_6, Digits=3)
matrix_37 = TransformMatrix(comp_7, Digits=3)
matrix_38 = TransformMatrix(comp_9, Digits=3)
matrix_39 = TransformMatrix(comp_4, Digits=3)
matrix_40 = TransformMatrix(comp_5, Digits=3)
matrix_41 = TransformMatrix(comp_10, Digits=3)
matrix_42 = TransformMatrix(comp_8, Digits=3)
