# Grasshopper definition LAB_04_CoordinateSystem.gh (Grasshopper 1.0.8)
# plug-ins: RhinoCodePluginGH

py3 = Python3Script(x=Slider(10, range=0..10), y=Slider(10, range=0..10))  # -> out, a; inputs x: Int32, y: Int32
# ---------- py3: Python ----------
import rhinoscriptsyntax as rs
pts = []
for j in range(y):
    for i in range(x):
        p = rs.AddPoint(i, j)
        pts.append(p)

a = pts
# ---------- end py3 ----------
py3_2 = Python3Script(x=Slider(10, range=0..10), y=Slider(10, range=0..10))  # -> out, a; inputs x: Int32, y: Int32
# ---------- py3_2: Python ----------
import rhinoscriptsyntax as rs



isocurve = []
for j in range(y):
    pts = []
    for i in range(x):
        p = rs.AddPoint(i, j)
        pts.append(p)
    isocurve.append(rs.AddInterpCurve(pts))

for j in range(y):
    pts = []
    for i in range(x):
        p = rs.AddPoint(j, i)
        pts.append(p)
    isocurve.append(rs.AddInterpCurve(pts))


a = isocurve
# ---------- end py3_2 ----------
py3_3 = Python3Script(x=Slider(10, range=0..10), y=Slider(10, range=0..10))  # -> out, a; inputs x: Int32, y: Int32
# ---------- py3_3: Python ----------
import math


def toPolarProjection(r, theta):
    x = r * math.cos(theta * math.pi / 180)
    y = r * math.sin(theta * math.pi / 180)
    return x, y



import rhinoscriptsyntax as rs
pts = []
for j in range(y):
    for i in range(x):
        pos = toPolarProjection(i,j * 36)
        p = rs.AddPoint(pos[0], pos[1])
        pts.append(p)


a = pts
# ---------- end py3_3 ----------
py3_4 = Python3Script(x=Slider(10, range=0..10), y=Slider(10, range=0..10))  # -> out, a, b; inputs x: Int32, y: Int32
# ---------- py3_4: Python ----------
import math

def toPolarProjection(r, theta):
    x = r * math.cos(theta * math.pi / 180)
    y = r * math.sin(theta * math.pi / 180)
    return x, y



import rhinoscriptsyntax as rs

interval = 360 / (y-1)

grid = []
for j in range(y):
    pts = []
    for i in range(x):
        pos = toPolarProjection(i,j * interval)
        p = rs.AddPoint(pos[0], pos[1])
        pts.append(p)
    grid.append(pts)



horizontalCurves = []
for row in grid:
    curve = rs.AddInterpCurve(row)  
    horizontalCurves.append(curve)

verticalCurves = []
for col_idx in range(x):
    col_points = [grid[row_idx][col_idx] for row_idx in range(y)]  
    curve = rs.AddInterpCurve(col_points)
    verticalCurves.append(curve)


a = horizontalCurves + verticalCurves
# ---------- end py3_4 ----------
py3_5 = Python3Script(x=Slider(10, range=0..10), y=Slider(10, range=0..10), z=Slider(1.5, range=0.2..1.5))  # -> out, a; inputs x: Int32, y: Int32
# ---------- py3_5: Python ----------
import rhinoscriptsyntax as rs
import math

def toEllipticalSpace(x, y, z):
    a = x  
    b = x * z  
    rad_angle = math.radians(y)  
    x_pos = a * math.cos(rad_angle)
    y_pos = b * math.sin(rad_angle)
    return (x_pos, y_pos)


interval = 360 / (y-1)
grid = []

for j in range(y):
    pts = []
    for i in range(x):
        pos = toEllipticalSpace(i, j * interval, z)  
        p = rs.AddPoint(pos[0], pos[1], 0)
        pts.append(p)
    grid.append(pts)


horizontalCurves = []
for row in grid:
    curve = rs.AddInterpCurve(row)  
    horizontalCurves.append(curve)

verticalCurves = []
for col_idx in range(x):
    col_points = [grid[row_idx][col_idx] for row_idx in range(y)]  
    curve = rs.AddInterpCurve(col_points)
    verticalCurves.append(curve)


a = horizontalCurves + verticalCurves
# ---------- end py3_5 ----------
py3_6 = Python3Script(x=Slider(10, range=0..10), y=Slider(10, range=0..10), z=Slider(10, range=0..10))  # -> out, a; inputs x: Int32, y: Int32, z: Int32
# ---------- py3_6: Python ----------
import math
import rhinoscriptsyntax as rs

def toCylindricalProjection(r, theta, z):
    x = r * math.cos(math.radians(theta))
    y = r * math.sin(math.radians(theta))
    return x, y, z

radius = y

intervalY = 360 / (x-1)
intervalZ = 10 / (z-1)

points = []  
grid = []   

for j in range(z):
    zVal = j * intervalZ
    row = []
    for i in range(x): 
        theta = i * intervalY
        pos = toCylindricalProjection(radius, theta, zVal) 
        p = rs.AddPoint(pos[0], pos[1], pos[2])  
        points.append(p)
        row.append(p) 
    grid.append(row)  


def getIsocurve():
    horizontal_curves = []
    for row in grid:
        curve = rs.AddInterpCurve(row, degree=1)  
        horizontal_curves.append(curve)

    vertical_curves = []
    for col_idx in range(x):
        col_points = [grid[row_idx][col_idx] for row_idx in range(z)]  
        curve = rs.AddInterpCurve(col_points, degree=1) 
        vertical_curves.append(curve)
    return horizontal_curves + vertical_curves

a = getIsocurve()
# ---------- end py3_6 ----------
panel = Panel("Seoul: 37.5503° N, 126.9971° E")
srf = Surface(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)
srf_2 = Surface(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)
srf_3 = Surface(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)
py3_7 = Python3Script(x=Slider(19, range=5..50), y=Slider(40, range=5..50), z=Slider(14, range=0..20))  # -> out, a; inputs x: Int32, y: Int32, z: Int32
# ---------- py3_7: Python ----------
import math
import rhinoscriptsyntax as rs

def toSphericalProjection(lng, lat, elevation):
    lngRad = math.radians(lng)
    latRad = math.radians(lat)
    return [
        elevation * math.sin(latRad) * math.cos(lngRad),
        elevation * math.sin(latRad) * math.sin(lngRad),
        elevation * math.cos(latRad)
    ]


intervalX = 360 / (x - 1)
intervalY = 180 / (y - 1)
radius = z      

points = []
grid = []

for j in range(y): 
    lat = j * intervalY
    row = []  
    for i in range(x): 
        theta = i * intervalX 
        pos = toSphericalProjection(theta, lat, radius)  
        p = rs.AddPoint(pos[0], pos[1], pos[2])  
        points.append(p)
        row.append(p)  
    grid.append(row)  


def getIsocurve():
    isocurves = []
    for row in grid:
        curve = rs.AddInterpCurve(row, degree=3)  
        isocurves.append(curve)
    for col_idx in range(x):
        col_points = [grid[row_idx][col_idx % len(grid[row_idx])] for row_idx in range(len(grid))]
        curve = rs.AddInterpCurve(col_points, degree=1)  
        isocurves.append(curve)
    return isocurves

a = getIsocurve()
# ---------- end py3_7 ----------
py3_8 = Python3Script(x=Slider(38, range=-180..180), y=Slider(-4, range=-90..90), z=Slider(16, range=-10..100))  # -> out, a; inputs x: Int32, y: Int32, z: Int32
# ---------- py3_8: Python ----------
import math
import rhinoscriptsyntax as rs

def toSphericalProjection(lng, lat, elevation):
    lngRad = math.radians(lng)
    latRad = math.radians(lat)
    return [
        elevation * math.sin(latRad) * math.cos(lngRad),
        elevation * math.sin(latRad) * math.sin(lngRad),
        elevation * math.cos(latRad)
    ]




p0 = toSphericalProjection(x, 90 - y, 0)
p1 = toSphericalProjection(x, 90 - y, z)

print(p0, p1)

a = rs.AddLine(p0, p1)
# ---------- end py3_8 ----------
c_script = CSharpScript(sur=[srf_3, srf, srf_2], x=Slider(126.997, range=-180..180), y=Slider(37.55, range=-90..90), z=Slider(10, range=-10..10))  # -> out, a; inputs sur: Surface, x: Double, y: Double, z: Double
# ---------- c_script: C# ----------
// Grasshopper Script Instance
#region Usings
using System;
using System.Linq;
using System.Collections;
using System.Collections.Generic;
using System.Drawing;

using Rhino;
using Rhino.Geometry;

using Grasshopper;
using Grasshopper.Kernel;
using Grasshopper.Kernel.Data;
using Grasshopper.Kernel.Types;
#endregion

public class Script_Instance : GH_ScriptInstance
{

    private void RunScript(Surface sur, double x, double y, double z, ref object a)
    {
       
        Interval domainU = sur.Domain(0);
        double interU =  (domainU.Max - domainU.Min) / 360;

        Interval domainV = sur.Domain(1);
        double interV =  (domainV.Max - domainV.Min) / 180;

        Plane plane;
        if (sur.FrameAt(interU * (x + 180), interV * (y + 90), out plane)) {
            Vector3d norV = plane.Normal;
            Point3d p0 = new Point3d(plane.Origin);
            Point3d p1 = p0 + (norV * z);

            Line ln = new Line(p0,p1);
            a = ln;
        }

     
    }
}
# ---------- end c_script ----------
# https://namjulee.github.io/njs-lab-public/lab/visualization-design-data-vr-ar-mr/projection?ui=0
pipe = Pipe(Curve=py3_8.a, Radius=1, Caps=0)
