# Grasshopper definition LAB_05_PlaneRhinoAPI.gh (Grasshopper 1.0.8)

pt = Point(Point(9.874593642, 13.72218407, 0))
pt_2 = Point(Point(9.874593642, 13.72218407, 0))
Y = UnitY(Factor=1)
Z = UnitZ(Factor=1)
srf = Surface(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)
pt_3 = Point(Point(25.20875933, 8.090567581, 7.932401765))
pt_4 = Point(pt_3)
pt_5 = Point(pt_3)
pt_6 = Point(Point(18.2266124, 16.51253579, 12.54585457))
pt_7 = Point(pt_6)
pt_8 = Point(pt_6)
pt_9 = Point(pt_6)
pt_10 = Point(pt_3)
python = GhPythonScript(O=pt)  # -> out, P; inputs O: Point3d
# ---------- python: Python ----------
import rhinoscriptsyntax as rs


xAxis = O + rs.CreateVector(1, 0, 0)
yAxis = O + rs.CreateVector(0, 0, 1)
P =rs.PlaneFromPoints(O, xAxis, yAxis)
# ---------- end python ----------
python_2 = GhPythonScript(O=pt)  # -> out, P; inputs O: Point3d
# ---------- python_2: Python ----------
import Rhino as r

xDir = r.Geometry.Vector3d(1, 0, 0)
yDir = r.Geometry.Vector3d(0, 0, 1)
P = r.Geometry.Plane(O, xDir, yDir)
# ---------- end python_2 ----------
c_script = CSharpScript(O=pt)  # -> out, P; inputs O: Point3d
# ---------- c_script: C# ----------
    P = new Rhino.Geometry.Plane(O, new Vector3d(1, 0, 0), new Vector3d(0, 0, 1));
# ---------- end c_script ----------
xz = XZPlane(Origin=pt)
pl = ConstructPlane(Origin=pt_2, XAxis=Y, YAxis=Z)
xy = XYPlane(Origin=pt_2)
yz = YZPlane(Origin=pt_2)
subtraction = Subtraction(A=pt_8, B=pt_5)
subtraction_2 = Subtraction(A=pt_9, B=pt_10)
pt_11 = Point(Point(68.99001616, 36.59718416, 22.1528462))
pt_12 = Point(pt_11)
pt_13 = Point(pt_11)
pt_14 = Point(pt_11)
subtraction_3 = Subtraction(A=pt_14, B=pt_10)
subtraction_4 = Subtraction(A=pt_13, B=pt_5)
c_script_2 = CSharpScript(O=pt_4, X=pt_12, Y=pt_7)  # -> out, Pl; inputs O: Point3d, X: Vector3d, Y: Vector3d
# ---------- c_script_2: C# ----------
    Vector3d xAxis = X - (Vector3d) O;
    Vector3d yAxis = Y - (Vector3d) O;

    xAxis.Unitize();
    yAxis.Unitize();

    Plane plane = new Rhino.Geometry.Plane(O, xAxis, yAxis);

    Pl = plane;
# ---------- end c_script_2 ----------
unit = UnitVector(Vector=subtraction)
unit_2 = UnitVector(Vector=subtraction_4)
panel = Panel(subtraction_3)
cir = Circle(Plane=xz, Radius=Slider(3, range=0..10))
pl_2 = ConstructPlane(Origin=pt_3, XAxis=pt_11, YAxis=pt_6)
cir_2 = Circle(Plane=c_script.P, Radius=Slider(3, range=0..10))
cir_3 = Circle(Plane=python.P, Radius=Slider(3, range=0..10))
cir_4 = Circle(Plane=python_2.P, Radius=Slider(3, range=0..10))
pl_3 = ConstructPlane(Origin=pt_10, XAxis=subtraction_3, YAxis=subtraction_2)
panel_2 = Panel(unit_2)
pl_4 = ConstructPlane(Origin=pt_5, XAxis=unit_2, YAxis=unit)
data = Data(xz)
data_2 = Data(c_script.P)
data_3 = Data(python_2.P)
data_4 = Data(python.P)
python_3 = GhPythonScript(P=data_4)  # -> out, O, X, Y, Z
# ---------- python_3: Python ----------
O = P.Origin

X = P.XAxis
Y = P.YAxis
Z = P.ZAxis
# ---------- end python_3 ----------
deplane = DeconstructPlane(Plane=data)  # -> Origin, XAxis, YAxis, ZAxis
c_script_3 = CSharpScript(P=data_2)  # -> out, O, X, Y, Z; inputs P: Plane
# ---------- c_script_3: C# ----------
    
    O = P.Origin;
    X = P.XAxis;
    Y = P.YAxis;
    Z = P.ZAxis;
# ---------- end c_script_3 ----------
python_4 = GhPythonScript(P=data_3)  # -> out, O, X, Y, Z; same code as python_3
c_script_4 = CSharpScript(P=c_script_2.Pl, X=Slider(20, range=0..100), Y=Slider(20, range=0..100))  # -> out, A; inputs P: Plane, X: Double, Y: Double, R: Double
# ---------- c_script_4: C# ----------
   A = new  Rhino.Geometry.Rectangle3d(P, X, Y);
# ---------- end c_script_4 ----------
rectangle = Rectangle(Plane=pl_4, XSize=Domain(-1, 1), YSize=Domain(-2, 2), Radius=0)  # -> Rectangle, Length
rectangle_2 = Rectangle(Plane=pl_3, XSize=Domain(-1, 1), YSize=Domain(-2, 2), Radius=0)  # -> Rectangle, Length
rectangle_3 = Rectangle(Plane=pl_2, XSize=Domain(-1, 1), YSize=Domain(-2, 2), Radius=0)  # -> Rectangle, Length
panel_3 = Panel([python_4.O, python_4.X, python_4.Y, python_4.Z])
panel_4 = Panel([c_script_3.O, c_script_3.X, c_script_3.Y, c_script_3.Z])
panel_5 = Panel([python_3.O, python_3.X, python_3.Y, python_3.Z])
panel_6 = Panel([deplane.Origin, deplane.XAxis, deplane.YAxis, deplane.ZAxis])
pt_15 = Point(Point(-10.78711834, 9.413668953, 0))
srf_2 = Surface(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)
pt_16 = Point(pt_3)
pt_17 = Point(pt_6)
pt_18 = Point(pt_11)
sph = Sphere(Base=pt_15, Radius=Slider(30, range=0..100))
c_script_5 = CSharpScript(O=pt_16, X=pt_18, Y=pt_17)  # -> out, Pl, R; inputs O: Point3d, X: Vector3d, Y: Vector3d
# ---------- c_script_5: C# ----------
    Vector3d xAxis = X - (Vector3d) O;
    Vector3d yAxis = Y - (Vector3d) O;

    O += xAxis * 0.5;
    O += yAxis * 0.5;

    Plane plane = new Rhino.Geometry.Plane(O, xAxis, yAxis);

    Pl = plane;


    // double xLength = xAxis.Length * 0.4;
    // double yLength = yAxis.Length * 0.4;

    double offset = 2;
    double xLength = (xAxis.Length * 0.5) - offset;
    double yLength = (yAxis.Length * 0.5) - offset;

    Interval width = new Interval(-xLength, xLength);
    Interval height = new Interval(-yLength, yLength);


    R = new Rectangle3d(plane, width, height);
# ---------- end c_script_5 ----------
srf_3 = Surface(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)
pt_19 = Point(pt_6)
pt_20 = Point(pt_3)
pt_21 = Point(pt_11)
c_script_6 = CSharpScript(O=pt_20, X=pt_21, Y=pt_19)  # -> out, Pl, Or, No; inputs O: Point3d, X: Vector3d, Y: Vector3d
# ---------- c_script_6: C# ----------
    NVector3d Origin = new NVector3d(O.X, O.Y, O.Z);
    NVector3d xAxis = new NVector3d(X.X, X.Y, X.Z);
    NVector3d yAxis = new NVector3d(Y.X, Y.Y, Y.Z);



    NPlane npl = new NPlane(Origin, xAxis, yAxis);

    Pl = npl.GetRhinoPlane();

    Or = npl.O.Print();
    No = npl.ZAxis.Print();
# ---------- c_script_6: C# additional code ----------
  class NPlane {
    public NVector3d O;
    public NVector3d XAxis;
    public NVector3d YAxis;
    public NVector3d ZAxis;
    public NPlane(NVector3d O, NVector3d X, NVector3d Y){
      this.O = O;
      this.XAxis = X;
      this.YAxis = Y;

      this.XAxis.Unitize();
      this.YAxis.Unitize();

      this.ZAxis = NVector3d.CrossProduct(this.XAxis, this.YAxis);
      this.ZAxis.Unitize();
    }
    public Plane GetRhinoPlane() {
      return new Rhino.Geometry.Plane(
        new Point3d(O.x, O.y, O.z),
        new Vector3d(this.XAxis.x, this.XAxis.y, this.XAxis.z),
        new Vector3d(this.YAxis.x, this.YAxis.y, this.YAxis.z));
    }
  }
  class NVector3d {
    public static NVector3d CrossProduct(NVector3d v1, NVector3d v2) {
      return new NVector3d(
        v1.y * v2.z - v1.z * v2.y,
        v1.z * v2.x - v1.x * v2.z,
        v1.x * v2.y - v1.y * v2.x
        );
    }
    public double x = 0;
    public double y = 0;
    public double z = 0;
    public double Length = 0;
    public NVector3d(double x, double y, double z){
      this.x = x;
      this.y = y;
      this.z = z;
      this.ComputeLength();
    }
    private void ComputeLength(){
      this.Length = Math.Sqrt(x * x + y * y + z * z);
    }
    public void Unitize(){
      this.x /= this.Length;
      this.y /= this.Length;
      this.z /= this.Length;
    }
    public string Print(){
      return "(" + this.x.ToString() + ", " + this.y.ToString() + ", " + this.z.ToString() + ")";
    }
  }
# ---------- end c_script_6 ----------
panel_7 = Panel([c_script_6.Pl, c_script_6.Or, c_script_6.No])
srf_4 = Surface(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)
pt_22 = Point(Point(25.20875933, 8.090567581, 7.932401765))
pt_23 = Point(Point(18.2266124, 16.51253579, 12.54585457))
pt_24 = Point(Point(68.99001616, 36.59718416, 22.1528462))
pl_5 = ConstructPlane(Origin=pt_22, XAxis=pt_24, YAxis=pt_23)
geo = Geometry(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)
c_script_7 = CSharpScript(x=geo, pl=pl_5)  # -> out, A; inputs x: Brep, pl: Plane
# ---------- c_script_7: C# ----------
    Transform xf = Transform.Identity;

    xf.M00 = pl.XAxis.X;
    xf.M10 = pl.XAxis.Y;
    xf.M20 = pl.XAxis.Z;
    xf.M01 = pl.YAxis.X;
    xf.M11 = pl.YAxis.Y;
    xf.M21 = pl.YAxis.Z;
    xf.M02 = pl.ZAxis.X;
    xf.M12 = pl.ZAxis.Y;
    xf.M22 = pl.ZAxis.Z;
    xf.M03 = pl.Origin.X;
    xf.M13 = pl.Origin.Y;
    xf.M23 = pl.Origin.Z;


    x.Transform(xf);

    A = x;
# ---------- end c_script_7 ----------
orient = Orient(Geometry=geo, Source=PlaneXY(0, 0, 0), Target=pl_5)  # -> Geometry, Transform

geo_2 = Geometry(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)
geo_3 = Geometry(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)
geo_4 = Geometry(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)
pt_25 = Point(Point(8.135291842, 7.489643704, 1.524588026))
lnln = LineLine(LineA=geo_2, LineB=geo_3)
lnpt = LinePt(Line=geo_4, Point=pt_25)
cir_5 = Circle(Plane=lnln, Radius=1)
cir_6 = Circle(Plane=lnpt, Radius=1)
geo_5 = Geometry(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)
geo_6 = Geometry(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)
geo_7 = Geometry(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)
pt_26 = Point(Point(8.135291842, 7.489643704, 1.524588026))
end = EndPoints(Curve=geo_6)  # -> Start, End
end_2 = EndPoints(Curve=geo_5)  # -> Start, End
end_3 = EndPoints(Curve=geo_7)  # -> Start, End
c_script_8 = CSharpScript(A=geo_5, B=geo_6)  # -> out, Origin, XAxis, YAxis, ZAxis, Plane; inputs A: Line, B: Line
# ---------- c_script_8: C# ----------
    Vector3d v0 = (Vector3d) A.PointAtLength(0);
    Vector3d v1 = (Vector3d) A.PointAtLength(A.Length);

    Vector3d v2 = (Vector3d) B.ToNurbsCurve().PointAtStart;
    Vector3d v3 = (Vector3d) B.ToNurbsCurve().PointAtEnd;

    Origin = A.PointAtLength(0);

    Vector3d referVec0 = v1 - v0;
    Vector3d referVec1 = v3 - v2;


    Vector3d zAxis = Vector3d.CrossProduct(referVec0, referVec1);
    zAxis.Unitize();

    Vector3d xAxis = new Vector3d(referVec0.X, referVec0.Y, referVec0.Z);
    xAxis.Unitize();

    Vector3d yAxis = Vector3d.CrossProduct(xAxis, zAxis);
    yAxis.Unitize();



    ZAxis = zAxis;
    XAxis = xAxis;
    YAxis = yAxis;


    Plane = new Rhino.Geometry.Plane(A.PointAtLength(0), xAxis, yAxis);
# ---------- end c_script_8 ----------
python_5 = GhPythonScript(A=geo_5, B=geo_6)  # -> out, Origin, XAxis, YAxis, ZAxis, Plane; inputs A: Line, B: Line
# ---------- python_5: Python ----------
import Rhino as r


v0 = r.Geometry.Vector3d(A.PointAtLength(0))
v1 = r.Geometry.Vector3d(A.PointAtLength(A.Length))

v2 = r.Geometry.Vector3d(B.ToNurbsCurve().PointAtStart)
v3 = r.Geometry.Vector3d(B.ToNurbsCurve().PointAtEnd)

Origin = A.PointAtLength(0);

referVec0 = v1 - v0;
referVec1 = v3 - v2;


zAxis = r.Geometry.Vector3d.CrossProduct(referVec0, referVec1);
zAxis.Unitize();

xAxis = r.Geometry.Vector3d(referVec0.X, referVec0.Y, referVec0.Z);
xAxis.Unitize();

yAxis = r.Geometry.Vector3d.CrossProduct(xAxis, zAxis);
yAxis.Unitize();



ZAxis = zAxis;
XAxis = xAxis;
YAxis = yAxis;


Plane = r.Geometry.Plane(A.PointAtLength(0), xAxis, yAxis);
# ---------- end python_5 ----------
python_6 = GhPythonScript(A=geo_5, B=geo_6)  # -> out, Origin, XAxis, YAxis, ZAxis, Plane; inputs A: Line, B: Line
# ---------- python_6: Python ----------
import rhinoscriptsyntax as rs


#v0 = r.Geometry.Vector3d(A.PointAtLength(0))
#v1 = r.Geometry.Vector3d(A.PointAtLength(A.Length))
#
#v2 = r.Geometry.Vector3d(B.ToNurbsCurve().PointAtStart)
#v3 = r.Geometry.Vector3d(B.ToNurbsCurve().PointAtEnd)
#
#Origin = A.PointAtLength(0);
#
#referVec0 = v1 - v0;
#referVec1 = v3 - v2;
#
#
#zAxis = r.Geometry.Vector3d.CrossProduct(referVec0, referVec1);
#zAxis.Unitize();
#
#xAxis = r.Geometry.Vector3d(referVec0.X, referVec0.Y, referVec0.Z);
#xAxis.Unitize();
#
#yAxis = r.Geometry.Vector3d.CrossProduct(xAxis, zAxis);
#yAxis.Unitize();
#
#
#
#ZAxis = zAxis;
#XAxis = xAxis;
#YAxis = yAxis;
#
#
#Plane = r.Geometry.Plane(A.PointAtLength(0), xAxis, yAxis);
# ---------- end python_6 ----------
vec = Vector(end_2.Start)
vec_2 = Vector(end.Start)
vec_3 = Vector(end_2.End)
vec_4 = Vector(end.End)
vec_5 = Vector(pt_26)
vec_6 = Vector(end_3.End)
vec_7 = Vector(end_3.Start)
pt_27 = Point(c_script_8.Origin)
pt_28 = Point(python_5.Origin)
subtraction_5 = Subtraction(A=vec_3, B=vec)
subtraction_6 = Subtraction(A=vec_2, B=vec_4)
subtraction_7 = Subtraction(A=vec_5, B=end_3.Start)
subtraction_8 = Subtraction(A=vec_6, B=vec_7)
vdis = VectorDisplay(Anchor=pt_27, Vector=c_script_8.YAxis)
vdis_2 = VectorDisplay(Anchor=pt_27, Vector=c_script_8.XAxis)
cir_7 = Circle(Plane=c_script_8.Plane, Radius=1)
vdis_3 = VectorDisplay(Anchor=pt_27, Vector=c_script_8.ZAxis)
vdis_4 = VectorDisplay(Anchor=pt_28, Vector=python_5.YAxis)
vdis_5 = VectorDisplay(Anchor=pt_28, Vector=python_5.XAxis)
vdis_6 = VectorDisplay(Anchor=pt_28, Vector=python_5.ZAxis)
cir_8 = Circle(Plane=python_5.Plane, Radius=1)
unit_3 = UnitVector(Vector=subtraction_5)
unit_4 = UnitVector(Vector=subtraction_6)
unit_5 = UnitVector(Vector=subtraction_7)
unit_6 = UnitVector(Vector=subtraction_8)
vdis_7 = VectorDisplay(Anchor=end_3.Start, Vector=unit_6)
xprod = CrossProduct(VectorA=unit_5, VectorB=unit_6, Unitize=True)  # -> Vector, Length
vdis_8 = VectorDisplay(Anchor=end_3.Start, Vector=unit_5)
xprod_2 = CrossProduct(VectorA=unit_4, VectorB=unit_3, Unitize=False)  # -> Vector, Length
xprod_3 = CrossProduct(VectorA=unit_6, VectorB=xprod.Vector, Unitize=True)  # -> Vector, Length
xprod_4 = CrossProduct(VectorA=unit_3, VectorB=xprod_2.Vector, Unitize=False)  # -> Vector, Length
vdis_9 = VectorDisplay(Anchor=end_3.Start, Vector=xprod.Vector)
unit_7 = UnitVector(Vector=xprod_2.Vector)
unit_8 = UnitVector(Vector=xprod_4.Vector)
pl_6 = ConstructPlane(Origin=end_3.Start, XAxis=unit_6, YAxis=xprod_3.Vector)
vdis_10 = VectorDisplay(Anchor=end_3.Start, Vector=xprod_3.Vector)
cir_9 = Circle(Plane=pl_6, Radius=1)

# ---- group: Origin
pt_29 = Point(end_2.Start)

# ----
pl_7 = ConstructPlane(Origin=pt_29, XAxis=unit_3, YAxis=unit_4)
cir_10 = Circle(Plane=pl_7, Radius=1)

vdis_11 = VectorDisplay(Anchor=end_2.Start, Vector=unit_3)
vdis_12 = VectorDisplay(Anchor=end_2.Start, Vector=unit_8)
vdis_13 = VectorDisplay(Anchor=end_2.Start, Vector=unit_7)
