# Grasshopper definition LAB_ALL_RhinoPythonSeries.gh (Grasshopper 1.0.8)

# 007_pointCloud
number_slider = Slider(285, range=0..1000)
python = GhPythonScript()  # -> out, a, b, c, d, e, f
# ---------- python: Python ----------
__author__ = "namju"
__version__ = "2023.05.30"

import rhinoscriptsyntax as rs
import njs

a = njs.getRendom(10)
b = njs.getRendom(5)

c = njs.addNum(a, b)

v0 = njs.NVector3(10, 0, 0)
v1 = njs.NVector3(0, 10, 0)

v0.add(v1)

d = v0
e = v1
# ---------- end python ----------
# 023_Decompose Line Polyline
geo = Geometry(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)
geo_2 = Geometry(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)
python_2 = GhPythonScript()  # -> out, a, b, c
# ---------- python_2: Python ----------
__author__ = "namju"
__version__ = "2023.05.30"

import rhinoscriptsyntax as rs
import njs

a = njs.getRendom(10)
b = njs.getRendom(5)

c = njs.addNum(a, b)
# ---------- end python_2 ----------
# 000_Lib
python_3 = GhPythonScript()  # -> out, a
# ---------- python_3: Python ----------
__author__ = "namju"
__version__ = "2023.05.30"

import rhinoscriptsyntax as rs
import njs


a = njs.getRendom(0.5)
# ---------- end python_3 ----------
# 028_N-Gon, Closed Polyline, Star shape
number_slider_2 = Slider(10, range=0..10)

# ---- group: Sphere
# https://en.wikipedia.org/wiki/Sphere
number_slider_3 = Slider(-48, range=-180..180)
number_slider_4 = Slider(6, range=0..100)
number_slider_5 = Slider(5, range=0..100)
python_4 = GhPythonScript(scale=Slider(5, range=0..100), angle=Slider(199, range=0..1000), zScale=Slider(5.302, range=0..10))  # -> out, a; inputs angle: Int32
# ---------- python_4: Python ----------
__author__ = "NJ9"
__version__ = "2019.06.03"

import rhinoscriptsyntax as rs
import math;

pts = []

r = (3.14 * 2) / 360
zr = 3.14 / 36

for j in range(36):
    for i in range(angle):
        
        x = math.cos(r * i) * math.sin(zr * j) * scale
        y = math.sin(r * i) * math.sin(zr * j) * scale
        z = math.cos(zr * j) * scale
        
        p = rs.AddPoint(x,y,z)
        pts.append(p)

a = pts;
# ---------- end python_4 ----------
python_5 = GhPythonScript(scale=number_slider_5, angle=Slider(272, range=0..1000), zScale=number_slider_5, segs=Slider(43, range=0..100))  # -> out, a; inputs angle: Int32, segs: Int32
# ---------- python_5: Python ----------
__author__ = "NJ9"
__version__ = "2019.06.03"

import rhinoscriptsyntax as rs
import math;

pts = []

r = (3.14 * 2) / segs
zr = 3.14 / segs

for j in range(segs):
    for i in range(segs):
        x = math.cos(r * i) * math.sin(zr * j) * scale
        y = math.sin(r * i) * math.sin(zr * j) * scale
        z = math.cos(zr * j) * scale
        
        p = rs.AddPoint(x,y,z)
        pts.append(p)
a = pts
# ---------- end python_5 ----------
python_6 = GhPythonScript(
    scale=number_slider_4,
    zScale=number_slider_4,
    segs=Slider(44, range=0..100),
    theLat=Slider(0, range=-90..90),
    theLong=number_slider_3)  # -> out, a, b; inputs segs: Int32
# ---------- python_6: Python ----------
__author__ = "NJ9"
__version__ = "2019.06.03"

import rhinoscriptsyntax as rs
import math;

def LongRemap(lon):
    return (lon + 180) * 3.14 * 2 / 360 * -1
def LatRemap(lat):
    return (lat + 90) * 3.14 /180  

def GetPointFromGPS(d, scale):
    LonProjected = LongRemap(d[1])
    latProjected = LatRemap(d[0])
    x = math.cos(LonProjected) * math.sin(latProjected) * -1
    y = math.sin(LonProjected) * math.sin(latProjected) 
    z = math.cos(latProjected) * -1
    
    return rs.AddPoint(x * scale,y * scale,z * scale)

pts = []

r = (3.14 * 2) / segs
zr = 3.14 / segs

for j in range(segs):
    for i in range(segs):
        x = math.cos(r * i) * math.sin(zr * j) * scale
        y = math.sin(r * i) * math.sin(zr * j) * scale
        z = math.cos(zr * j) * scale
        
        p = rs.AddPoint(x,y,z)
        pts.append(p)
a = pts


data = [
        [theLat,theLong],
        [89,0],
        [-89,0],
        [37.550244, 126.984715],
        [39.174048, 127.248203],
        [42.362232, -71.05889],
        ]
        

posCities = []

for d in data:
    p = GetPointFromGPS(d, zScale)
    posCities.append(p)

b = posCities
# ---------- end python_6 ----------
number_slider_6 = Slider(5.355, range=0..10)
number_slider_7 = Slider(1.085, range=0..10)
number_slider_8 = Slider(0.31652216, range=0..1)
pt = Point(Point(4.724328248, 0.01103054405, 1.063580062))
sph = Sphere(Base=python_6.b, Radius=Slider(1, range=0..1))

# ----
pt_2 = Point(Point(5.925441897, 3.343254546, 0))

# ---- group: Cone
# 015_Cone, Sphere, Projection
# https://en.wikipedia.org/wiki/Cone
number_slider_9 = Slider(1, range=0..100)
python_7 = GhPythonScript(
    scale=number_slider_9,
    angle=Slider(9, range=0..1000),
    zScale=Slider(1.838, range=0..10),
    R=Slider(22, range=0..100),
    height=Slider(14, range=0..100))  # -> out, a; inputs angle: Int32, height: Int32
# ---------- python_7: Python ----------
__author__ = "NJ9"
__version__ = "2019.06.03"

import rhinoscriptsyntax as rs
import math;

pts = []

r = (math.pi * 2) / angle

for j in range(height):
    for i in range(angle):
        x = math.cos(r * i) * j * scale
        y = math.sin(r * i) * j * scale
        
        z = ((height - j -1) * zScale)
        
        p = rs.AddPoint(x,y,z)
        pts.append(p)

a = pts;
# ---------- end python_7 ----------
python_8 = GhPythonScript(
    scale=Slider(1, range=0..100),
    angle=Slider(338, range=0..1000),
    zScale=Slider(0.684, range=0..10),
    bScale=Slider(8.9605, range=0..10))  # -> out, a; inputs angle: Int32
# ---------- python_8: Python ----------
__author__ = "NJ9"
__version__ = "2019.06.03"

import rhinoscriptsyntax as rs
import math;

pts = []

r = (3.14 * 2) / 360

for j in range(20):
    for i in range(angle):
        x = math.cos(r * i) * j * scale
        y = math.sin(r * i) * j * scale
        z = ((20 - j -1) * zScale)

        x += math.cos(r*i) * math.cos(r*i) * bScale
        y += math.sin(r*i) * math.sin(r*i) * bScale

        p = rs.AddPoint(x,y,z)
        pts.append(p)

a = pts;
# ---------- end python_8 ----------

# ----
# 022_Ellipse_Data_Rotate_Traslate_Axis
number_slider_10 = Slider(117, range=0..1000)
python_9 = GhPythonScript(x=geo)  # -> out, a
# ---------- python_9: Python ----------
__author__ = "namju"
__version__ = "2023.05.24"

import rhinoscriptsyntax as rs


p0 = rs.CurveStartPoint(x)
p1 = rs.CurveEndPoint(x)

t = rs.Distance(p0, p1) * 0.5


lns = rs.SplitCurve(x, t)

a = lns



#print(t * 2)
#print(rs.CurveLength(x))
#print(rs.Distance(p0, p1))
# ---------- end python_9 ----------
python_10 = GhPythonScript(x=geo_2)  # -> out, a
# ---------- python_10: Python ----------
__author__ = "namju"
__version__ = "2023.05.24"

import rhinoscriptsyntax as rs


p0 = rs.CurveStartPoint(x)
p1 = rs.CurveEndPoint(x)
mp = rs.CurveMidPoint(x)

lns = [
rs.AddLine(p0, mp),
rs.AddLine(mp, p1),
]

a = lns
# ---------- end python_10 ----------
panel = Panel(python_3.a)
panel_2 = Panel([python_2.a, python_2.b, python_2.c])
panel_3 = Panel([python.a, python.b, python.c])
panel_4 = Panel([python.d, python.e])
python_11 = GhPythonScript(pNum=number_slider, width=Slider(20, range=0..1000), length=Slider(10, range=0..1000), height=Slider(133, range=0..1000))  # -> out, a; inputs pNum: Int32
# ---------- python_11: Python ----------
__author__ = "NJ9"
__version__ = "2019.06.02"

import rhinoscriptsyntax as rs
import random



pts = []

for i in range(pNum):
    
    x = (random.random() - 0.5 )* width # 0.0 to 1.0
    y = (random.random() - 0.5 )* length
    z = random.random() * height
    p = rs.AddPoint(x, y,z)
    pts.append(p)

a = pts;
# ---------- end python_11 ----------
pt_3 = Point(Point(30.72320729, 19.36937181, 0))
pt_4 = Point(Point(111.9990084, 99.04998443, 93.36792835))
# 010_point_line_polyline
panel_5 = Panel(pt_2)
python_12 = GhPythonScript(x=pt_2)  # -> out, a
# ---------- python_12: Python ----------
__author__ = "NJ9"
__version__ = "2019.08.14"

import rhinoscriptsyntax as rs


lns = []

p0 = rs.AddPoint([0,3,0])
p1 = rs.AddPoint([3,9,9])
p2 = rs.AddPoint([10,15,3])
p3 = rs.AddPoint([2,8,10])


ln1 = rs.AddLine(p0, p1)
ln2 = rs.AddLine(p2, p3)
ln3 = rs.AddLine(p1, p2)
ln4 = rs.AddLine(p3, p0)

lns.append(ln1);
lns.append(ln2);
lns.append(ln3);
lns.append(ln4);

a = lns
# ---------- end python_12 ----------
python_13 = GhPythonScript(x=pt_2)  # -> out, p0, p1, ln1, ln2, ln3, ln4, cp
# ---------- python_13: Python ----------
__author__ = "NJ9"
__version__ = "2019.08.14"

import rhinoscriptsyntax as rs


p0 = rs.AddPoint([0,0,0])
p1 = rs.AddPoint([3,6,9])

print(p0)
print(x)

ln1 = rs.AddLine(p0, p1)

cp = rs.LineClosestPoint(ln1, x)


p2 = rs.AddPoint([10,5,3])
p3 = rs.AddPoint([0,8,10])
ln2 = rs.AddLine(p2, p3)

ln3 = rs.AddLine(p1, p2)
ln4 = rs.AddLine(p3, p0)
# ---------- end python_13 ----------
pt_5 = Point(Point(30.72320729, 19.36937181, 0))
pt_6 = Point(Point(30.72320729, 19.36937181, 0))
# 999_Sphere_Packing
pt_7 = Point(Point(111.9990084, 76.95814785, 0))
pt_8 = Point(Point(111.9990084, 76.95814785, 0))
python_14 = GhPythonScript(r=number_slider_2, n=Slider(9, range=0..10))  # -> out, a; inputs n: Int32
# ---------- python_14: Python ----------
__author__ = "namju"
__version__ = "2023.05.26"

import rhinoscriptsyntax as rs
import math

pts = []

if n > 2:
    radian = (math.pi * 2) / n
    print(radian)
    
    for i in range(n):
        x = math.cos(radian * i) * r
        y = math.sin(radian * i) * r
        p = rs.AddPoint(x,y,0)
        pts.append(p)
    

lns = [] 
theLength = len(pts)
if theLength > 2:
    p0 = None
    p1 = None
    for i in range(theLength):
        if (theLength -1 == i):
            p0 = pts[i]
            p1 = pts[0]
        else:
            p0 = pts[i]
            p1 = pts[i+1]
        if p0 != None and p1 != None:
            ln = rs.AddLine(p0, p1)
            lns.append(ln)

a = lns
# ---------- end python_14 ----------
panel_6 = Panel(python_9.a)
panel_7 = Panel(python_10.a)
python_15 = GhPythonScript(r=Slider(10, range=0..10), r2=Slider(6, range=0..110), n=Slider(10, range=0..10))  # -> out, a; inputs n: Int32
# ---------- python_15: Python ----------
__author__ = "namju"
__version__ = "2023.05.26"

import rhinoscriptsyntax as rs
import math

pts = []

n = n * 2

if n > 2:
    radian = (math.pi * 2) / n
    print(radian)
    
    for i in range(n):
        if (i % 2) == 0:
            x = math.cos(radian * i) * r2
            y = math.sin(radian * i) * r2
            p = rs.AddPoint(x,y,0)
            pts.append(p)
        else:
            x = math.cos(radian * i) * r
            y = math.sin(radian * i) * r
            p = rs.AddPoint(x,y,0)
            pts.append(p)










lns = [] 
theLength = len(pts)
if theLength > 2:
    p0 = None
    p1 = None
    for i in range(theLength):
        if (theLength -1 == i):
            p0 = pts[i]
            p1 = pts[0]
        else:
            p0 = pts[i]
            p1 = pts[i+1]
        if p0 != None and p1 != None:
            ln = rs.AddLine(p0, p1)
            lns.append(ln)

a = lns
# ---------- end python_15 ----------
python_16 = GhPythonScript(degree=number_slider_10)  # -> out, a
# ---------- python_16: Python ----------
__author__ = "namju"
__version__ = "2023.05.23"

import rhinoscriptsyntax as rs

center = [0, 10 ,0]
el = rs.AddEllipse(center, 10,5)

el = rs.RotateObject(el, center, degree, [1, 0, 0])

el = rs.MoveObject(el, [0, 0, 10])

a = el
# ---------- end python_16 ----------
python_17 = GhPythonScript(degree=Slider(499, range=0..1000))  # -> out, a, cp, qp, spt, ept
# ---------- python_17: Python ----------
__author__ = "namju"
__version__ = "2023.05.23"

import rhinoscriptsyntax as rs

center = [0, 10 ,0]
el = rs.AddEllipse(center, 10,5)
el = rs.RotateObject(el, center, degree)

cp = rs.EllipseCenterPoint(el)
qp = rs.EllipseQuadPoints(el)


spt = rs.CurveStartPoint(el)
ept = rs.CurveStartPoint(el)

a = el
# ---------- end python_17 ----------
python_18 = GhPythonScript(degree=Slider(0, range=0..1000), param0=Slider(0.05, range=0.01..2), param1=Slider(1.45, range=0.01..2))  # -> out, a
# ---------- python_18: Python ----------
__author__ = "namju"
__version__ = "2023.05.23"

import rhinoscriptsyntax as rs
import math

els =[]

for i in range(100):
    center = [0, 10 ,0]
    el = rs.AddEllipse(center, 10,5)
    
    el = rs.RotateObject(el, center, degree + math.pow(i, 2) * param0)
    
    el = rs.MoveObject(el, [0, 0, i * param1])
    
    els.append(el)


a = els;
# ---------- end python_18 ----------
python_19 = GhPythonScript(p0=pt_3, p1=pt_7)  # -> out, a; inputs p0: Point3d, p1: Point3d
# ---------- python_19: Python ----------
__author__ = "namju"
__version__ = "2023.05.23"

import rhinoscriptsyntax as rs

import random



def addCircle(p, r):
    return rs.AddCircle(p, r)

circles = []

domainX = p1[0] - p0[0];
domainY = p1[1] - p0[1];

print(domainX)

for i in range(100):
    
    x = p0[0] + random.random() * domainX
    y = p0[1] + random.random() * domainY
    z = 0
    r = 2 + random.random() * 10
    c = addCircle([x,y,z], r)
    circles.append(c)

a = circles;
# ---------- end python_19 ----------
python_20 = GhPythonScript(p0=pt_5, p1=pt_4, N=Slider(100, range=0..100))  # -> out, a, p, r; inputs p0: Point3d, p1: Point3d, N: Int32
# ---------- python_20: Python ----------
__author__ = "namju"
__version__ = "2023.05.23"

import rhinoscriptsyntax as rs

import random

def CircleIntersection(c0, c1):
    p0 = rs.CircleCenterPoint(c0)
    r0 = rs.CircleRadius(c0)
    p1 = rs.CircleCenterPoint(c1)
    r1 = rs.CircleRadius(c1)
    dis = rs.Distance(p0, p1)
    return dis < r0 + r1

def addCircle(p, r):
    return rs.AddCircle(p, r)


circles = []

domainX = p1[0] - p0[0];
domainY = p1[1] - p0[1];
domainZ = p1[2] - p0[2];

print(domainX)
p = []
r = []
for i in range(N):
    
    x = p0[0] + random.random() * domainX
    y = p0[1] + random.random() * domainY
    z = p0[2] + random.random() * domainZ
    radius = 1 + random.random() * 15
    c = addCircle([x,y,z], radius)
    
    isIntersected = False
    for cir in circles:
        if (CircleIntersection(cir, c)):
            isIntersected = True
    
    if (isIntersected == False):
        p.append(rs.AddPoint(x,y,z))
        r.append(radius)
        circles.append(c)
    else:
        print(i)

a = circles;

print(len(circles))
# ---------- end python_20 ----------
panel_8 = Panel(python_11.a)
python_21 = GhPythonScript(p0=pt_6, p1=pt_8)  # -> out, a; inputs p0: Point3d, p1: Point3d
# ---------- python_21: Python ----------
__author__ = "namju"
__version__ = "2023.05.23"

import rhinoscriptsyntax as rs

import random

def CircleIntersection(c0, c1):
    p0 = rs.CircleCenterPoint(c0)
    r0 = rs.CircleRadius(c0)
    p1 = rs.CircleCenterPoint(c1)
    r1 = rs.CircleRadius(c1)
    dis = rs.Distance(p0, p1)
    return dis < r0 + r1

def addCircle(p, r):
    return rs.AddCircle(p, r)


circles = []

domainX = p1[0] - p0[0];
domainY = p1[1] - p0[1];

print(domainX)

for i in range(1000):
    
    x = p0[0] + random.random() * domainX
    y = p0[1] + random.random() * domainY
    z = 0
    r = 1 + random.random() * 15
    c = addCircle([x,y,z], r)
    
    isIntersected = False
    for cir in circles:
        if (CircleIntersection(cir, c)):
            isIntersected = True
    
    if (isIntersected == False):
        circles.append(c)
    else:
        print(i)

a = circles;
print(len(circles))
# ---------- end python_21 ----------
item = ListItem(List=python_9.a, Index=Slider(0, range=0..10), Wrap=False)
item_2 = ListItem(List=python_10.a, Index=Slider(1, range=0..10), Wrap=False)
panel_9 = Panel(python_14.a)
panel_10 = Panel(python_15.a)
panel_11 = Panel(python_19.a)
sph_2 = Sphere(Base=python_17.spt, Radius=1)
panel_12 = Panel(python_21.out)
sph_3 = Sphere(Base=python_20.p, Radius=python_20.r)
panel_13 = Panel(python_20.a)
panel_14 = Panel(python_18.a)

# ---- group: Sphere / fish eye
python_22 = GhPythonScript(pts=python_5.a, point=pt, e=number_slider_6, a=number_slider_8, s=number_slider_7)  # -> out, A; inputs pts: list of Point3d, point: Point3d
# ---------- python_22: Python ----------
__author__ = "NJ9"
__version__ = "2019.06.07"

import rhinoscriptsyntax as rs
import math;

ptsOut = []

for p in pts:
    x = p.X
    y = p.Y
    
    dis = math.sqrt(((point.X - x) * (point.X - x)) + ((point.Y - y) * (point.Y - y))) 
    
#    val = math.pow(e, -(a* (dis * dis * dis)))*s;
#    val = math.pow(e, -(a* (math.pow(dis, 2)) + math.pow(dis, 2)))*s;
    val = math.pow(e, -(a* (math.pow(dis, 2) + math.pow(dis, 2))))*s;
    
    xVal = val
    yVal = val
    
    if x < point.X:
        xVal = xVal * -1
    if y < point.Y:
        yVal = yVal * -1
        
    ptsOut.append(rs.AddPoint(p.X + xVal, p.Y + yVal, p.Z + val))

A = ptsOut
# ---------- end python_22 ----------

# ----
# 001_basicSyntaxPython
number_slider_11 = Slider(5.2, range=0..10)
pt_9 = Point(Point(93.59079084, 92.75635979, 40.89271768))
pt_10 = Point(Point(30.72320729, 19.36937181, 0))
python_23 = GhPythonScript(x=Slider(16, range=0..100), y=Slider(24, range=0..100))  # -> out, a, b, c
# ---------- python_23: Python ----------
__author__ = "namju"
__version__ = "2023.05.23"

import rhinoscriptsyntax as rs


def CircleIntersection(c0, c1):
    p0 = rs.CircleCenterPoint(c0)
    r0 = rs.CircleRadius(c0)
    p1 = rs.CircleCenterPoint(c1)
    r1 = rs.CircleRadius(c0)
    dis = rs.Distance(p0, p1)
    return dis < r0 + r1



c0 = rs.AddCircle([x, y , 0], 10)
c1 = rs.AddCircle([0, 0 , 0], 10)


a = c0
b = c1

c = CircleIntersection(c0, c1)
# ---------- end python_23 ----------
# 008_pointCloudNormalDistribution
number_slider_12 = Slider(10000, range=0..10000)
python_24 = GhPythonScript(x=number_slider_11, y=Slider(66.7, range=0..100))  # -> out, c
# ---------- python_24: Python ----------
#a = 3 * 3 + 5

#a = x
#b = y
#c = a * b + 5

#for i in [0,1,2,3,4]:
#    print(i)

#for i in range(0,10):
#    print(i + i)

#myList = [4,6,9,10,15]
#print(len(myList))

#for i in range(len(myList)):
#    print( 'index', i ,' = ', myList[i])


myList = []
myList.append(10)
myList.append(1)
myList.append(3)
myList.append(9)
myList.append(5)
myList.append('5')
myList.pop()
#print(myList)
#c = myList[2] + myList[-2]

for i in myList:
    if i < 5 :
        print(i)
    else :
        print('bigger than 5: ',   i)
# ---------- end python_24 ----------
geo_3 = Geometry(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)
python_25 = GhPythonScript(p0=pt_10, p1=pt_9, N=Slider(1100, range=0..1100))  # -> out, a, p, r; inputs p0: Point3d, p1: Point3d, N: Int32
# ---------- python_25: Python ----------
__author__ = "namju"
__version__ = "2023.05.23"

import rhinoscriptsyntax as rs
import math
import random

def getDistance(x0, y0, z0, x1, y1, z1):
    return math.sqrt((x0 - x1) * (x0 - x1) + (y0 - y1) * (y0 - y1) + (z0 - z1) * (z0 - z1));

class Sphere:
    def __init__(self, x, y, z, r):
        self.r = r
        self.x = x  
        self.y = y  
        self.z = z  
        
    def increase(self):
        self.r = self.r + 1
        
    def isIntersected(self, others):
        for i in others:
            if getDistance(self.x, self.y, self.z, i.x, i.y, i.z) < self.r + i.r:
                return True
        return False;

def updateSphere(sphere, spheres, max):
    if sphere.isIntersected(spheres) == True or sphere.r > max:
        return sphere
        pass
    else:
        sphere.increase()
        return updateSphere(sphere, spheres, max)  


def getData():
    
    domainX = p1[0] - p0[0];
    domainY = p1[1] - p0[1];
    domainZ = p1[2] - p0[2];
    x = p0[0] + random.random() * domainX
    y = p0[1] + random.random() * domainY
    z = p0[2] + random.random() * domainZ
    radius = 1 + random.random() * 5
    return [x, y, z, radius]

d = getData()
spheres = [Sphere(d[0], d[1], d[2], d[3])]

max = 20
for i in range(N):
    d = getData()
    s = Sphere(d[0], d[1], d[2], d[3])
    if s.isIntersected(spheres) == False:
        s = updateSphere(s, spheres, max)
        spheres.append(s)

p = []
r = []
for s in spheres:
    p.append(rs.AddPoint(s.x, s.y, s.z))
    r.append(s.r)
# ---------- end python_25 ----------
panel_15 = Panel(python_23.c)
geo_4 = Geometry(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)
geo_5 = Geometry(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)
pt_11 = Point([Point(9.435671804, 20.32113627, 14.90594309), Point(17.47551518, 12.95390054, 7.612966271)])
panel_16 = Panel(python_24.c)
# 011_line intersection_length.gh
python_26 = GhPythonScript()  # -> out, ln0, ln1, cp
# ---------- python_26: Python ----------
__author__ = "NJ9"
__version__ = "2019.08.14"

import rhinoscriptsyntax as rs

p0 = rs.AddPoint(-5.25, -5, 0)
p1 = rs.AddPoint(5, 3, 0)

ln0 = rs.AddLine(p0, p1);

p0 = rs.AddPoint(-5, 9, 0)
p1 = rs.AddPoint(-1, -1, 0)

ln1 = rs.AddLine(p0, p1);

cp = rs.LineLineIntersection(ln0, ln1)
# ---------- end python_26 ----------
python_27 = GhPythonScript()  # -> out, ln0, ln1, cp, dis, disOther
# ---------- python_27: Python ----------
__author__ = "NJ9"
__version__ = "2019.08.14"

import rhinoscriptsyntax as rs
import math;
p0 = rs.AddPoint(-5.25, -5, 0)
p1 = rs.AddPoint(5, 3, 0)

ln0 = rs.AddLine(p0, p1);

p0 = rs.AddPoint(-5.5, 9.02, 0)
p1 = rs.AddPoint(-1, -1, 0)

ln1 = rs.AddLine(p0, p1);

cp = rs.LineLineIntersection(ln0, ln1)

dis = rs.Distance(p0, p1)

p0 = rs.PointCoordinates(p0)
p1 = rs.PointCoordinates(p1)

print(p0)
print(p1)
disOther = math.sqrt( math.pow( p1[0] - p0[0] ,2) + math.pow( p1[1] - p0[1] ,2) + math.pow( p1[2] - p0[2] ,2) )
# ---------- end python_27 ----------
# 024_Decompose Polyline & Data
panel_17 = Panel(geo_3)
python_28 = GhPythonScript(x=geo_3)  # -> out, a
# ---------- python_28: Python ----------
__author__ = "namju"
__version__ = "2023.05.24"

import rhinoscriptsyntax as rs

pts = rs.PolylineVertices(x)

ptsOut = []

for i in range(len(pts)-1):
    p0 = pts[i]
    p1 = pts[i+1]
    print(p0, p1)
    ln = rs.AddLine(p0, p1)
    ptsOut.append(ln)


a = ptsOut
# ---------- end python_28 ----------
python_29 = GhPythonScript(x=geo_4, t=Slider(91, range=0..100))  # -> out, a
# ---------- python_29: Python ----------
__author__ = "namju"
__version__ = "2023.05.24"

import rhinoscriptsyntax as rs


p0 = rs.CurveStartPoint(x)
p1 = rs.CurveEndPoint(x)

#t = rs.Distance(p0, p1) * 0.5


lns = rs.SplitCurve(x, t)

a = lns



#print(t * 2)
#print(rs.CurveLength(x))
#print(rs.Distance(p0, p1))
# ---------- end python_29 ----------
panel_18 = Panel(python_25.r)
python_30 = GhPythonScript(
    points=pt_11,
    dNum=Slider(5000, range=0..10000),
    gPow=Slider(1.1, range=0..10),
    b=Slider(6.2, range=0..10),
    scale=Slider(29, range=0..100),
    pow=Slider(100, range=0..100),
    tDis=Slider(100, range=0..100))  # -> out, a; inputs points: list, dNum: Int32
# ---------- python_30: Python ----------
__author__ = "NJ9"
__version__ = "2019.06.02"

import rhinoscriptsyntax as rs
import random
import math

pts = []

seed = 0

for point in points:
    point = rs.PointCoordinates(point)
    random.seed(seed)
    seed += 1
    for i in range(dNum):
        
        epsilon = math.pow(gPow, -  math.pow(random.random() * 2 , 2 ) * b )
        
        x = (random.random() - 0.5) * 200 * math.pow(epsilon, pow)
        y = (random.random() - 0.5) * 200 * math.pow(epsilon, pow)
        z = (random.random() - 0.5) * 200 * math.pow(epsilon, pow)
        
        dis = x * x + y * y + z * z
        
        if(dis < tDis):
            p = rs.AddPoint(point[0] + x, point[1] + y, point[2] + z);
            pts.append(p)

a = pts
# ---------- end python_30 ----------
python_31 = GhPythonScript(
    dNum=number_slider_12,
    gPow=Slider(1.1, range=0..10),
    b=Slider(6.2, range=0..10),
    scale=Slider(29, range=0..100),
    pow=Slider(100, range=0..100),
    tDis=Slider(100, range=0..100))  # -> out, a; inputs dNum: Int32
# ---------- python_31: Python ----------
__author__ = "NJ9"
__version__ = "2019.06.02"

import rhinoscriptsyntax as rs
import random
import math

pts = []
random.seed(0)

for i in range(dNum):
    
    epsilon = math.pow(gPow, -  math.pow(random.random() * 2 , 2 ) * b )
    
    x = (random.random() - 0.5) * 200 * math.pow(epsilon, pow)
    y = (random.random() - 0.5) * 200 * math.pow(epsilon, pow)
    z = (random.random() - 0.5) * 200 * math.pow(epsilon, pow)
    
    dis = x * x + y * y + z * z
    
    if(dis < tDis):
        p = rs.AddPoint(x,y,z);
        pts.append(p)

a = pts
# ---------- end python_31 ----------
sph_4 = Sphere(Base=python_25.p, Radius=python_25.r)
len = Length(Curve=python_27.ln1)
item_3 = ListItem(List=python_28.a, Index=Slider(0, range=0..10), Wrap=False)
panel_19 = Panel([len, python_27.dis, python_27.disOther])
python_32 = GhPythonScript(x=python_28.a)  # -> out, a; inputs x: list
# ---------- python_32: Python ----------
__author__ = "namju"
__version__ = "2023.05.24"

import rhinoscriptsyntax as rs


a = rs.JoinCurves(x)
# ---------- end python_32 ----------
panel_20 = Panel(python_29.a)
panel_21 = Panel(python_28.a)
pt_12 = Point(Point(38.81448754, 22.12947503, 0))
pt_13 = Point(Point(36.38180968, 57.8299252, 0))
panel_22 = Panel(python_32.a)
pt_14 = Point(Point(72.98416701, 39.4784463, 0))
item_4 = ListItem(List=python_29.a, Index=Slider(0, range=0..10), Wrap=False)
item_5 = ListItem(List=python_29.a, Index=Slider(1, range=0..10), Wrap=False)
# 029_Fillet, Arc, Line Vector
geo_6 = Geometry(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)
geo_7 = Geometry(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)
python_33 = GhPythonScript()  # -> out, a, b, c, d
# ---------- python_33: Python ----------
__author__ = "namju"
__version__ = "2023.05.23"

import rhinoscriptsyntax as rs

plane = rs.WorldXYPlane()



a = rs.AddCircle( plane, 5.0 )

b = rs.CircleCenterPoint(a)

c = rs.CircleCircumference(a)

d = rs.Area(a)
# ---------- end python_33 ----------
python_34 = GhPythonScript(p0=pt_13, p1=pt_14, p2=pt_12)  # -> out, a
# ---------- python_34: Python ----------
__author__ = "namju"
__version__ = "2023.05.23"

import rhinoscriptsyntax as rs


a = rs.AddCircle3Pt(p0, p1, p2)
# ---------- end python_34 ----------
# 016_Circle
python_35 = GhPythonScript()  # -> out, a
# ---------- python_35: Python ----------
__author__ = "namju"
__version__ = "2023.05.23"

import rhinoscriptsyntax as rs

plane = rs.WorldXYPlane()



a = rs.AddCircle( plane, 5.0 )
# ---------- end python_35 ----------
python_36 = GhPythonScript()  # -> out, a
# ---------- python_36: Python ----------
__author__ = "namju"
__version__ = "2023.05.23"

import rhinoscriptsyntax as rs
import math
cirs = []

for i in range(100):
    y = math.sin(i) * 2 * i * 0.1
    c = rs.AddCircle([i * 2, y, 0], 1 )
    cirs.append(c)
    
a = cirs
# ---------- end python_36 ----------
python_37 = GhPythonScript()  # -> out, a, b
# ---------- python_37: Python ----------
__author__ = "namju"
__version__ = "2023.05.23"

import rhinoscriptsyntax as rs


p = rs.AddPoint([15,8,3])
a = rs.AddCircle( p, 5.0 )
# ---------- end python_37 ----------
pipe = Pipe(Curve=item_4, Radius=1, Caps=0)
pipe_2 = Pipe(Curve=item_5, Radius=Slider(3, range=0..10), Caps=0)

# ----
# Python -1
# Python -2
number_slider_13 = Slider(5, range=0..10)
pt_15 = Point(Point(20.54503096, 24.15409767, -3.032856066))
python_38 = GhPythonScript(x=number_slider_13, y=Slider(10, range=0..10))  # -> out, d
# ---------- python_38: Python ----------
import rhinoscriptsyntax as rs

#a = (x)
#b = (y)
#c = a+b*5
#print(c)

#for i in [0,1,2,3,4]:
    #print(i)
    
#for i in range(0,10):
    #print(i)

#myList = [4,6,9,10,15,16]
#print(len(myList))

#for i in range(len(myList)):
    #print(i)
    #print myList[i]
    #print ('index', i, '=', myList[i])
    
    

myList = []
myList.append(10)
myList.append(1)
myList.append(3)
myList.append(6)
myList.append('6')
#print(myList)

#c = myList
#c = myList[3] + myList[-2]

for i in myList:
    if i<5:
        print(i)
    else :
        print ('bigger than 5:', i)
        
#d = i
d = 'bigger than 5:', i
# ---------- end python_38 ----------
python_39 = GhPythonScript(k=pt_15, x=Slider(50, range=0..50), y=Slider(50, range=0..50))  # -> out, a; inputs x: Int32, y: Int32
# ---------- python_39: Python ----------
import rhinoscriptsyntax as rs

#mylist = []
#for i in range(10):
#    p = rs.AddPoint( (i,0,0) )
#    mylist.append(p)
#    
#a = mylist

#mylist = []
#for i in range(10):
#    if i > 5:
#        p = rs.AddPoint( (i,0,0) )
#    else:
#        p = rs.AddPoint( (i,0,1) )
#    mylist.append(p)
#a = mylist


#mylist = []
#for j in range(10):
#    for i in range(10):
#        if i > 5:
#            p = rs.AddPoint( (i,j,0) )
#        else:
#            p = rs.AddPoint( (i,j,1) )
#        mylist.append(p)
#a = mylist

mylist = []

refPos = rs.PointCoordinates(k)

for j in range(x):
    for i in range(y):
        p = rs.AddPoint( (i,j,0) )
        dis = rs.Distance(refPos,p)
        t = rs.MoveObject(p, [0,0,dis])
#        print(dis)
        mylist.append(p)
a = mylist
# ---------- end python_39 ----------
panel_23 = Panel(python_38.d)
panel_24 = Panel(python_39.out)

pt_16 = Point(Point(5.918427903, 6.239268636, 0))
# 002_basicPointGrid
panel_25 = Panel(pt_16)
python_40 = GhPythonScript(p=pt_16, x=Slider(10, range=0..10), y=Slider(14, range=0..100))  # -> out, a; inputs x: Int32, y: Int32
# ---------- python_40: Python ----------
import rhinoscriptsyntax as rs

myList = []

refPos = rs.PointCoordinates(p);

for j in range(y):
    for i in range(x):
        p = rs.AddPoint( (i,j,0) )
        dis = rs.Distance(refPos, p);
        rs.MoveObject(p, [0,0,dis])

#        if i > 5:
#            p = rs.AddPoint( (i,j,0) )
#        else:
#            p = rs.AddPoint( (i,j,1) )

        myList.append(p)

a = myList;



#print(pos[2])
# ---------- end python_40 ----------
panel_26 = Panel(python_40.out)

panel_27 = Panel(python_37.out)
panel_28 = Panel(python_34.a)
crv = Curve(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)
panel_29 = Panel([python_33.b, python_33.c, python_33.d])
end = EndPoints(Curve=crv)  # -> Start, End
sph_5 = Sphere(Base=end.Start, Radius=1)
# 009_pointCloudLinealRegression
number_slider_14 = Slider(-300, range=-1000..1000)
number_slider_15 = Slider(2, range=0..2)
number_slider_16 = Slider(599, range=0..1000)
sigma = Slider(3.06, range=0..15)
vec = Vector(end.End)
pt_17 = ConstructPoint(XCoordinate=0, YCoordinate=0, ZCoordinate=0)
vec_2 = Vector(end.Start)
subtraction = Subtraction(A=vec, B=vec_2)
panel_30 = Panel([vec_2, vec])
# 025 Divide line and polyline segment
number_slider_17 = Slider(3, range=0..10)
python_41 = GhPythonScript(
    min=number_slider_14,
    max=number_slider_16,
    scale=number_slider_15,
    a=Slider(0.6, range=-10..10),
    b=Slider(0, range=-10..10),
    sigma=sigma)  # -> out, a, b, A, B; inputs min: Int32, max: Int32
# ---------- python_41: Python ----------
__author__ = "NJ9"
__version__ = "2019.06.02"

import rhinoscriptsyntax as rs
import random
import math

pts = []
X = []
Y = []

for i in range(min, max):
    epsilon = (random.random() - 0.5 ) * sigma
    x = i * 0.01
#    y = x * a + b + epsilon
    y = x * a + b + epsilon + math.sin(x * scale)
    X.append(x);
    Y.append(y);
    p = rs.AddPoint(x,y,0);
    pts.append(p)
a =pts;


def GetMean(d):
    return sum(d) / len(d)
    
def GetLose(d):
    theMean = GetMean(d)
    print(theMean)
    lose = 0.0;
    for i in d:
        lose += i - theMean
    return lose
    
def FitLinearModel(X,Y):
    # Estimate the coefficients 
    # beta1 = np.sum((X-np.mean(X)) * (Y-np.mean(Y))) / np.sum( (X-np.mean(X))**2)
    # beta0 = np.mean(Y) - beta1 * np.mean(X)  
    xMean = GetMean(X)
    yMean = GetMean(Y)
    
    lose1 = 0.0;
    for i in X:
        lose1 += math.pow(i - xMean, 2) # np.sum( (X-np.mean(X))**2)
    lose2 = 0.0;
    for i in range(len(X)):
        x = X[i]
        y = Y[i]
        lose2 += (x - xMean) * (y - yMean)
    
    beta1 = lose2 / lose1
    beta0 = yMean - beta1 * xMean
    
    return beta0, beta1

betas = FitLinearModel(X,Y)

B = betas[0]
A = betas[1]
# ---------- end python_41 ----------
unit = UnitVector(Vector=subtraction)
python_42 = GhPythonScript(x=geo_6, y=geo_7, r=Slider(5, range=0..10), v=unit)  # -> out, a, arc
# ---------- python_42: Python ----------
__author__ = "namju"
__version__ = "2023.05.24"

import rhinoscriptsyntax as rs

pts = rs.CurveFilletPoints(x, y, r)

spt = rs.CurveStartPoint(x)
ept = rs.CurveEndPoint(x)

tv = rs.VectorSubtract(ept, spt)
tv = rs.VectorUnitize(tv)

arc = rs.AddArcPtTanPt(pts[0], tv, pts[1])
# ---------- end python_42 ----------
panel_31 = Panel(python_42.arc)
item_6 = ListItem(List=python_42.a, Index=Slider(2, range=0..10), Wrap=True)
vdis = VectorDisplay(Anchor=pt_17, Vector=subtraction)
# 012_Line_start_end_mid
geo_8 = Geometry(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)
panel_32 = Panel(subtraction)
pt_18 = Point(Point(30.72320729, 19.36937181, 0))
pt_19 = Point(Point(30.72320729, 19.36937181, 0))
# 017_Circle_Packing
pt_20 = Point(Point(111.9990084, 76.95814785, 0))
pt_21 = Point(Point(111.9990084, 76.95814785, 0))
panel_33 = Panel(python_41.A)
panel_34 = Panel(python_41.B)
python_43 = GhPythonScript(n=number_slider_17)  # -> out, p0, p1, l, a; inputs n: Int32
# ---------- python_43: Python ----------
__author__ = "namju"
__version__ = "2023.05.24"

import rhinoscriptsyntax as rs


p0 = rs.AddPoint(10, 15,20)
p1 = rs.AddPoint(-8, 5,0)

l = rs.AddLine(p0, p1)

dis = rs.CurveLength(l)
print(dis)

pts = []
for t in range(0, int(dis) + 1, n):
    p = rs.EvaluateCurve(l, t)
    pts.append(p)

a = pts
# ---------- end python_43 ----------
python_44 = GhPythonScript(n=Slider(4, range=0..10))  # -> out, p0, p1, l, a; inputs n: Int32
# ---------- python_44: Python ----------
__author__ = "namju"
__version__ = "2023.05.24"

import rhinoscriptsyntax as rs


p0 = rs.AddPoint(10, 15,20)
p1 = rs.AddPoint(-8, 5,0)

l = rs.AddLine(p0, p1)


dis = rs.Distance(p0, p1)

interval = dis / ( n -1) 

print(interval)

pts = []
for i in range(n):
    t = (i * interval)
    p = rs.EvaluateCurve(l, t)
    pts.append(p)

a = pts
# ---------- end python_44 ----------
python_45 = GhPythonScript(min=number_slider_14, max=number_slider_16, scale=number_slider_15, a=python_41.A, b=python_41.B)  # -> out, a, b, c; inputs min: Int32, max: Int32
# ---------- python_45: Python ----------
__author__ = "NJ9"
__version__ = "2019.06.01"

import rhinoscriptsyntax as rs
import random
import math

pts = []

for i in range(min, max):
    x = i * 0.01
    y = a *x + b
    p = rs.AddPoint(x,y,0);
    pts.append(p)
a =pts;
# ---------- end python_45 ----------
line = Line(geo_8)
python_46 = GhPythonScript(p0=pt_18, p1=pt_20)  # -> out, a; inputs p0: Point3d, p1: Point3d; same code as python_19
python_47 = GhPythonScript(p0=pt_19, p1=pt_21)  # -> out, a; inputs p0: Point3d, p1: Point3d; same code as python_21
python_48 = GhPythonScript(x=Slider(16, range=0..100), y=Slider(24, range=0..100))  # -> out, a, b, c; same code as python_23

c_script = CSharpScript()  # -> out, A
# ---------- c_script: C# ----------
    List < int> myNum = new List<int>(){2};
    Increase(myNum);

    Print("By ref : " + myNum[0].ToString());




    List < int> youNum = new List<int>(){2};
    IncreaseByValue(youNum);

    Print("By value : " + youNum[0].ToString());
# ---------- c_script: C# additional code ----------
  public List<int> Increase(List<int> data){
    data[0]++;
    return data;
  }


  public List<int> IncreaseByValue(List<int> data){

    List<int> dataNew = new List<int>();
    dataNew.Add(data[0] + 1);
    return dataNew;
  }
# ---------- end c_script ----------
c_script_2 = CSharpScript()  # -> out, A
# ---------- c_script_2: C# ----------
    int myNum = 2;
    Increase(myNum);

    Print("By ref : " + myNum.ToString());


    int yourNum = 2;
    yourNum = Increase(yourNum);

    Print("By value : " + yourNum.ToString());
# ---------- c_script_2: C# additional code ----------
  public int Increase(int data){
    data++;
    return data;
  }
# ---------- end c_script_2 ----------
c_script_3 = CSharpScript()  # -> out, A
# ---------- c_script_3: C# ----------
    Person p0 = new Person();
    Increase(p0);

    Print("By ref : " + p0.age.ToString());


    Person p1 = new Person();
    IncreaseByValue(p1);

    Print("By value : " + p1.age.ToString());
# ---------- c_script_3: C# additional code ----------
  public Person Increase(Person data){
    data.age++;
    return data;
  }

  public Person IncreaseByValue(Person data){
    Person p = new Person();
    p.age = data.age + 1;
    return data;
  }


  public class Person {
    public int age = 2;
    public double height = 90;
  }
# ---------- end c_script_3 ----------
panel_35 = Panel(c_script.out)
# 003 help file
panel_36 = Panel(c_script_2.out)
panel_37 = Panel(c_script_3.out)

panel_38 = Panel(geo_8)
python_49 = GhPythonScript(ln=geo_8)  # -> out, a, b, c, mp
# ---------- python_49: Python ----------
__author__ = "namju"
__version__ = "2023.05.20"

import rhinoscriptsyntax as rs

line = rs.coerceline(ln)


a = line.From
b = line.To
c = rs.CurveMidPoint(ln)


x = (b[0] - a[0]) * 0.5
y = (b[1] - a[1]) * 0.5
z = 0

mp = rs.AddPoint([x + a[0], y + a[1], z])
# ---------- end python_49 ----------
panel_39 = Panel(line)
panel_40 = Panel(python_46.a)
panel_41 = Panel(python_47.out)
panel_42 = Panel(python_48.c)
panel_43 = Panel(python_49.out)
# 030_Fillet Example, Polyline & fillet, GetDirection
geo_9 = Geometry(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)
python_50 = GhPythonScript(pl=geo_9, r=Slider(8, range=0..10))  # -> out, a, b
# ---------- python_50: Python ----------
__author__ = "namju"
__version__ = "2023.05.24"

import rhinoscriptsyntax as rs

def GetDirection(line):
    spt = rs.CurveStartPoint(line)
    ept = rs.CurveEndPoint(line)
    v = rs.VectorSubtract(ept, spt)
    return rs.VectorUnitize(v)


pts = rs.PolylineVertices(pl)

lns = []
for i in range(len(pts)-1):
    p0 =  pts[i]
    p1 =  pts[i+1]
    
    ln = rs.AddLine(p0, p1)
    lns.append(ln)

arcList = []
ptsList = []
for i in range(len(lns)-1):
    l0 = lns[i]
    l1 = lns[i+1]
    
    points = rs.CurveFilletPoints(l0, l1, r)
    dir = GetDirection(l0)
    arc = rs.AddArcPtTanPt(points[0], dir, points[1])
    
    arcList.append(arc)
    ptsList.append(points[0])
    ptsList.append(points[1])


#print(len(lns))
#print(len(arcList))
#print(len(ptsList))

count = 0
countArc = 0


curveList = []

for i in range(len(lns)):
    line = lns[i]
    if (i == 0):
        p = ptsList[count]
        t = rs.CurveClosestPoint(line, p)
        lineModified = rs.TrimCurve(line, [0, t])
        curveList.append(lineModified)
        curveList.append(arcList[countArc])
        countArc += 1
        count += 1
        
        print(i)
    elif(i == len(lns) -1):
        p = ptsList[count]
        t = rs.CurveClosestPoint(line, p)
        domain = rs.CurveDomain(line);
        lineModified = rs.TrimCurve(line, [t, domain[1]])
        curveList.append(lineModified)
        print(i)
    else:
        p0 = ptsList[count]
        count += 1
        p1 = ptsList[count]
        count += 1
        
        t0 = rs.CurveClosestPoint(line, p0)
        t1 = rs.CurveClosestPoint(line, p1)
        
        lineModified = rs.TrimCurve(line, [t0, t1])
        curveList.append(lineModified)
        curveList.append(arcList[countArc])
        countArc += 1
        print(i)



a = arcList
b = curveList
# ---------- end python_50 ----------
sph_6 = Sphere(Base=python_49.mp, Radius=Slider(28, range=0..100))
number_slider_18 = Slider(16, range=0..1100)
panel_44 = Panel(python_50.out)
geo_10 = Geometry(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)
geo_11 = Geometry(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)
geo_12 = Geometry(python_50.b)
geo_13 = Geometry(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)
item_7 = ListItem(List=python_50.b, Index=Slider(5, range=0..10), Wrap=True)
python_51 = GhPythonScript(x=geo_11, len=Slider(17, range=0..1100))  # -> out, a
# ---------- python_51: Python ----------
__author__ = "namju"
__version__ = "2023.05.24"

import rhinoscriptsyntax as rs


a = rs.DivideCurveLength(x, len)
# ---------- end python_51 ----------
pipe_3 = Pipe(Curve=geo_12, Radius=1, Caps=0)
pipe_4 = Pipe(Curve=item_7, Radius=1, Caps=0)
python_52 = GhPythonScript(x=geo_10, t=number_slider_18)  # -> out, a
# ---------- python_52: Python ----------
__author__ = "namju"
__version__ = "2023.05.24"

import rhinoscriptsyntax as rs

a = rs.SplitCurve(x, t)
# ---------- end python_52 ----------
python_53 = GhPythonScript(x=geo_13, n=Slider(11, range=0..1100))  # -> out, a
# ---------- python_53: Python ----------
__author__ = "namju"
__version__ = "2023.05.24"

import rhinoscriptsyntax as rs


a = rs.DivideCurve(x, n)
# ---------- end python_53 ----------
# 026_Curve, SplitCurve, DivideCurve, DivideCurveLength
divlength = DivideLength(Curve=geo_10, Length=number_slider_18)  # -> Points, Tangents, Parameters
# 013_Polyline_Curve_data
pt_22 = Point([Point(11.06500255, 21.56126981, 0), Point(47.69975645, 67.28786044, 0), Point(116.1559389, 48.83678001, 0), Point(138.8855308, -21.75865816, 0)])
panel_45 = Panel(python_52.out)
# 018_Rectangle
number_slider_19 = Slider(50, range=0..100)
panel_46 = Panel(python_53.out)
pt_23 = Point(Point(137.281089, 83.59968517, 0))
item_8 = ListItem(List=python_52.a, Index=Slider(0, range=0..100), Wrap=True)
python_54 = GhPythonScript(pts=pt_22, degree=Slider(3, range=0..10), p=pt_23)  # -> out, a, b, c, d, e, cp; inputs pts: list, degree: Int32
# ---------- python_54: Python ----------
__author__ = "namju"
__version__ = "2023.05.20"

import rhinoscriptsyntax as rs


pl = rs.AddInterpCurve(pts, degree)

if rs.IsCurve(pl):
    b = rs.CurveLength(pl)
    c = rs.CurveStartPoint(pl)
    d = rs.CurveEndPoint(pl)
    e = rs.CurveMidPoint(pl)
    
    t = rs.CurveClosestPoint(pl, p)
    
    cp = rs.EvaluateCurve(pl, t);
    
    print(t)
    a = pl
# ---------- end python_54 ----------
python_55 = GhPythonScript(pts=pt_22)  # -> out, a, b, c, d, e; inputs pts: list
# ---------- python_55: Python ----------
__author__ = "namju"
__version__ = "2023.05.20"

import rhinoscriptsyntax as rs


pl = rs.AddPolyline(pts)

if rs.IsPolyline(pl):
    b = rs.CurveLength(pl)
    c = rs.CurveStartPoint(pl)
    d = rs.CurveEndPoint(pl)
    e = rs.CurveMidPoint(pl)
    a = pl
# ---------- end python_55 ----------
pipe_5 = Pipe(Curve=item_8, Radius=1, Caps=0)
pt_24 = Point(Point(44.49810275, 62.48751459, 0))
pt_25 = Point([Point(-58.89627456, 100.0076618, 0), Point(-29.48150866, 133.968346, 0), Point(13.83841932, 160.9764493, 0), Point(80.42275305, 154.0238682, 0), Point(115.1856582, 127.8179859, 0), Point(143.7982032, 104.0187662, 0)])
python_56 = GhPythonScript(pts=pt_22, p=pt_23)  # -> out, a, b, c, d, e, cp; inputs pts: list
# ---------- python_56: Python ----------
__author__ = "namju"
__version__ = "2023.05.20"

import rhinoscriptsyntax as rs


pl = rs.AddCurve(pts)

if rs.IsCurve(pl):
    b = rs.CurveLength(pl)
    c = rs.CurveStartPoint(pl)
    d = rs.CurveEndPoint(pl)
    e = rs.CurveMidPoint(pl)
    
    t = rs.CurveClosestPoint(pl, p)
    
    cp = rs.EvaluateCurve(pl, t);
    
    print(t)
    a = pl
# ---------- end python_56 ----------
panel_47 = Panel(pt_22)
python_57 = GhPythonScript(x=number_slider_19, y=Slider(28, range=0..100))  # -> out, a
# ---------- python_57: Python ----------
__author__ = "namju"
__version__ = "2023.05.23"

import rhinoscriptsyntax as rs

plane = rs.WorldXYPlane()
plane = rs.MovePlane(plane, [-x * 0.5, -y* 0.5, 0])

a = rs.AddRectangle(plane, x , y)
# ---------- end python_57 ----------
python_58 = GhPythonScript(p=pt_24, x=Slider(42, range=0..100), y=Slider(32, range=0..100))  # -> out, a; inputs p: Plane
# ---------- python_58: Python ----------
__author__ = "namju"
__version__ = "2023.05.23"

import rhinoscriptsyntax as rs



a = rs.AddRectangle(p, x , y)
# ---------- end python_58 ----------
python_59 = GhPythonScript(p=pt_25, x=Slider(26, range=0..100), y=Slider(22, range=0..100))  # -> out, a; inputs p: Plane; same code as python_58
python_60 = GhPythonScript(x=Slider(42, range=0..100), y=Slider(32, range=0..100))  # -> out, a
# ---------- python_60: Python ----------
__author__ = "namju"
__version__ = "2023.05.23"

import rhinoscriptsyntax as rs



a = rs.AddRectangle([x * -0.5, y * -0.5,0], x , y)
# ---------- end python_60 ----------
panel_48 = Panel(python_55.b)
panel_49 = Panel(python_55.e)
panel_50 = Panel(python_54.out)

number_slider_20 = Slider(6, range=0..10)
# 004_function1d.gh
number_slider_21 = Slider(-500, range=-500..100)
python_61 = GhPythonScript(
    min=number_slider_21,
    max=Slider(480, range=0..500),
    scale=Slider(0.02, range=0..1),
    a=Slider(0.93, range=-10..10),
    b=Slider(0, range=-10..10),
    c=Slider(2.69, range=-10..10),
    d=Slider(0.3, range=-10..10))  # -> out, a, b, c; inputs min: Int32, max: Int32
# ---------- python_61: Python ----------
__author__ = "NJ9"
__version__ = "2019.05.30"

import rhinoscriptsyntax as rs
import math

pts = []
pts2 = []

pts3 = []

for i in range(min, max):
    
    x = i * scale
#    y = x * a + b
#    y = math.pow(x, int(a))
#    y = math.sqrt(x)
#    y = math.sqrt(math.pow(a, 2) - math.pow(x, 2) )
#    y = math.fabs(x);
#    y = math.cos(x * c + d) * a + b;
    y = math.sin(x * c);
    yy = math.cos(x * c + d) * a + b;
    yyy = y * yy;
    z = 0
    
    p = rs.AddPoint(x,y,z);
    pts.append(p)
    
    p = rs.AddPoint(x,yy,z);
    pts2.append(p)
    
    p = rs.AddPoint(x,yyy,z);
    pts3.append(p)

a = pts;
b = pts2;
c = pts3;
# ---------- end python_61 ----------
intcrv_t = InterpolateT(Vertices=python_61.c, TangentStart=Vector(0, 0, 0), TangentEnd=Vector(0, 0, 0), KnotStyle=1)  # -> Curve, Length, Domain
panel_51 = Panel(python_61.a)
pipe_6 = Pipe(Curve=intcrv_t.Curve, Radius=Slider(0.066, range=0..1), Caps=0)

python_62 = GhPythonScript(
    min=Slider(-262, range=-500..100),
    max=Slider(275, range=0..500),
    scale=Slider(0.02, range=0..1),
    a=Slider(0.93, range=-10..10),
    b=Slider(-2.48, range=-10..10),
    b0=Slider(-1.72, range=-10..10),
    b1=Slider(1.63, range=-10..10),
    c=Slider(1, range=-10..10),
    d=Slider(3.45, range=-10..10))  # -> out, a; inputs min: Int32, max: Int32
# ---------- python_62: Python ----------
__author__ = "NJ9"
__version__ = "2019.05.30"

import rhinoscriptsyntax as rs
import math

pts = []
pts2 = []

pts3 = []

for i in range(min, max):
    
    x = i * scale
#    y = math.tan(x);
#    y = math.floor(x * c + d) + b;
#    y = math.pow(d, - (a * math.pow(b0 + x , 2)))
    y = math.pow(d, - (a * math.pow(b0 + x , 2))) + 0.5 / math.pow(d, math.pow(b1 + x , 2))
    y = y*c
    z = 0
    
    p = rs.AddPoint(x,y,z);
    pts.append(p)

a = pts;
# ---------- end python_62 ----------
panel_52 = Panel(python_62.a)

pt_26 = Point([Point(-58.89627456, 100.0076618, 0), Point(-29.48150866, 133.968346, 0), Point(13.83841932, 160.9764493, 0), Point(80.42275305, 154.0238682, 0), Point(115.1856582, 127.8179859, 0), Point(143.7982032, 104.0187662, 0)])
pt_27 = Point([Point(-58.89627456, 100.0076618, 0), Point(-29.48150866, 133.968346, 0), Point(13.83841932, 160.9764493, 0), Point(80.42275305, 154.0238682, 0), Point(115.1856582, 127.8179859, 0), Point(143.7982032, 104.0187662, 0)])
# 031_Fillet Example, Polyline & Trim, Arc
geo_14 = Geometry(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)
python_63 = GhPythonScript(p=pt_27, target=Slider(503, range=0..1100))  # -> out, a, b, wi, he, d; inputs p: list of Plane
# ---------- python_63: Python ----------
__author__ = "namju"
__version__ = "2023.05.23"

import rhinoscriptsyntax as rs
import random

plane = rs.WorldXYPlane()
width = (random.random() * 50) + 50
height = (random.random() * 50) + 50


data = []
rect = []
count = 0

for j in range(100):
    for i in range(1000):
        offsetX = (random.random() * 0.8) + 0.1
        offsetY = (random.random() * 0.8) + 0.1
        area = width * height
        if (area < target):
            width +=offsetX
            height +=offsetY
        else:
            width -= offsetX
            height -= offsetY
        area = width * height
        
        print(area)
        
        if (area - 5 < target and area +5 > target ):
            rect = rs.AddRectangle(plane, width , height)
            data.append(str(width) + " ," + str(height))
            count+=1
            break
    if(count == 50):
        break

a = rect
b = width * height # rs.Area(a);
wi = width
he = height
d = data
# ---------- end python_63 ----------

# ---- group: Bézier curve
# https://en.wikipedia.org/wiki/B%C3%A9zier_curve
number_slider_22 = Slider(0.6825, range=0..1)
# 014_Bézier, Sigmid, Circle, Arc, Helix, Gear Curve
pt_28 = Point([Point(-7.103456899, -1.226468463, 0), Point(-10.88465722, 31.11013242, 0), Point(46.79582702, 27.3805936, 0), Point(32.00847824, -8.004950828, 0)])
python_64 = GhPythonScript(p=pt_28, t=number_slider_22)  # -> out, a, b; inputs p: list of Point3d
# ---------- python_64: Python ----------
__author__ = "NJ9"
__version__ = "2019.06.03"

import rhinoscriptsyntax as rs


def getPoint(p0,p1,p2,p3,t):
    if t > 1:
        t = 1;
    elif t < 0:
        t = 0;
    i = 1 - t;
    out = []
    out.append(i * i * i * p0.X + 3 * i * i * t * p1.X + 3 * i * t * t * p2.X + t * t * t * p3.X)
    out.append(i * i * i * p0.Y + 3 * i * i * t * p1.Y + 3 * i * t * t * p2.Y + t * t * t * p3.Y )
    out.append(i * i * i * p0.Z + 3 * i * i * t * p1.Z + 3 * i * t * t * p2.Z + t * t * t * p3.Z)
    return out;


pt = getPoint(p[0], p[1], p[2], p[3], t)
a = rs.AddPoint(pt[0], pt[1], pt[2])


pts = []
for i in range(100):
    pt = getPoint(p[0], p[1], p[2], p[3], i * 0.01);
    pt = rs.AddPoint(pt[0], pt[1], pt[2])
    pts.append(pt)
b = pts;
# ---------- end python_64 ----------
sph_7 = Sphere(Base=python_64.a, Radius=1)
panel_53 = Panel(pt_28)

# ----
python_65 = GhPythonScript(p=pt_26, target=Slider(503, range=0..1100))  # -> out, a, b, wi, he; inputs p: list of Plane
# ---------- python_65: Python ----------
__author__ = "namju"
__version__ = "2023.05.23"

import rhinoscriptsyntax as rs
import random

plane = rs.WorldXYPlane()
width = (random.random() * 50) + 50
height = (random.random() * 50) + 50



rect = []


for i in range(1000):
    offsetX = (random.random() * 0.8) + 0.1
    offsetY = (random.random() * 0.8) + 0.1
    area = width * height
    if (area < target):
        width +=offsetX
        height +=offsetY
    else:
        width -= offsetX
        height -= offsetY
    area = width * height
    
    print(area)
    
    if (area - 5 < target and area +5 > target ):
        rect = rs.AddRectangle(plane, width , height)
        break


a = rect
b = width * height # rs.Area(a);
wi = width
he = height
# ---------- end python_65 ----------

# ---- group: Sigmoid
# https://en.wikipedia.org/wiki/Sigmoid_function
number_slider_23 = Slider(0.506, range=0..1)
python_66 = GhPythonScript(xIn=Slider(-5.75, range=-10..10), b=Slider(0.58, range=0..10), scale=number_slider_23)  # -> out, a
# ---------- python_66: Python ----------
__author__ = "NJ9"
__version__ = "2019.06.03"

import rhinoscriptsyntax as rs
import math

pts = []

e = math.exp(1)
for x in range(-900, 900):
    x *= scale
    y = 1 / (1 + math.pow(e, -x)) 
    pts.append(rs.AddPoint((x * scale) + b,y,0))
    
a = pts;
# ---------- end python_66 ----------
panel_54 = Panel(python_66.a)

# ---- group: Circle
# https://en.wikipedia.org/wiki/Circle
number_slider_24 = Slider(18, range=0..100)
# 019_Rectangle_Optimization
number_slider_25 = Slider(0, range=0..10)
python_67 = GhPythonScript(scale=Slider(11, range=0..100))  # -> out, a
# ---------- python_67: Python ----------
__author__ = "NJ9"
__version__ = "2019.06.03"

import rhinoscriptsyntax as rs
import math;

pts = []

r = (3.14 * 2) /100
print(r)

for i in range(100):
    x = i * 0.01
    y = math.sin(r * i) 
    
    x = math.cos(r * i) * scale 
    y = math.sin(r * i) * scale
    
    p = rs.AddPoint(x,y,0)
    pts.append(p)

a = pts;
# ---------- end python_67 ----------
python_68 = GhPythonScript(scale=Slider(10, range=0..100), angle=Slider(1000, range=0..1000), zScale=number_slider_25)  # -> out, a; inputs angle: Int32
# ---------- python_68: Python ----------
__author__ = "NJ9"
__version__ = "2019.06.03"

import rhinoscriptsyntax as rs
import math;

pts = []

r = (3.14 * 2) / 360

for i in range(angle):
    x = math.cos(r * i) * scale
    y = math.sin(r * i) * scale
    z = i * zScale
    p = rs.AddPoint(x,y,z)
    pts.append(p)

a = pts;
# ---------- end python_68 ----------
python_69 = GhPythonScript(scale=number_slider_24, angle=Slider(179, range=0..1000))  # -> out, a; inputs angle: Int32
# ---------- python_69: Python ----------
__author__ = "NJ9"
__version__ = "2019.06.03"

import rhinoscriptsyntax as rs
import math;

pts = []

r = (3.14 * 2) / 360

for i in range(angle):
    x = math.cos(r * i) * scale
    y = math.sin(r * i) * scale
    
    p = rs.AddPoint(x,y,0)
    pts.append(p)

a = pts;
# ---------- end python_69 ----------

# ----
python_70 = GhPythonScript(pl=geo_14, r=Slider(8, range=0..10))  # -> out, a, b; same code as python_50
python_71 = GhPythonScript(x=python_63.d)  # -> out, a; inputs x: list
# ---------- python_71: Python ----------
__author__ = "namju"
__version__ = "2023.05.23"

import rhinoscriptsyntax as rs


print(x)
# ---------- end python_71 ----------
panel_55 = Panel(python_65.b)
graph = QuickGraph(python_65.out, SortOrder=0)
panel_56 = Panel(python_65.a)
panel_57 = Panel([python_65.wi, python_65.he])
panel_58 = Panel(python_63.b)
graph_2 = QuickGraph(python_63.out, SortOrder=0)
panel_59 = Panel(python_63.a)
panel_60 = Panel([python_63.wi, python_63.he])
panel_61 = Panel(python_70.out)
geo_15 = Geometry(python_70.b)
item_9 = ListItem(List=python_70.b, Index=Slider(5, range=0..10), Wrap=True)
panel_62 = Panel(python_65.out)
pipe_7 = Pipe(Curve=geo_15, Radius=1, Caps=0)
pipe_8 = Pipe(Curve=item_9, Radius=1, Caps=0)
panel_63 = Panel(python_63.out)

python_72 = GhPythonScript(scale=Slider(18, range=0..100), angle=Slider(360, range=0..1000))  # -> out, a; inputs angle: Int32
# ---------- python_72: Python ----------
__author__ = "NJ9"
__version__ = "2019.06.03"

import rhinoscriptsyntax as rs
import math;

pts = []

r = (3.14 * 2) / 360

index = 0

for i in range(0, angle, 10):
    if (index % 2 == 0):
        x = math.cos(r * i) * scale
        y = math.sin(r * i) * scale
    else :
        x = math.cos(r * i) * scale * 0.8
        y = math.sin(r * i) * scale * 0.8
    p = rs.AddPoint(x,y,0)
    pts.append(p)
    index += 1

a = pts;
# ---------- end python_72 ----------
intcrv = Interpolate(Vertices=python_72.a, Degree=3, Periodic=False, KnotStyle=1)  # -> Curve, Length, Domain

panel_64 = Panel(python_63.d)
geo_16 = Geometry(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)
# 027_Curve, SplitCurve, CopyObject & Debugging
geo_17 = Geometry(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)
python_73 = GhPythonScript(x=geo_16, length=Slider(17, range=0..1100))  # -> out, pts, curveSeg
# ---------- python_73: Python ----------
__author__ = "namju"
__version__ = "2023.05.24"

import rhinoscriptsyntax as rs


pts = rs.DivideCurveLength(x, length)

curves = []

for i in range(len(pts)-1):
    p0 = pts[i]
    p1 = pts[i+1]

    curve = rs.CopyObject(x)
    
    t0 = rs.CurveClosestPoint(curve, p0)
    t1 = rs.CurveClosestPoint(curve, p1)
    
    c = rs.TrimCurve(curve,[t0, t1]) 
    curves.append(c)


curveSeg = curves
# ---------- end python_73 ----------
python_74 = GhPythonScript(x=geo_17, length=Slider(17, range=0..1100))  # -> out, pts, curveSeg
# ---------- python_74: Python ----------
__author__ = "namju"
__version__ = "2023.05.24"

import rhinoscriptsyntax as rs


pts = rs.DivideCurveLength(x, length)

curves = []

for i in range(len(pts)-1):
    p0 = pts[i]
    p1 = pts[i+1]

    curve = rs.CopyObject(x)
    
    t0 = rs.CurveClosestPoint(curve, p0)
    t1 = rs.CurveClosestPoint(curve, p1)
    
    c = rs.SplitCurve(curve, t1)[0]
    
    if (i != 0):
        c = rs.SplitCurve(c, t0)[1]
    
    curves.append(c)


curveSeg = curves
# ---------- end python_74 ----------
panel_65 = Panel(python_74.out)
panel_66 = Panel(python_74.curveSeg)
item_10 = ListItem(List=python_74.curveSeg, Index=Slider(18, range=0..100), Wrap=True)
item_11 = ListItem(List=python_73.curveSeg, Index=Slider(16, range=0..100), Wrap=True)

# ----
# 005_pointGrid 006 3D grid
pt_29 = Point(Point(87.70927521, -2.599306752, -15.46215143))
pt_30 = Point(Point(138.2666317, 44.68447053, 7.309576011))
panel_67 = Panel(pt_29)
python_75 = GhPythonScript(
    p0=pt_29,
    p1=pt_30,
    xNum=Slider(10, range=0..100),
    yNum=Slider(10, range=0..100),
    zNum=Slider(5, range=0..100),
    mode=Slider(0, range=0..10),
    theDis=Slider(89.25, range=0..100))  # -> out, a, b; inputs xNum: Int32, yNum: Int32, zNum: Int32, mode: Int32
# ---------- python_75: Python ----------
__author__ = "NJ9"
__version__ = "2019.05.31"

import rhinoscriptsyntax as rs

def dis2(p0, p1):
    pos0 = rs.PointCoordinates(p0);
    pos1 = rs.PointCoordinates(p1);
    dis = (pos1[0] - pos0[0]) * (pos1[0] - pos0[0]) + (pos1[1] - pos0[1]) * (pos1[1] - pos0[1]) + (pos1[2] - pos0[2]) * (pos1[2] - pos0[2])
    return dis

pos0 = rs.PointCoordinates(p0);
pos1 = rs.PointCoordinates(p1);

xInterval = (pos1[0] - pos0[0]) / (xNum - 1)
yInterval = (pos1[1] - pos0[1]) / (yNum - 1)
zInterval = (pos1[2] - pos0[2]) / (zNum - 1)

pts = []

for k in range(int(zNum)):
    for j in range(int(yNum)):
        for i in range(int(xNum)):
            x = pos0[0] + xInterval * i
            y = pos0[1] + yInterval * j
            z = pos0[2] + zInterval * k
            if mode == 0:
                if (i * j) & 2 == 0:
                    p = rs.AddPoint(x,y,z)
                    pts.append(p)
            elif mode == 1:
                if (i * j + i * j ) & 2 == 0:
                    p = rs.AddPoint(x,y,z)
                    pts.append(p)
            elif mode == 2:
                if (i * j - i * j ) & 2 == 0:
                    p = rs.AddPoint(x,y,z)
                    pts.append(p)
            elif mode == 3:
                if (i * j - i - j ) & 2 == 0:
                    p = rs.AddPoint(x,y,z)
                    pts.append(p)

lns = []

for j in range(len(pts)-1):
    p0 = pts[j]
    for i in range(j, len(pts)):
        p1 = pts[i]
        if (p0 != p1):
            dis = dis2(p0, p1)
            if dis < theDis:
                ln = rs.AddLine(p0, p1);
                lns.append(ln);
#        print(dis)
        
    
a = pts
b = lns
# ---------- end python_75 ----------

pipe_9 = Pipe(Curve=item_10, Radius=1, Caps=0)
pipe_10 = Pipe(Curve=item_11, Radius=1, Caps=0)
# 020_Arc_Data_Rotate_Traslate_Axis
number_slider_26 = Slider(100, range=0..100)
pt_31 = Point(Point(-3.194190744, 23.33217444, 0))
python_76 = GhPythonScript(degree=number_slider_26, r=Slider(581, range=0..1000), p=pt_31)  # -> out, a
# ---------- python_76: Python ----------
__author__ = "namju"
__version__ = "2023.05.23"

import rhinoscriptsyntax as rs

arc = rs.AddArc([10, 10, 0], 15, degree)

#rs.MoveObject(arc, [-50, 0 ,0])

arc = rs.RotateObject(arc, [0, 0, 0], r)
arc = rs.MoveObject(arc, p)


a = arc
# ---------- end python_76 ----------
panel_68 = Panel(pt_31)
# 021_Arc, Data, Rotation Based on Axis
number_slider_27 = Slider(101, range=-100..101)
python_77 = GhPythonScript(degree=number_slider_27, r=Slider(38, range=-1..100))  # -> out, a, spt, ept, mpt, CP; inputs p: Plane
# ---------- python_77: Python ----------
__author__ = "namju"
__version__ = "2023.05.23"

import rhinoscriptsyntax as rs

arc = rs.AddArc(p, r, degree)


spt = rs.CurveStartPoint(arc)
ept = rs.CurveEndPoint(arc)

print(rs.ArcAngle(arc))
print(rs.ArcCenterPoint(arc))
mpt = rs.ArcMidPoint(arc)
print(rs.ArcRadius(arc))


t = rs.CurveClosestPoint(arc, cp)
CP = rs.EvaluateCurve(arc, t)

a = arc
# ---------- end python_77 ----------
python_78 = GhPythonScript(degree=Slider(171, range=0..400))  # -> out, a, spt, ept, mpt, CP; inputs degree: Int32, p: Plane
# ---------- python_78: Python ----------
__author__ = "namju"
__version__ = "2023.05.23"

import rhinoscriptsyntax as rs

arc = rs.AddArc([10, 10, 0], 13, 90)

CP = rs.ArcCenterPoint(arc)
CP = rs.ArcMidPoint(arc)

arc = rs.RotateObject(arc, CP, degree, [0, 0, 1])


a = arc
# ---------- end python_78 ----------
panel_69 = Panel(python_77.CP)
