# Grasshopper definition LAB_01_VectorRhinoAPI.gh (Grasshopper 1.0.8)

# ----
# Data in Design
# 
# Instructor : NJ Namju Lee / nj.namju@gmail.com
# 
# * class - https://namjulee.github.io/data-in-design/
# 
# * Lab - https://namjulee.github.io/njs-lab-public/
# 
# * Video(English) - https://www.youtube.com/c/njnamjulee
# * Writing(English) - https://medium.com/@nj-namju
# 
# * Video(Korean) - https://www.youtube.com/c/CodeforDesign
# * Writing(Korean) - https://brunch.co.kr/@njnamju
# 
# Installation - https://namjulee.github.io/njs-lab-public/installation
# https://computationaldesign.tistory.com/39
# Vector construction
number_slider = Slider(5, range=0..10)
number_slider_2 = Slider(10, range=0..10)
number_slider_3 = Slider(0, range=0..10)

# ----
# Scalar Multiplication of a Vector &
# Division by a Scalar (Scalar Division of a Vector)
number_slider_4 = Slider(63, range=0..100)
pt = Point(Point(31.70203215, -11.15786631, 0))
pt_2 = Point(Point(23.21938373, 13.57029378, 0))

# ----
# Vector addition
pt_3 = Point(Point(39.26666409, 39.24109607, 0))
pt_4 = Point(Point(59.05914631, 18.74173948, 0))

# ----
# Vector subtraction
pt_5 = Point(Point(71.55914466, 16.21133967, 0))
pt_6 = Point(Point(34.10622422, 30.24523842, 0))

vdis = VectorDisplay(Anchor="0,0,0", Vector=pt_3)
vdis_2 = VectorDisplay(Anchor="0,0,0", Vector=pt_4)
addition = Addition(A=pt_3, B=pt_4)
vdis_3 = VectorDisplay(Anchor=pt_3, Vector=pt_4)
vdis_4 = VectorDisplay(Anchor="0,0,0", Vector=addition)

py3 = Python3Script(v0=pt_3, v1=pt_4)  # -> out, a; inputs v0: Vector3d, v1: Vector3d
# ---------- py3: Python ----------
import rhinoscriptsyntax as rs

a = rs.VectorAdd(v0, v1)
# ---------- end py3 ----------
py3_2 = Python3Script(v0=pt_3, v1=pt_4)  # -> out, a; inputs v0: Vector3d, v1: Vector3d
# ---------- py3_2: Python ----------
import rhinoscriptsyntax as rs

x = v0.X + v1.X
y = v0.Y + v1.Y
z = v0.Z + v1.Z

a = rs.AddPoint(x, y, z)
# ---------- end py3_2 ----------
py3_3 = Python3Script(v0=pt_3, v1=pt_4)  # -> out, a; inputs v0: Vector3d, v1: Vector3d
# ---------- py3_3: Python ----------
import rhinoscriptsyntax as rs


v = v0 + v1
a = v
# ---------- end py3_3 ----------
c_script = CSharpScript(v0=pt_3, v1=pt_4)  # -> out, a; inputs v0: Vector3d, v1: Vector3d
# ---------- c_script: C# ----------
// Grasshopper Script Instance
#region Usings
using System;
using System.Linq;
using System.Collections;
using System.Collections.Generic;
using System.Drawing;

using Rhino;
using Rhino.Geometry;

using Grasshopper;
using Grasshopper.Kernel;
using Grasshopper.Kernel.Data;
using Grasshopper.Kernel.Types;
#endregion

public class Script_Instance : GH_ScriptInstance
{
    private void RunScript(Vector3d v0, Vector3d v1, ref object a)
    {
        // Write your logic here
       
        Vector3d v = v0 + v1;
        a = v;
    }
}
# ---------- end c_script ----------
vdis_5 = VectorDisplay(Anchor="0,0,0", Vector=py3.a)
vdis_6 = VectorDisplay(Anchor="0,0,0", Vector=py3_2.a)
vdis_7 = VectorDisplay(Anchor="0,0,0", Vector=py3_3.a)
vdis_8 = VectorDisplay(Anchor="0,0,0", Vector=c_script.a)

vdis_9 = VectorDisplay(Anchor="0,0,0", Vector=pt_6)
vdis_10 = VectorDisplay(Anchor="0,0,0", Vector=pt_5)
subtraction = Subtraction(A=pt_6, B=pt_5)
subtraction_2 = Subtraction(A=pt_5, B=pt_6)
multiplication = Multiplication(A=pt_6, B="-1")
vdis_11 = VectorDisplay(Anchor=pt_5, Vector=multiplication)
vdis_12 = VectorDisplay(Anchor="0,0,0", Vector=subtraction_2)
vdis_13 = VectorDisplay(Anchor=pt_5, Vector=pt_6)
vdis_14 = VectorDisplay(Anchor="0,0,0", Vector=subtraction)

vec = VectorXYZ(XComponent=number_slider, YComponent=number_slider_2, ZComponent=number_slider_3)  # -> Vector, Length
vdis_15 = VectorDisplay(Anchor="0,0,0", Vector=vec.Vector)
pt_7 = Point(vec.Vector)

py3_4 = Python3Script(x=number_slider, y=number_slider_2, z=number_slider_3)  # -> out, a
# ---------- py3_4: Python ----------
import rhinoscriptsyntax as rs

a = rs.AddPoint(x, y, z)
# ---------- end py3_4 ----------
py3_5 = Python3Script(x=number_slider, y=number_slider_2, z=number_slider_3)  # -> out, a
# ---------- py3_5: Python ----------
import Rhino as r

a = (x, y, z)
# ---------- end py3_5 ----------
c_script_2 = CSharpScript(x=number_slider, y=number_slider_2, z=number_slider_3)  # -> out, a; inputs x: Double, y: Double, z: Double
# ---------- c_script_2: C# ----------
// Grasshopper Script Instance
#region Usings
using System;
using System.Linq;
using System.Collections;
using System.Collections.Generic;
using System.Drawing;

using Rhino;
using Rhino.Geometry;

using Grasshopper;
using Grasshopper.Kernel;
using Grasshopper.Kernel.Data;
using Grasshopper.Kernel.Types;
#endregion

public class Script_Instance : GH_ScriptInstance
{
    private void RunScript(double x, double y, double z, ref object a)
    {
        Vector3d v = new Vector3d(x, y, z);
        a = v;
    }
}
# ---------- end c_script_2 ----------
py3_6 = Python3Script(x=number_slider, y=number_slider_2, z=number_slider_3)  # -> out, a
# ---------- py3_6: Python ----------
import Rhino as r

a = r.Geometry.Vector3d(x, y, z)
# ---------- end py3_6 ----------
panel = Panel(py3_5.a)
vdis_16 = VectorDisplay(Anchor="0,0,0", Vector=py3_4.a)
vdis_17 = VectorDisplay(Anchor="0,0,0", Vector=py3_6.a)
vdis_18 = VectorDisplay(Anchor="0,0,0", Vector=c_script_2.a)

py3_7 = Python3Script(v0=pt_5, v1=pt_6)  # -> out, a; inputs v0: Vector3d, v1: Vector3d
# ---------- py3_7: Python ----------
import rhinoscriptsyntax as rs

a = rs.VectorSubtract(v0, v1)
# ---------- end py3_7 ----------
py3_8 = Python3Script(v0=pt_5, v1=pt_6)  # -> out, a; inputs v0: Vector3d, v1: Vector3d
# ---------- py3_8: Python ----------
import rhinoscriptsyntax as rs

x = v0.X - v1.X
y = v0.Y - v1.Y
z = v0.Z - v1.Z

a = rs.AddPoint(x, y, z)
# ---------- end py3_8 ----------
py3_9 = Python3Script(v0=pt_5, v1=pt_6)  # -> out, a; inputs v0: Vector3d, v1: Vector3d
# ---------- py3_9: Python ----------
import rhinoscriptsyntax as rs


v = v0 - v1
a = v
# ---------- end py3_9 ----------
c_script_3 = CSharpScript(v0=pt_5, v1=pt_6)  # -> out, a; inputs v0: Vector3d, v1: Vector3d
# ---------- c_script_3: C# ----------
// Grasshopper Script Instance
#region Usings
using System;
using System.Linq;
using System.Collections;
using System.Collections.Generic;
using System.Drawing;

using Rhino;
using Rhino.Geometry;

using Grasshopper;
using Grasshopper.Kernel;
using Grasshopper.Kernel.Data;
using Grasshopper.Kernel.Types;
#endregion

public class Script_Instance : GH_ScriptInstance
{
    private void RunScript(Vector3d v0, Vector3d v1, ref object a)
    {
        // Write your logic here
       
        Vector3d v = new Vector3d(v0.X, v0.Y, v0.Z);

        v.X = v.X - v1.X;
        v.Y = v0.Y - v1.Y;
        v.Z -= v1.Z;

        a = v;
    }
}
# ---------- end c_script_3 ----------
vdis_19 = VectorDisplay(Anchor="0,0,0", Vector=py3_7.a)
vdis_20 = VectorDisplay(Anchor="0,0,0", Vector=py3_8.a)
vdis_21 = VectorDisplay(Anchor="0,0,0", Vector=py3_9.a)
vdis_22 = VectorDisplay(Anchor="0,0,0", Vector=c_script_3.a)

unit = UnitVector(Vector=pt_2)
amp = Amplitude(Vector=unit, Amplitude=number_slider_4)
vdis_23 = VectorDisplay(Anchor="0,0,0", Vector=pt_2)
move = Move(Geometry=pt, Motion=pt_2)  # -> Geometry, Transform
move_2 = Move(Geometry=pt, Motion=amp)  # -> Geometry, Transform

py3_10 = Python3Script(vec=pt_2, tVec=pt)  # -> out, a; inputs vec: Vector3d, tVec: Vector3d
# ---------- py3_10: Python ----------
import rhinoscriptsyntax as rs

a = rs.AddPoint(
    tVec.X + vec.X,
    tVec.Y + vec.Y,
    tVec.Z + vec.Z
    )
# ---------- end py3_10 ----------
py3_11 = Python3Script(vec=pt_2, tVec=pt, amp=number_slider_4)  # -> out, a; inputs vec: Vector3d, tVec: Vector3d
# ---------- py3_11: Python ----------
import rhinoscriptsyntax as rs


vecNor = rs.VectorUnitize(vec)


a = rs.AddPoint(
    tVec.X + (vecNor[0] * amp),
    tVec.Y + (vecNor[1] * amp),
    tVec.Z + (vecNor[2] * amp),
    )
# ---------- end py3_11 ----------
c_script_4 = CSharpScript(vec=pt_2, tVec=pt, amp=number_slider_4)  # -> out, a; inputs vec: Vector3d, tVec: Vector3d, amp: Double
# ---------- c_script_4: C# ----------
// Grasshopper Script Instance
#region Usings
using System;
using System.Linq;
using System.Collections;
using System.Collections.Generic;
using System.Drawing;

using Rhino;
using Rhino.Geometry;

using Grasshopper;
using Grasshopper.Kernel;
using Grasshopper.Kernel.Data;
using Grasshopper.Kernel.Types;
#endregion

public class Script_Instance : GH_ScriptInstance
{
    private void RunScript(Vector3d vec, Vector3d tVec, double amp, ref object a)
    {
        // Write your logic here
        vec.Unitize();

        tVec.X += vec.X * amp;
        tVec.Y += vec.Y * amp;
        tVec.Z += vec.Z * amp;

        a = tVec;
    }
}
# ---------- end c_script_4 ----------
py3_12 = Python3Script(vec=pt_2, tVecObj=pt)  # -> out, a; inputs vec: Vector3d
# ---------- py3_12: Python ----------
import rhinoscriptsyntax as rs

a = rs.MoveObject(tVecObj, vec)
# ---------- end py3_12 ----------
vdis_24 = VectorDisplay(Anchor="0,0,0", Vector=py3_11.a)
vdis_25 = VectorDisplay(Anchor="0,0,0", Vector=c_script_4.a)

# ----
# Length of Vector
pt_8 = Point(Point(26.31242815, 8.868225097, 0))
py3_13 = Python3Script(p0=pt_8)  # -> out, a; inputs p0: Point3d
# ---------- py3_13: Python ----------
import rhinoscriptsyntax as rs

a = rs.VectorLength(p0)
# ---------- end py3_13 ----------
py3_14 = Python3Script(p0=pt_8)  # -> out, a; inputs p0: Point3d
# ---------- py3_14: Python ----------
import rhinoscriptsyntax as rs
import math

def deistance(p0):
    return math.sqrt(p0.X * p0.X +  p0.Y * p0.Y + p0.Z * p0.Z)

a = deistance(p0)
# ---------- end py3_14 ----------
c_script_5 = CSharpScript(p0=pt_8)  # -> out, a; inputs p0: Point3d
# ---------- c_script_5: C# ----------
// Grasshopper Script Instance
#region Usings
using System;
using System.Linq;
using System.Collections;
using System.Collections.Generic;
using System.Drawing;

using Rhino;
using Rhino.Geometry;

using Grasshopper;
using Grasshopper.Kernel;
using Grasshopper.Kernel.Data;
using Grasshopper.Kernel.Types;
#endregion

public class Script_Instance : GH_ScriptInstance
{
    #region Notes
    /* 
      Members:
        RhinoDoc RhinoDocument
        GH_Document GrasshopperDocument
        IGH_Component Component
        int Iteration

      Methods (Virtual & overridable):
        Print(string text)
        Print(string format, params object[] args)
        Reflect(object obj)
        Reflect(object obj, string method_name)
    */
    #endregion

    private void RunScript(Point3d p0, ref object a)
    {

        // Write your logic here
        a = ((Vector3d)p0).Length;
    }
}
# ---------- end c_script_5 ----------
vlen = VectorLength(Vector=pt_8)
panel_2 = Panel([vlen, py3_13.a, py3_14.a, c_script_5.a])

# ----
# Distance
pt_9 = Point(Point(39.90326481, 51.54171705, 0))
pt_10 = Point(Point(26.31242815, 8.868225097, 0))
dist = Distance(PointA=pt_10, PointB=pt_9)
py3_15 = Python3Script(p0=pt_10, p1=pt_9)  # -> out, a; inputs p0: Point3d, p1: Point3d
# ---------- py3_15: Python ----------
import rhinoscriptsyntax as rs

a = rs.Distance(p0, p1)
# ---------- end py3_15 ----------
py3_16 = Python3Script(p0=pt_10, p1=pt_9)  # -> out, a; inputs p0: Point3d, p1: Point3d
# ---------- py3_16: Python ----------
import rhinoscriptsyntax as rs
import math

def deistance(p0, p1):
    return math.sqrt((p1.X - p0.X) * (p1.X - p0.X) + (p1.Y - p0.Y) * (p1.Y - p0.Y) + (p1.Z - p0.Z) * (p1.Z - p0.Z))


a = deistance(p0, p1)
# ---------- end py3_16 ----------
c_script_6 = CSharpScript(p0=pt_10, p1=pt_9)  # -> out, a; inputs p0: Point3d, p1: Point3d
# ---------- c_script_6: C# ----------
// Grasshopper Script Instance
#region Usings
using System;
using System.Linq;
using System.Collections;
using System.Collections.Generic;
using System.Drawing;

using Rhino;
using Rhino.Geometry;

using Grasshopper;
using Grasshopper.Kernel;
using Grasshopper.Kernel.Data;
using Grasshopper.Kernel.Types;
#endregion

public class Script_Instance : GH_ScriptInstance
{
    #region Notes
    /* 
      Members:
        RhinoDoc RhinoDocument
        GH_Document GrasshopperDocument
        IGH_Component Component
        int Iteration

      Methods (Virtual & overridable):
        Print(string text)
        Print(string format, params object[] args)
        Reflect(object obj)
        Reflect(object obj, string method_name)
    */
    #endregion

    private void RunScript(Point3d p0, Point3d p1, ref object a)
    {

        // Write your logic here
        a = p0.DistanceTo(p1);
    }
}
# ---------- end c_script_6 ----------
panel_3 = Panel([dist, py3_15.a, py3_16.a, c_script_6.a])

# ----
# Vector Angle
pt_11 = Point(Point(26.31242815, 8.868225097, 0))
pt_12 = Point(Point(39.90326481, 51.54171705, 0))
py3_17 = Python3Script(p0=pt_11, p1=pt_12)  # -> out, a; inputs p0: Point3d, p1: Point3d
# ---------- py3_17: Python ----------
import rhinoscriptsyntax as rs
import math


import math

def getVectorAngle(p0, p1):
    def magnitude(v):
        return math.sqrt(v.X**2 + v.Y**2 + v.Z**2)
    def dot_product(v1, v2):
        return v1.X * v2.X + v1.Y * v2.Y + v1.Z * v2.Z
    
    mag_p0 = magnitude(p0)
    mag_p1 = magnitude(p1)
    
    dot = dot_product(p0, p1)
    angle_rad = math.acos(dot / (mag_p0 * mag_p1))
    angle_deg = math.degrees(angle_rad)
    
    return [angle_rad, angle_deg]


a = getVectorAngle(p0, p1)[0]
# ---------- end py3_17 ----------
py3_18 = Python3Script(p0=pt_11, p1=pt_12)  # -> out, a; inputs p0: Point3d, p1: Point3d
# ---------- py3_18: Python ----------
import rhinoscriptsyntax as rs

a = rs.VectorAngle(p0, p1) * 3.14159 / 180
# ---------- end py3_18 ----------
c_script_7 = CSharpScript(p0=pt_11, p1=pt_12)  # -> out, a; inputs p0: Vector3d, p1: Vector3d
# ---------- c_script_7: C# ----------
// Grasshopper Script Instance
#region Usings
using System;
using System.Linq;
using System.Collections;
using System.Collections.Generic;
using System.Drawing;

using Rhino;
using Rhino.Geometry;

using Grasshopper;
using Grasshopper.Kernel;
using Grasshopper.Kernel.Data;
using Grasshopper.Kernel.Types;
#endregion

public class Script_Instance : GH_ScriptInstance
{
    private void RunScript(Vector3d p0, Vector3d p1, ref object a)
    {

        // Write your logic here
        a = Vector3d.VectorAngle(p0, p1);
    }
}
# ---------- end c_script_7 ----------
angle = Angle(VectorA=pt_11, VectorB=pt_12)  # -> Angle, Reflex
panel_4 = Panel([c_script_7.a, angle.Angle, py3_18.a, py3_17.a])

# ----
# Unit Vector
pt_13 = Point(Point(39.90326481, 51.54171705, 0))
py3_19 = Python3Script(p=pt_13)  # -> out, a; inputs p: Point3d
# ---------- py3_19: Python ----------
import rhinoscriptsyntax as rs

a = rs.VectorUnitize(p)
# ---------- end py3_19 ----------
unit_2 = UnitVector(Vector=pt_13)
py3_20 = Python3Script(p=pt_13)  # -> out, a; inputs p: Point3d
# ---------- py3_20: Python ----------
import rhinoscriptsyntax as rs
import math

def getNormalized(v):
    print(v)
    len = math.sqrt(v.X * v.X + v.Y * v.Y + v.Z * v.Z);
    if len < 0.0001:
        return [v.X, v.Y, v.Z];
    return [v.X / len, v.Y / len, v.Z / len];


np = getNormalized(p)

a = rs.AddPoint(np)
# ---------- end py3_20 ----------
c_script_8 = CSharpScript(p=pt_13)  # -> out, a; inputs p: Vector3d
# ---------- c_script_8: C# ----------
// Grasshopper Script Instance
#region Usings
using System;
using System.Linq;
using System.Collections;
using System.Collections.Generic;
using System.Drawing;

using Rhino;
using Rhino.Geometry;

using Grasshopper;
using Grasshopper.Kernel;
using Grasshopper.Kernel.Data;
using Grasshopper.Kernel.Types;
#endregion

public class Script_Instance : GH_ScriptInstance
{
    private void RunScript(Vector3d p, ref object a)
    {
        // Write your logic here
        p.Unitize();
        a = p;
    }
}
# ---------- end c_script_8 ----------
pt_14 = Point(py3_19.a)
pt_15 = Point(unit_2)
pt_16 = Point(py3_20.a)
pt_17 = Point(c_script_8.a)
panel_5 = Panel([pt_15, pt_14, pt_16, pt_17])

# ----
# Dot Product
toggle = BooleanToggle(True)
pt_18 = Point(Point(47.19998883, 54.55045878, 0))
pt_19 = Point(Point(-15.286727, 47.9932229, 0))
py3_21 = Python3Script(p0=pt_18, p1=pt_19, U=toggle)  # -> out, a; inputs p0: Point3d, p1: Point3d
# ---------- py3_21: Python ----------
import rhinoscriptsyntax as rs


if U:
    p0Unit = rs.VectorUnitize(p0)
    p1Unit = rs.VectorUnitize(p1)
    a = rs.VectorDotProduct(p0Unit, p1Unit)
else:
    a = rs.VectorDotProduct(p0, p1)
# ---------- end py3_21 ----------
dprod = DotProduct(VectorA=pt_18, VectorB=pt_19, Unitize=toggle)
py3_22 = Python3Script(p0=pt_18, p1=pt_19, U=toggle)  # -> out, a; inputs p0: Point3d, p1: Point3d, U: Boolean
# ---------- py3_22: Python ----------
import rhinoscriptsyntax as rs
import math

def getDotProduct (v1, v2):
    return v1.X * v2.X + v1.Y * v2.Y + v1.Z * v2.Z;

def getDotProductDict (v1, v2):
    return v1["X"] * v2["X"] + v1["Y"] * v2["Y"] + v1["Z"] * v2["Z"];

def getUnitVector(v):
    print(v)
    len = math.sqrt(v.X * v.X + v.Y * v.Y + v.Z * v.Z);
    if len < 0.0001:
        return [v.X, v.Y, v.Z];
    return { 
        "X": v.X / len, 
        "Y": v.Y / len, 
        "Z": v.Z / len
        };

if U:
    unitP0 = getUnitVector(p0)
    unitP1 = getUnitVector(p1)
    a = getDotProductDict(unitP0, unitP1)
else :
    a = getDotProduct(p0, p1)
# ---------- end py3_22 ----------
c_script_9 = CSharpScript(p0=pt_18, p1=pt_19, U=toggle)  # -> out, a; inputs p0: Point3d, p1: Point3d, U: Boolean
# ---------- c_script_9: C# ----------
// Grasshopper Script Instance
#region Usings
using System;
using System.Linq;
using System.Collections;
using System.Collections.Generic;
using System.Drawing;

using Rhino;
using Rhino.Geometry;

using Grasshopper;
using Grasshopper.Kernel;
using Grasshopper.Kernel.Data;
using Grasshopper.Kernel.Types;
#endregion

public class Script_Instance : GH_ScriptInstance
{

    public double GetDotProduct (Vector3d v1, Vector3d v2) {
        return v1.X * v2.X + v1.Y * v2.Y + v1.Z * v2.Z;
    }

    private void RunScript(Point3d p0, Point3d p1, bool U, ref object a)
    {
        // Write your logic here
        Vector3d v0 =(Vector3d)p0;
        Vector3d v1 =(Vector3d)p1;
        if (U) {
            v0.Unitize();
            v1.Unitize();
        } 
         double dotValue = this.GetDotProduct(v0 , v1);
        a = dotValue;
    }
}
# ---------- end c_script_9 ----------
panel_6 = Panel(dprod)
panel_7 = Panel([py3_21.a, py3_22.a, c_script_9.a])

# ----
# Cross Product
toggle_2 = BooleanToggle(True)
pt_20 = Point(Point(37.4647209, 7.429503802, 0))
pt_21 = Point(Point(-15.286727, 47.9932229, 0))
xprod = CrossProduct(VectorA=pt_20, VectorB=pt_21, Unitize=toggle_2)  # -> Vector, Length
py3_23 = Python3Script(p0=pt_20, p1=pt_21, U=toggle_2)  # -> out, a; inputs p0: Point3d, p1: Point3d
# ---------- py3_23: Python ----------
import rhinoscriptsyntax as rs

a = rs.VectorCrossProduct(p0, p1)

if U:
    a = rs.VectorUnitize(a)
# ---------- end py3_23 ----------
py3_24 = Python3Script(p0=pt_20, p1=pt_21, U=toggle_2)  # -> out, a; inputs p0: Point3d, p1: Point3d, U: Boolean
# ---------- py3_24: Python ----------
import rhinoscriptsyntax as rs
import math

def getCrossProduct (v1, v2):
    return [
        v1.Y * v2.Z - v1.Z * v2.Y,
        v1.Z * v2.X - v1.X * v2.Z,
        v1.X * v2.Y - v1.Y * v2.X
    ];

def getNormalized(v):
    print(v)
    len = math.sqrt(v[0] * v[0] + v[1] * v[1] + v[2] * v[2]);
    if len < 0.0001:
        return [v[0], v[1], v[2]];
    return [v[0] / len, v[1] / len, v[2] / len];

cv = getCrossProduct(p0, p1)

rhinoPoint = rs.AddPoint(cv)

a = rhinoPoint

if U:
    a = rs.AddPoint(getNormalized(cv))
# ---------- end py3_24 ----------
py3_25 = Python3Script(p0=pt_20, p1=pt_21, U=toggle_2)  # -> out, a; inputs p0: Point3d, p1: Point3d, U: Boolean
# ---------- py3_25: Python ----------
import Rhino as r


a = r.Geometry.Vector3d.CrossProduct(p0, p1)


if U:
    a.Unitize()
# ---------- end py3_25 ----------
c_script_10 = CSharpScript(p0=pt_20, p1=pt_21, U=toggle_2)  # -> out, a; inputs p0: Point3d, p1: Point3d, U: Boolean
# ---------- c_script_10: C# ----------
// Grasshopper Script Instance
#region Usings
using System;
using System.Linq;
using System.Collections;
using System.Collections.Generic;
using System.Drawing;

using Rhino;
using Rhino.Geometry;

using Grasshopper;
using Grasshopper.Kernel;
using Grasshopper.Kernel.Data;
using Grasshopper.Kernel.Types;
#endregion

public class Script_Instance : GH_ScriptInstance
{
    private void RunScript(Point3d p0, Point3d p1, bool U, ref object a)
    {
        // Write your logic here
        Vector3d cv = Vector3d.CrossProduct((Vector3d)p0 , (Vector3d)p1);
        if (U) {
            cv.Unitize();
        } 
        a = cv;
    }
}
# ---------- end c_script_10 ----------
pt_22 = Point(Point(0, 0, 0))
vdis_26 = VectorDisplay(Anchor=pt_22, Vector=xprod.Vector)
vdis_27 = VectorDisplay(Anchor=pt_22, Vector=c_script_10.a)
vdis_28 = VectorDisplay(Anchor=pt_22, Vector=py3_24.a)
vdis_29 = VectorDisplay(Anchor=pt_22, Vector=py3_23.a)
vdis_30 = VectorDisplay(Anchor=pt_22, Vector=py3_25.a)
panel_8 = Panel(xprod.Vector)
panel_9 = Panel([py3_23.a, py3_24.a, py3_25.a, c_script_10.a])

pt_23 = Point(Point(83.06983115, 50.75180855, 0))
pt_24 = Point(Point(54.68337412, 86.01180132, 0))
pt_25 = Point(Point(34.73878357, 47.79196248, 0))
subtraction_3 = Subtraction(A=pt_24, B=pt_23)
subtraction_4 = Subtraction(A=pt_23, B=pt_25)
pt_26 = Point(Point(0, 0, 0))
pt_27 = Point(Point(0, 0, 0))
vdis_31 = VectorDisplay(Anchor=pt_26, Vector=subtraction_4)
vdis_32 = VectorDisplay(Anchor=pt_27, Vector=subtraction_3)
xprod_2 = CrossProduct(VectorA=subtraction_4, VectorB=subtraction_3, Unitize=False)  # -> Vector, Length
division = Division(A=xprod_2.Length, B="2")
panel_10 = Panel(division)

py3_26 = Python3Script(p0=pt_25, p1=pt_23, p2=pt_24)  # -> out, a; inputs p0: Point3d, p1: Point3d, p2: Point3d
# ---------- py3_26: Python ----------
import rhinoscriptsyntax as rs
import math

v0 = [
    p1.X - p0.X,
    p1.Y - p0.Y,
    p1.Z - p0.Z
]

v1 = [
    p2.X - p0.X,
    p2.Y - p0.Y,
    p2.Z - p0.Z
]

def getCrossProduct (v1, v2):
    return [
        v1[1] * v2[2] - v1[2] * v2[1],
        v1[2] * v2[0] - v1[0] * v2[2],
        v1[0] * v2[1] - v1[1] * v2[0]
    ];

def getLength(vec):
    return math.sqrt(vec[0] * vec[0] + vec[1] * vec[1] + vec[2] * vec[2])

cp = getCrossProduct(v0, v1)
area = getLength(cp) * 0.5

a = area
# ---------- end py3_26 ----------
c_script_11 = CSharpScript(p0=pt_25, p1=pt_23, p2=pt_24)  # -> out, a; inputs p0: Vector3d, p1: Vector3d, p2: Vector3d
# ---------- c_script_11: C# ----------
// Grasshopper Script Instance
#region Usings
using System;
using System.Linq;
using System.Collections;
using System.Collections.Generic;
using System.Drawing;

using Rhino;
using Rhino.Geometry;

using Grasshopper;
using Grasshopper.Kernel;
using Grasshopper.Kernel.Data;
using Grasshopper.Kernel.Types;
#endregion

public class Script_Instance : GH_ScriptInstance
{

    private void RunScript(Vector3d p0, Vector3d p1, Vector3d p2, ref object a)
    {
        
        Vector3d v0 = p1 - p0;
        Vector3d v1 = p2 - p0;

        a = Vector3d.CrossProduct(v0, v1).Length * 0.5;;
    }
}
# ---------- end c_script_11 ----------
panel_11 = Panel(c_script_11.a)
panel_12 = Panel(py3_26.a)

pt_28 = Point(Point(54.68337412, 86.01180132, 0))
pt_29 = Point(Point(83.06983115, 50.75180855, 0))
# Area of triangle
pt_30 = Point(Point(34.73878357, 47.79196248, 0))

ln = Line(StartPoint=pt_30, EndPoint=pt_29)
ln_2 = Line(StartPoint=pt_29, EndPoint=pt_28)
ln_3 = Line(StartPoint=pt_28, EndPoint=pt_30)
boundary = BoundarySurfaces(Edges=[ln, ln_2, ln_3])
area = Area(Geometry=boundary)  # -> Area, Centroid

srf4pt = _4PointSurface(CornerA=pt_30, CornerB=pt_29, CornerC=pt_28)
area_2 = Area(Geometry=srf4pt)  # -> Area, Centroid

panel_13 = Panel([area_2.Area, area.Area])
