# Grasshopper definition LAB_03_TransformRhinoAPI.gh (Grasshopper 1.0.8)

# ---- group: TRANSLATION
number_slider = Slider(10, range=-10..10)
number_slider_2 = Slider(9.59, range=-10..10)
number_slider_3 = Slider(10, range=-10..10)
vec = VectorXYZ(XComponent=number_slider, YComponent=number_slider_3, ZComponent=number_slider_2)  # -> Vector, Length
move = Move(Motion=vec.Vector)  # -> Geometry, Transform
matrix = TransformMatrix(move.Transform, Digits=3)

# ---- group: SCALING
number_slider_4 = Slider(1.5, range=-10..10)
number_slider_5 = Slider(6.57, range=-10..10)
number_slider_6 = Slider(0.89, range=-10..10)
scale_nu = ScaleNU(Plane=PlaneXY(0, 0, 0), ScaleX=number_slider_5, ScaleY=number_slider_4, ScaleZ=number_slider_6)  # -> Geometry, Transform
matrix_2 = TransformMatrix(scale_nu.Transform, Digits=3)

# ---- group: ROTATION AROUND Y AXIS
Y = UnitY(Factor=1)
rot3d = Rotate3D(Angle=Slider(0, range=0..6.28), Center=Point(0, 0, 0), Axis=Y)  # -> Geometry, Transform
matrix_3 = TransformMatrix(rot3d.Transform, Digits=3)

# ---- group: ROTATION AROUND X AXIS
X = UnitX(Factor=1)
pi = Pi(Factor=Slider(0, range=0..1))
rot3d_2 = Rotate3D(Angle=pi, Center=Point(0, 0, 0), Axis=X)  # -> Geometry, Transform
matrix_4 = TransformMatrix(rot3d_2.Transform, Digits=3)

# ---- group: ROTATION AROUND Z AXIS
Z = UnitZ(Factor=1)
rot3d_3 = Rotate3D(Angle=Slider(0, range=0..6.28), Center=Point(0, 0, 0), Axis=Z)  # -> Geometry, Transform
matrix_5 = TransformMatrix(rot3d_3.Transform, Digits=3)

# ---- group: Obj
geo = Geometry(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)

# ----
geo_2 = Geometry(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)
geo_3 = Geometry(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)
transform = Transform(Geometry=geo_2, Transform=matrix_4)
py3 = Python3Script(O=geo, mat=matrix)  # -> out, a
# ---------- py3: Python ----------
"""Grasshopper Script"""
a = "Hello Python 3 in Grasshopper!"
print(a)


import rhinoscriptsyntax as rs

a = rs.TransformObject(O, mat)
# ---------- end py3 ----------
transform_2 = Transform(Geometry=geo, Transform=matrix)
c_script = CSharpScript(O=geo, mat=matrix)  # -> out, a; inputs O: GeometryBase, mat: Transform
# ---------- c_script: C# ----------
// Grasshopper Script Instance
#region Usings
using System;
using System.Linq;
using System.Collections;
using System.Collections.Generic;
using System.Drawing;

using Rhino;
using Rhino.Geometry;

using Grasshopper;
using Grasshopper.Kernel;
using Grasshopper.Kernel.Data;
using Grasshopper.Kernel.Types;
#endregion

public class Script_Instance : GH_ScriptInstance
{
    private void RunScript(GeometryBase O, Transform mat, ref object a)
    {

        O.Transform(mat);
        a = O;
    }
}
# ---------- end c_script ----------
py3_2 = Python3Script(O=geo_2, xRot=matrix_4, yRot=matrix_3, zRot=matrix_5)  # -> out, a
# ---------- py3_2: Python ----------
"""Grasshopper Script"""
a = "Hello Python 3 in Grasshopper!"
print(a)


import rhinoscriptsyntax as rs

mat = xRot * yRot * zRot

a = rs.TransformObject(O, mat)
# ---------- end py3_2 ----------
c_script_2 = CSharpScript(O=geo, x=number_slider, y=number_slider_3, z=number_slider_2)  # -> out, a; inputs O: GeometryBase, x: Double, y: Double, z: Double
# ---------- c_script_2: C# ----------
// Grasshopper Script Instance
#region Usings
using System;
using System.Linq;
using System.Collections;
using System.Collections.Generic;
using System.Drawing;

using Rhino;
using Rhino.Geometry;

using Grasshopper;
using Grasshopper.Kernel;
using Grasshopper.Kernel.Data;
using Grasshopper.Kernel.Types;
#endregion

public class Script_Instance : GH_ScriptInstance
{
    #region Notes
    /* 
      Members:
        RhinoDoc RhinoDocument
        GH_Document GrasshopperDocument
        IGH_Component Component
        int Iteration

      Methods (Virtual & overridable):
        Print(string text)
        Print(string format, params object[] args)
        Reflect(object obj)
        Reflect(object obj, string method_name)
    */
    #endregion

    private void RunScript(
		GeometryBase O,
		double x,
		double y,
		double z,
		ref object a)
    {

;

        Transform xform = Transform.Identity;

        xform.M03 = x + x;
        xform.M13 = y + y;
        xform.M23 = z + z;

        Print(xform.ToString());
        O.Transform(xform);
        
        a = O;
    }
}
# ---------- end c_script_2 ----------
transform_3 = Transform(Geometry=geo_2, Transform=matrix_3)
transform_4 = Transform(Geometry=geo_3, Transform=matrix_2)
py3_3 = Python3Script(O=geo_3, xS=number_slider_5, yS=number_slider_4, zS=number_slider_6)  # -> out, a; inputs xS: Double, yS: Double, zS: Double
# ---------- py3_3: Python ----------
"""Grasshopper Script"""
a = "Hello Python 3 in Grasshopper!"
print(a)


import rhinoscriptsyntax as rs

scale_matrix = rs.XformScale([xS, yS, zS])

mat = rs.XformIdentity()

mat = rs.XformMultiply(mat, scale_matrix)

a = rs.TransformObject(O, mat)
# ---------- end py3_3 ----------
c_script_3 = CSharpScript(O=geo_3, x=number_slider_5, y=number_slider_4, z=number_slider_6)  # -> out, a; inputs O: GeometryBase, x: Double, y: Double, z: Double
# ---------- c_script_3: C# ----------
// Grasshopper Script Instance
#region Usings
using System;
using System.Linq;
using System.Collections;
using System.Collections.Generic;
using System.Drawing;

using Rhino;
using Rhino.Geometry;

using Grasshopper;
using Grasshopper.Kernel;
using Grasshopper.Kernel.Data;
using Grasshopper.Kernel.Types;
#endregion

public class Script_Instance : GH_ScriptInstance
{
    #region Notes
    /* 
      Members:
        RhinoDoc RhinoDocument
        GH_Document GrasshopperDocument
        IGH_Component Component
        int Iteration

      Methods (Virtual & overridable):
        Print(string text)
        Print(string format, params object[] args)
        Reflect(object obj)
        Reflect(object obj, string method_name)
    */
    #endregion

    private void RunScript(
		GeometryBase O,
		double x,
		double y,
		double z,
		ref object a)
    {

;

        Transform xform = Transform.Identity;

        xform.M00 = x;
        xform.M11 = y;
        xform.M22 = z;

        Print(xform.ToString());
        O.Transform(xform);
        
        a = O;
    }
}
# ---------- end c_script_3 ----------
transform_5 = Transform(Geometry=geo_2, Transform=matrix_5)
geo_4 = Geometry(transform)
geo_5 = Geometry(transform_2)
geo_6 = Geometry(transform_3)
panel = Panel(c_script_2.out)
geo_7 = Geometry(transform_4)
geo_8 = Geometry(py3_3.a)
panel_2 = Panel(c_script_3.out)
geo_9 = Geometry(transform_5)
geo_10 = Geometry(py3_2.a)

# ---- group: ROTATION AROUND X AXIS
pi_2 = Pi(Factor=Slider(0.059, range=0..1))
X_2 = UnitX(Factor=1)
rot3d_4 = Rotate3D(Angle=pi_2, Center=Point(0, 0, 0), Axis=X_2)  # -> Geometry, Transform
matrix_6 = TransformMatrix(rot3d_4.Transform, Digits=3)

# ----
pi_3 = Pi(Factor=Slider(0.234, range=0..1))
Z_2 = UnitZ(Factor=1)
rot3d_5 = Rotate3D(Angle=pi_3, Center=Point(0, 0, 0), Axis=Z_2)  # -> Geometry, Transform
matrix_7 = TransformMatrix(rot3d_5.Transform, Digits=3)

scale_nu_2 = ScaleNU(
    Plane=PlaneXY(0, 0, 0),
    ScaleX=Slider(1, range=-10..10),
    ScaleY=Slider(5.3, range=-10..10),
    ScaleZ=Slider(4.05, range=-10..10))  # -> Geometry, Transform
matrix_8 = TransformMatrix(scale_nu_2.Transform, Digits=3)

pi_4 = Pi(Factor=Slider(0.504, range=0..1))
Y_2 = UnitY(Factor=1)
rot3d_6 = Rotate3D(Angle=pi_4, Center=Point(0, 0, 0), Axis=Y_2)  # -> Geometry, Transform
matrix_9 = TransformMatrix(rot3d_6.Transform, Digits=3)

# ---- group: TRANSLATION
vec_2 = VectorXYZ(XComponent=Slider(1.29, range=-10..10), YComponent=Slider(-0.3, range=-10..10), ZComponent=Slider(-0.33, range=-10..10))  # -> Vector, Length
move_2 = Move(Motion=vec_2.Vector)  # -> Geometry, Transform
matrix_10 = TransformMatrix(move_2.Transform, Digits=3)

# ----
geo_11 = Geometry(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)
comp = Compound(Transforms=[matrix_6, matrix_9, matrix_7, matrix_10])
comp_2 = Compound(Transforms=[matrix_10, matrix_6, matrix_9, matrix_7, matrix_8])
comp_3 = Compound(Transforms=[matrix_8, matrix_10, matrix_6, matrix_9, matrix_7])
transform_6 = Transform(Geometry=geo_11, Transform=comp_2)
transform_7 = Transform(Geometry=geo_11, Transform=comp)
transform_8 = Transform(Geometry=geo_11, Transform=comp_3)

# ---- group: SCALING
scale_nu_3 = ScaleNU(
    Plane=PlaneXY(0, 0, 0),
    ScaleX=Slider(1, range=-10..10),
    ScaleY=Slider(2, range=-10..10),
    ScaleZ=Slider(3, range=-10..10))  # -> Geometry, Transform
matrix_11 = TransformMatrix(scale_nu_3.Transform, Digits=3)

# ---- group: TRANSLATION
vec_3 = VectorXYZ(XComponent=Slider(1.29, range=-10..10), YComponent=Slider(-0.3, range=-10..10), ZComponent=Slider(-0.33, range=-10..10))  # -> Vector, Length
move_3 = Move(Motion=vec_3.Vector)  # -> Geometry, Transform
matrix_12 = TransformMatrix(move_3.Transform, Digits=3)

# ---- group: ROTATION AROUND X AXIS
pi_5 = Pi(Factor=Slider(0.333, range=0..1))
X_3 = UnitX(Factor=1)
rot3d_7 = Rotate3D(Angle=pi_5, Center=Point(0, 0, 0), Axis=X_3)  # -> Geometry, Transform
matrix_13 = TransformMatrix(rot3d_7.Transform, Digits=3)

# ---- group: ROTATION AROUND Y AXIS
pi_6 = Pi(Factor=Slider(0.333, range=0..1))
Y_3 = UnitY(Factor=1)
rot3d_8 = Rotate3D(Angle=pi_6, Center=Point(0, 0, 0), Axis=Y_3)  # -> Geometry, Transform
matrix_14 = TransformMatrix(rot3d_8.Transform, Digits=3)

# ---- group: ROTATION AROUND Z AXIS
pi_7 = Pi(Factor=Slider(0.333, range=0..1))
Z_3 = UnitZ(Factor=1)
rot3d_9 = Rotate3D(Angle=pi_7, Center=Point(0, 0, 0), Axis=Z_3)  # -> Geometry, Transform
matrix_15 = TransformMatrix(rot3d_9.Transform, Digits=3)

# ----
geo_12 = Geometry(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)

# ---- group: TRANSLATE + ROTATE Z
comp_4 = Compound(Transforms=[move_3.Transform, rot3d_9.Transform])
transform_9 = Transform(Geometry=geo_12, Transform=comp_4)

# ---- group: ROTATE Z + TRANSLATE
comp_5 = Compound(Transforms=[rot3d_9.Transform, move_3.Transform])
transform_10 = Transform(Geometry=geo_12, Transform=comp_5)

# ---- group: ROTATE X,Y,Z + TRANSLATE
comp_6 = Compound(Transforms=[rot3d_7.Transform, rot3d_8.Transform, rot3d_9.Transform, move_3.Transform])
transform_11 = Transform(Geometry=geo_12, Transform=comp_6)

comp_7 = Compound(Transforms=[move_3.Transform, rot3d_7.Transform, rot3d_8.Transform, rot3d_9.Transform])
transform_12 = Transform(Geometry=geo_12, Transform=comp_7)

# ---- group: TRANSLATE + SCALE
comp_8 = Compound(Transforms=[move_3.Transform, scale_nu_3.Transform])
transform_13 = Transform(Geometry=geo_12, Transform=comp_8)

# ---- group: TRANSLATE
comp_9 = Compound(Transforms=move_3.Transform)
transform_14 = Transform(Geometry=geo_12, Transform=comp_9)

# ---- group: SCALE + TRANSLATE
comp_10 = Compound(Transforms=[scale_nu_3.Transform, move_3.Transform])
transform_15 = Transform(Geometry=geo_12, Transform=comp_10)

# ----
matrix_16 = TransformMatrix(comp_6, Digits=3)
matrix_17 = TransformMatrix(comp_7, Digits=3)
matrix_18 = TransformMatrix(comp_9, Digits=3)
matrix_19 = TransformMatrix(comp_4, Digits=3)
matrix_20 = TransformMatrix(comp_5, Digits=3)
matrix_21 = TransformMatrix(comp_10, Digits=3)
matrix_22 = TransformMatrix(comp_8, Digits=3)
