# Grasshopper definition LAB_04_CoordinateSystem.gh (Grasshopper 1.0.8)

# https://namjulee.github.io/njs-lab-public/lab/visualization-design-data-vr-ar-mr/projection?ui=0
py3 = Python3Script(x=Slider(10, range=0..10), y=Slider(10, range=0..10))  # -> out, a; inputs x: Int32, y: Int32
# ---------- py3: Python ----------
import rhinoscriptsyntax as rs
pts = []
for j in range(y):
    for i in range(x):
        p = rs.AddPoint(i, j)
        pts.append(p)

a = pts
# ---------- end py3 ----------
