# Grasshopper definition 2016_NumericalEnvironmentLandAnalysis_A_revised.gh (Grasshopper 1.0.8)
# plug-ins: NJSEnvironment, NumericalGeoUtilsForGH

# ----
# Cambridge, MA
number_slider = Slider(42.367, range=0..90)

# ----
# Time 0 to 24
number_slider_2 = Slider(13.5, range=0.1..23.9)

# ----
# Day from 1 to 365
number_slider_3 = Slider(181, range=1..365)

# ----
# Land Analysis
# Cambridge, MA
number_slider_4 = Slider(42.367, range=0..90)

# ----
# Time 0 to 24
number_slider_5 = Slider(5.6, range=0.1..23.9)

# ----
# Day from 1 to 365
number_slider_6 = Slider(181, range=1..365)

crv = Curve(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)
ncurve_class_for_geomerty_analysis = NCurve(C=crv, N=Slider(15, range=0..100), NS=2, AS=2, AF=0.5, ES=2, EF=0.5, RS=2, RF=0.5)  # -> Curve, Points, Tangent, Normal, Binormal

number_slider_7 = Slider(44, range=1..60)
pt = Point(Point(80, 62, 0))
pt_2 = Point(Point(5, 4, 0))
pt_3 = Point(Point(22, 28, 14))
pt_4 = Point(Point(53, 35, 4.899367495))
two_dimensional_point_grid_object = NPoint2D(
    P1=pt,
    P2=pt_2,
    U=number_slider_7,
    V=number_slider_7,
    Attr=pt_3,
    AS=Slider(92.11, range=0..100),
    AF=Slider(2.28, range=0..10),
    Explo=pt_4,
    ES=Slider(69.4, range=0..100),
    EF=Slider(2.47, range=0..10),
    RS=2,
    RF=0.5)  # -> Point, U, V, UCurve, VCurve, Surface, Mesh

number_slider_8 = Slider(7.6, range=0..10)
timer = Timer(Interval=5, TimerInterval=5, Target=solar)  # disabled
solar = SolarEvaluation(
    Latitude=number_slider,
    Day=number_slider_3,
    Hour=number_slider_2,
    SunDistance=100,
    SunScale=3,
    SouthDegree=-90,
    Bool=Toggle(False),
    Bool_2=Button())  # -> Latitude, SolarObject, Declination, SolarAltitude, SolarAzimuth, SunVector, SouthLine, Sun, SunTrajectory, SunVector_2
panel = Panel(solar.SolarObject)

number_slider_9 = Slider(181, range=1..365)
number_slider_10 = Slider(13.5, range=0.1..23.9)
number_slider_11 = Slider(7.6, range=0..10)
solar_2 = SolarEvaluation(
    Latitude=Slider(42.367, range=0..90),
    Day=number_slider_9,
    Hour=number_slider_10,
    SunDistance=100,
    SunScale=3,
    SouthDegree=-90,
    Bool=Toggle(False),
    Bool_2=Button())  # -> Latitude, SolarObject, Declination, SolarAltitude, SolarAzimuth, SunVector, SouthLine, Sun, SunTrajectory, SunVector_2
panel_2 = Panel(solar_2.SolarObject)
panel_3 = Panel(solar_2.Declination)
panel_4 = Panel(solar_2.SolarAzimuth)
panel_5 = Panel(solar_2.SolarAltitude)

# ----
# Data in Design
# 
# Instructor : NJ Namju Lee / nj.namju@gmail.com
# 
# * class - https://namjulee.github.io/data-in-design/
# 
# * Lab - https://namjulee.github.io/njs-lab-public/
# 
# * Video(English) - https://www.youtube.com/c/njnamjulee
# * Writing(English) - https://medium.com/@nj-namju
# 
# * Video(Korean) - https://www.youtube.com/c/CodeforDesign
# * Writing(Korean) - https://brunch.co.kr/@njnamju
# 
# Installation - https://namjulee.github.io/njs-lab-public/installation
# NUMERICAL ENVIRONMENT UTILITY [DEVELOPMENT], 2015:
# 
# https://namjulee.github.io/njs-lab-public/work?id=2015-neu-development
timer_2 = Timer(Interval=5, TimerInterval=5, Target=solar_3)  # disabled
solar_3 = SolarEvaluation(
    Latitude=number_slider_4,
    Day=number_slider_6,
    Hour=number_slider_5,
    SunDistance=100,
    SunScale=3,
    SouthDegree=-90,
    GoBool=Toggle(True),
    ResertBool=Button())  # -> Latitude, SolarObject, Declination, SolarAltitude, SolarAzimuth, SunVector, SouthLine, Sun, SunTrajectory, SunVector_2
panel_6 = Panel(solar_3.SolarObject)

# ---- group: epw
path = FilePath("C:\Dropbox\[02 Lecture]\2025_data-design\Material\class-09-pixel-voxel\NumericalEnvironmentalUtility\USA_MA_Boston-Logan.Intl.AP.725090_TMY3.epw")

# ----
data = Data(path)
ladybug = Ladybug_Ladybug()  # -> Vviiiiiiiiiizzz; plug-in component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
python = PythonScript(epw=data, D=number_slider_9, H=number_slider_10)  # -> out, WindSpeed, windDirection, relativeHumidity, dryBulbTemperature
# ---------- python: Python ----------
import scriptcontext as sc
import os
from clr import AddReference
AddReference('Grasshopper')
import Grasshopper.Kernel as gh


def main(_epw_file):
    # import the classes
    if sc.sticky.has_key('ladybug_release'):

        lb_preparation = sc.sticky["ladybug_Preparation"]()
        
        if not os.path.isfile(_epw_file):
            warningM = "Failed to find the file: " + str(_epw_file)
            print warningM
            w = gh.GH_RuntimeMessageLevel.Warning
            ghenv.Component.AddRuntimeMessage(w, warningM)
            return -1
        
        locationData = lb_preparation.epwLocation(_epw_file)
        weatherData = lb_preparation.epwDataReader(_epw_file, locationData[0])
        
        return locationData, weatherData



# Collecting Data
if epw and epw.endswith('.epw') and  epw != 'C:\Example.epw':
    result = main(epw)
    if result!= -1:
        location, locName, latitude = result[0][-1], result[0][0], result[0][1]
        #dryBulbTemperature, dewPointTemperature, relativeHumidity, windSpeed, windDirection, directNormalRadiation, diffuseHorizontalRadiation, globalHorizontalRadiation, directNormalIlluminance, diffuseHorizontalIlluminance, globalHorizontalIlluminance, totalSkyCover, liquidPrecipitationDepth, barometricPressure = result[1][:]
        
        num = int((D*H)+ 7)
        WindSpeed = result[1][3][num];
        windDirection = result[1][4][num];
        relativeHumidity = result[1][2][num];
        dryBulbTemperature = result[1][0][num];
# ---------- end python ----------
panel_7 = Panel([python.WindSpeed, python.windDirection, python.relativeHumidity, python.dryBulbTemperature])

panel_8 = Panel(path)

# ----
# Declination
panel_9 = Panel(solar.Declination)

# ----
# Solar Azimuth
panel_10 = Panel(solar.SolarAzimuth)

# ----
# Solar Altitude
panel_11 = Panel(solar.SolarAltitude)

preview = CustomPreview(Geometry=solar.SunTrajectory, Shader=ColourSwatch(SwatchColor=RGBA(103, 105, 0, 51)))

preview_2 = CustomPreview(Geometry=solar.Sun, Shader=ColourSwatch(SwatchColor=RGB(255, 136, 0)))

# ----
# Declination
panel_12 = Panel(solar_3.Declination)

# ----
# Solar Azimuth
panel_13 = Panel(solar_3.SolarAzimuth)

# ----
# Solar Altitude
panel_14 = Panel(solar_3.SolarAltitude)

preview_3 = CustomPreview(Geometry=solar_3.SunTrajectory, Shader=ColourSwatch(SwatchColor=RGBA(103, 105, 0, 51)))

preview_4 = CustomPreview(Geometry=solar_3.Sun, Shader=ColourSwatch(SwatchColor=RGB(255, 136, 0)))

preview_5 = CustomPreview(Geometry=solar_2.SunTrajectory, Shader=ColourSwatch(SwatchColor=RGBA(103, 105, 0, 51)))

preview_6 = CustomPreview(Geometry=solar_2.Sun, Shader=ColourSwatch(SwatchColor=RGB(255, 136, 0)))

pt_5 = Point(Point(62.94355333, 48.83103353, 0))
pt_6 = Point(ncurve_class_for_geomerty_analysis.Points)
pt_7 = Point([Point(14, 39, 3), Point(59, 11, 0), Point(38, 34, 0), Point(27, 50, 0)])
brep = Brep([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])

land_evaluation_with_pts = LandEvalPTs(
    Points=two_dimensional_point_grid_object.Point,
    UInt=two_dimensional_point_grid_object.U,
    VInt=two_dimensional_point_grid_object.V,
    ScaleFactor=0.5,
    SoilHardnessPTs=pt_7,
    Strength=Slider(15, range=0..100),
    Falloff=Slider(0.018, range=0..1),
    PHLevelPTs=pt_5,
    Strength_2=Slider(3, range=0..100),
    Falloff_2=Slider(0.004, range=0..1),
    DampnessPts=pt_6,
    Strength_3=Slider(2, range=0..100),
    Falloff_3=Slider(0.01, range=0..1),
    ShadownessVector=solar_2.SunVector_2,
    GroundZ=0.25,
    RayScale=100,
    Buildings=brep)  # -> Mesh, SoilVisLine, SoilNorDouble, PhVisLine, PHNorDouble, DampVisLine, DapNorDouble, SunMesh, SunNorDouble
mesh = Mesh(land_evaluation_with_pts.Mesh)
pt_8 = Point(two_dimensional_point_grid_object.Point)

number_slider_12 = Slider(45, range=0..100)
srf = Surface(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)
brep_2 = Brep(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)
solar_evaluation = SolarWSur(
    Surface=srf,
    GroundZ=Slider(0.42, range=0..1),
    URes=number_slider_12,
    VRes=number_slider_12,
    SolarV=solar.SunVector_2,
    RayScale=100,
    Buildings=brep_2)  # -> Mesh, Surface, RaysLine
mesh_2 = Mesh(solar_evaluation.Mesh)

preview_7 = CustomPreview(Geometry=land_evaluation_with_pts.PhVisLine, Shader=ColourSwatch(SwatchColor=RGB(107, 252, 81)))
tag = TextTag(Location=pt_8, Text=land_evaluation_with_pts.PHNorDouble)

preview_8 = CustomPreview(Geometry=land_evaluation_with_pts.DampVisLine, Shader=ColourSwatch(SwatchColor=RGB(81, 207, 252)))
tag_2 = TextTag(Location=pt_8, Text=land_evaluation_with_pts.DapNorDouble)

preview_9 = CustomPreview(Geometry=land_evaluation_with_pts.SoilVisLine, Shader=ColourSwatch(SwatchColor=RGB(255, 200, 0)))
tag_3 = TextTag(Location=pt_8, Text=land_evaluation_with_pts.SoilNorDouble)

solar_4 = SolarEvaluation(
    Latitude=42.3,
    Day=121,
    Hour=14,
    SunDistance=Slider(16, range=0..100),
    SunScale=Slider(1, range=0..1),
    SouthDegree=-90,
    Bool=False,
    Bool_2=False)  # -> Latitude, SolarObject, Declination, SolarAltitude, SolarAzimuth, SunVector, SouthLine, Sun, SunTrajectory, SunVector_2
three_dimensional_point_grid_object = NPoint3D(P1=Point(-5, -5, 0), P2=Point(5, 5, 5), X=10, Y=10, Z=10, AS=2, AF=0.5, ES=2, EF=0.5, RS=2, RF=0.5)  # -> P, X, Y, Z

crv_2 = Curve(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)
ncurve_class_for_geomerty_analysis_2 = NCurve(C=crv_2, N=Slider(15, range=0..100), NS=2, AS=2, AF=0.5, ES=2, EF=0.5, RS=2, RF=0.5)  # -> Curve, Points, Tangent, Normal, Binormal

number_slider_13 = Slider(44, range=1..60)
pt_9 = Point(Point(80, 62, 0))
pt_10 = Point(Point(5, 4, 0))
pt_11 = Point(Point(22, 28, 14))
pt_12 = Point(Point(53, 35, 4.899367495))
two_dimensional_point_grid_object_2 = NPoint2D(
    P1=pt_9,
    P2=pt_10,
    U=number_slider_13,
    V=number_slider_13,
    Attr=pt_11,
    AS=Slider(92.11, range=0..100),
    AF=Slider(2.28, range=0..10),
    Explo=pt_12,
    ES=Slider(69.4, range=0..100),
    EF=Slider(2.47, range=0..10),
    RS=2,
    RF=0.5)  # -> Point, U, V, UCurve, VCurve, Surface, Mesh

number_slider_14 = Slider(7.6, range=0..10)
solar_5 = SolarEvaluation(
    Latitude=Slider(42.367, range=0..90),
    Day=Slider(181, range=1..365),
    Hour=Slider(13.5, range=0.1..23.9),
    SunDistance=100,
    SunScale=3,
    SouthDegree=-90,
    Bool=Toggle(False),
    Bool_2=Button())  # -> Latitude, SolarObject, Declination, SolarAltitude, SolarAzimuth, SunVector, SouthLine, Sun, SunTrajectory, SunVector_2
panel_15 = Panel(solar_5.SolarObject)
panel_16 = Panel(solar_5.Declination)
panel_17 = Panel(solar_5.SolarAzimuth)
panel_18 = Panel(solar_5.SolarAltitude)

brep_3 = Brep([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])
solar_average_eval = SolarWPts(
    Point3d=three_dimensional_point_grid_object.P,
    GroundZ=0.13,
    Latitude=solar_4.Latitude,
    South=-90,
    RayScale=10000,
    Buildings=brep_3,
    ReScale=15,
    MinRayNumber=10,
    SunZVecMin=0.2)  # -> PointGrid, Shadowness

pt_13 = Point(Point(62.94355333, 48.83103353, 0))
pt_14 = Point(ncurve_class_for_geomerty_analysis_2.Points)
pt_15 = Point([Point(14, 39, 3), Point(59, 11, 0), Point(38, 34, 0), Point(27, 50, 0)])
brep_4 = Brep([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])

preview_10 = CustomPreview(Geometry=solar_5.SunTrajectory, Shader=ColourSwatch(SwatchColor=RGBA(103, 105, 0, 51)))

preview_11 = CustomPreview(Geometry=solar_5.Sun, Shader=ColourSwatch(SwatchColor=RGB(255, 136, 0)))

land_evaluation_with_a_surface = LandEvalSurface(
    Surface=two_dimensional_point_grid_object_2.Surface,
    UInt=two_dimensional_point_grid_object_2.U,
    VInt=two_dimensional_point_grid_object_2.V,
    ScaleFactor=0.5,
    SoilHardPts=pt_15,
    Strength=Slider(15, range=0..100),
    Falloff=Slider(0.018, range=0..1),
    PHLevelPts=pt_13,
    Strength_2=Slider(3, range=0..100),
    Falloff_2=Slider(0.004, range=0..1),
    DampnessPts=pt_14,
    Strength_3=Slider(2, range=0..100),
    Falloff_3=Slider(0.01, range=0..1),
    SolarVector=solar_5.SunVector_2,
    GroundZ=0.25,
    RayScale=100,
    Buildings=brep_4)  # -> Mesh, SoilVisLine, SoilNorDouble, PhVisLine, PhNorDouble, DampVisLine, Double, SunMesh, SunNor

division = Division(A=solar_average_eval.Shadowness, B=Slider(1000, range=0..1000))
box = CenterBox(Base=solar_average_eval.PointGrid, X=division, Y=division, Z=division)

mesh_3 = Mesh(land_evaluation_with_a_surface.Mesh)
pt_16 = Point(two_dimensional_point_grid_object_2.Point)

preview_12 = CustomPreview(Geometry=land_evaluation_with_a_surface.PhVisLine, Shader=ColourSwatch(SwatchColor=RGB(107, 252, 81)))
tag_4 = TextTag(Location=pt_16, Text=land_evaluation_with_a_surface.PhNorDouble)

preview_13 = CustomPreview(Geometry=land_evaluation_with_a_surface.DampVisLine, Shader=ColourSwatch(SwatchColor=RGB(81, 207, 252)))
tag_5 = TextTag(Location=pt_16, Text=land_evaluation_with_a_surface.Double)

preview_14 = CustomPreview(Geometry=land_evaluation_with_a_surface.SoilVisLine, Shader=ColourSwatch(SwatchColor=RGB(255, 200, 0)))
tag_6 = TextTag(Location=pt_16, Text=land_evaluation_with_a_surface.SoilNorDouble)
