# Grasshopper definition 2016_NumericalEnvironmentLandObject_A_revised.gh (Grasshopper 1.0.8)
# plug-ins: NumericalArchitectureCompilerForGH, NJSEnvironment, NumericalGeoUtilsForGH

pt = Point([Point(5.096279122, 1.889956656, 0), Point(-1.830429918, -3.997298618, 0), Point(2.594814325, -3.085068462, 0), Point(4.702425825, 8.014456061, 0), Point(2.321408916, 15.36523098, 0), Point(-4.898413981, 16.31880353, 0), Point(-9.697764726, 10.32925132, 0), Point(-8.451272571, 1.515844683, 0)])
# Data in Design
# 
# Instructor : NJ Namju Lee / nj.namju@gmail.com
# 
# * class - https://namjulee.github.io/data-in-design/
# 
# * Lab - https://namjulee.github.io/njs-lab-public/
# 
# * Video(English) - https://www.youtube.com/c/njnamjulee
# * Writing(English) - https://medium.com/@nj-namju
# 
# * Video(Korean) - https://www.youtube.com/c/CodeforDesign
# * Writing(Korean) - https://brunch.co.kr/@njnamju
# 
# Installation - https://namjulee.github.io/njs-lab-public/installation
# NUMERICAL ENVIRONMENT UTILITY [DEVELOPMENT], 2015:
# 
# https://namjulee.github.io/njs-lab-public/work?id=2015-neu-development
# Land Object
pt_2 = Point(Point(1.588769009, 5.168291449, 0))
pt_3 = Point(Point(1.346532817, 10.0924449, 0))
ntree = SimpleTree(
    LocationPts=pt,
    TrunkScale=Slider(2.758, range=1..10),
    BranchMinScale=Slider(0.157, range=0..10),
    BranchMaxScale=Slider(0.98, range=0..10),
    Angle=Slider(53, range=0..100),
    IterationNumber=5,
    NumberOfBranch=5,
    Scale=1,
    SeedNumber=1,
    Template=Slider(0, range=0..10))

number_slider = Slider(6, range=0..10)
srf = Surface(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)
nsurface_class_for_geomerty_analysis = NSurface(S=srf, U=number_slider, V=number_slider, NS=1, AS=2, AF=0.5, ES=2, EF=0.5, RS=2, RF=0.5, SC=5, Tri=True, SG=10, SM=10)  # -> Surface, UInt, VInt, UCurve, VCurve, LinesNormal, LinesSlope, CurvaturePositive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
ntree_2 = SimpleTree(
    LocationPts=nsurface_class_for_geomerty_analysis.Point,
    TrunkScale=1,
    BranchMinScale=0.2,
    BranchMaxScale=0.4,
    Angle=55,
    IterationNumber=5,
    NumberOfBranch=5,
    Scale=1,
    SeedNumber=1,
    Template=0)

crv = Curve(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)
ncurve_class_for_geomerty_analysis = NCurve(C=crv, N=Slider(28, range=0..100), NS=2, AS=2, AF=0.5, ES=2, EF=0.5, RS=2, RF=0.5)  # -> Curve, Points, Tangent, Normal, Binormal
ntree_3 = SimpleTree(
    LocationPts=ncurve_class_for_geomerty_analysis.Points,
    TrunkScale=1,
    BranchMinScale=0.2,
    BranchMaxScale=0.4,
    Angle=55,
    IterationNumber=5,
    NumberOfBranch=5,
    Scale=1,
    SeedNumber=Slider(5, range=0..10),
    Template=0)

ngrasscover = GrassCover(Height1=0.3, Height2=0.5, Bend1=10, Template=0)
ngrass = SimpleGrass(Height1=0.5, Height2=1, Bend1=0.5, Bend2=0.6, Template=0)
pop2d = Populate2D(Region={Plane=PlaneXY(0, 0, 0), Size=Domain2(u=0..20, v=0..10)}, Count=Slider(1000, range=0..1000), Seed=1)

# ---- group: GrassLandCover
ngrasscover_2 = GrassCover(LocationPts=pop2d, Height1=0.3, Height2=0.5, Bend1=10, Template=0)

# ---- group: Grass
ngrass_2 = SimpleGrass(LocationPts=pop2d, Height1=0.5, Height2=1, Bend1=0.5, Bend2=0.6, Template=0)
ngrass_3 = SimpleGrass(
    LocationPts=pop2d,
    Height1=Slider(1, range=0..10),
    Height2=Slider(1.1, range=0..10),
    Bend1=Slider(3, range=0..10),
    Bend2=Slider(1.1, range=0..10),
    Template=0)
ngrass_4 = SimpleGrass(
    LocationPts=pop2d,
    Height1=Slider(1, range=0..10),
    Height2=Slider(1.1, range=0..10),
    Bend1=Slider(1, range=0..1),
    Bend2=0.6,
    Template=0)

# ----
rectangle = Rectangle(Plane=PlaneXY(0, 0, 0), XSize=Domain(-1, 1), YSize=Domain(-2, 2), Radius=0)  # -> Rectangle, Length
pt_4 = Point([Point(-0.5397429842, -1.490524894, 0), Point(-0.02525292248, 1.347224405, 0)])
pop2d_2 = Populate2D(Region=rectangle.Rectangle, Count=Slider(1000, range=0..1000), Seed=1)
pt_5 = Point([Point(-0.5219613323, -0.01274423129, 0), Point(0.313389191, 0.5815161068, 0), Point(0.1625433201, -0.5101266969, 0)])
ntree_4 = SimpleTree(
    LocationPts=pt_4,
    TrunkScale=1,
    BranchMinScale=0.2,
    BranchMaxScale=0.4,
    Angle=55,
    IterationNumber=5,
    NumberOfBranch=5,
    Scale=1,
    SeedNumber=1,
    Template=0)
ngrasscover_3 = GrassCover(LocationPts=pop2d_2, Height1=0.3, Height2=0.5, Bend1=10, Template=0)
ntree_5 = SimpleTree(
    LocationPts=pt_5,
    TrunkScale=Slider(0.41, range=0..1),
    BranchMinScale=Slider(0.38, range=0..1),
    BranchMaxScale=Slider(0.07, range=0..1),
    Angle=Slider(20, range=0..100),
    IterationNumber=Slider(4, range=0..10),
    NumberOfBranch=5,
    Scale=1,
    SeedNumber=1,
    Template=0)
geo = Geometry([ngrasscover_3, ntree_4, ntree_5])

# ---- group: CED Laser cutter Template
list = ValueList({"0 Bounding Box", "1 Raster", "2 Engrave 1", "3 Engrave 2", "4 Engrave 3", "5 Inside Cut", "6 Outside Cut", "7 Outermost Cut"}, selected="3 Engrave 2")

# ---- group: GSD Universal Laser Template Fies
list_2 = ValueList({"DEFPOINTS", "LASER-CUT", "LASER-SCORE", "LASER-SCORE-0", "LASER-SCORE-1", "LASER-SCORE-2", "LASER-SCORE-3", "LASER-SCORE-4"}, selected="LASER-SCORE-2")

# ---- group: Execute
button = Button()

# ----
crv_2 = Curve(ntree_5)
bake_for_cutting = PassCBakeForCutting(Geometry=crv_2, LayerName=list_2, ExecuteBool=button)
