# Grasshopper definition GH09_imageProcessing .gh (Grasshopper 1.0.8)
# plug-ins: NumericalImageUtilityForGH

path = FilePath("C:\Dropbox\[02 Lecture]\2025_data-design\Material\class-09-pixel-voxel\NumericalImageUtility\data\rabbit.png")
load_img = LoadImage(String=path)
image_to_mesh = ImageToMesh(Image=load_img)

path_2 = FilePath("C:\Dropbox\[02 Lecture]\2025_data-design\Material\class-09-pixel-voxel\NumericalImageUtility\data\rabbit.png")
load_img_2 = LoadImage(String=path_2)
image_to_mesh_2 = ImageToMesh(Image=load_img_2)
image_resize = Resize(Img=load_img_2, XR=Slider(46, range=0..100), YR=Slider(30, range=0..100))
pt = Point(Point(16.90170612, 12.4517305, 0))
image_to_mesh_3 = ImageToMesh(Image=image_resize)
python = GhPythonScript(Mesh=image_to_mesh_3, pt=pt)  # -> out, Color; inputs Mesh: Mesh
# ---------- python: Python ----------
__author__ = "NJ9"
__version__ = "2018.10.09"

import rhinoscriptsyntax as rs

pts = [];
dis = 100000000;
index = -1;
for i in range(len(Mesh.Vertices)):
    theDistance = rs.Distance(pt, rs.AddPoint(Mesh.Vertices[i]))
    if theDistance < dis:
        dis = theDistance
        index = i
print index
Color =Mesh.VertexColors[index] ;
# ---------- end python ----------
panel = Panel(python.Color)
python_2 = GhPythonScript(Mesh=image_to_mesh_3, Color=python.Color, tor=Slider(64, range=0..100))  # -> out, Pts; inputs Mesh: Mesh
# ---------- python_2: Python ----------
__author__ = "NJ9"
__version__ = "2018.10.09"

import rhinoscriptsyntax as rs

pts = [];

for i in range(len(Mesh.Vertices)):
    color = Mesh.VertexColors[i]
    print color.G
    print color
    if ( color.R < Color[0]+ tor and color.R > Color[0]- tor and color.G < Color[1]+ tor and color.G > Color[1]- tor and color.B < Color[2]+ tor and color.B > Color[2]- tor ):
        p = Mesh.Vertices[i]
        pts.append(rs.AddPoint(p.X , p.Y, p.Z ))
Pts = pts;
# ---------- end python_2 ----------

path_3 = FilePath("C:\Dropbox\[02 Lecture]\2025_data-design\Material\class-09-pixel-voxel\NumericalImageUtility\data\example.bmp")
load_img_3 = LoadImage(String=path_3)
image_to_mesh_4 = ImageToMesh(Image=load_img_3)
image_resize_2 = Resize(Img=load_img_3, XR=Slider(46, range=0..100), YR=Slider(30, range=0..100))
pt_2 = Point(Point(26.6290283, 13.44541097, 0))
image_to_mesh_5 = ImageToMesh(Image=image_resize_2)
python_3 = GhPythonScript(Mesh=image_to_mesh_5, pt=pt_2)  # -> out, Color; inputs Mesh: Mesh; same code as python
panel_2 = Panel(python_3.Color)
python_4 = GhPythonScript(Mesh=image_to_mesh_5, Color=python_3.Color, tor=Slider(60, range=0..100))  # -> out, Pts; inputs Mesh: Mesh; same code as python_2

path_4 = FilePath("C:\Dropbox\[02 Lecture]\2025_data-design\Material\class-09-pixel-voxel\NumericalImageUtility\data\rabbit.png")
path_5 = FilePath("C:\Dropbox\[02 Lecture]\2025_data-design\Material\class-09-pixel-voxel\NumericalImageUtility\data\elephant.png")
load_img_4 = LoadImage(String=path_5)
load_img_5 = LoadImage(String=path_4)
image_to_mesh_6 = ImageToMesh(Image=load_img_5)
image_to_mesh_7 = ImageToMesh(Image=load_img_4)

panel_3 = Panel(path_2)
panel_4 = Panel(path_3)
# Data in Design
# 
# Instructor : NJ Namju Lee / nj.namju@gmail.com
# 
# * class - https://namjulee.github.io/data-in-design/
# 
# * Lab - https://namjulee.github.io/njs-lab-public/
# 
# * Video(English) - https://www.youtube.com/c/njnamjulee
# * Writing(English) - https://medium.com/@nj-namju
# 
# * Video(Korean) - https://www.youtube.com/c/CodeforDesign
# * Writing(Korean) - https://brunch.co.kr/@njnamju
# 
# Installation - https://namjulee.github.io/njs-lab-public/installation
# Numerical Image Utility, 2018
# 
# https://namjulee.github.io/njs-lab-public/work?id=2018-niu-development
panel_5 = Panel(path)
panel_6 = Panel(path_5)
panel_7 = Panel(path_4)

list = ValueList({"BLENDING", "ADDITION", "SUBSTRACTION", "DARKEN", "MULTIPLY", "COLOR_BURN", "LINEAR_BURN", "LIGHTEN", "SCREEN", "COLOR_DODGE", "LINEAR_DODGE", "OVERLAY", "SOFTLIGHT", "DIFFERENCE", "EXCLUSION"}, selected="DIFFERENCE")
bi = Blending(ImgA=load_img_4, ImgB=load_img_5, Mode=list, V=Slider(1, range=0..3))
image_to_mesh_8 = ImageToMesh(Image=bi)

path_6 = FilePath("C:\Dropbox\[02 Lecture]\2025_data-design\Material\class-09-pixel-voxel\NumericalImageUtility\data\rabbit.png")
load_img_6 = LoadImage(String=path_6)
image_to_mesh_9 = ImageToMesh(Image=load_img_6)
nickname = Invert(Image=load_img_6)
X = UnitX(Factor=Slider(306, range=0..1000))
image_to_mesh_10 = ImageToMesh(Image=nickname)
move = Move(Geometry=image_to_mesh_10, Motion=X)  # -> Geometry, Transform

panel_8 = Panel(path_6)

path_7 = FilePath("C:\Dropbox\[02 Lecture]\2025_data-design\Material\class-09-pixel-voxel\NumericalImageUtility\data\boston.jpg")
load_img_7 = LoadImage(String=path_7)

panel_9 = Panel(path_7)

list_2 = ValueList({"NORMAL", "GAUSSIAN_BLUR_1", "GAUSSIAN_BLUR_2", "GAUSSIAN_BLUR_3", "BOX_BLUR", "TRIANGLE_BLUR", "EMBOSS", "UNSHARPEN", "SHARPENESS", "SHARPEN", "EDGE_DETECTION_1", "EDGE_DETECTION_2", "EDGE_DETECTION_3", "EDGE_DETECTION_4", "EDGE_DETECTION_5", "EDGE_DETECTION_6", "SOBEL_HORIZONTAL", "SOBEL_VERTICAL", "PREVIT_HORIZONTAL", "PREVIT_VERTICAL"}, selected="EDGE_DETECTION_2")
ck = ConvolutionalKernel(String=list_2)
nickname_2 = ConvolutionalFilter(Image=load_img_7, Bool=Toggle(True), ListOfDouble=ck)
image_to_mesh_11 = ImageToMesh(Image=nickname_2)
X_2 = UnitX(Factor=Slider(300, range=0..1000))
move_2 = Move(Geometry=image_to_mesh_11, Motion=X_2)  # -> Geometry, Transform

list_3 = ValueList({"NORMAL", "GAUSSIAN_BLUR_1", "GAUSSIAN_BLUR_2", "GAUSSIAN_BLUR_3", "BOX_BLUR", "TRIANGLE_BLUR", "EMBOSS", "UNSHARPEN", "SHARPENESS", "SHARPEN", "EDGE_DETECTION_1", "EDGE_DETECTION_2", "EDGE_DETECTION_3", "EDGE_DETECTION_4", "EDGE_DETECTION_5", "EDGE_DETECTION_6", "SOBEL_HORIZONTAL", "SOBEL_VERTICAL", "PREVIT_HORIZONTAL", "PREVIT_VERTICAL"}, selected="EMBOSS")
ck_2 = ConvolutionalKernel(String=list_3)
nickname_3 = ConvolutionalFilter(Image=load_img_7, Bool=Toggle(False), ListOfDouble=ck_2)
image_to_mesh_12 = ImageToMesh(Image=nickname_3)
X_3 = UnitX(Factor=Slider(600, range=0..1000))
move_3 = Move(Geometry=image_to_mesh_12, Motion=X_3)  # -> Geometry, Transform

list_4 = ValueList({"NORMAL", "GAUSSIAN_BLUR_1", "GAUSSIAN_BLUR_2", "GAUSSIAN_BLUR_3", "BOX_BLUR", "TRIANGLE_BLUR", "EMBOSS", "UNSHARPEN", "SHARPENESS", "SHARPEN", "EDGE_DETECTION_1", "EDGE_DETECTION_2", "EDGE_DETECTION_3", "EDGE_DETECTION_4", "EDGE_DETECTION_5", "EDGE_DETECTION_6", "SOBEL_HORIZONTAL", "SOBEL_VERTICAL", "PREVIT_HORIZONTAL", "PREVIT_VERTICAL"}, selected="NORMAL")
ck_3 = ConvolutionalKernel(String=list_4)
nickname_4 = ConvolutionalFilter(Image=load_img_7, Bool=Toggle(False), ListOfDouble=ck_3)
image_to_mesh_13 = ImageToMesh(Image=nickname_4)

list_5 = ValueList({"NORMAL", "GAUSSIAN_BLUR_1", "GAUSSIAN_BLUR_2", "GAUSSIAN_BLUR_3", "BOX_BLUR", "TRIANGLE_BLUR", "EMBOSS", "UNSHARPEN", "SHARPENESS", "SHARPEN", "EDGE_DETECTION_1", "EDGE_DETECTION_2", "EDGE_DETECTION_3", "EDGE_DETECTION_4", "EDGE_DETECTION_5", "EDGE_DETECTION_6", "SOBEL_HORIZONTAL", "SOBEL_VERTICAL", "PREVIT_HORIZONTAL", "PREVIT_VERTICAL"}, selected="GAUSSIAN_BLUR_3")
ck_4 = ConvolutionalKernel(String=list_5)

path_8 = FilePath("C:\Dropbox\[02 Lecture]\2025_data-design\Material\class-09-pixel-voxel\NumericalImageUtility\data\boston.jpg")
load_img_8 = LoadImage(String=path_8)
image_to_mesh_14 = ImageToMesh(Image=load_img_8)
image_resize_3 = Resize(Img=load_img_8, XR=Slider(100, range=0..100), YR=Slider(74, range=0..100))
nickname_5 = ConvolutionalFilter(Image=image_resize_3, Bool=Toggle(False), ListOfDouble=ck_4)

panel_10 = Panel(path_8)

list_6 = ValueList({"BLENDING", "ADDITION", "SUBSTRACTION", "DARKEN", "MULTIPLY", "COLOR_BURN", "LINEAR_BURN", "LIGHTEN", "SCREEN", "COLOR_DODGE", "LINEAR_DODGE", "OVERLAY", "SOFTLIGHT", "DIFFERENCE", "EXCLUSION"}, selected="EXCLUSION")

image_to_mesh_15 = ImageToMesh(Image=nickname_5)
pt_3 = Point(Point(29.40589655, 12.40613806, 0))
python_5 = GhPythonScript(
    Mesh=image_to_mesh_15,
    invert=Toggle(False),
    torR=Slider(60, range=0..255),
    torG=Slider(113, range=0..255),
    torB=Slider(127, range=0..255))  # -> out, Pts; inputs Mesh: Mesh, invert: Boolean
# ---------- python_5: Python ----------
__author__ = "NJ9"
__version__ = "2018.10.09"

import rhinoscriptsyntax as rs

pts = [];

for i in range(len(Mesh.Vertices)):
    color = Mesh.VertexColors[i]
    print color.G
    print color
    if(invert):
        if color.R < torR and color.G < torG  and color.B < torB :
            p = Mesh.Vertices[i]
            pts.append(rs.AddPoint(p.X , p.Y, p.Z ))
    else:
        if color.R > torR and color.G > torG  and color.B > torB :
            p = Mesh.Vertices[i]
            pts.append(rs.AddPoint(p.X , p.Y, p.Z ))
Pts = pts;
# ---------- end python_5 ----------
python_6 = GhPythonScript(Mesh=image_to_mesh_15, pt=pt_3)  # -> out, Color; inputs Mesh: Mesh; same code as python
panel_11 = Panel(python_6.Color)
python_7 = GhPythonScript(Mesh=image_to_mesh_15, Color=python_6.Color, tor=Slider(6, range=0..100))  # -> out, Pts; inputs Mesh: Mesh; same code as python_2

list_7 = ValueList({"NORMAL", "GAUSSIAN_BLUR_1", "GAUSSIAN_BLUR_2", "GAUSSIAN_BLUR_3", "BOX_BLUR", "TRIANGLE_BLUR", "EMBOSS", "UNSHARPEN", "SHARPENESS", "SHARPEN", "EDGE_DETECTION_1", "EDGE_DETECTION_2", "EDGE_DETECTION_3", "EDGE_DETECTION_4", "EDGE_DETECTION_5", "EDGE_DETECTION_6", "SOBEL_HORIZONTAL", "SOBEL_VERTICAL", "PREVIT_HORIZONTAL", "PREVIT_VERTICAL"}, selected="GAUSSIAN_BLUR_2")
ck_5 = ConvolutionalKernel(String=list_7)

list_8 = ValueList({"NORMAL", "GAUSSIAN_BLUR_1", "GAUSSIAN_BLUR_2", "GAUSSIAN_BLUR_3", "BOX_BLUR", "TRIANGLE_BLUR", "EMBOSS", "UNSHARPEN", "SHARPENESS", "SHARPEN", "EDGE_DETECTION_1", "EDGE_DETECTION_2", "EDGE_DETECTION_3", "EDGE_DETECTION_4", "EDGE_DETECTION_5", "EDGE_DETECTION_6", "SOBEL_HORIZONTAL", "SOBEL_VERTICAL", "PREVIT_HORIZONTAL", "PREVIT_VERTICAL"}, selected="PREVIT_VERTICAL")
ck_6 = ConvolutionalKernel(String=list_8)
nickname_6 = ConvolutionalFilter(Image=load_img_7, Bool=Toggle(False), ListOfDouble=ck_6)
nickname_7 = Invert(Image=nickname_6)
nickname_8 = BrightnessContrast(Img=nickname_7, Brightness=Slider(-0.18, range=-1..1), Contrast=Slider(0.36, range=-1..1.01))
hue = Slider(0.24, range=-1..1)
lightness = Slider(0, range=-1..1)
lightness_2 = Slider(-0.58, range=-1..1)
nickname_9 = HueSaturationLightness(Img=nickname_8, Hue=hue, Sat=lightness, Lig=lightness_2)
image_to_mesh_16 = ImageToMesh(Image=nickname_9)
X_4 = UnitX(Factor=Slider(0, range=0..1000))
move_4 = Move(Geometry=image_to_mesh_16, Motion=X_4)  # -> Geometry, Transform
Y = UnitY(Factor=Slider(202, range=0..1000))
move_5 = Move(Geometry=move_4.Geometry, Motion=Y)  # -> Geometry, Transform

list_9 = ValueList({"NORMAL", "GAUSSIAN_BLUR_1", "GAUSSIAN_BLUR_2", "GAUSSIAN_BLUR_3", "BOX_BLUR", "TRIANGLE_BLUR", "EMBOSS", "UNSHARPEN", "SHARPENESS", "SHARPEN", "EDGE_DETECTION_1", "EDGE_DETECTION_2", "EDGE_DETECTION_3", "EDGE_DETECTION_4", "EDGE_DETECTION_5", "EDGE_DETECTION_6", "SOBEL_HORIZONTAL", "SOBEL_VERTICAL", "PREVIT_HORIZONTAL", "PREVIT_VERTICAL"}, selected="NORMAL")
ck_7 = ConvolutionalKernel(String=list_9)
nickname_10 = ConvolutionalFilter(Image=load_img_7, Bool=Toggle(False), ListOfDouble=ck_7)
nickname_11 = BrightnessContrast(Img=nickname_10, Brightness=Slider(0, range=0..1), Contrast=Slider(1, range=0..1))
nickname_12 = HueSaturationLightness(Img=nickname_11, Hue=Slider(0.63, range=0..1), Sat=0.5, Lig=0.5)
image_to_mesh_17 = ImageToMesh(Image=nickname_12)
X_5 = UnitX(Factor=Slider(300, range=0..1000))
move_6 = Move(Geometry=image_to_mesh_17, Motion=X_5)  # -> Geometry, Transform
Y_2 = UnitY(Factor=Slider(202, range=0..1000))
move_7 = Move(Geometry=move_6.Geometry, Motion=Y_2)  # -> Geometry, Transform

list_10 = ValueList({"NORMAL", "GAUSSIAN_BLUR_1", "GAUSSIAN_BLUR_2", "GAUSSIAN_BLUR_3", "BOX_BLUR", "TRIANGLE_BLUR", "EMBOSS", "UNSHARPEN", "SHARPENESS", "SHARPEN", "EDGE_DETECTION_1", "EDGE_DETECTION_2", "EDGE_DETECTION_3", "EDGE_DETECTION_4", "EDGE_DETECTION_5", "EDGE_DETECTION_6", "SOBEL_HORIZONTAL", "SOBEL_VERTICAL", "PREVIT_HORIZONTAL", "PREVIT_VERTICAL"}, selected="GAUSSIAN_BLUR_2")
ck_8 = ConvolutionalKernel(String=list_10)
nickname_13 = ConvolutionalFilter(Image=load_img_7, Bool=Toggle(False), ListOfDouble=ck_8)
nickname_14 = BrightnessContrast(Img=nickname_13, Brightness=Slider(0, range=0..1), Contrast=Slider(0.68, range=0..1))
nickname_15 = HueSaturationLightness(Img=nickname_14, Hue=Slider(0, range=0..1), Sat=Slider(1, range=0..1), Lig=0.5)
image_to_mesh_18 = ImageToMesh(Image=nickname_15)
X_6 = UnitX(Factor=Slider(600, range=0..1000))
move_8 = Move(Geometry=image_to_mesh_18, Motion=X_6)  # -> Geometry, Transform
Y_3 = UnitY(Factor=Slider(202, range=0..1000))
move_9 = Move(Geometry=move_8.Geometry, Motion=Y_3)  # -> Geometry, Transform

pt_4 = Point(Point(159.8374775, 247.486944, 0))
python_8 = GhPythonScript(Mesh=move_5.Geometry, pt=pt_4)  # -> out, Color; inputs Mesh: Mesh; same code as python
python_9 = GhPythonScript(Mesh=move_5.Geometry, Color=python_8.Color, tor=Slider(23, range=0..100))  # -> out, Pts; inputs Mesh: Mesh; same code as python_2

path_9 = FilePath("C:\Dropbox\[02 Lecture]\2025_data-design\Material\class-09-pixel-voxel\NumericalImageUtility\data\rabbit.png")
load_img_9 = LoadImage(String=path_9)
image_to_mesh_19 = ImageToMesh(Image=load_img_9)
X_7 = UnitX(Factor=Slider(306, range=0..1000))

panel_12 = Panel(path_9)

hue_2 = Slider(-0.4, range=-1..1)
lightness_3 = Slider(-0.13, range=-1..1)
lightness_4 = Slider(0.29, range=-1..1)
nickname_16 = HueSaturationLightness(Img=load_img_9, Hue=hue_2, Sat=lightness_4, Lig=lightness_3)

image_to_mesh_20 = ImageToMesh(Image=nickname_16)
move_10 = Move(Geometry=image_to_mesh_20, Motion=X_7)  # -> Geometry, Transform

path_10 = FilePath("C:\Dropbox\[02 Lecture]\2025_data-design\Material\class-09-pixel-voxel\NumericalImageUtility\data\rabbit.png")
load_img_10 = LoadImage(String=path_10)
image_to_mesh_21 = ImageToMesh(Image=load_img_10)
X_8 = UnitX(Factor=Slider(306, range=0..1000))

panel_13 = Panel(path_10)

nickname_17 = Threshold(Img=load_img_10, Threshold=Slider(0.35, range=0..1), High=Slider(1, range=0..1), Low=Slider(0, range=0..1))

image_to_mesh_22 = ImageToMesh(Image=nickname_17)
move_11 = Move(Geometry=image_to_mesh_22, Motion=X_8)  # -> Geometry, Transform

path_11 = FilePath("C:\Dropbox\[02 Lecture]\2025_data-design\Material\class-09-pixel-voxel\NumericalImageUtility\data\rabbit.png")
load_img_11 = LoadImage(String=path_11)
image_to_mesh_23 = ImageToMesh(Image=load_img_11)
X_9 = UnitX(Factor=Slider(306, range=0..1000))

panel_14 = Panel(path_11)

nickname_18 = BrightnessContrast(Img=load_img_11, Brightness=Slider(0.53, range=-1..1), Contrast=Slider(0.64, range=-1..1))

image_to_mesh_24 = ImageToMesh(Image=nickname_18)
move_12 = Move(Geometry=image_to_mesh_24, Motion=X_9)  # -> Geometry, Transform

path_12 = FilePath("C:\Dropbox\[02 Lecture]\2025_data-design\Material\class-09-pixel-voxel\NumericalImageUtility\data\sample.jpg")
load_img_12 = LoadImage(String=path_12)
# https://en.wikipedia.org/wiki/Kernel_(image_processing)
image_to_mesh_25 = ImageToMesh(Image=load_img_12)

panel_15 = Panel(path_12)

list_11 = ValueList({"NORMAL", "GAUSSIAN_BLUR_1", "GAUSSIAN_BLUR_2", "GAUSSIAN_BLUR_3", "BOX_BLUR", "TRIANGLE_BLUR", "EMBOSS", "UNSHARPEN", "SHARPENESS", "SHARPEN", "EDGE_DETECTION_1", "EDGE_DETECTION_2", "EDGE_DETECTION_3", "EDGE_DETECTION_4", "EDGE_DETECTION_5", "EDGE_DETECTION_6", "SOBEL_HORIZONTAL", "SOBEL_VERTICAL", "PREVIT_HORIZONTAL", "PREVIT_VERTICAL"}, selected="EDGE_DETECTION_2")
panel_16 = Panel("""-1
-1
-1
-1
8
-1
-1
-1
-1""")
ck_9 = ConvolutionalKernel(String=list_11)
panel_17 = Panel(ck_9)

nickname_19 = ConvolutionalFilter(Image=load_img_12, Bool=Toggle(False), ListOfDouble=ck_9)
image_to_mesh_26 = ImageToMesh(Image=nickname_19)

panel_18 = Panel(nickname_19)

path_13 = FilePath("C:\Dropbox\[02 Lecture]\2025_data-design\Material\class-09-pixel-voxel\NumericalImageUtility\data\boston.jpg")
load_img_13 = LoadImage(String=path_13)
image_to_mesh_27 = ImageToMesh(Image=load_img_13)

path_14 = FilePath("C:\Dropbox\[02 Lecture]\2025_data-design\Material\class-09-pixel-voxel\NumericalImageUtility\data\NYC.jpg")
load_img_14 = LoadImage(String=path_14)
image_to_mesh_28 = ImageToMesh(Image=load_img_14)

panel_19 = Panel(path_13)
panel_20 = Panel(path_14)
number_slider = Slider(126, range=0..150)
number_slider_2 = Slider(101, range=0..150)

image_resize_4 = Resize(Img=load_img_13, XR=number_slider, YR=number_slider_2)
image_to_mesh_29 = ImageToMesh(Image=image_resize_4)

image_resize_5 = Resize(Img=load_img_14, XR=number_slider, YR=number_slider_2)
image_to_mesh_30 = ImageToMesh(Image=image_resize_5)

bi_2 = Blending(ImgA=image_resize_4, ImgB=image_resize_5, Mode=list_6, V=Slider(1, range=0..2))
image_to_mesh_31 = ImageToMesh(Image=bi_2)

nickname_20 = ConvolutionalFilter(Image=bi_2, Bool=Toggle(False), ListOfDouble=ck_5)
image_to_mesh_32 = ImageToMesh(Image=nickname_20)

nickname_21 = BrightnessContrast(Img=nickname_20, Brightness=Slider(-0.17, range=-1..1), Contrast=Slider(1, range=-1..1))

image_to_mesh_33 = ImageToMesh(Image=nickname_21)
pt_5 = Point(Point(49.43771338, 34.46493987, 0))
python_10 = GhPythonScript(Mesh=image_to_mesh_33, pt=pt_5)  # -> out, Color; inputs Mesh: Mesh; same code as python
panel_21 = Panel(python_10.Color)
python_11 = GhPythonScript(Mesh=image_to_mesh_33, Color=python_10.Color, tor=Slider(26, range=0..100))  # -> out, Pts; inputs Mesh: Mesh; same code as python_2
